# Grasshopper definition Viereendel_ties_3d.ghx (Grasshopper 1.0.7)
# plug-ins: Human, Wombat, treesloth01

Y = UnitY(Factor=1)
btm_chord = Curve([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])
number_slider = Slider(10, range=0..10)
height = Slider(1.451, range=0..10)
move = Move(Geometry=btm_chord, Motion=Y)  # -> Geometry, Transform
join = JoinCurves(Curves=move.Geometry, Preserve=False)
addition = Addition(A=Slider(13, range=1..13), B=Slider(7, range=0..100))
btm_chord_2 = Curve([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])
number_slider_2 = Slider(10, range=0..10)
height_2 = Slider(1.451, range=0..10)
join_2 = JoinCurves(Curves=btm_chord_2, Preserve=False)
addition_2 = Addition(A=Slider(13, range=1..13), B=Slider(13, range=0..100))
num = Number(addition_2)
divide = DivideCurve(Curve=join, Count=num, Kinks=False)  # -> Points, Tangents, Parameters
shatter = Shatter(Curve=join, Parameters=divide.Parameters)
len = Length(Curve=shatter)
item = ListItem(List=len, Index=0, Wrap=True)
expression = Expression(x=height, y=item, Expression="sqrt(x^2+y^2)")
xz = XZPlane(Origin=divide.Points)
line = LineSDL(Start=divide.Points, Direction=Vector(0, 0, 1), Length=expression)
# 01 CEM framework model
button = Button()
division = Division(A=height, B=item)
divide_2 = DivideCurve(Curve=join_2, Count=num, Kinks=False)  # -> Points, Tangents, Parameters
atan = ArcTangent(Value=division)
shatter_2 = Shatter(Curve=join_2, Parameters=divide_2.Parameters)
pi = Pi(Factor=1)
len_2 = Length(Curve=shatter_2)
python = GhPythonScript(unload=button)  # -> out; inputs unload: Boolean
# ---------- python: Python ----------
from compas_ghpython.utilities import unload_modules


if unload:
    unloaded = unload_modules("compas")
    print("Unloaded: {}".format(unloaded))
# ---------- end python ----------
division_2 = Division(A=pi, B=2)
subtraction = Subtraction(A=atan, B=division_2)
neg = Negative(Value=subtraction)
rotate = Rotate(Geometry=line, Angle=expr("-x", neg), Plane=xz)  # -> reverse(Geometry), Transform
rotate_2 = Rotate(Geometry=line, Angle=expr("-x", subtraction), Plane=xz)  # -> Geometry, Transform
lng = ListLength(List=rotate_2.Geometry)
lng_2 = ListLength(List=rotate.Geometry)
division_3 = Division(A=lng_2, B=2)
item_2 = ListItem(List=len_2, Index=0, Wrap=True)
expression_2 = Expression(x=height_2, y=item_2, Expression="sqrt(x^2+y^2)")
xz_2 = XZPlane(Origin=divide_2.Points)
division_4 = Division(A=lng, B=2)
split = SplitList(List=rotate_2.Geometry, Index=division_4)  # -> ListA, ListB
line_2 = LineSDL(Start=divide_2.Points, Direction=Vector(0, 0, 1), Length=expression_2)
split_2 = SplitList(List=rotate.Geometry, Index=division_3)  # -> ListA, ListB
entwine = Entwine(Branch00=split.ListA, Branch01=split_2.ListA, FlattenInputs=True)  # -> flatten(Result)
webs = Curve(entwine)
mp = Midpoint(Curve=webs)
pdecon = Deconstruct(Point=mp)  # -> XComponent, YComponent, ZComponent
sort = SortList(Keys=pdecon.XComponent, ValuesA=webs)  # -> Keys, ValuesA
end = EndPoints()  # -> Start, End

# ---- group: Reload compas_cem
# 01 CEM framework model
button_2 = Button()
python_2 = GhPythonScript(unload=button_2)  # -> out; inputs unload: Boolean; same code as python

# ----
division_5 = Division(A=height_2, B=item_2)
cull_ends = CullEnds(List=sort.ValuesA)  # -> List, Culled; disabled
end_2 = EndPoints(Curve=entwine)  # -> Start, End
atan_2 = ArcTangent(Value=division_5)
crv = Curve([split.ListA, split_2.ListA])
cullpt = CullDuplicates(Points=end_2.End, Tolerance=0.1, CullMode=1)  # -> Points, Indices, Valence
pdecon_2 = Deconstruct(Point=cullpt.Points)  # -> XComponent, YComponent, ZComponent
entwine_2 = Entwine(Branch00=divide_2.Points, Branch01=divide.Points, FlattenInputs=True)
pi_2 = Pi(Factor=1)
sort_2 = SortList(Keys=pdecon_2.XComponent, ValuesA=cullpt.Points)  # -> Keys, ValuesA
pline = PolyLine(Vertices=sort_2.ValuesA, Closed=False)
ccx = CurveCurve(CurveA=pline, CurveB=graft(line))  # -> Points, ParamsA, ParamsB
division_6 = Division(A=pi_2, B=2)
subtraction_2 = Subtraction(A=atan_2, B=division_6)
neg_2 = Negative(Value=subtraction_2)
rotate_3 = Rotate(Geometry=line_2, Angle=expr("-x", neg_2), Plane=xz_2)  # -> reverse(Geometry), Transform
rotate_4 = Rotate(Geometry=line_2, Angle=expr("-x", subtraction_2), Plane=xz_2)  # -> Geometry, Transform
lng_3 = ListLength(List=rotate_4.Geometry)
lng_4 = ListLength(List=rotate_3.Geometry)
division_7 = Division(A=lng_4, B=2)
flip = FlipMatrix(Data=entwine_2)
mp_2 = Midpoint(Curve=shatter)
pt = Point(Point(0, 0, 0))
division_8 = Division(A=lng_3, B=2)
item_3 = ListItem(List=ccx.Points, Index=0, Wrap=True)
ln = Line(StartPoint=graft(divide.Points), EndPoint=item_3)  # -> flatten(Line)
line_3 = Line(ln)
cull_ends_2 = CullEnds(List=line_3)  # -> List, Culled
lng_5 = ListLength(List=cull_ends_2.List)
end_3 = EndPoints(Curve=cull_ends_2.Culled)  # -> Start, End
end_4 = EndPoints(Curve=ln)  # -> Start, End
division_9 = Division(A=lng_5, B=2)
split_3 = SplitList(List=cull_ends_2.List, Index=expr("x+1", division_9))  # -> ListA, ListB
split_4 = SplitList(List=reverse(cull_ends_2.List), Index=expr("x+1", division_9))  # -> ListA, ListB
end_5 = EndPoints(Curve=split_3.ListA)  # -> Start, End
end_6 = EndPoints(Curve=split_4.ListA)  # -> Start, End
first_last = FirstLast(List=end_3.End)  # -> FirstValue, LastValue
pline_2 = PolyLine(Vertices=end_4.End, Closed=False)
explode = Explode(Curve=pline_2, Recursive=True)  # -> Segments, Vertices
cp = ClosestPoint(Point=pt, Cloud=mp_2)  # -> ClosestPoint, CPIndex, Distance
ln_2 = Line(StartPoint=first_last.LastValue, EndPoint=end_6.Start)
split_5 = SplitList(List=rotate_4.Geometry, Index=division_8)  # -> ListA, ListB
pline_3 = PolyLine(Vertices=flip, Closed=False)
ln_3 = Line(StartPoint=first_last.FirstValue, EndPoint=end_5.Start)
cull_ends_3 = CullEnds(List=ln)  # -> List, Culled
split_6 = SplitList(List=rotate_3.Geometry, Index=division_7)  # -> ListA, ListB
entwine_3 = Entwine(Branch00=split_5.ListA, Branch01=split_6.ListA, FlattenInputs=True)  # -> flatten(Result)
webs_2 = Curve(entwine_3)
mp_3 = Midpoint(Curve=webs_2)
pdecon_3 = Deconstruct(Point=mp_3)  # -> XComponent, YComponent, ZComponent
sort_3 = SortList(Keys=pdecon_3.XComponent, ValuesA=webs_2)  # -> Keys, ValuesA
pt_2 = Point(Point(-0.09377879545, 0, 0))
mp_4 = Midpoint(Curve=explode.Segments)
pt_3 = Point(Point(1e-05, 0, 0))
pt_4 = Point(Point(1e-05, 0, 0))
pt_5 = Point(Point(0, 0, 0))
pt_6 = Point()
cull_ends_4 = CullEnds(List=sort_3.ValuesA)  # -> List, Culled; disabled
cull_i = CullIndex(List=shatter, Indices=cp.CPIndex, Wrap=True)
pt_7 = Point(Point(0, 0, 0))
item_4 = ListItem(List=shatter, Index=cp.CPIndex, Wrap=True)
relay = Relay([ln_2, ln_3])
end_7 = EndPoints(Curve=entwine_3)  # -> Start, End
crv_2 = Curve(cull_ends_3.Culled)
crv_3 = Curve(crv_2)
flip_2 = FlipCurve(Curve=crv_3)  # -> Curve, Flag
shatter_3 = Shatter(Curve=reparameterize(flip_2.Curve), Parameters=Slider(0.91, range=0..1))
item_5 = ListItem(List=shatter_3, Index=0, Wrap=True)
cp_2 = ClosestPoint(Point=pt_2, Cloud=mp_4)  # -> ClosestPoint, CPIndex, Distance
crv_4 = Curve([split_5.ListA, split_6.ListA])
end_8 = EndPoints(Curve=flip_2.Curve)  # -> Start, End
other = Curve(cull_i)
mid = Curve(item_4)
cullpt_2 = CullDuplicates(Points=end_7.End, Tolerance=0.1, CullMode=1)  # -> Points, Indices, Valence
pdecon_4 = Deconstruct(Point=cullpt_2.Points)  # -> XComponent, YComponent, ZComponent
item_6 = ListItem(List=explode.Segments, Index=cp_2.CPIndex, Wrap=True)
cull_i_2 = CullIndex(List=explode.Segments, Indices=cp_2.CPIndex, Wrap=True)
Y_2 = UnitY(Factor=1)
sort_4 = SortList(Keys=pdecon_4.XComponent, ValuesA=cullpt_2.Points)  # -> Keys, ValuesA
pline_4 = PolyLine(Vertices=sort_4.ValuesA, Closed=False)
ccx_2 = CurveCurve(CurveA=pline_4, CurveB=graft(line_2))  # -> Points, ParamsA, ParamsB
mid_2 = Curve(item_6)
mp_5 = Midpoint(Curve=shatter_2)
pt_8 = Point(Point(0, 0, 0))
pt_9 = Point([Point(-5, -3.425166865, 1.5), Point(5, -3.425166865, 1.5)])
other_2 = Curve(cull_i_2)
number_slider_3 = Slider(77.85, range=0..100)
item_7 = ListItem(List=ccx_2.Points, Index=0, Wrap=True)
ln_4 = Line(StartPoint=graft(divide_2.Points), EndPoint=item_7)  # -> flatten(Line)
line_4 = Line(ln_4)
cull_ends_5 = CullEnds(List=line_4)  # -> List, Culled
lng_6 = ListLength(List=cull_ends_5.List)
end_9 = EndPoints(Curve=cull_ends_5.Culled)  # -> Start, End
end_10 = EndPoints(Curve=ln_4)  # -> Start, End
division_10 = Division(A=lng_6, B=2)
split_7 = SplitList(List=cull_ends_5.List, Index=expr("x+1", division_10))  # -> ListA, ListB
split_8 = SplitList(List=reverse(cull_ends_5.List), Index=expr("x+1", division_10))  # -> ListA, ListB
end_11 = EndPoints(Curve=split_7.ListA)  # -> Start, End
end_12 = EndPoints(Curve=split_8.ListA)  # -> Start, End
first_last_2 = FirstLast(List=end_9.End)  # -> FirstValue, LastValue
pline_5 = PolyLine(Vertices=end_10.End, Closed=False)
explode_2 = Explode(Curve=pline_5, Recursive=True)  # -> Segments, Vertices
cp_3 = ClosestPoint(Point=pt_8, Cloud=mp_5)  # -> ClosestPoint, CPIndex, Distance
ln_5 = Line(StartPoint=first_last_2.LastValue, EndPoint=end_12.Start)
ln_6 = Line(StartPoint=first_last_2.FirstValue, EndPoint=end_11.Start)
cull_ends_6 = CullEnds(List=ln_4)  # -> List, Culled
pt_10 = Point(Point(-0.09377879545, 0, 0))
mp_6 = Midpoint(Curve=explode_2.Segments)
pt_11 = Point(Point(1e-05, 0, 0))
pt_12 = Point(Point(1e-05, 0, 0))
pt_13 = Point(Point(0, 0, 0))
verticles = Curve([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])
pt_14 = Point()
number_slider_4 = Slider(1.1, range=0..10)
number_slider_5 = Slider(1, range=0..1)
cull_i_3 = CullIndex(List=shatter_2, Indices=cp_3.CPIndex, Wrap=True)
pt_15 = Point(Point(0, 0, 0))
item_8 = ListItem(List=shatter_2, Index=cp_3.CPIndex, Wrap=True)
move_2 = Move(Geometry=pt_9, Motion=Y_2)  # -> Geometry, Transform
relay_2 = Relay([ln_5, ln_6])
crv_5 = Curve(mid_2)
btmchord = Curve(mid)
top_chord = Curve(mid_2)
crv_6 = Curve(other_2)
number_slider_6 = Slider(33.4, range=0..100)
crv_7 = Curve(cull_ends_6.Culled)
crv_8 = Curve(crv_7)
flip_3 = FlipCurve(Curve=crv_8)  # -> Curve, Flag
shatter_4 = Shatter(Curve=reparameterize(flip_3.Curve), Parameters=Slider(0.91, range=0..1))
item_9 = ListItem(List=shatter_4, Index=0, Wrap=True)
number_slider_7 = Slider(1.7, range=0..10)
cp_4 = ClosestPoint(Point=pt_10, Cloud=mp_6)  # -> ClosestPoint, CPIndex, Distance
cull_ends_7 = CullEnds(List=verticles)  # -> List, Culled
number_slider_8 = Slider(0.1, range=0..0.1)
crv_9 = Curve(flip_2.Curve)
end_13 = EndPoints(Curve=flip_3.Curve)  # -> Start, End
other_3 = Curve(cull_i_3)
mid_3 = Curve(item_8)
crv_10 = Curve(relay)
cull_ends_8 = CullEnds(List=crv_10)  # -> List, Culled
item_10 = ListItem(List=explode_2.Segments, Index=cp_4.CPIndex, Wrap=True)
crv_11 = Curve(shatter)
join_3 = JoinCurves(Curves=crv_11, Preserve=False)
len_3 = Length(Curve=crv_6)
merge = Merge(Data1=move_2.Geometry, Data2=end_8.Start)  # -> flatten(Result)
len_4 = Length(Curve=crv_9)
cull_i_4 = CullIndex(List=explode_2.Segments, Indices=cp_4.CPIndex, Wrap=True)
crv_12 = Curve(other)
neg_3 = Negative(Value=Slider(20, range=0..20))
crv_13 = Curve(cull_ends_3.List)
neg_4 = Negative(Value=Slider(12.5, range=0..20))
neg_5 = Negative(Value=number_slider_4)
neg_6 = Negative(Value=Slider(10, range=0..10))
mid_4 = Curve(item_10)
len_5 = Length(Curve=crv_12)
cull_ends_9 = CullEnds(List=crv_13)  # -> List, Culled
neg_7 = Negative(Value=Slider(0.1, range=0..0.1))
neg_8 = Negative(Value=len_3)
neg_9 = Negative(Value=number_slider_7)
other_4 = Curve(cull_i_4)
number_slider_9 = Slider(77.85, range=0..100)
number_slider_10 = Slider(8.7, range=0..10)
neg_10 = Negative(Value=len_5)
neg_11 = Negative(Value=len_4)
deviationedge = DeviationEdge(line=crv_9, force=Slider(2.429, range=0..10))  # -> deviation_edge; inputs line: Line
#   port line: A line that defines the end nodes of the edge.
#   port force: The desired force on the edge. If negative, the edge is in compression. Otherwise, it is in tension.
#   port deviation_edge: A COMPAS CEM deviation edge.
# ---------- deviationedge: Python ----------
"""
Create a deviation edge from a rhino line.
"""
from ghpythonlib.componentbase import executingcomponent as component

from compas_cem.elements import DeviationEdge


class DeviationEdgeComponent(component):
    def RunScript(self, line, force):
        if line and force is not None:
            return DeviationEdge.from_rhino_line(line, force)
# ---------- end deviationedge ----------
Z = UnitZ(Factor=neg_7)
deviationedge_2 = DeviationEdge(line=top_chord, force=Slider(20, range=0..20))  # -> deviation_edge; inputs line: Line; same code as deviationedge
deviationedge_3 = DeviationEdge(line=flatten(crv_10), force=number_slider_7)  # -> deviation_edge; inputs line: Line; same code as deviationedge
deviationedge_4 = DeviationEdge(line=btmchord, force=neg_3)  # -> deviation_edge; inputs line: Line; same code as deviationedge
verticles_2 = Curve([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])
number_slider_11 = Slider(1.1, range=0..10)
number_slider_12 = Slider(1, range=0..1)
deviationedge_5 = DeviationEdge(line=cull_ends_9.List, force=number_slider_4)  # -> deviation_edge; inputs line: Line; same code as deviationedge
trailedge = TrailEdge(line=crv_6, length=len_3)  # -> trail_edge; inputs line: Line
#   port line: A line that defines the end nodes of the edge.
#   port length: The desired length of the edge. If negative, the edge is in compression. Otherwise, it is in tension.
#   port trail_edge: A COMPAS CEM trail edge.
# ---------- trailedge: Python ----------
"""
Create a trail edge from a rhino line.
"""
from ghpythonlib.componentbase import executingcomponent as component

from compas_cem.elements import TrailEdge


class TrailEdgeComponent(component):
    def RunScript(self, line, length):
        if line and length is not None:
            return TrailEdge.from_rhino_line(line, length)
# ---------- end trailedge ----------
lineload = GhPythonScript(line=crv_11, load_vector=Z)  # -> out, point, vector; inputs line: list of Line, load_vector: Vector3d
# ---------- lineload: Python ----------
from compas_rhino.geometry import RhinoLine
from compas_rhino.geometry import RhinoVector

from compas.geometry import add_vectors
from compas.geometry import scale_vector

from compas.utilities import geometric_key

import rhinoscriptsyntax as rs

gkey_xyz = {}
gkey_load = {}

load_vector = RhinoVector.from_geometry(load_vector).to_compas()

for ln in line:
    ln = RhinoLine.from_geometry(ln).to_compas()
    
    # calculate load on line end-points    
    lvec = scale_vector(load_vector, ln.length * 0.5)
    
    for pt in ln:
        gkey = geometric_key(pt)
        gkey_xyz[gkey] = pt
        
        if gkey in gkey_load:
            gkey_load[gkey] = add_vectors(gkey_load[gkey], lvec)
        else:
            gkey_load[gkey] = lvec

point = []
vector = []

for gkey, xyz in gkey_xyz.items():
    point.append(rs.AddPoint(*xyz))
    vector.append(rs.AddPoint(*gkey_load[gkey]))
# ---------- end lineload ----------
crv_14 = Curve(mid_4)
nodesupport = NodeSupport(point=merge)  # -> node_support; inputs point: Point3d
#   port point: The position of the node where to assign a support.
#   port node_support: A COMPAS CEM node support.
# ---------- nodesupport: Python ----------
"""
Create a node support from a rhino point.
"""
from ghpythonlib.componentbase import executingcomponent as component

from compas_cem.supports import NodeSupport


class NodeSupportComponent(component):
    def RunScript(self, point):
        if point:
            return NodeSupport.from_rhino_point(point)
# ---------- end nodesupport ----------
top_chord_2 = Curve(mid_4)
trailedge_2 = TrailEdge(line=crv_12, length=neg_10)  # -> trail_edge; inputs line: Line; same code as trailedge
crv_15 = Curve(other_4)
entwine_4 = Entwine(Branch00=crv_15, Branch01=crv_6, FlattenInputs=True)
end_14 = EndPoints(Curve=entwine_4)  # -> Start, End
merge_2 = Merge(Data1=end_14.Start, Data2=end_14.End)
cullpt_3 = CullDuplicates(Points=merge_2, Tolerance=0.1, CullMode=1)  # -> Points, Indices, Valence
flip_4 = FlipMatrix(Data=cullpt_3.Points)
pline_6 = PolyLine(Vertices=flip_4, Closed=False)
number_slider_13 = Slider(33.4, range=0..100)
cull_ends_10 = CullEnds(List=verticles_2)  # -> List, Culled
number_slider_14 = Slider(0.1, range=0..0.1)
neg_12 = Negative(Value=number_slider_10)
crv_16 = Curve(flip_3.Curve)
crv_17 = Curve(relay_2)
cull_ends_11 = CullEnds(List=crv_17)  # -> List, Culled
len_6 = Length(Curve=crv_15)
len_7 = Length(Curve=crv_16)

crv_18 = Curve(other_3)
len_8 = Length(Curve=crv_18)
neg_13 = Negative(Value=len_8)
trailedge_3 = TrailEdge(line=crv_18, length=neg_13)  # -> trail_edge; inputs line: Line; same code as trailedge

crv_19 = Curve(cull_ends_6.List)
neg_14 = Negative(Value=Slider(0.1, range=0..0.1))
neg_15 = Negative(Value=Slider(12.5, range=0..20))
neg_16 = Negative(Value=number_slider_11)
nodeload = NodeLoad(point=lineload.point, vector=lineload.vector)  # -> node_load; inputs point: Point3d, vector: Vector3d
#   port point: The position of the node where to apply the load.
#   port vector: The load vector.
#   port node_load: A COMPAS CEM node load.
# ---------- nodeload: Python ----------
"""
Create a load vector to be applied at a node.
"""
from ghpythonlib.componentbase import executingcomponent as component

from compas_cem.loads import NodeLoad


class NodeLoadComponent(component):
    def RunScript(self, point, vector):
        if point and vector:
            return NodeLoad.from_rhino_point_and_vector(point, vector)
# ---------- end nodeload ----------
deviationedge_6 = DeviationEdge(line=cull_ends_9.Culled, force=number_slider_10)  # -> deviation_edge; inputs line: Line; same code as deviationedge
cull_ends_12 = CullEnds(List=crv_19)  # -> List, Culled
neg_17 = Negative(Value=len_6)
number_slider_15 = Slider(8.7, range=0..10)
neg_18 = Negative(Value=len_7)
deviationedge_7 = DeviationEdge(line=crv_16, force=Slider(2.429, range=0..10))  # -> deviation_edge; inputs line: Line; same code as deviationedge
deviationedge_8 = DeviationEdge(line=top_chord_2, force=Slider(20, range=0..20))  # -> deviation_edge; inputs line: Line; same code as deviationedge
merge_3 = Merge(
    Data1=deviationedge_5,
    Data2=deviationedge_2,
    Data3=deviationedge_3,
    Data4=deviationedge_4,
    Data5=deviationedge_6,
    Data7=deviationedge)  # -> flatten(Result)
deviationedge_9 = DeviationEdge(line=[pline_3, pline_6], force=neg_14)  # -> deviation_edge; inputs line: Line; same code as deviationedge
deviationedge_10 = DeviationEdge(line=cull_ends_12.List, force=number_slider_11)  # -> deviation_edge; inputs line: Line; same code as deviationedge
trailedge_4 = TrailEdge(line=crv_15, length=len_6)  # -> trail_edge; inputs line: Line; same code as trailedge
neg_19 = Negative(Value=number_slider_15)
deviationedge_11 = DeviationEdge(line=cull_ends_12.Culled, force=number_slider_15)  # -> deviation_edge; inputs line: Line; same code as deviationedge
view_constrained_form = BooleanToggle(False)

# ---- group: Form Display - Controls
lineweight_thickness_factor = Slider(0.1, range=0..10)
load_scale = Slider(1, range=0..1)
load_min = Slider(0.001, range=0..0.001)
list = ValueList({"Forces": 0, "Lengths": 1}, selected="Forces")
int = Integer(list)
num_2 = Number(lineweight_thickness_factor)
num_3 = Number(load_scale)
num_4 = Number(load_min)

# ---- group: Topoloy Display - Controls
dash_length = Slider(0.04, range=0..0.1)
sphere_radius = Slider(0.07, range=0..0.1)
load_scale_2 = Slider(0.1, range=0..1)
load_min_2 = Slider(0.001, range=0..0.001)
num_5 = Number(Slider(2.1, range=0..10))
num_6 = Number(load_min_2)
num_7 = Number(dash_length)
num_8 = Number(sphere_radius)

# ----
number_slider_16 = Slider(0.001, range=0..0.001)
cem_colors = CEMColors()  # -> color_tension, color_compression, color_edge, color_node, color_node_support, color_node_origin, color_load, color_reaction, color_trail, color_auxiliary_trail
#   port color_tension: The color for edges under a tension force.
#   port color_compression: The color for edges under a compression force.
#   port color_edge: The color for a regular edge.
#   port color_node: The color for a regular node.
#   port color_node_support: The color for a support node.
#   port color_node_origin: The color for an origin node.
#   port color_load: The color for an applied load.
#   port color_reaction: The color for a reaction force.
#   port color_trail: The color to paint a trail.
#   port color_auxiliary_trail: The color to paint an auxiliary trail.
# ---------- cem_colors: Python ----------
"""
Get the artists color scheme for the objects of the CEM framework.
"""
from ghpythonlib.componentbase import executingcomponent as component

from compas_cem import COLORS
import rhinoscriptsyntax as rs


class ArtistColorsComponent(component):
    def RunScript(self):
        colors = {key: rs.CreateColor(c) for key, c in COLORS.items()}

        color_tension = colors["tension"]
        color_compression = colors["compression"]
        color_edge = colors["edge"]
        color_node = colors["node"]
        color_node_support = colors["node_support"]
        color_node_origin = colors["node_origin"]
        color_load = colors["load"]
        color_reaction = colors["support_force"]
        color_trail = colors["trail"]
        color_auxiliary_trail = colors["auxiliary_trail"]

        colors = (color_tension, color_compression, color_edge, color_node, color_node_support, color_node_origin, color_load, color_reaction, color_trail, color_auxiliary_trail)

        return colors
# ---------- end cem_colors ----------
entwine_5 = Entwine(Branch00=cem_colors.color_node_origin, Branch01=cem_colors.color_node_support, FlattenInputs=True)
merge_4 = Merge(Data1=cem_colors.color_compression, Data2=cem_colors.color_tension)
col = Colour(cem_colors.color_auxiliary_trail)
col_2 = Colour(entwine_5)
col_3 = Colour(cem_colors.color_load)
cem_colors_2 = CEMColors()  # -> color_tension, color_compression, color_edge, color_node, color_node_support, color_node_origin, color_load, color_reaction, color_trail, color_auxiliary_trail; same code as cem_colors
merge_5 = Merge(Data1=cem_colors_2.color_compression, Data2=cem_colors_2.color_tension)
col_4 = Colour(cem_colors_2.color_load)

# ---- group: Make2D - Camera plane
camera_plane_index = Slider(1, range=0..1)
update_camera_plane = Button()
bool = Boolean(update_camera_plane)
int_2 = Integer(camera_plane_index)

# ---- group: File metadata
family_name = Panel("Viereendel_ties")
base_directory = Panel("C:\Users\Mark\Documents\GitHub\cem_dataset\bridges\14_Viereendel_ties")
is_3d = BooleanToggle(True)
txt = Text(family_name)
txt_2 = Text(base_directory)
bool_2 = Boolean(is_3d)

# ----
export_topology_json = BooleanToggle(False)
export_form_json = BooleanToggle(False)
bool_3 = Boolean(export_topology_json)
bool_4 = Boolean(export_form_json)

save_form_pdf = BooleanToggle(False)
save_topology_pdf = BooleanToggle(False)
bool_5 = Boolean(save_topology_pdf)
bool_6 = Boolean(save_form_pdf)

reaction_scale = Slider(0.1, range=0..4)

# ---- group: PDF Controls
edge_width = Slider(2, range=0..5)
node_radius = Slider(0.05, range=0..0.5)
node_edgeweight = Slider(1.5, range=0..5)
arrow_width = Slider(1.5, range=0..5)
load_scale_3 = Slider(3.6, range=0..4)
load_gap = Slider(0.07, range=0..2)
reaction_gap = Slider(0.07, range=0..1)
extra_segments_lineweight = Panel("dotted")
extra_segments_line_thickness_form = Panel("0.75")
extra_segments_line_color_form = Panel("120, 120, 120")
num_9 = Number(edge_width)
num_10 = Number(node_radius)
num_11 = Number(node_edgeweight)
num_12 = Number(arrow_width)
num_13 = Number(load_scale_3)
num_14 = Number(load_gap)
num_15 = Number(reaction_scale)
txt_3 = Text(extra_segments_lineweight)
num_16 = Number(reaction_gap)
num_17 = Number(extra_segments_line_thickness_form)
txt_4 = Text(extra_segments_line_color_form)

# ---- group: COMPAS-based Make2D
int_3 = Integer(int_2)
bool_7 = Boolean(bool)
viewports = ViewportProperties(Update=bool_7, AutoUpdate=False)  # -> ViewportNames, ActiveViewportIndex, ViewportBounds, ViewportDisplayMode, CameraLocation, CameraTarget, CameraPlane, CameraLensLength, CameraProjection, CameraUp
item_11 = ListItem(List=viewports.CameraPlane, Index=int_3, Wrap=True)
panel = Panel(viewports.ViewportNames)
pln = Plane(item_11)
panel_2 = Panel(pln)

# ----
pt_16 = Point([Point(-5, -3.425166865, 1.5), Point(5, -3.425166865, 1.5)])
btmchord_2 = Curve(mid_3)
number_slider_17 = Slider(1.7, range=0..10)
crv_20 = Curve(shatter_2)
neg_20 = Negative(Value=Slider(20, range=0..20))
neg_21 = Negative(Value=Slider(0.1, range=0..0.1))
neg_22 = Negative(Value=number_slider_17)
Z_2 = UnitZ(Factor=neg_21)
deviationedge_12 = DeviationEdge(line=flatten(crv_17), force=number_slider_17)  # -> deviation_edge; inputs line: Line; same code as deviationedge
deviationedge_13 = DeviationEdge(line=btmchord_2, force=neg_20)  # -> deviation_edge; inputs line: Line; same code as deviationedge
lineload_2 = GhPythonScript(line=crv_20, load_vector=Z_2)  # -> out, point, vector; inputs line: list of Line, load_vector: Vector3d; same code as lineload
nodeload_2 = NodeLoad(point=lineload_2.point, vector=lineload_2.vector)  # -> node_load; inputs point: Point3d, vector: Vector3d; same code as nodeload
merge_6 = Merge(
    Data1=deviationedge_10,
    Data2=deviationedge_8,
    Data3=deviationedge_12,
    Data4=deviationedge_13,
    Data5=deviationedge_11,
    Data6=deviationedge_9,
    Data7=deviationedge_7)  # -> flatten(Result)

join_4 = JoinCurves(Curves=crv_20, Preserve=False)
merge_7 = Merge(Data1=pt_16, Data2=end_13.Start)  # -> flatten(Result)
neg_23 = Negative(Value=Slider(10, range=0..10))

nodesupport_2 = NodeSupport(point=merge_7)  # -> node_support; inputs point: Point3d; same code as nodesupport

# ---- group: Build topology diagram and trails
topologydiagram = TopologyDiagram(
    trail_edges=flatten([trailedge_3, trailedge_4, trailedge_2, trailedge]),
    deviation_edges=flatten([merge_6, merge_3]),
    loads=flatten([nodeload_2, nodeload]),
    supports=flatten([nodesupport_2, nodesupport]))  # -> topology; inputs nodes: list, trail_edges: list, deviation_edges: list, loads: list, supports: list
#   port nodes: A list of COMPAS CEM nodes to add to the diagram.
#   port trail_edges: A list of COMPAS CEM trail edges to add to the diagram.
#   port deviation_edges: A list of COMPAS CEM deviation edges to add to the diagram.
#   port loads: A list of COMPAS CEM loads to add to the diagram.
#   port supports: A list of COMPAS CEM supports to add to the diagram.
#   port topology: A COMPAS CEM topology diagram.
# ---------- topologydiagram: Python ----------
"""
Build a topology diagram.
"""
from ghpythonlib.componentbase import executingcomponent as component

from compas_cem.diagrams import TopologyDiagram


class BuildTopologyDiagramComponent(component):
    def RunScript(self, nodes, trail_edges, deviation_edges, loads, supports):

        topology = TopologyDiagram()

        if nodes:
            for node in nodes:
                topology.add_node(node)

        if trail_edges is not None:
            for trail_edge in trail_edges:
                topology.add_edge(trail_edge)

        if deviation_edges:
            for deviation_edge in deviation_edges:
                topology.add_edge(deviation_edge)

        if loads:
            for load in loads:
                topology.add_load(load)

        if supports:
            for support in supports:
                topology.add_support(support)

        return topology
# ---------- end topologydiagram ----------
Z_3 = UnitZ(Factor=1)

# ----
rev = Reverse(Vector=Z_3)

# ---- group: Build topology diagram and trails (continued)
buildtrails = BuildTrails(topology=topologydiagram, add_auxiliary_trails=Toggle(True), auxiliary_trail_length="0.33", auxiliary_trail_vector=rev)  # -> topology, trails, auxiliary_trails; inputs add_auxiliary_trails: Boolean, auxiliary_trail_vector: Vector3d
#   port topology: A COMPAS CEM topology diagram.
#   port add_auxiliary_trails: Append auxiliary trail edges to the free nodes of the topology diagram. Defaults to False.
#   port auxiliary_trail_length: The length of the auxiliary trail edges to add. Defaults to 1.0.
#   port auxiliary_trail_vector: The direction to which the auxiliary trail edges will initially point to. Defaults to [1.0, 1.0, 1.0].
#   port topology: The input topology diagram. But now with computed trails.
#   port trails: The keys of the nodes in each of the found trails.
#   port auxiliary_trails: The keys of the appended auxiliary trail edges.
# ---------- buildtrails: Python ----------
"""
Automatically find the trails in a topology diagram. The diagram is modified in-place.
"""
from ghpythonlib.componentbase import executingcomponent as component

from compas_rhino.geometry import RhinoVector


class BuildTopologyDiagramComponent(component):
    def RunScript(self, topology, add_auxiliary_trails, auxiliary_trail_length, auxiliary_trail_vector):
        add_auxiliary_trails = add_auxiliary_trails or False

        if topology:

            topology = topology.copy()

            if auxiliary_trail_length:
                topology.auxiliary_trail_length = auxiliary_trail_length
            if auxiliary_trail_vector:
                topology.auxiliary_trail_vector = RhinoVector.from_geometry(auxiliary_trail_vector).to_compas()

            topology.build_trails(add_auxiliary_trails)

            trails = list(topology.trails())
            auxiliary_trails = list(topology.auxiliary_trail_edges())

            return topology, trails, auxiliary_trails
# ---------- end buildtrails ----------

# ---- group: Optimization parameters
topologydisassembly = DisassembleTopologyDiagram(topology=buildtrails.topology)  # -> nodes, origin_nodes, support_nodes, edges, trail_edges, deviation_edges, trails, auxiliary_trails
#   port topology: A COMPAS CEM topology diagram.
#   port nodes: All the node keys in the topology diagram.
#   port origin_nodes: The keys of the origin nodes in the topology diagram.
#   port support_nodes: The keys of the support nodes in the topology diagram.
#   port edges: All the edge keys in the topology diagram.
#   port trail_edges: The keys of the trail edges in the topology diagram.
#   port deviation_edges: The keys of the deviation edges in the topology diagram.
#   port trails: The trails in the topology diagram.
#   port auxiliary_trails: The auxiliary trails in the topology diagram.
# ---------- topologydisassembly: Python ----------
"""
Disassemble a topology diagram into its constituent parts.
"""
from ghpythonlib.componentbase import executingcomponent as component


class TopologyDisassemblyComponent(component):
    def RunScript(self, topology):
        if topology:
            trails = list(topology.trails())
            auxiliary_trails = list(topology.auxiliary_trails())

            edges = list(topology.edges())
            trail_edges = list(topology.trail_edges())
            deviation_edges = list(topology.deviation_edges())

            nodes = list(topology.nodes())
            origin_nodes = list(topology.origin_nodes())
            support_nodes = list(topology.support_nodes())

            return nodes, origin_nodes, support_nodes, edges, trail_edges, deviation_edges, trails, auxiliary_trails
# ---------- end topologydisassembly ----------
deviationedgeforceparameter = DeviationEdgeForceParameter(edge_key=topologydisassembly.deviation_edges, bound_low="3000", bound_up="3000")  # -> parameter
#   port edge_key: The key of a COMPAS CEM deviation edge.
#   port bound_low: The lower bound of the edge optimization parameter. Calculated as the initial edge parameter minus the absolute value of this bound.
#   port bound_up: The upper bound of the edge optimization parameter. Calculated as the initial edge parameter plus the absolute value of this bound.
#   port parameter: A COMPAS CEM deviation edge force parameter.
# ---------- deviationedgeforceparameter: Python ----------
"""
Set the force of a deviation edge as an optimization parameter.
"""
from ghpythonlib.componentbase import executingcomponent as component

from compas_cem.optimization import DeviationEdgeParameter


class DeviationEdgeParameterComponent(component):
    def RunScript(self, edge_key, bound_low, bound_up):
        if edge_key and bound_low is not None and bound_up is not None:
            return DeviationEdgeParameter(edge_key, bound_low, bound_up)
# ---------- end deviationedgeforceparameter ----------

# ---- group: topology
data = Data(buildtrails.topology)

# 02 Visualize Diagrams
data_2 = Data(data)

# ---- group: Inputs / Topology
data_3 = Data(data)

# ---- group: COMPAS-based Make2D
xy = XYPlane(Origin=Point(0, 0, 0))
data_4 = Data(data_3)
pln_2 = Plane(pln)
orient_and_project = GhPythonScript(topology=data_4, initial_plane=pln_2, target_plane=xy)  # -> out, topology_transformed; inputs initial_plane: Plane, target_plane: Plane
# ---------- orient_and_project: Python ----------
from compas_rhino.geometry import RhinoPlane
from compas.geometry import Transformation
from compas.geometry import Projection
from compas.geometry import Frame
from compas.geometry import transform_vectors
from compas.datastructures import network_transformed

# Build frames from rhino planes
frames = []
for plane in (initial_plane, target_plane):
    plane = RhinoPlane.from_geometry(plane)
    frame = Frame(plane.point, plane.xaxis, plane.yaxis)
    frames.append(frame)    
fa, fb = frames

# Re-orient node positions
transf = Transformation.from_frame_to_frame(fa, fb)
topology_transformed = network_transformed(topology, transf)

# Squash node positions to plane
z = fb.point.z
for node in topology_transformed.nodes():
    topology_transformed.node_attribute(node, "z", z)
# ---------- end orient_and_project ----------
data_5 = Data(orient_and_project.topology_transformed)

# ----
num_18 = Number(num_13)
data_6 = Data(data_5)
topologyartist = TopologyArtist(topology=data_6, load_scale=num_18)  # -> nodes, origin_nodes, support_nodes, edges, trail_edges, deviation_edges, loads; inputs node: list of Int32, edge: list
#   port topology: A COMPAS CEM topology diagram.
#   port node: A selection of the nodes in the diagram. Defaults to all the nodes.
#   port edge: A selection of the edges in the diagram. Defaults to all the edges.
#   port load_min: The minimum load magnitude to plot. Defaults to 1e-3.
#   port load_scale: The scaling factor of the loads. Defaults to 1.
#   port nodes: The nodes in the diagram as points.
#   port origin_nodes: The origin nodes in the diagram as points.
#   port support_nodes: The position of the support nodes in the diagram.
#   port edges: The edges in the diagram as lines.
#   port trail_edges: The trail edges in the diagram as lines.
#   port deviation_edges: The deviation edges in the diagram as lines.
#   port loads: The applied node loads as lines.
# ---------- topologyartist: Python ----------
"""
Draw a topology diagram.
"""
from ghpythonlib.componentbase import executingcomponent as component

from compas_cem.ghpython import TopologyArtist


class TopologyArtistComponent(component):
    def RunScript(self, topology, node, edge, load_min, load_scale):
        node = node or None
        edge = edge or None
        load_min = load_min or 1e-3
        load_scale = load_scale or 1.0
        if topology:
            artist = TopologyArtist(topology)

            nodes = artist.draw_nodes(node)
            origin_nodes = artist.draw_nodes_origin(node)
            support_nodes = artist.draw_nodes_support(node)

            edges = artist.draw_edges(edge)
            trail_edges = artist.draw_edges_trail(edge)
            deviation_edges = artist.draw_edges_deviation(edge)

            loads = artist.draw_loads(node, min_load=load_min, scale=load_scale)

            return nodes, origin_nodes, support_nodes, edges, trail_edges, deviation_edges, loads
# ---------- end topologyartist ----------
clean = CleanTree(RemoveNulls=True, RemoveInvalid=True, RemoveEmpty=False, Tree=[topologyartist.edges, topologyartist.loads])
python_3 = GhPythonScript(segment=clean)  # -> out, segment; inputs segment: list
# ---------- python_3: Python ----------
from compas_rhino.utilities import get_line_coordinates


segment = get_line_coordinates(segment)
# ---------- end python_3 ----------
data_7 = Data(python_3.segment)

data_8 = Data(data_7)
txt_5 = Text(txt_4)
txt_6 = Text(txt_3)
num_19 = Number(num_17)
lng_7 = ListLength(List=data_8)
python_4 = GhPythonScript(D=flatten(txt_5), L=flatten(lng_7))  # -> out, color; inputs D: list, L: list of Int32
# ---------- python_4: Python ----------
color = []

for d, l in zip(D, L):
    
    d = [int(n) for n in d.split(", ")]
    c = [d] * l
    color.extend(c)
# ---------- end python_4 ----------
repeat = RepeatData(Data=num_19, Length=lng_7)
repeat_2 = RepeatData(Data=txt_6, Length=lng_7)
data_9 = Data(python_4.color)
txt_7 = Text(repeat_2)
num_20 = Number(repeat)

nodesearch = NodeSearch(diagram=buildtrails.topology, point=pt_16)  # -> node; inputs point: list of Point3d
#   port diagram: A COMPAS CEM topology or form diagram.
#   port point: The points to search for in the diagram.
#   port node: The node keys.
# ---------- nodesearch: Python ----------
"""
Search a node key in a topology or a form diagram using a point.
"""
from ghpythonlib.componentbase import executingcomponent as component

from compas.utilities import geometric_key
from compas_rhino.geometry import RhinoPoint


class NodeSearchComponent(component):
    def RunScript(self, diagram, point):
        if point and diagram:
            node = []
            for pt in point:
                pt = RhinoPoint.from_geometry(pt).to_compas()
                gkey = geometric_key(pt, diagram.tol)
                node.append(diagram.gkey_node[gkey])
            return node
# ---------- end nodesearch ----------
formfinding = FormFinding(topology=buildtrails.topology)  # -> form; inputs tmax: Int32
#   port topology: A COMPAS CEM topology diagram.
#   port tmax: The maximum number of iterations to run the form-finding algorithm for. Defaults to 100.
#   port eps_min: The convergence threshold of the form-finding algorithm. Default to 1e-6.
#   port form: A COMPAS CEM form diagram in static equilibrium.
# ---------- formfinding: Python ----------
"""
Generate a form diagram in static equilibrium.
"""
from ghpythonlib.componentbase import executingcomponent as component

from compas_cem.equilibrium import static_equilibrium


class FormFindingComponent(component):
    def RunScript(self, topology, tmax, eta_min):
        tmax = tmax or 100
        eta_min = eta_min or 1e-6
        if topology:
            return static_equilibrium(topology, tmax=tmax, eta=eta_min)
# ---------- end formfinding ----------

# ---- group: Optimization goal constraints
trailedgeforceconstraint = TrailEdgeForceConstraint(edge_key=buildtrails.auxiliary_trails, force="0.0")  # -> constraint
#   port edge_key: The key of a COMPAS CEM trail edge.
#   port force: The target force.
#   port weight: The weight of the constraint in the optimization problem. Defaults to one.
#   port constraint: A COMPAS CEM trail force constraint.
# ---------- trailedgeforceconstraint: Python ----------
"""
Make the force on a trail edge to reach a goal force value.
"""
from ghpythonlib.componentbase import executingcomponent as component

from compas_cem.optimization import TrailEdgeForceConstraint


class TrailEdgeForceConstraintComponent(component):
    def RunScript(self, edge_key, force, weight):
        weight = weight or 1.0
        if edge_key and force is not None:
            return TrailEdgeForceConstraint(edge_key, force, weight)
# ---------- end trailedgeforceconstraint ----------
topologydisassembly_2 = DisassembleTopologyDiagram(topology=topologydiagram)  # -> nodes, origin_nodes, support_nodes, edges, trail_edges, deviation_edges, trails, auxiliary_trails; same code as topologydisassembly
pointconstraint = PointConstraint(node_key=nodesearch, point=merge_7)  # -> constraint; inputs node_key: Int32, point: Point3d; disabled
#   port node_key: The key of a COMPAS CEM node.
#   port point: The target point.
#   port weight: The weight of the constraint in the optimization problem. Defaults to one.
#   port constraint: A COMPAS CEM node point constraint.
# ---------- pointconstraint: Python ----------
"""
Pull the position of a node to a target point.
"""
from ghpythonlib.componentbase import executingcomponent as component

from compas_cem.optimization import PointConstraint
from compas_rhino.geometry import RhinoPoint


class PointConstraintComponent(component):
    def RunScript(self, node_key, point, weight):
        weight = weight or 1.0
        if node_key is not None and point:
            point = RhinoPoint.from_geometry(point).to_compas()
            return PointConstraint(node_key, point, weight)
# ---------- end pointconstraint ----------
entwine_6 = Entwine(Branch00=pointconstraint, Branch01=trailedgeforceconstraint, FlattenInputs=True)  # -> flatten(Result)

# ----
constrainedformfinding = ConstrainedFormFinding(
    topology=buildtrails.topology,
    constraints=entwine_6,
    parameters=deviationedgeforceparameter,
    iters_max="400",
    eps="1e-6")  # -> form, penalty, iters, time; inputs constraints: list, parameters: list, iters_max: Int32; disabled
#   port topology: A COMPAS CEM topology diagram.
#   port constraints: A list of COMPAS CEM optimization constraints.
#   port parameters: A list of COMPAS CEM optimization parameters.
#   port algorithm: The name of the optimization algorithm to use.
#   port iters_max: The maximum number of iterations to run the optimization algorithm for.
#   port eps: The minimum penalty value to declare convergence.
#   port form: A COMPAS CEM form diagram in static equilibrium.
#   port penalty: The penalty score after optimization.
#   port iters: The elapsed number of iterations.
#   port time: The optimization elapsed time.
# ---------- constrainedformfinding: Python ----------
"""
Generate a form diagram in static equilibrium.
"""
from ghpythonlib.componentbase import executingcomponent as component

from compas_cem import PROXY_PORT

from compas.rpc import Proxy


class ConstrainedFormFindingComponent(component):
    def RunScript(self, topology, constraints, parameters, algorithm, iters_max, eps):
        algorithm = algorithm or "LD_SLSQP"
        iters_max = iters_max or 100
        eps = eps or 1e-6

        if topology and constraints and parameters:
            topology = topology.copy()

            with Proxy("compas_cem.optimization", port=PROXY_PORT) as opt:
                form, penalty, iters, time = opt.solve_nlopt_proxy(topology,
                                                                   constraints,
                                                                   parameters,
                                                                   algorithm,
                                                                   iters_max,
                                                                   eps)
            return form, penalty, iters, time
# ---------- end constrainedformfinding ----------
panel_3 = Panel(constrainedformfinding.penalty)
panel_4 = Panel(constrainedformfinding.iters)

# ---- group: constrained form
data_10 = Data(constrainedformfinding.form)

# ---- group: form
data_11 = Data(formfinding)

data_12 = Data(data_11)

# ---- group: constrained form
data_13 = Data(data_10)

# ----
filter = StreamFilter(Gate=view_constrained_form, Stream0=data_12, Stream1=data_13)
data_14 = Data(filter)

# ---- group: Inputs / Constrained Form
data_15 = Data(data_14)

# ----
data_16 = Data(data_3)
bool_8 = Boolean(bool_2)
txt_8 = Text(txt)
txt_9 = Text(txt_2)
data_17 = Data(data_15)
bool_9 = Boolean(bool_2)
txt_10 = Text(txt)
txt_11 = Text(txt_2)
nameschema = GhPythonScript(topology=data_16, is_3d=bool_8, family_name=txt_8, base_dir=txt_9)  # -> out, filepath; inputs is_3d: Boolean
# ---------- nameschema: Python ----------
"""familyname_diagram_2dor3d_numnodes_numsupports_numloads_numedges_numtrailedges_numdeviationedges_numauxtrails"""


import os

from compas_cem.diagrams import TopologyDiagram
from compas_cem.diagrams import FormDiagram


diagram = topology
# find out diagram type
cls = diagram.__class__.__name__
if cls == "TopologyDiagram":
    diagram_name = "T"

# check dimensionality
if is_3d:
    dim = "3d"
else:
    dim = "2d"
    
# get data from diagram
numnodes = str(len(list(diagram.nodes())))    
numsupports = str(len(list(diagram.support_nodes())))
numloads = str(len(list(diagram.loaded_nodes())))

numedges = str(len(list(diagram.edges())))
numtrailedges = str(len(list(diagram.trail_edges())))
numdeviationedges = str(len(list(diagram.deviation_edges())))
numauxtrails = str(len(list(diagram.auxiliary_trails()))) 
    
schema = (family_name, diagram_name, dim, numnodes, numsupports, numloads, numedges, numtrailedges, numdeviationedges, numauxtrails)
schema = "_".join(schema)
base_dir = os.path.abspath(base_dir)
filepath = os.path.abspath(os.path.join(base_dir, family_name, dim, schema))
# ---------- end nameschema ----------
nameschema_2 = GhPythonScript(form=data_17, is_3d=bool_9, family_name=txt_10, base_dir=txt_11)  # -> out, filepath; inputs is_3d: Boolean
# ---------- nameschema_2: Python ----------
"""familyname_diagram_2dor3d_numnodes_numsupports_numloads_numedges_numtrailedges_numdeviationedges_numauxtrails"""


import os

from compas_cem.diagrams import TopologyDiagram
from compas_cem.diagrams import FormDiagram


diagram = form
# find out diagram type
cls = diagram.__class__.__name__
if cls == "FormDiagram":
    diagram_name = "F"

# check dimensionality
if is_3d:
    dim = "3d"
else:
    dim = "2d"
    
# get data from diagram
numnodes = str(len(list(diagram.nodes())))    
numsupports = str(len(list(diagram.support_nodes())))
numloads = str(len(list(diagram.loaded_nodes())))
numedges = str(len(list(diagram.edges())))
    
schema = (family_name, diagram_name, dim, numnodes, numsupports, numloads, numedges)
schema = "_".join(schema)
base_dir = os.path.abspath(base_dir)
filepath = os.path.abspath(os.path.join(base_dir, family_name, dim, schema))
# ---------- end nameschema_2 ----------
txt_12 = Text(nameschema.filepath)
txt_13 = Text(nameschema_2.filepath)

# ---- group: COMPAS-based Make2D
xy_2 = XYPlane(Origin=Point(0, 0, 0))
data_18 = Data(data_15)
pln_3 = Plane(pln)
orient_and_project_2 = GhPythonScript(form=data_18, initial_plane=pln_3, target_plane=xy_2)  # -> out, form_transformed; inputs initial_plane: Plane, target_plane: Plane
# ---------- orient_and_project_2: Python ----------
from compas_rhino.geometry import RhinoPlane
from compas.geometry import Transformation
from compas.geometry import Projection
from compas.geometry import Frame
from compas.geometry import transform_vectors
from compas.datastructures import network_transformed

# Build frames from rhino planes
frames = []
for plane in (initial_plane, target_plane):
    plane = RhinoPlane.from_geometry(plane)
    frame = Frame(plane.point, plane.xaxis, plane.yaxis)
    frames.append(frame)    
fa, fb = frames

# Re-orient node positions
transf = Transformation.from_frame_to_frame(fa, fb)
form_transformed = network_transformed(form, transf)

# Squash node positions to plane
z = fb.point.z
for node in form_transformed.nodes():
    form_transformed.node_attribute(node, "z", z)
    

# Re-orient and squash loads
for node in form_transformed.nodes():
    # loads
    load = form_transformed.node_load(node)
    loadt = transform_vectors([load], transf).pop()
    form_transformed.node_attributes(node, ("qx", "qy", "qz"), loadt)
    
    # reaction force
    reaction = form_transformed.reaction_force(node)
    reactiont = transform_vectors([reaction], transf).pop()
    form_transformed.node_attributes(node, ("rx", "ry", "rz"), reactiont)
# ---------- end orient_and_project_2 ----------
data_19 = Data(orient_and_project_2.form_transformed)
data_20 = Data(data_19)
python_5 = GhPythonScript(form=data_20, reaction_min="0.001")  # -> out, form
# ---------- python_5: Python ----------
from compas.geometry import length_vector


nodes = list(form.nodes())


for node in nodes:
    if form.is_node_support(node) and length_vector(form.reaction_force(node)) <= reaction_min:
        form.delete_node(node)
# ---------- end python_5 ----------
data_21 = Data(python_5.form)

# ----
txt_14 = Text(txt_13)
num_21 = Number(flatten(num_20))
txt_15 = Text(flatten(txt_7))
bool_10 = Boolean(bool_5)
num_22 = Number(num_9)
num_23 = Number(num_10)
data_22 = Data(data_5)
num_24 = Number(num_11)
num_25 = Number(num_11)
txt_16 = Text(txt_12)
bool_11 = Boolean(bool_6)
data_23 = Data(data_21)
num_26 = Number(num_11)
num_27 = Number(num_13)
num_28 = Number(num_9)
num_29 = Number(num_10)
num_30 = Number(num_12)
num_31 = Number(num_14)
num_32 = Number(num_15)
num_33 = Number(num_16)
data_24 = Data(data_7)
data_25 = Data(data_9)
concat = Concatenate(FragmentA=txt_14, FragmentB=".pdf")
division_11 = Division(A=num_25, B=2)
concat_2 = Concatenate(FragmentA=txt_16, FragmentB=".pdf")
python_6 = GhPythonScript(
    save_file=bool_10,
    topology=data_22,
    edge_width=num_22,
    node_radius=num_23,
    node_edgewidth=num_24,
    load_width=division_11,
    load_radius=num_23,
    fig_width="16",
    fig_height="9",
    fig_dpi="100",
    filepath=concat_2)  # -> out; inputs save_file: Boolean, fig_width: Int32, fig_height: Int32, fig_dpi: Int32
# ---------- python_6: Python ----------
from compas.rpc import Proxy


kwargs = {"topology": topology,
          "filepath": filepath,
          "edge_width": edge_width,
          "node_radius": node_radius,
          "node_edgewidth": node_edgewidth,
          "load_width": load_width,
          "load_radius": load_radius,
          "fig_width": fig_width,
          "fig_height": fig_height,
          "fig_dpi": fig_dpi}


if save_file:
    with Proxy("compas_cem.plotters") as plotters:
        data = plotters.topology_plotter_proxy(**kwargs)
        
    print("Done!")
    print(data)
# ---------- end python_6 ----------
python_7 = GhPythonScript(
    save_file=bool_11,
    form=data_23,
    edge_width=num_28,
    node_radius=num_29,
    node_edgewidth=num_26,
    load_width=num_30,
    load_scale=num_27,
    load_gap=num_31,
    reaction_width=num_30,
    reaction_scale=num_32,
    reaction_gap=num_33,
    segment=data_24,
    segment_color=data_25,
    segment_width=num_21,
    segment_ls=txt_15,
    fig_width="16",
    fig_height="9",
    fig_dpi="100",
    filepath=concat)  # -> out; inputs save_file: Boolean, segment: list, segment_color: list, segment_width: list, segment_ls: list, fig_width: Int32, fig_height: Int32, fig_dpi: Int32
# ---------- python_7: Python ----------
from compas.rpc import Proxy


kwargs = {"form": form,
          "filepath": filepath,
          "edge_width": edge_width,
          "node_radius": node_radius,
          "node_edgewidth": node_edgewidth,
          "load_width": load_width,
          "load_scale": load_scale,
          "load_gap": load_gap,
          "reaction_width": reaction_width,
          "reaction_scale": reaction_scale,
          "reaction_gap": reaction_gap,
          "segment": segment,
          "segment_color": segment_color,
          "segment_width": segment_width,
          "segment_ls": segment_ls,
          "fig_width": fig_width,
          "fig_height": fig_height,
          "fig_dpi": fig_dpi}


if save_file:
    with Proxy("compas_cem.plotters") as plotters:
        plotters.form_plotter_proxy(**kwargs)
        
    print("Done!")
# ---------- end python_7 ----------
panel_5 = Panel(python_6)
panel_6 = Panel(python_7)

txt_17 = Text(txt_12)
txt_18 = Text(txt_13)
bool_12 = Boolean(bool_3)
data_26 = Data(data_3)
bool_13 = Boolean(bool_4)
data_27 = Data(data_15)
exportjson = GhPythonScript(export=bool_12, diagram=data_26, filepath=txt_17)  # -> out
# ---------- exportjson: Python ----------
if export:
    diagram.to_json(filepath + ".json")
    
    print("Exported file to {}!".format(filepath + ".json"))
# ---------- end exportjson ----------
exportjson_2 = GhPythonScript(export=bool_13, diagram=data_27, filepath=txt_18)  # -> out; same code as exportjson
panel_7 = Panel(exportjson_2)
panel_8 = Panel(exportjson)

num_34 = Number(num_4)
num_35 = Number(num_2)
num_36 = Number(num_3)
int_4 = Integer(int)
data_28 = Data(data_14)
col_5 = Colour(col_4)
swatch = ColourSwatch(SwatchColor=RGBA(156, 156, 156, 195))

num_37 = Number(num_35)
int_5 = Integer(int_4)
data_29 = Data(data_28)
num_38 = Number(num_34)
num_39 = Number(num_36)
formartist = FormArtist(form=data_29, force_min=num_38, force_scale=num_39)  # -> nodes, support_nodes, edges, loads, reactions; inputs node: list of Int32, edge: list
#   port form: A COMPAS CEM topology diagram.
#   port node: A selection of the nodes in the diagram. Defaults to all the nodes.
#   port edge: A selection of the edges in the diagram. Defaults to all the edges.
#   port force_min: The smallest force magnitude to draw. Defaults to 1e-3
#   port force_scale: The scale of the loads and the reactions. Defaults to 1.
#   port nodes: The nodes of the diagram as points.
#   port support_nodes: The support nodes of the diagram as points
#   port edges: The edges of the diagram as lines.
#   port loads: The applied loads as lines.
#   port reactions: The reaction forces at the supports, as lines.
# ---------- formartist: Python ----------
"""
Draw a form diagram.
"""
from ghpythonlib.componentbase import executingcomponent as component

from compas_cem.ghpython import FormArtist


class FormArtistComponent(component):
    def RunScript(self, form, node, edge, force_min, force_scale):
        force_min = force_min or 1e-3
        force_scale = force_scale or 1
        if form:
            artist = FormArtist(form)

            nodes = artist.draw_nodes(node)
            edges = artist.draw_edges(edge)
            support_nodes = artist.draw_nodes_support(node)

            loads = artist.draw_loads(node, min_load=force_min, scale=force_scale)
            reactions = artist.draw_reactions(node, min_force=force_min, scale=force_scale)

            return nodes, support_nodes, edges, loads, reactions
# ---------- end formartist ----------
edgeresults = EdgeResults(form=data_29)  # -> length, force; inputs edge: list
#   port form: A COMPAS CEM form diagram.
#   port edge: A selection of edge keys to query the results on. Defaults to all the edges.
#   port length: The edge lengths.
#   port force: The edge forces.
# ---------- edgeresults: Python ----------
"""
Extract the post form-finding results of the edges in a form diagram.
"""
from ghpythonlib.componentbase import executingcomponent as component


class EdgeResultsComponent(component):
    def RunScript(self, form, edge):
        if form:
            edge = edge or list(form.edges())
            length = [form.edge_length_2(ed) for ed in edge]
            force = [form.edge_force(ed) for ed in edge]
            return length, force
# ---------- end edgeresults ----------
formdisassembly = DisassembleFormDiagram(form=data_29)  # -> nodes, support_nodes, edges
#   port form: A COMPAS CEM form diagram.
#   port nodes: All the node keys in the form diagram.
#   port support_nodes: The keys of the support nodes in the form diagram.
#   port edges: All the edge keys in the form diagram.
# ---------- formdisassembly: Python ----------
"""
Disassemble a form diagram into its constituent parts.
"""
from ghpythonlib.componentbase import executingcomponent as component


class FormDisassemblyComponent(component):
    def RunScript(self, form):
        if form:
            edges = list(form.edges())
            nodes = list(form.nodes())
            support_nodes = list(form.support_nodes())

            return nodes, support_nodes, edges
# ---------- end formdisassembly ----------
larger = LargerThan(FirstNumber=edgeresults.force, SecondNumber=0)  # -> LargerThan, OrEqualTo
abs = Absolute(Value=edgeresults.force)
filter_2 = StreamFilter(Gate=int_5, Stream0=edgeresults.force, Stream1=edgeresults.length)
item_12 = ListItem(List=merge_5, Index=larger.OrEqualTo, Wrap=True)
multiplication = Multiplication(A=abs, B=num_37)
python_8 = GhPythonScript(x=filter_2)  # -> out, a
# ---------- python_8: Python ----------
a = round(x, 3)
# ---------- end python_8 ----------
int_6 = Integer(formdisassembly.nodes)
data_30 = Data(formdisassembly.edges)
pt_17 = Point(formartist.nodes)
crv_21 = Curve(formartist.edges)
crv_22 = Curve(formartist.loads)
crv_23 = Curve(formartist.loads)
crv_24 = Curve(formartist.reactions)
col_6 = Colour(item_12)
num_40 = Number(multiplication)
num_41 = Number(python_8.a)

pt_18 = Point(pt_17)
int_7 = Integer(int_6)
data_31 = Data(data_30)
crv_25 = Curve(crv_21)
crv_26 = Curve(crv_22)
crv_27 = Curve(crv_23)
crv_28 = Curve(crv_24)
col_7 = Colour(col_6)
num_42 = Number(num_40)
num_43 = Number(num_41)
data_32 = Data(data_31)
pt_19 = Point(pt_18)
int_8 = Integer(int_7)
crv_29 = Curve(crv_25)
midpt = CurveMiddle(Curve=crv_29)

crv_30 = Curve(crv_25)
col_8 = Colour(col_7)
num_44 = Number(num_42)

crv_31 = Curve(crv_27)
crv_32 = Curve(crv_28)
col_9 = Colour(col_5)
end_15 = EndPoints(Curve=crv_31)  # -> Start, End
end_16 = EndPoints(Curve=crv_32)  # -> Start, End
vec2pt = Vector2Pt(PointA=end_16.Start, PointB=end_16.End, Unitize=False)  # -> Vector, Length
vec2pt_2 = Vector2Pt(PointA=end_15.Start, PointB=end_15.End, Unitize=False)  # -> Vector, Length

num_45 = Number(num_43)
crv_33 = Curve(crv_25)
midpt_2 = CurveMiddle(Curve=crv_33)

# ---- group: Edges
previewlw = CustomPreviewLineweights(Geometry=crv_30, Shader=col_8, Thickness=num_44, Absolute=False)

# ---- group: Reaction forces
vdisex = VectorDisplayEx(Point=end_16.Start, Vector=vec2pt.Vector, Colour=col_9, Width=2)

# ---- group: Node keys
tag = TextTag(Location=pt_19, Text=int_8, Colour=swatch)

# ---- group: Edge keys
tag_2 = TextTag(Location=midpt, Text=data_32, Colour=swatch)

# ---- group: Edge results
tag_3 = TextTag(Location=midpt_2, Text=num_45, Colour=ColourSwatch(SwatchColor=RGB(191, 4, 4)))

# ---- group: Loads
vdisex_2 = VectorDisplayEx(Point=end_15.Start, Vector=vec2pt_2.Vector, Colour=col_9, Width=2)

# ----
num_46 = Number(num_5)
data_33 = Data(data)
num_47 = Number(num_6)
num_48 = Number(num_8)
col_10 = Colour(col_3)
col_11 = Colour(col)
col_12 = Colour(col_2)

num_49 = Number(num_48)
num_50 = Number(num_47)
num_51 = Number(num_46)
data_34 = Data(data_33)
topologyartist_2 = TopologyArtist(topology=data_34)  # -> nodes, origin_nodes, support_nodes, edges, trail_edges, deviation_edges, loads; inputs node: list of Int32, edge: list; same code as topologyartist
topologydisassembly_3 = DisassembleTopologyDiagram(topology=data_34)  # -> nodes, origin_nodes, support_nodes, edges, trail_edges, deviation_edges, trails, auxiliary_trails; same code as topologydisassembly
python_9 = GhPythonScript(topology=data_34, auxiliary_trail=topologydisassembly_3.auxiliary_trails)  # -> out, auxiliary_trail; inputs auxiliary_trail: list
# ---------- python_9: Python ----------
from compas_cem.ghpython import TopologyArtist


if auxiliary_trail is not None:
    artist = TopologyArtist(topology)
   
    if auxiliary_trail is not None:
        auxiliary_trail = artist.draw_edges_trail(auxiliary_trail)
# ---------- end python_9 ----------
python_10 = GhPythonScript(trail=topologydisassembly_3.trail_edges, auxiliary_trail=topologydisassembly_3.auxiliary_trails)  # -> out, trail; inputs trail: list, auxiliary_trail: list
# ---------- python_10: Python ----------
trail = [tr for tr in trail if tr not in auxiliary_trail]
# ---------- end python_10 ----------
topologyartist_3 = TopologyArtist(topology=data_34, edge=python_10.trail, load_min=num_50, load_scale=num_51)  # -> nodes, origin_nodes, support_nodes, edges, trail_edges, deviation_edges, loads; inputs node: list of Int32, edge: list
#   port topology: A COMPAS CEM topology diagram.
#   port node: A selection of the nodes in the diagram. Defaults to all the nodes.
#   port edge: A selection of the edges in the diagram. Defaults to all the edges.
#   port load_min: The minimum load magnitude to plot. Defaults to 1e-3.
#   port load_scale: The scaling factor of the loads. Defaults to 1.
#   port nodes: The nodes in the diagram as points.
#   port origin_nodes: The origin nodes in the diagram as points.
#   port support_nodes: The position of the support nodes in the diagram.
#   port edges: The edges in the diagram as lines.
#   port trail_edges: The trail edges in the diagram as lines.
#   port deviation_edges: The deviation edges in the diagram as lines.
#   port loads: The applied node loads as lines.
# ---------- topologyartist_3: Python ----------
"""
Draw a topology diagram.
"""
from ghpythonlib.componentbase import executingcomponent as component

from compas_cem.ghpython import TopologyArtist


class TopologyArtistComponent(component):
    def RunScript(self, topology, node, edge, load_min, load_scale):
        node = node or None
        edge = edge or None
        load_min = load_min or 1e-3
        load_scale = load_scale or 1.0
        if topology:
            artist = TopologyArtist(topology)

            nodes = artist.draw_nodes(node)
            origin_nodes = artist.draw_nodes_origin(node)
            support_nodes = artist.draw_nodes_support(node)

            edges = artist.draw_edges(edge)
            trail_edges = artist.draw_edges_trail(node)
            deviation_edges = artist.draw_edges_deviation(node)

            loads = artist.draw_loads(node, min_load=load_min, scale=load_scale)

            return nodes, origin_nodes, support_nodes, edges, trail_edges, deviation_edges, loads
# ---------- end topologyartist_3 ----------
entwine_7 = Entwine(Branch00=topologyartist_3.origin_nodes, Branch01=topologyartist_3.support_nodes, FlattenInputs=True)
edgeresults_2 = EdgeResults(form=data_34, edge=python_10.trail)  # -> length, force; inputs edge: list; same code as edgeresults
edgeresults_3 = EdgeResults(form=data_34, edge=topologydisassembly_3.deviation_edges)  # -> length, force; inputs edge: list; same code as edgeresults
larger_2 = LargerThan(FirstNumber=edgeresults_3.force, SecondNumber=0)  # -> LargerThan, OrEqualTo
larger_3 = LargerThan(FirstNumber=edgeresults_2.length, SecondNumber=0)  # -> LargerThan, OrEqualTo
sph = Sphere(Base=entwine_7, Radius=num_49)
item_13 = ListItem(List=merge_4, Index=larger_2.OrEqualTo, Wrap=True)
item_14 = ListItem(List=merge_4, Index=larger_3.OrEqualTo, Wrap=True)
graft = GraftTree(Tree=item_13, IncludeEmptyLists=True, IncludeNullItems=True)
int_9 = Integer(topologydisassembly_3.nodes)
pt_20 = Point(topologyartist_2.nodes)
num_52 = Number(edgeresults_2.length)
num_53 = Number(edgeresults_3.force)
col_13 = Colour(graft)
data_35 = Data(topologydisassembly_3.edges)
crv_34 = Curve(topologyartist_2.edges)

# ---- group: trail edges w/o aux
crv_35 = Curve(topologyartist_3.edges)

# ---- group: aux trails
crv_36 = Curve(python_9.auxiliary_trail)

# ---- group: deviation edges
crv_37 = Curve(topologyartist_3.deviation_edges)

# ----
crv_38 = Curve(topologyartist_3.loads)
brep = Brep(sph)
col_14 = Colour(item_14)

data_36 = Data(data_35)
int_10 = Integer(int_9)
pt_21 = Point(pt_20)
crv_39 = Curve(crv_35)
crv_40 = Curve(crv_36)
crv_41 = Curve(crv_37)
crv_42 = Curve(crv_38)
brep_2 = Brep(brep)
num_54 = Number(num_52)
num_55 = Number(num_53)
col_15 = Colour(col_14)
col_16 = Colour(col_13)
crv_43 = Curve(crv_34)

data_37 = Data(data_36)
pt_22 = Point(pt_21)
crv_44 = Curve(crv_43)
int_11 = Integer(int_10)
swatch_2 = ColourSwatch(SwatchColor=RGBA(156, 156, 156, 195))
midpt_3 = CurveMiddle(Curve=crv_44)

crv_45 = Curve(crv_39)
num_56 = Number(num_54)
crv_46 = Curve(crv_41)
num_57 = Number(num_55)
swatch_3 = ColourSwatch(SwatchColor=RGB(184, 184, 184))
midpt_4 = CurveMiddle(Curve=crv_45)
midpt_5 = CurveMiddle(Curve=crv_46)

crv_47 = Curve(crv_40)
crv_48 = Curve(crv_39)
col_17 = Colour(col_15)
col_18 = Colour(col_11)
crv_49 = Curve(crv_41)
num_58 = Number(num_7)
col_19 = Colour(col_16)
dash = DashPattern(Curve=crv_49, Pattern=num_58)  # -> Dashes, Gaps

crv_50 = Curve(crv_42)
col_20 = Colour(col_10)
end_17 = EndPoints(Curve=crv_50)  # -> Start, End
vec2pt_3 = Vector2Pt(PointA=end_17.Start, PointB=end_17.End, Unitize=False)  # -> Vector, Length

brep_3 = Brep(brep_2)
col_21 = Colour(col_12)

# ---- group: Trail edges
preview = CustomPreview(Geometry=crv_48, Material=col_17)

# ---- group: Nodes
preview_2 = CustomPreview(Geometry=brep_3, Material=col_21)

# ---- group: Loads
vdisex_3 = VectorDisplayEx(Point=end_17.Start, Vector=vec2pt_3.Vector, Colour=col_20, Width=2)

# ---- group: Edge keys
tag_4 = TextTag(Location=midpt_3, Text=data_37, Colour=swatch_2)

# ---- group: Node keys
# 03 Export Data
tag_5 = TextTag(Location=pt_22, Text=int_11, Colour=swatch_2)

# ---- group: Deviation edges
preview_3 = CustomPreview(Geometry=crv_47, Material=col_18)

# ---- group: Auxiliary trails
preview_4 = CustomPreview(Geometry=dash.Dashes, Material=col_19)

# ---- group: Deviation forces
tag_6 = TextTag(Location=midpt_5, Text=num_57, Colour=swatch_3)

# ---- group: Trail lengths
tag_7 = TextTag(Location=midpt_4, Text=num_56, Colour=swatch_3)
