# Grasshopper definition Unterspannte_3d.ghx (Grasshopper 1.0.7)
# plug-ins: Human, treesloth01, Wombat

Y = UnitY(Factor=1)
btm_chord = Curve([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])
number_slider = Slider(21, range=3..21)
join = JoinCurves(Curves=btm_chord, Preserve=False)
move = Move(Geometry=join, Motion=Y)  # -> Geometry, Transform
height = Slider(1.451, range=0..10)
entwine = Entwine(Branch00=join, Branch01=move.Geometry, FlattenInputs=True)
end = EndPoints(Curve=join)  # -> Start, End
cat = Catenary(PointA=end.Start, PointB=end.End, Length=Slider(10.48, range=10..11), Gravity=Vector(0, 0, -1))
Y_2 = UnitY(Factor="0.5")
divide = DivideCurve(Curve=entwine, Count=number_slider, Kinks=False)  # -> Points, Tangents, Parameters
move_2 = Move(Geometry=cat, Motion=Y_2)  # -> Geometry, Transform
mp = Midpoint(Curve=entwine)
mp_2 = Midpoint(Curve=move_2.Geometry)
flip = FlipMatrix(Data=divide.Points)
dist = Distance(PointA=mp, PointB=mp_2)
divide_2 = DivideCurve(Curve=move_2.Geometry, Count=number_slider, Kinks=False)  # -> Points, Tangents, Parameters
xz = XZPlane(Origin=divide.Points)
Z = UnitZ(Factor=Slider(0.01, range=0..1))

# ---- group: Reload compas_cem
# 01 CEM framework model
button = Button()
python = GhPythonScript(unload=button)  # -> out; inputs unload: Boolean
# ---------- python: Python ----------
from compas_ghpython.utilities import unload_modules


if unload:
    unloaded = unload_modules("compas")
    print("Unloaded: {}".format(unloaded))
# ---------- end python ----------

# ----
neg = Negative(Value=Z)
move_3 = Move(Geometry=divide_2.Points, Motion=neg)  # -> Geometry, Transform
ln = Line(StartPoint=move_3.Geometry, EndPoint=divide.Points)
shatter = Shatter(Curve=entwine, Parameters=divide.Parameters)
len = Length(Curve=shatter)
item = ListItem(List=len, Index=0, Wrap=True)
division = Division(A=height, B=item)
expression = Expression(x=height, y=item, Expression="sqrt(x^2+y^2)")
line = LineSDL(Start=divide.Points, Direction=Vector(0, 0, 1), Length=expression)
atan = ArcTangent(Value=division)
pline = PolyLine(Vertices=move_3.Geometry, Closed=False)
cull_ends = CullEnds(List=ln)  # -> List, Culled
pi = Pi(Factor=1)
division_2 = Division(A=pi, B=2)
subtraction = Subtraction(A=atan, B=division_2)
neg_2 = Negative(Value=subtraction)
rotate = Rotate(Geometry=line, Angle=neg_2, Plane=xz)  # -> reverse(Geometry), Transform
rotate_2 = Rotate(Geometry=line, Angle=subtraction, Plane=xz)  # -> Geometry, Transform
lng = ListLength(List=rotate_2.Geometry)
lng_2 = ListLength(List=rotate.Geometry)
division_3 = Division(A=lng, B=2)
division_4 = Division(A=lng_2, B=2)
explode = Explode(Curve=pline, Recursive=True)  # -> Segments, Vertices
split = SplitList(List=rotate_2.Geometry, Index=expr("x-1", division_3))  # -> ListA, ListB
split_2 = SplitList(List=rotate.Geometry, Index=expr("x-1", division_4))  # -> ListA, ListB
entwine_2 = Entwine(Branch00=split.ListA, Branch01=split_2.ListA, FlattenInputs=True)  # -> flatten(Result)
cull_ends_2 = CullEnds(List=explode.Segments)  # -> List, Culled
first_last = FirstLast(List=cull_ends_2.Culled)  # -> FirstValue, LastValue
end_2 = EndPoints(Curve=first_last.LastValue)  # -> Start, End
crv = Curve([split.ListA, split_2.ListA])
end_3 = EndPoints(Curve=first_last.FirstValue)  # -> Start, End
crv_2 = Curve(split.ListB)
crv_3 = Curve(split_2.ListB)
merge = Merge(Data2=cull_ends_2.List)
crv_4 = Curve(cull_ends_2.List)
mp_3 = Midpoint(Curve=shatter)
pt = Point(Point(0, 0, 0))
entwine_3 = Entwine(Branch00=reverse(crv_2), Branch01=crv_3, FlattenInputs=True)  # -> flatten(Result)
cp = ClosestPoint(Point=pt, Cloud=mp_3)  # -> ClosestPoint, CPIndex, Distance
mp_4 = Midpoint(Curve=crv_4)
Y_3 = UnitY(Factor="-.5")
pt_2 = Point(Point(0, 0, 0))
Y_4 = UnitY(Factor="-.5")
cp_2 = ClosestPoint(Point=pt_2, Cloud=mp_4)  # -> ClosestPoint, CPIndex, Distance
move_4 = Move(Geometry=end_3.Start, Motion=Y_3)  # -> Geometry, Transform
cull_i = CullIndex(List=shatter, Indices=cp.CPIndex, Wrap=True)
item_2 = ListItem(List=shatter, Index=cp.CPIndex, Wrap=True)
move_5 = Move(Geometry=end_2.End, Motion=Y_4)  # -> Geometry, Transform
cull_ends_3 = CullEnds(List=entwine_3)  # -> List, Culled
cull_i_2 = CullIndex(List=crv_4, Indices=cp_2.CPIndex, Wrap=True)
item_3 = ListItem(List=crv_4, Index=cp_2.CPIndex, Wrap=True)
other = Curve(cull_i)
mid = Curve(item_2)
cull_ends_4 = CullEnds(List=shatter)  # -> List, Culled
first_last_2 = FirstLast(List=shatter)  # -> FirstValue, LastValue
ln_2 = Line(StartPoint=move_5.Geometry, EndPoint=end_2.Start)
crv_5 = Curve(cull_ends_3.List)
end_4 = EndPoints(Curve=crv_5)  # -> Start, End
pline_2 = PolyLine(Vertices=end_4.End, Closed=False)
ccx = CurveCurve(CurveA=pline_2, CurveB=graft(line))  # -> Points, ParamsA, ParamsB
item_4 = ListItem(List=ccx.Points, Index=0, Wrap=True)
explode_2 = Explode(Curve=pline_2, Recursive=True)  # -> Segments, Vertices
ln_3 = Line(StartPoint=graft(divide.Points), EndPoint=item_4)  # -> flatten(Line)
cull_ends_5 = CullEnds(List=ln_3)  # -> List, Culled
mid_2 = Curve(item_3)
ln_4 = Line(StartPoint=move_4.Geometry, EndPoint=end_3.End)
first_last_3 = FirstLast(List=cull_ends_4.List)  # -> FirstValue, LastValue
cull_ends_6 = CullEnds(List=cull_ends_4.List)  # -> List, Culled
end_5 = EndPoints(Curve=pline)  # -> Start, End
number_slider_2 = Slider(100, range=0..100)
end_6 = EndPoints(Curve=[ln_4, ln_2])  # -> Start, End
Y_5 = UnitY(Factor=1)
verticles = Curve([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])
other_2 = Curve(flatten([cull_i_2, ln_2, ln_4]))
number_slider_3 = Slider(1, range=0..1)
top_chord = Curve(explode.Segments)

crv_6 = Curve(other)
len_2 = Length(Curve=crv_6)
neg_3 = Negative(Value=len_2)
trailedge = TrailEdge(line=crv_6, length=neg_3)  # -> trail_edge; inputs line: Line
#   port line: A line that defines the end nodes of the edge.
#   port length: The desired length of the edge. If negative, the edge is in compression. Otherwise, it is in tension.
#   port trail_edge: A COMPAS CEM trail edge.
# ---------- trailedge: Python ----------
"""
Create a trail edge from a rhino line.
"""
from ghpythonlib.componentbase import executingcomponent as component

from compas_cem.elements import TrailEdge


class TrailEdgeComponent(component):
    def RunScript(self, line, length):
        if line and length is not None:
            return TrailEdge.from_rhino_line(line, length)
# ---------- end trailedge ----------

cull_ends_7 = CullEnds(List=verticles)  # -> List, Culled
number_slider_4 = Slider(202, range=0..1000)
len_3 = Length(Curve=other_2)
end_7 = EndPoints(Curve=entwine)  # -> Start, End
join_2 = JoinCurves(Preserve=False)
pline_3 = PolyLine(Vertices=flip, Closed=False)
merge_2 = Merge(Data1=end_7.Start, Data2=end_6.Start, Data3=end_7.End)  # -> flatten(Result)
neg_4 = Negative(Value=Slider(1.1, range=0..10))
webs = Curve([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])
deviationedge = DeviationEdge(line=mid_2, force=Slider(9, range=0..100))  # -> deviation_edge; inputs line: Line
#   port line: A line that defines the end nodes of the edge.
#   port force: The desired force on the edge. If negative, the edge is in compression. Otherwise, it is in tension.
#   port deviation_edge: A COMPAS CEM deviation edge.
# ---------- deviationedge: Python ----------
"""
Create a deviation edge from a rhino line.
"""
from ghpythonlib.componentbase import executingcomponent as component

from compas_cem.elements import DeviationEdge


class DeviationEdgeComponent(component):
    def RunScript(self, line, force):
        if line and force is not None:
            return DeviationEdge.from_rhino_line(line, force)
# ---------- end deviationedge ----------
deviationedge_2 = DeviationEdge(line=cull_ends.List, force=neg_4)  # -> deviation_edge; inputs line: Line; same code as deviationedge
trailedge_2 = TrailEdge(line=other_2, length=len_3)  # -> trail_edge; inputs line: Line; same code as trailedge
view_constrained_form = BooleanToggle(False)

# ---- group: Form Display - Controls
lineweight_thickness_factor = Slider(0.1, range=0..10)
load_scale = Slider(1, range=0..1)
load_min = Slider(0.001, range=0..0.001)
list = ValueList({"Forces": 0, "Lengths": 1}, selected="Forces")
int = Integer(list)
num = Number(lineweight_thickness_factor)
num_2 = Number(load_scale)
num_3 = Number(load_min)

# ---- group: Topoloy Display - Controls
dash_length = Slider(0.04, range=0..0.1)
sphere_radius = Slider(0.07, range=0..0.1)
load_scale_2 = Slider(0.1, range=0..1)
load_min_2 = Slider(0.001, range=0..0.001)
num_4 = Number(Slider(2.1, range=0..10))
num_5 = Number(load_min_2)
num_6 = Number(dash_length)
num_7 = Number(sphere_radius)

# ----
number_slider_5 = Slider(0.001, range=0..0.001)
cem_colors = CEMColors()  # -> color_tension, color_compression, color_edge, color_node, color_node_support, color_node_origin, color_load, color_reaction, color_trail, color_auxiliary_trail
#   port color_tension: The color for edges under a tension force.
#   port color_compression: The color for edges under a compression force.
#   port color_edge: The color for a regular edge.
#   port color_node: The color for a regular node.
#   port color_node_support: The color for a support node.
#   port color_node_origin: The color for an origin node.
#   port color_load: The color for an applied load.
#   port color_reaction: The color for a reaction force.
#   port color_trail: The color to paint a trail.
#   port color_auxiliary_trail: The color to paint an auxiliary trail.
# ---------- cem_colors: Python ----------
"""
Get the artists color scheme for the objects of the CEM framework.
"""
from ghpythonlib.componentbase import executingcomponent as component

from compas_cem import COLORS
import rhinoscriptsyntax as rs


class ArtistColorsComponent(component):
    def RunScript(self):
        colors = {key: rs.CreateColor(c) for key, c in COLORS.items()}

        color_tension = colors["tension"]
        color_compression = colors["compression"]
        color_edge = colors["edge"]
        color_node = colors["node"]
        color_node_support = colors["node_support"]
        color_node_origin = colors["node_origin"]
        color_load = colors["load"]
        color_reaction = colors["support_force"]
        color_trail = colors["trail"]
        color_auxiliary_trail = colors["auxiliary_trail"]

        colors = (color_tension, color_compression, color_edge, color_node, color_node_support, color_node_origin, color_load, color_reaction, color_trail, color_auxiliary_trail)

        return colors
# ---------- end cem_colors ----------
entwine_4 = Entwine(Branch00=cem_colors.color_node_origin, Branch01=cem_colors.color_node_support, FlattenInputs=True)
merge_3 = Merge(Data1=cem_colors.color_compression, Data2=cem_colors.color_tension)
col = Colour(cem_colors.color_auxiliary_trail)
col_2 = Colour(entwine_4)
col_3 = Colour(cem_colors.color_load)
cem_colors_2 = CEMColors()  # -> color_tension, color_compression, color_edge, color_node, color_node_support, color_node_origin, color_load, color_reaction, color_trail, color_auxiliary_trail; same code as cem_colors
merge_4 = Merge(Data1=cem_colors_2.color_compression, Data2=cem_colors_2.color_tension)
col_4 = Colour(cem_colors_2.color_load)

# ---- group: File metadata
family_name = Panel("Unterspannte")
base_directory = Panel("C:\Users\Mark\Documents\GitHub\ms_cem_datasete\2.0\25_ Unterspannte")
is_3d = BooleanToggle(True)
txt = Text(family_name)
txt_2 = Text(base_directory)
bool = Boolean(is_3d)

# ----
export_form_json = BooleanToggle(False)
export_topology_json = BooleanToggle(False)
bool_2 = Boolean(export_topology_json)
bool_3 = Boolean(export_form_json)

save_topology_pdf = BooleanToggle(False)
save_form_pdf = BooleanToggle(False)
bool_4 = Boolean(save_topology_pdf)
bool_5 = Boolean(save_form_pdf)

# ---- group: Make2D - Camera plane
update_camera_plane = Button()
camera_plane_index = Slider(1, range=0..1)
bool_6 = Boolean(update_camera_plane)
int_2 = Integer(camera_plane_index)

# ----
reaction_scale = Slider(0.1, range=0..4)

# ---- group: PDF Controls
edge_width = Slider(2, range=0..5)
node_radius = Slider(0.05, range=0..0.5)
node_edgeweight = Slider(1.5, range=0..5)
arrow_width = Slider(1.5, range=0..5)
load_gap = Slider(0.07, range=0..2)
reaction_gap = Slider(0.07, range=0..1)
extra_segments_lineweight = Panel("dotted")
extra_segments_line_thickness_form = Panel("0.75")
extra_segments_line_color_form = Panel("120, 120, 120")
load_scale_3 = Slider(3.6, range=0..4)
num_8 = Number(edge_width)
num_9 = Number(node_radius)
num_10 = Number(node_edgeweight)
num_11 = Number(arrow_width)
num_12 = Number(load_scale_3)
num_13 = Number(load_gap)
num_14 = Number(reaction_scale)
txt_3 = Text(extra_segments_lineweight)
num_15 = Number(reaction_gap)
num_16 = Number(extra_segments_line_thickness_form)
txt_4 = Text(extra_segments_line_color_form)

# ---- group: COMPAS-based Make2D
int_3 = Integer(int_2)
bool_7 = Boolean(bool_6)
viewports = ViewportProperties(Update=bool_7, AutoUpdate=False)  # -> ViewportNames, ActiveViewportIndex, ViewportBounds, ViewportDisplayMode, CameraLocation, CameraTarget, CameraPlane, CameraLensLength, CameraProjection, CameraUp
item_5 = ListItem(List=viewports.CameraPlane, Index=int_3, Wrap=True)
panel = Panel(viewports.ViewportNames)
pln = Plane(item_5)
panel_2 = Panel(pln)

# ----
pt_3 = Point([Point(-5, -3.425166865, 1.5), Point(5, -3.425166865, 1.5)])
crv_7 = Curve(mid)
crv_8 = Curve(shatter)
number_slider_6 = Slider(0.1, range=0..0.1)
neg_5 = Negative(Value=Slider(20, range=0..20))
neg_6 = Negative(Value=Slider(0.1, range=0..10))
neg_7 = Negative(Value=Slider(0.1, range=0..0.1))
Z_2 = UnitZ(Factor=neg_7)
lineload = GhPythonScript(line=flatten(crv_8), load_vector=Z_2)  # -> out, point, vector; inputs line: list of Line, load_vector: Vector3d
# ---------- lineload: Python ----------
from compas_rhino.geometry import RhinoLine
from compas_rhino.geometry import RhinoVector

from compas.geometry import add_vectors
from compas.geometry import scale_vector

from compas.utilities import geometric_key

import rhinoscriptsyntax as rs

gkey_xyz = {}
gkey_load = {}

load_vector = RhinoVector.from_geometry(load_vector).to_compas()

for ln in line:
    ln = RhinoLine.from_geometry(ln).to_compas()
    
    # calculate load on line end-points    
    lvec = scale_vector(load_vector, ln.length * 0.5)
    
    for pt in ln:
        gkey = geometric_key(pt)
        gkey_xyz[gkey] = pt
        
        if gkey in gkey_load:
            gkey_load[gkey] = add_vectors(gkey_load[gkey], lvec)
        else:
            gkey_load[gkey] = lvec

point = []
vector = []

for gkey, xyz in gkey_xyz.items():
    point.append(rs.AddPoint(*xyz))
    vector.append(rs.AddPoint(*gkey_load[gkey]))
# ---------- end lineload ----------
deviationedge_3 = DeviationEdge(line=flatten(pline_3), force=neg_6)  # -> deviation_edge; inputs line: Line; same code as deviationedge
deviationedge_4 = DeviationEdge(line=crv_7, force=neg_5)  # -> deviation_edge; inputs line: Line; same code as deviationedge
nodesupport = NodeSupport(point=merge_2)  # -> node_support; inputs point: Point3d
#   port point: The position of the node where to assign a support.
#   port node_support: A COMPAS CEM node support.
# ---------- nodesupport: Python ----------
"""
Create a node support from a rhino point.
"""
from ghpythonlib.componentbase import executingcomponent as component

from compas_cem.supports import NodeSupport


class NodeSupportComponent(component):
    def RunScript(self, point):
        if point:
            return NodeSupport.from_rhino_point(point)
# ---------- end nodesupport ----------
nodeload = NodeLoad(point=lineload.point, vector=lineload.vector)  # -> node_load; inputs point: Point3d, vector: Vector3d
#   port point: The position of the node where to apply the load.
#   port vector: The load vector.
#   port node_load: A COMPAS CEM node load.
# ---------- nodeload: Python ----------
"""
Create a load vector to be applied at a node.
"""
from ghpythonlib.componentbase import executingcomponent as component

from compas_cem.loads import NodeLoad


class NodeLoadComponent(component):
    def RunScript(self, point, vector):
        if point and vector:
            return NodeLoad.from_rhino_point_and_vector(point, vector)
# ---------- end nodeload ----------

move_6 = Move(Geometry=pt_3, Motion=Y_5)  # -> Geometry, Transform
ln_5 = Line(StartPoint=[end_3.End, end_2.Start], EndPoint=move_6.Geometry)
join_3 = JoinCurves(Curves=crv_8, Preserve=False)
neg_8 = Negative(Value=Slider(10, range=0..10))
deviationedge_5 = DeviationEdge(line=ln_5, force=Slider(0.3, range=0..10))  # -> deviation_edge; inputs line: Line; same code as deviationedge

merge_5 = Merge(Data1=deviationedge_2, Data2=deviationedge, Data3=deviationedge_3, Data4=deviationedge_4, Data6=deviationedge_5)  # -> flatten(Result)

# ---- group: Build topology diagram and trails
topologydiagram = TopologyDiagram(trail_edges=flatten([trailedge, trailedge_2]), deviation_edges=merge_5, loads=nodeload, supports=nodesupport)  # -> topology; inputs nodes: list, trail_edges: list, deviation_edges: list, loads: list, supports: list
#   port nodes: A list of COMPAS CEM nodes to add to the diagram.
#   port trail_edges: A list of COMPAS CEM trail edges to add to the diagram.
#   port deviation_edges: A list of COMPAS CEM deviation edges to add to the diagram.
#   port loads: A list of COMPAS CEM loads to add to the diagram.
#   port supports: A list of COMPAS CEM supports to add to the diagram.
#   port topology: A COMPAS CEM topology diagram.
# ---------- topologydiagram: Python ----------
"""
Build a topology diagram.
"""
from ghpythonlib.componentbase import executingcomponent as component

from compas_cem.diagrams import TopologyDiagram


class BuildTopologyDiagramComponent(component):
    def RunScript(self, nodes, trail_edges, deviation_edges, loads, supports):

        topology = TopologyDiagram()

        if nodes:
            for node in nodes:
                topology.add_node(node)

        if trail_edges is not None:
            for trail_edge in trail_edges:
                topology.add_edge(trail_edge)

        if deviation_edges:
            for deviation_edge in deviation_edges:
                topology.add_edge(deviation_edge)

        if loads:
            for load in loads:
                topology.add_load(load)

        if supports:
            for support in supports:
                topology.add_support(support)

        return topology
# ---------- end topologydiagram ----------
Z_3 = UnitZ(Factor=1)

# ----
rev = Reverse(Vector=Z_3)

# ---- group: Build topology diagram and trails (continued)
buildtrails = BuildTrails(topology=topologydiagram, add_auxiliary_trails=Toggle(True), auxiliary_trail_length="0.33", auxiliary_trail_vector=rev)  # -> topology, trails, auxiliary_trails; inputs add_auxiliary_trails: Boolean, auxiliary_trail_vector: Vector3d
#   port topology: A COMPAS CEM topology diagram.
#   port add_auxiliary_trails: Append auxiliary trail edges to the free nodes of the topology diagram. Defaults to False.
#   port auxiliary_trail_length: The length of the auxiliary trail edges to add. Defaults to 1.0.
#   port auxiliary_trail_vector: The direction to which the auxiliary trail edges will initially point to. Defaults to [1.0, 1.0, 1.0].
#   port topology: The input topology diagram. But now with computed trails.
#   port trails: The keys of the nodes in each of the found trails.
#   port auxiliary_trails: The keys of the appended auxiliary trail edges.
# ---------- buildtrails: Python ----------
"""
Automatically find the trails in a topology diagram. The diagram is modified in-place.
"""
from ghpythonlib.componentbase import executingcomponent as component

from compas_rhino.geometry import RhinoVector


class BuildTopologyDiagramComponent(component):
    def RunScript(self, topology, add_auxiliary_trails, auxiliary_trail_length, auxiliary_trail_vector):
        add_auxiliary_trails = add_auxiliary_trails or False

        if topology:

            topology = topology.copy()

            if auxiliary_trail_length:
                topology.auxiliary_trail_length = auxiliary_trail_length
            if auxiliary_trail_vector:
                topology.auxiliary_trail_vector = RhinoVector.from_geometry(auxiliary_trail_vector).to_compas()

            topology.build_trails(add_auxiliary_trails)

            trails = list(topology.trails())
            auxiliary_trails = list(topology.auxiliary_trail_edges())

            return topology, trails, auxiliary_trails
# ---------- end buildtrails ----------

# ---- group: Optimization parameters
topologydisassembly = DisassembleTopologyDiagram(topology=buildtrails.topology)  # -> nodes, origin_nodes, support_nodes, edges, trail_edges, deviation_edges, trails, auxiliary_trails
#   port topology: A COMPAS CEM topology diagram.
#   port nodes: All the node keys in the topology diagram.
#   port origin_nodes: The keys of the origin nodes in the topology diagram.
#   port support_nodes: The keys of the support nodes in the topology diagram.
#   port edges: All the edge keys in the topology diagram.
#   port trail_edges: The keys of the trail edges in the topology diagram.
#   port deviation_edges: The keys of the deviation edges in the topology diagram.
#   port trails: The trails in the topology diagram.
#   port auxiliary_trails: The auxiliary trails in the topology diagram.
# ---------- topologydisassembly: Python ----------
"""
Disassemble a topology diagram into its constituent parts.
"""
from ghpythonlib.componentbase import executingcomponent as component


class TopologyDisassemblyComponent(component):
    def RunScript(self, topology):
        if topology:
            trails = list(topology.trails())
            auxiliary_trails = list(topology.auxiliary_trails())

            edges = list(topology.edges())
            trail_edges = list(topology.trail_edges())
            deviation_edges = list(topology.deviation_edges())

            nodes = list(topology.nodes())
            origin_nodes = list(topology.origin_nodes())
            support_nodes = list(topology.support_nodes())

            return nodes, origin_nodes, support_nodes, edges, trail_edges, deviation_edges, trails, auxiliary_trails
# ---------- end topologydisassembly ----------
deviationedgeforceparameter = DeviationEdgeForceParameter(edge_key=topologydisassembly.deviation_edges, bound_low="3000", bound_up="3000")  # -> parameter
#   port edge_key: The key of a COMPAS CEM deviation edge.
#   port bound_low: The lower bound of the edge optimization parameter. Calculated as the initial edge parameter minus the absolute value of this bound.
#   port bound_up: The upper bound of the edge optimization parameter. Calculated as the initial edge parameter plus the absolute value of this bound.
#   port parameter: A COMPAS CEM deviation edge force parameter.
# ---------- deviationedgeforceparameter: Python ----------
"""
Set the force of a deviation edge as an optimization parameter.
"""
from ghpythonlib.componentbase import executingcomponent as component

from compas_cem.optimization import DeviationEdgeParameter


class DeviationEdgeParameterComponent(component):
    def RunScript(self, edge_key, bound_low, bound_up):
        if edge_key and bound_low is not None and bound_up is not None:
            return DeviationEdgeParameter(edge_key, bound_low, bound_up)
# ---------- end deviationedgeforceparameter ----------

# ---- group: topology
data = Data(buildtrails.topology)

# 02 Visualize Diagrams
data_2 = Data(data)

# ---- group: Inputs / Topology
data_3 = Data(data)

# ---- group: COMPAS-based Make2D
xy = XYPlane(Origin=Point(0, 0, 0))
data_4 = Data(data_3)
pln_2 = Plane(pln)
orient_and_project = GhPythonScript(topology=data_4, initial_plane=pln_2, target_plane=xy)  # -> out, topology_transformed; inputs initial_plane: Plane, target_plane: Plane
# ---------- orient_and_project: Python ----------
from compas_rhino.geometry import RhinoPlane
from compas.geometry import Transformation
from compas.geometry import Projection
from compas.geometry import Frame
from compas.geometry import transform_vectors
from compas.datastructures import network_transformed

# Build frames from rhino planes
frames = []
for plane in (initial_plane, target_plane):
    plane = RhinoPlane.from_geometry(plane)
    frame = Frame(plane.point, plane.xaxis, plane.yaxis)
    frames.append(frame)    
fa, fb = frames

# Re-orient node positions
transf = Transformation.from_frame_to_frame(fa, fb)
topology_transformed = network_transformed(topology, transf)

# Squash node positions to plane
z = fb.point.z
for node in topology_transformed.nodes():
    topology_transformed.node_attribute(node, "z", z)
# ---------- end orient_and_project ----------
data_5 = Data(orient_and_project.topology_transformed)

# ----
num_17 = Number(num_12)
data_6 = Data(data_5)
topologyartist = TopologyArtist(topology=data_6, load_scale=num_17)  # -> nodes, origin_nodes, support_nodes, edges, trail_edges, deviation_edges, loads; inputs node: list of Int32, edge: list
#   port topology: A COMPAS CEM topology diagram.
#   port node: A selection of the nodes in the diagram. Defaults to all the nodes.
#   port edge: A selection of the edges in the diagram. Defaults to all the edges.
#   port load_min: The minimum load magnitude to plot. Defaults to 1e-3.
#   port load_scale: The scaling factor of the loads. Defaults to 1.
#   port nodes: The nodes in the diagram as points.
#   port origin_nodes: The origin nodes in the diagram as points.
#   port support_nodes: The position of the support nodes in the diagram.
#   port edges: The edges in the diagram as lines.
#   port trail_edges: The trail edges in the diagram as lines.
#   port deviation_edges: The deviation edges in the diagram as lines.
#   port loads: The applied node loads as lines.
# ---------- topologyartist: Python ----------
"""
Draw a topology diagram.
"""
from ghpythonlib.componentbase import executingcomponent as component

from compas_cem.ghpython import TopologyArtist


class TopologyArtistComponent(component):
    def RunScript(self, topology, node, edge, load_min, load_scale):
        node = node or None
        edge = edge or None
        load_min = load_min or 1e-3
        load_scale = load_scale or 1.0
        if topology:
            artist = TopologyArtist(topology)

            nodes = artist.draw_nodes(node)
            origin_nodes = artist.draw_nodes_origin(node)
            support_nodes = artist.draw_nodes_support(node)

            edges = artist.draw_edges(edge)
            trail_edges = artist.draw_edges_trail(edge)
            deviation_edges = artist.draw_edges_deviation(edge)

            loads = artist.draw_loads(node, min_load=load_min, scale=load_scale)

            return nodes, origin_nodes, support_nodes, edges, trail_edges, deviation_edges, loads
# ---------- end topologyartist ----------
clean = CleanTree(RemoveNulls=True, RemoveInvalid=True, RemoveEmpty=False, Tree=[topologyartist.edges, topologyartist.loads])
python_2 = GhPythonScript(segment=clean)  # -> out, segment; inputs segment: list
# ---------- python_2: Python ----------
from compas_rhino.utilities import get_line_coordinates


segment = get_line_coordinates(segment)
# ---------- end python_2 ----------
data_7 = Data(python_2.segment)

data_8 = Data(data_7)
txt_5 = Text(txt_4)
txt_6 = Text(txt_3)
num_18 = Number(num_16)
lng_3 = ListLength(List=data_8)
python_3 = GhPythonScript(D=flatten(txt_5), L=flatten(lng_3))  # -> out, color; inputs D: list, L: list of Int32
# ---------- python_3: Python ----------
color = []

for d, l in zip(D, L):
    
    d = [int(n) for n in d.split(", ")]
    c = [d] * l
    color.extend(c)
# ---------- end python_3 ----------
repeat = RepeatData(Data=num_18, Length=lng_3)
repeat_2 = RepeatData(Data=txt_6, Length=lng_3)
data_9 = Data(python_3.color)
txt_7 = Text(repeat_2)
num_19 = Number(repeat)

nodesearch = NodeSearch(diagram=buildtrails.topology, point=pt_3)  # -> node; inputs point: list of Point3d
#   port diagram: A COMPAS CEM topology or form diagram.
#   port point: The points to search for in the diagram.
#   port node: The node keys.
# ---------- nodesearch: Python ----------
"""
Search a node key in a topology or a form diagram using a point.
"""
from ghpythonlib.componentbase import executingcomponent as component

from compas.utilities import geometric_key
from compas_rhino.geometry import RhinoPoint


class NodeSearchComponent(component):
    def RunScript(self, diagram, point):
        if point and diagram:
            node = []
            for pt in point:
                pt = RhinoPoint.from_geometry(pt).to_compas()
                gkey = geometric_key(pt, diagram.tol)
                node.append(diagram.gkey_node[gkey])
            return node
# ---------- end nodesearch ----------
formfinding = FormFinding(topology=buildtrails.topology)  # -> form; inputs tmax: Int32
#   port topology: A COMPAS CEM topology diagram.
#   port tmax: The maximum number of iterations to run the form-finding algorithm for. Defaults to 100.
#   port eps_min: The convergence threshold of the form-finding algorithm. Default to 1e-6.
#   port form: A COMPAS CEM form diagram in static equilibrium.
# ---------- formfinding: Python ----------
"""
Generate a form diagram in static equilibrium.
"""
from ghpythonlib.componentbase import executingcomponent as component

from compas_cem.equilibrium import static_equilibrium


class FormFindingComponent(component):
    def RunScript(self, topology, tmax, eta_min):
        tmax = tmax or 100
        eta_min = eta_min or 1e-6
        if topology:
            return static_equilibrium(topology, tmax=tmax, eta=eta_min)
# ---------- end formfinding ----------

# ---- group: Optimization goal constraints
trailedgeforceconstraint = TrailEdgeForceConstraint(edge_key=buildtrails.auxiliary_trails, force="0.0")  # -> constraint
#   port edge_key: The key of a COMPAS CEM trail edge.
#   port force: The target force.
#   port weight: The weight of the constraint in the optimization problem. Defaults to one.
#   port constraint: A COMPAS CEM trail force constraint.
# ---------- trailedgeforceconstraint: Python ----------
"""
Make the force on a trail edge to reach a goal force value.
"""
from ghpythonlib.componentbase import executingcomponent as component

from compas_cem.optimization import TrailEdgeForceConstraint


class TrailEdgeForceConstraintComponent(component):
    def RunScript(self, edge_key, force, weight):
        weight = weight or 1.0
        if edge_key and force is not None:
            return TrailEdgeForceConstraint(edge_key, force, weight)
# ---------- end trailedgeforceconstraint ----------
topologydisassembly_2 = DisassembleTopologyDiagram(topology=topologydiagram)  # -> nodes, origin_nodes, support_nodes, edges, trail_edges, deviation_edges, trails, auxiliary_trails; same code as topologydisassembly
pointconstraint = PointConstraint(node_key=nodesearch, point=merge_2)  # -> constraint; inputs node_key: Int32, point: Point3d; disabled
#   port node_key: The key of a COMPAS CEM node.
#   port point: The target point.
#   port weight: The weight of the constraint in the optimization problem. Defaults to one.
#   port constraint: A COMPAS CEM node point constraint.
# ---------- pointconstraint: Python ----------
"""
Pull the position of a node to a target point.
"""
from ghpythonlib.componentbase import executingcomponent as component

from compas_cem.optimization import PointConstraint
from compas_rhino.geometry import RhinoPoint


class PointConstraintComponent(component):
    def RunScript(self, node_key, point, weight):
        weight = weight or 1.0
        if node_key is not None and point:
            point = RhinoPoint.from_geometry(point).to_compas()
            return PointConstraint(node_key, point, weight)
# ---------- end pointconstraint ----------
entwine_5 = Entwine(Branch00=pointconstraint, Branch01=trailedgeforceconstraint, FlattenInputs=True)  # -> flatten(Result)

# ----
constrainedformfinding = ConstrainedFormFinding(
    topology=buildtrails.topology,
    constraints=entwine_5,
    parameters=deviationedgeforceparameter,
    iters_max="400",
    eps="1e-6")  # -> form, penalty, iters, time; inputs constraints: list, parameters: list, iters_max: Int32; disabled
#   port topology: A COMPAS CEM topology diagram.
#   port constraints: A list of COMPAS CEM optimization constraints.
#   port parameters: A list of COMPAS CEM optimization parameters.
#   port algorithm: The name of the optimization algorithm to use.
#   port iters_max: The maximum number of iterations to run the optimization algorithm for.
#   port eps: The minimum penalty value to declare convergence.
#   port form: A COMPAS CEM form diagram in static equilibrium.
#   port penalty: The penalty score after optimization.
#   port iters: The elapsed number of iterations.
#   port time: The optimization elapsed time.
# ---------- constrainedformfinding: Python ----------
"""
Generate a form diagram in static equilibrium.
"""
from ghpythonlib.componentbase import executingcomponent as component

from compas_cem import PROXY_PORT

from compas.rpc import Proxy


class ConstrainedFormFindingComponent(component):
    def RunScript(self, topology, constraints, parameters, algorithm, iters_max, eps):
        algorithm = algorithm or "LD_SLSQP"
        iters_max = iters_max or 100
        eps = eps or 1e-6

        if topology and constraints and parameters:
            topology = topology.copy()

            with Proxy("compas_cem.optimization", port=PROXY_PORT) as opt:
                form, penalty, iters, time = opt.solve_nlopt_proxy(topology,
                                                                   constraints,
                                                                   parameters,
                                                                   algorithm,
                                                                   iters_max,
                                                                   eps)
            return form, penalty, iters, time
# ---------- end constrainedformfinding ----------
panel_3 = Panel(constrainedformfinding.penalty)
panel_4 = Panel(constrainedformfinding.iters)

# ---- group: constrained form
data_10 = Data(constrainedformfinding.form)

# ---- group: form
data_11 = Data(formfinding)

data_12 = Data(data_11)

# ---- group: constrained form
data_13 = Data(data_10)

# ----
filter = StreamFilter(Gate=view_constrained_form, Stream0=data_12, Stream1=data_13)
data_14 = Data(filter)

# ---- group: Inputs / Constrained Form
data_15 = Data(data_14)

# ----
data_16 = Data(data_3)
bool_8 = Boolean(bool)
txt_8 = Text(txt)
txt_9 = Text(txt_2)
data_17 = Data(data_15)
bool_9 = Boolean(bool)
txt_10 = Text(txt)
txt_11 = Text(txt_2)
nameschema = GhPythonScript(topology=data_16, is_3d=bool_8, family_name=txt_8, base_dir=txt_9)  # -> out, filepath; inputs is_3d: Boolean
# ---------- nameschema: Python ----------
"""familyname_diagram_2dor3d_numnodes_numsupports_numloads_numedges_numtrailedges_numdeviationedges_numauxtrails"""


import os

from compas_cem.diagrams import TopologyDiagram
from compas_cem.diagrams import FormDiagram


diagram = topology
# find out diagram type
cls = diagram.__class__.__name__
if cls == "TopologyDiagram":
    diagram_name = "T"

# check dimensionality
if is_3d:
    dim = "3d"
else:
    dim = "2d"
    
# get data from diagram
numnodes = str(len(list(diagram.nodes())))    
numsupports = str(len(list(diagram.support_nodes())))
numloads = str(len(list(diagram.loaded_nodes())))

numedges = str(len(list(diagram.edges())))
numtrailedges = str(len(list(diagram.trail_edges())))
numdeviationedges = str(len(list(diagram.deviation_edges())))
numauxtrails = str(len(list(diagram.auxiliary_trails()))) 
    
schema = (family_name, diagram_name, dim, numnodes, numsupports, numloads, numedges, numtrailedges, numdeviationedges, numauxtrails)
schema = "_".join(schema)
base_dir = os.path.abspath(base_dir)
filepath = os.path.abspath(os.path.join(base_dir, family_name, dim, schema))
# ---------- end nameschema ----------
nameschema_2 = GhPythonScript(form=data_17, is_3d=bool_9, family_name=txt_10, base_dir=txt_11)  # -> out, filepath; inputs is_3d: Boolean
# ---------- nameschema_2: Python ----------
"""familyname_diagram_2dor3d_numnodes_numsupports_numloads_numedges_numtrailedges_numdeviationedges_numauxtrails"""


import os

from compas_cem.diagrams import TopologyDiagram
from compas_cem.diagrams import FormDiagram


diagram = form
# find out diagram type
cls = diagram.__class__.__name__
if cls == "FormDiagram":
    diagram_name = "F"

# check dimensionality
if is_3d:
    dim = "3d"
else:
    dim = "2d"
    
# get data from diagram
numnodes = str(len(list(diagram.nodes())))    
numsupports = str(len(list(diagram.support_nodes())))
numloads = str(len(list(diagram.loaded_nodes())))
numedges = str(len(list(diagram.edges())))
    
schema = (family_name, diagram_name, dim, numnodes, numsupports, numloads, numedges)
schema = "_".join(schema)
base_dir = os.path.abspath(base_dir)
filepath = os.path.abspath(os.path.join(base_dir, family_name, dim, schema))
# ---------- end nameschema_2 ----------
txt_12 = Text(nameschema.filepath)
txt_13 = Text(nameschema_2.filepath)

# ---- group: COMPAS-based Make2D
xy_2 = XYPlane(Origin=Point(0, 0, 0))
data_18 = Data(data_15)
pln_3 = Plane(pln)
orient_and_project_2 = GhPythonScript(form=data_18, initial_plane=pln_3, target_plane=xy_2)  # -> out, form_transformed; inputs initial_plane: Plane, target_plane: Plane
# ---------- orient_and_project_2: Python ----------
from compas_rhino.geometry import RhinoPlane
from compas.geometry import Transformation
from compas.geometry import Projection
from compas.geometry import Frame
from compas.geometry import transform_vectors
from compas.datastructures import network_transformed

# Build frames from rhino planes
frames = []
for plane in (initial_plane, target_plane):
    plane = RhinoPlane.from_geometry(plane)
    frame = Frame(plane.point, plane.xaxis, plane.yaxis)
    frames.append(frame)    
fa, fb = frames

# Re-orient node positions
transf = Transformation.from_frame_to_frame(fa, fb)
form_transformed = network_transformed(form, transf)

# Squash node positions to plane
z = fb.point.z
for node in form_transformed.nodes():
    form_transformed.node_attribute(node, "z", z)
    

# Re-orient and squash loads
for node in form_transformed.nodes():
    # loads
    load = form_transformed.node_load(node)
    loadt = transform_vectors([load], transf).pop()
    form_transformed.node_attributes(node, ("qx", "qy", "qz"), loadt)
    
    # reaction force
    reaction = form_transformed.reaction_force(node)
    reactiont = transform_vectors([reaction], transf).pop()
    form_transformed.node_attributes(node, ("rx", "ry", "rz"), reactiont)
# ---------- end orient_and_project_2 ----------
data_19 = Data(orient_and_project_2.form_transformed)
data_20 = Data(data_19)
python_4 = GhPythonScript(form=data_20, reaction_min="0.001")  # -> out, form
# ---------- python_4: Python ----------
from compas.geometry import length_vector


nodes = list(form.nodes())


for node in nodes:
    if form.is_node_support(node) and length_vector(form.reaction_force(node)) <= reaction_min:
        form.delete_node(node)
# ---------- end python_4 ----------
data_21 = Data(python_4.form)

# ----
txt_14 = Text(txt_13)
num_20 = Number(flatten(num_19))
txt_15 = Text(flatten(txt_7))
bool_10 = Boolean(bool_4)
num_21 = Number(num_8)
num_22 = Number(num_9)
data_22 = Data(data_5)
num_23 = Number(num_10)
num_24 = Number(num_10)
txt_16 = Text(txt_12)
bool_11 = Boolean(bool_5)
data_23 = Data(data_21)
num_25 = Number(num_10)
num_26 = Number(num_12)
num_27 = Number(num_8)
num_28 = Number(num_9)
num_29 = Number(num_11)
num_30 = Number(num_13)
num_31 = Number(num_14)
num_32 = Number(num_15)
data_24 = Data(data_7)
data_25 = Data(data_9)
concat = Concatenate(FragmentA=txt_14, FragmentB=".pdf")
division_5 = Division(A=num_24, B=2)
concat_2 = Concatenate(FragmentA=txt_16, FragmentB=".pdf")
python_5 = GhPythonScript(
    save_file=bool_10,
    topology=data_22,
    edge_width=num_21,
    node_radius=num_22,
    node_edgewidth=num_23,
    load_width=division_5,
    load_radius=num_22,
    fig_width="16",
    fig_height="9",
    fig_dpi="100",
    filepath=concat_2)  # -> out; inputs save_file: Boolean, fig_width: Int32, fig_height: Int32, fig_dpi: Int32
# ---------- python_5: Python ----------
from compas.rpc import Proxy


kwargs = {"topology": topology,
          "filepath": filepath,
          "edge_width": edge_width,
          "node_radius": node_radius,
          "node_edgewidth": node_edgewidth,
          "load_width": load_width,
          "load_radius": load_radius,
          "fig_width": fig_width,
          "fig_height": fig_height,
          "fig_dpi": fig_dpi}


if save_file:
    with Proxy("compas_cem.plotters") as plotters:
        data = plotters.topology_plotter_proxy(**kwargs)
        
    print("Done!")
    print(data)
# ---------- end python_5 ----------
python_6 = GhPythonScript(
    save_file=bool_11,
    form=data_23,
    edge_width=num_27,
    node_radius=num_28,
    node_edgewidth=num_25,
    load_width=num_29,
    load_scale=num_26,
    load_gap=num_30,
    reaction_width=num_29,
    reaction_scale=num_31,
    reaction_gap=num_32,
    segment=data_24,
    segment_color=data_25,
    segment_width=num_20,
    segment_ls=txt_15,
    fig_width="16",
    fig_height="9",
    fig_dpi="100",
    filepath=concat)  # -> out; inputs save_file: Boolean, segment: list, segment_color: list, segment_width: list, segment_ls: list, fig_width: Int32, fig_height: Int32, fig_dpi: Int32
# ---------- python_6: Python ----------
from compas.rpc import Proxy


kwargs = {"form": form,
          "filepath": filepath,
          "edge_width": edge_width,
          "node_radius": node_radius,
          "node_edgewidth": node_edgewidth,
          "load_width": load_width,
          "load_scale": load_scale,
          "load_gap": load_gap,
          "reaction_width": reaction_width,
          "reaction_scale": reaction_scale,
          "reaction_gap": reaction_gap,
          "segment": segment,
          "segment_color": segment_color,
          "segment_width": segment_width,
          "segment_ls": segment_ls,
          "fig_width": fig_width,
          "fig_height": fig_height,
          "fig_dpi": fig_dpi}


if save_file:
    with Proxy("compas_cem.plotters") as plotters:
        plotters.form_plotter_proxy(**kwargs)
        
    print("Done!")
# ---------- end python_6 ----------
panel_5 = Panel(python_5)
panel_6 = Panel(python_6)

txt_17 = Text(txt_12)
txt_18 = Text(txt_13)
bool_12 = Boolean(bool_2)
data_26 = Data(data_3)
bool_13 = Boolean(bool_3)
data_27 = Data(data_15)
exportjson = GhPythonScript(export=bool_12, diagram=data_26, filepath=txt_17)  # -> out
# ---------- exportjson: Python ----------
if export:
    diagram.to_json(filepath + ".json")
    
    print("Exported file to {}!".format(filepath + ".json"))
# ---------- end exportjson ----------
exportjson_2 = GhPythonScript(export=bool_13, diagram=data_27, filepath=txt_18)  # -> out; same code as exportjson
panel_7 = Panel(exportjson_2)
panel_8 = Panel(exportjson)

num_33 = Number(num_3)
num_34 = Number(num)
num_35 = Number(num_2)
int_4 = Integer(int)
data_28 = Data(data_14)
col_5 = Colour(col_4)
swatch = ColourSwatch(SwatchColor=RGBA(156, 156, 156, 195))

num_36 = Number(num_34)
int_5 = Integer(int_4)
data_29 = Data(data_28)
num_37 = Number(num_33)
num_38 = Number(num_35)
formartist = FormArtist(form=data_29, force_min=num_37, force_scale=num_38)  # -> nodes, support_nodes, edges, loads, reactions; inputs node: list of Int32, edge: list
#   port form: A COMPAS CEM topology diagram.
#   port node: A selection of the nodes in the diagram. Defaults to all the nodes.
#   port edge: A selection of the edges in the diagram. Defaults to all the edges.
#   port force_min: The smallest force magnitude to draw. Defaults to 1e-3
#   port force_scale: The scale of the loads and the reactions. Defaults to 1.
#   port nodes: The nodes of the diagram as points.
#   port support_nodes: The support nodes of the diagram as points
#   port edges: The edges of the diagram as lines.
#   port loads: The applied loads as lines.
#   port reactions: The reaction forces at the supports, as lines.
# ---------- formartist: Python ----------
"""
Draw a form diagram.
"""
from ghpythonlib.componentbase import executingcomponent as component

from compas_cem.ghpython import FormArtist


class FormArtistComponent(component):
    def RunScript(self, form, node, edge, force_min, force_scale):
        force_min = force_min or 1e-3
        force_scale = force_scale or 1
        if form:
            artist = FormArtist(form)

            nodes = artist.draw_nodes(node)
            edges = artist.draw_edges(edge)
            support_nodes = artist.draw_nodes_support(node)

            loads = artist.draw_loads(node, min_load=force_min, scale=force_scale)
            reactions = artist.draw_reactions(node, min_force=force_min, scale=force_scale)

            return nodes, support_nodes, edges, loads, reactions
# ---------- end formartist ----------
edgeresults = EdgeResults(form=data_29)  # -> length, force; inputs edge: list
#   port form: A COMPAS CEM form diagram.
#   port edge: A selection of edge keys to query the results on. Defaults to all the edges.
#   port length: The edge lengths.
#   port force: The edge forces.
# ---------- edgeresults: Python ----------
"""
Extract the post form-finding results of the edges in a form diagram.
"""
from ghpythonlib.componentbase import executingcomponent as component


class EdgeResultsComponent(component):
    def RunScript(self, form, edge):
        if form:
            edge = edge or list(form.edges())
            length = [form.edge_length_2(ed) for ed in edge]
            force = [form.edge_force(ed) for ed in edge]
            return length, force
# ---------- end edgeresults ----------
formdisassembly = DisassembleFormDiagram(form=data_29)  # -> nodes, support_nodes, edges
#   port form: A COMPAS CEM form diagram.
#   port nodes: All the node keys in the form diagram.
#   port support_nodes: The keys of the support nodes in the form diagram.
#   port edges: All the edge keys in the form diagram.
# ---------- formdisassembly: Python ----------
"""
Disassemble a form diagram into its constituent parts.
"""
from ghpythonlib.componentbase import executingcomponent as component


class FormDisassemblyComponent(component):
    def RunScript(self, form):
        if form:
            edges = list(form.edges())
            nodes = list(form.nodes())
            support_nodes = list(form.support_nodes())

            return nodes, support_nodes, edges
# ---------- end formdisassembly ----------
larger = LargerThan(FirstNumber=edgeresults.force, SecondNumber=0)  # -> LargerThan, OrEqualTo
abs = Absolute(Value=edgeresults.force)
filter_2 = StreamFilter(Gate=int_5, Stream0=edgeresults.force, Stream1=edgeresults.length)
item_6 = ListItem(List=merge_4, Index=larger.OrEqualTo, Wrap=True)
multiplication = Multiplication(A=abs, B=num_36)
python_7 = GhPythonScript(x=filter_2)  # -> out, a
# ---------- python_7: Python ----------
a = round(x, 3)
# ---------- end python_7 ----------
int_6 = Integer(formdisassembly.nodes)
data_30 = Data(formdisassembly.edges)
pt_4 = Point(formartist.nodes)
crv_9 = Curve(formartist.edges)
crv_10 = Curve(formartist.loads)
crv_11 = Curve(formartist.loads)
crv_12 = Curve(formartist.reactions)
col_6 = Colour(item_6)
num_39 = Number(multiplication)
num_40 = Number(python_7.a)

pt_5 = Point(pt_4)
int_7 = Integer(int_6)
data_31 = Data(data_30)
crv_13 = Curve(crv_9)
crv_14 = Curve(crv_10)
crv_15 = Curve(crv_11)
crv_16 = Curve(crv_12)
col_7 = Colour(col_6)
num_41 = Number(num_39)
num_42 = Number(num_40)
data_32 = Data(data_31)
pt_6 = Point(pt_5)
int_8 = Integer(int_7)
crv_17 = Curve(crv_13)
midpt = CurveMiddle(Curve=crv_17)

crv_18 = Curve(crv_13)
col_8 = Colour(col_7)
num_43 = Number(num_41)

crv_19 = Curve(crv_15)
crv_20 = Curve(crv_16)
col_9 = Colour(col_5)
end_8 = EndPoints(Curve=crv_19)  # -> Start, End
end_9 = EndPoints(Curve=crv_20)  # -> Start, End
vec2pt = Vector2Pt(PointA=end_9.Start, PointB=end_9.End, Unitize=False)  # -> Vector, Length
vec2pt_2 = Vector2Pt(PointA=end_8.Start, PointB=end_8.End, Unitize=False)  # -> Vector, Length

num_44 = Number(num_42)
crv_21 = Curve(crv_13)
midpt_2 = CurveMiddle(Curve=crv_21)

# ---- group: Edges
previewlw = CustomPreviewLineweights(Geometry=crv_18, Shader=col_8, Thickness=num_43, Absolute=False)

# ---- group: Reaction forces
vdisex = VectorDisplayEx(Point=end_9.Start, Vector=vec2pt.Vector, Colour=col_9, Width=2)

# ---- group: Node keys
tag = TextTag(Location=pt_6, Text=int_8, Colour=swatch)

# ---- group: Edge keys
tag_2 = TextTag(Location=midpt, Text=data_32, Colour=swatch)

# ---- group: Edge results
tag_3 = TextTag(Location=midpt_2, Text=num_44, Colour=ColourSwatch(SwatchColor=RGB(191, 4, 4)))

# ---- group: Loads
vdisex_2 = VectorDisplayEx(Point=end_8.Start, Vector=vec2pt_2.Vector, Colour=col_9, Width=2)

# ----
num_45 = Number(num_4)
data_33 = Data(data)
num_46 = Number(num_5)
num_47 = Number(num_7)
col_10 = Colour(col_3)
col_11 = Colour(col)
col_12 = Colour(col_2)

num_48 = Number(num_47)
num_49 = Number(num_46)
num_50 = Number(num_45)
data_34 = Data(data_33)
topologyartist_2 = TopologyArtist(topology=data_34)  # -> nodes, origin_nodes, support_nodes, edges, trail_edges, deviation_edges, loads; inputs node: list of Int32, edge: list; same code as topologyartist
topologydisassembly_3 = DisassembleTopologyDiagram(topology=data_34)  # -> nodes, origin_nodes, support_nodes, edges, trail_edges, deviation_edges, trails, auxiliary_trails; same code as topologydisassembly
python_8 = GhPythonScript(topology=data_34, auxiliary_trail=topologydisassembly_3.auxiliary_trails)  # -> out, auxiliary_trail; inputs auxiliary_trail: list
# ---------- python_8: Python ----------
from compas_cem.ghpython import TopologyArtist


if auxiliary_trail is not None:
    artist = TopologyArtist(topology)
   
    if auxiliary_trail is not None:
        auxiliary_trail = artist.draw_edges_trail(auxiliary_trail)
# ---------- end python_8 ----------
python_9 = GhPythonScript(trail=topologydisassembly_3.trail_edges, auxiliary_trail=topologydisassembly_3.auxiliary_trails)  # -> out, trail; inputs trail: list, auxiliary_trail: list
# ---------- python_9: Python ----------
trail = [tr for tr in trail if tr not in auxiliary_trail]
# ---------- end python_9 ----------
topologyartist_3 = TopologyArtist(topology=data_34, edge=python_9.trail, load_min=num_49, load_scale=num_50)  # -> nodes, origin_nodes, support_nodes, edges, trail_edges, deviation_edges, loads; inputs node: list of Int32, edge: list
#   port topology: A COMPAS CEM topology diagram.
#   port node: A selection of the nodes in the diagram. Defaults to all the nodes.
#   port edge: A selection of the edges in the diagram. Defaults to all the edges.
#   port load_min: The minimum load magnitude to plot. Defaults to 1e-3.
#   port load_scale: The scaling factor of the loads. Defaults to 1.
#   port nodes: The nodes in the diagram as points.
#   port origin_nodes: The origin nodes in the diagram as points.
#   port support_nodes: The position of the support nodes in the diagram.
#   port edges: The edges in the diagram as lines.
#   port trail_edges: The trail edges in the diagram as lines.
#   port deviation_edges: The deviation edges in the diagram as lines.
#   port loads: The applied node loads as lines.
# ---------- topologyartist_3: Python ----------
"""
Draw a topology diagram.
"""
from ghpythonlib.componentbase import executingcomponent as component

from compas_cem.ghpython import TopologyArtist


class TopologyArtistComponent(component):
    def RunScript(self, topology, node, edge, load_min, load_scale):
        node = node or None
        edge = edge or None
        load_min = load_min or 1e-3
        load_scale = load_scale or 1.0
        if topology:
            artist = TopologyArtist(topology)

            nodes = artist.draw_nodes(node)
            origin_nodes = artist.draw_nodes_origin(node)
            support_nodes = artist.draw_nodes_support(node)

            edges = artist.draw_edges(edge)
            trail_edges = artist.draw_edges_trail(node)
            deviation_edges = artist.draw_edges_deviation(node)

            loads = artist.draw_loads(node, min_load=load_min, scale=load_scale)

            return nodes, origin_nodes, support_nodes, edges, trail_edges, deviation_edges, loads
# ---------- end topologyartist_3 ----------
entwine_6 = Entwine(Branch00=topologyartist_3.origin_nodes, Branch01=topologyartist_3.support_nodes, FlattenInputs=True)
edgeresults_2 = EdgeResults(form=data_34, edge=python_9.trail)  # -> length, force; inputs edge: list; same code as edgeresults
edgeresults_3 = EdgeResults(form=data_34, edge=topologydisassembly_3.deviation_edges)  # -> length, force; inputs edge: list; same code as edgeresults
larger_2 = LargerThan(FirstNumber=edgeresults_3.force, SecondNumber=0)  # -> LargerThan, OrEqualTo
larger_3 = LargerThan(FirstNumber=edgeresults_2.length, SecondNumber=0)  # -> LargerThan, OrEqualTo
sph = Sphere(Base=entwine_6, Radius=num_48)
item_7 = ListItem(List=merge_3, Index=larger_2.OrEqualTo, Wrap=True)
item_8 = ListItem(List=merge_3, Index=larger_3.OrEqualTo, Wrap=True)
graft = GraftTree(Tree=item_7, IncludeEmptyLists=True, IncludeNullItems=True)
int_9 = Integer(topologydisassembly_3.nodes)
pt_7 = Point(topologyartist_2.nodes)
num_51 = Number(edgeresults_2.length)
num_52 = Number(edgeresults_3.force)
col_13 = Colour(graft)
data_35 = Data(topologydisassembly_3.edges)
crv_22 = Curve(topologyartist_2.edges)

# ---- group: trail edges w/o aux
crv_23 = Curve(topologyartist_3.edges)

# ---- group: aux trails
crv_24 = Curve(python_8.auxiliary_trail)

# ---- group: deviation edges
crv_25 = Curve(topologyartist_3.deviation_edges)

# ----
crv_26 = Curve(topologyartist_3.loads)
brep = Brep(sph)
col_14 = Colour(item_8)

data_36 = Data(data_35)
int_10 = Integer(int_9)
pt_8 = Point(pt_7)
crv_27 = Curve(crv_23)
crv_28 = Curve(crv_24)
crv_29 = Curve(crv_25)
crv_30 = Curve(crv_26)
brep_2 = Brep(brep)
num_53 = Number(num_51)
num_54 = Number(num_52)
col_15 = Colour(col_14)
col_16 = Colour(col_13)
crv_31 = Curve(crv_22)

data_37 = Data(data_36)
pt_9 = Point(pt_8)
crv_32 = Curve(crv_31)
int_11 = Integer(int_10)
swatch_2 = ColourSwatch(SwatchColor=RGBA(156, 156, 156, 195))
midpt_3 = CurveMiddle(Curve=crv_32)

crv_33 = Curve(crv_27)
num_55 = Number(num_53)
crv_34 = Curve(crv_29)
num_56 = Number(num_54)
swatch_3 = ColourSwatch(SwatchColor=RGB(184, 184, 184))
midpt_4 = CurveMiddle(Curve=crv_33)
midpt_5 = CurveMiddle(Curve=crv_34)

crv_35 = Curve(crv_28)
crv_36 = Curve(crv_27)
col_17 = Colour(col_15)
col_18 = Colour(col_11)
crv_37 = Curve(crv_29)
num_57 = Number(num_6)
col_19 = Colour(col_16)
dash = DashPattern(Curve=crv_37, Pattern=num_57)  # -> Dashes, Gaps

crv_38 = Curve(crv_30)
col_20 = Colour(col_10)
end_10 = EndPoints(Curve=crv_38)  # -> Start, End
vec2pt_3 = Vector2Pt(PointA=end_10.Start, PointB=end_10.End, Unitize=False)  # -> Vector, Length

brep_3 = Brep(brep_2)
col_21 = Colour(col_12)

# ---- group: Trail edges
preview = CustomPreview(Geometry=crv_36, Material=col_17)

# ---- group: Nodes
preview_2 = CustomPreview(Geometry=brep_3, Material=col_21)

# ---- group: Loads
vdisex_3 = VectorDisplayEx(Point=end_10.Start, Vector=vec2pt_3.Vector, Colour=col_20, Width=2)

# ---- group: Edge keys
tag_4 = TextTag(Location=midpt_3, Text=data_37, Colour=swatch_2)

# ---- group: Node keys
# 03 Export Data
tag_5 = TextTag(Location=pt_9, Text=int_11, Colour=swatch_2)

# ---- group: Deviation edges
preview_3 = CustomPreview(Geometry=crv_35, Material=col_18)

# ---- group: Auxiliary trails
preview_4 = CustomPreview(Geometry=dash.Dashes, Material=col_19)

# ---- group: Deviation forces
tag_6 = TextTag(Location=midpt_5, Text=num_56, Colour=swatch_3)

# ---- group: Trail lengths
tag_7 = TextTag(Location=midpt_4, Text=num_55, Colour=swatch_3)
