# Grasshopper definition Stabbogen_3d.ghx (Grasshopper 1.0.7)
# plug-ins: Human, treesloth01, Wombat

top_chord = Curve([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])
number_slider = Slider(3, range=0..10)
# 01 CEM framework model
button = Button()
Y = UnitY(Factor=1)
move = Move(Geometry=top_chord, Motion=Y)  # -> Geometry, Transform
python = GhPythonScript(unload=button)  # -> out; inputs unload: Boolean
# ---------- python: Python ----------
from compas_ghpython.utilities import unload_modules


if unload:
    unloaded = unload_modules("compas")
    print("Unloaded: {}".format(unloaded))
# ---------- end python ----------
join = JoinCurves(Curves=move.Geometry, Preserve=False)
divide = DivideCurve(Curve=join, Count=13, Kinks=False)  # -> Points, Tangents, Parameters
odd_number = Slider(21, range=0..100)
subtraction = Subtraction(A=odd_number, B=10)
divide_2 = DivideCurve(Curve=join, Count=odd_number, Kinks=False)  # -> Points, Tangents, Parameters
number_slider_2 = Slider(3, range=0..10)

# ---- group: Reload compas_cem
# 01 CEM framework model
button_2 = Button()
python_2 = GhPythonScript(unload=button_2)  # -> out; inputs unload: Boolean; same code as python

# ----
item = ListItem(List=reverse(divide.Points), Index=number_slider, Wrap=True)
item_2 = ListItem(List=divide.Points, Index=number_slider, Wrap=True)
neg = Negative(Value=Slider(0.67, range=0..1))
top_chord_2 = Curve([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])
cp = ClosestPoint(Point=item_2, Cloud=divide_2.Points)  # -> ClosestPoint, CPIndex, Distance
cp_2 = ClosestPoint(Point=item, Cloud=divide_2.Points)  # -> ClosestPoint, CPIndex, Distance
Z = UnitZ(Factor=neg)
move_2 = Move(Geometry=cp.ClosestPoint, Motion=Z)  # -> Geometry, Transform
move_3 = Move(Geometry=cp_2.ClosestPoint, Motion=Z)  # -> Geometry, Transform
join_2 = JoinCurves(Curves=top_chord_2, Preserve=False)
subtraction_2 = Subtraction(A=odd_number, B=10)
number_slider_3 = Slider(4.3, range=0..10)
ln = Line(StartPoint=move_2.Geometry, EndPoint=move_3.Geometry)
len = Length(Curve=ln)
divide_3 = DivideCurve(Curve=join_2, Count=odd_number, Kinks=False)  # -> Points, Tangents, Parameters
divide_4 = DivideCurve(Curve=join_2, Count=13, Kinks=False)  # -> Points, Tangents, Parameters
Z_2 = UnitZ(Factor=1)
addition = Addition(A=len, B=Slider(0.15, range=0..10))
line = LineSDL(Start=divide_2.Points, Direction=Vector(0, 0, 1), Length=1)
item_3 = ListItem(List=reverse(divide_4.Points), Index=number_slider_2, Wrap=True)
item_4 = ListItem(List=divide_4.Points, Index=number_slider_2, Wrap=True)
neg_2 = Negative(Value=Slider(0.67, range=0..1))
cat = Catenary(PointA=move_2.Geometry, PointB=move_3.Geometry, Length=addition, Gravity=Z_2)
cp_3 = ClosestPoint(Point=item_4, Cloud=divide_3.Points)  # -> ClosestPoint, CPIndex, Distance
merge = Merge(Data1=graft(divide_3.Points), Data2=graft(divide_2.Points))
cp_4 = ClosestPoint(Point=item_3, Cloud=divide_3.Points)  # -> ClosestPoint, CPIndex, Distance
Z_3 = UnitZ(Factor=neg_2)
clx = CurveLine(Curve=cat, Line=line)  # -> Points, Params, Count
dist = Distance(PointA=graft(divide_2.Points), PointB=clx.Points)
move_4 = Move(Geometry=cp_3.ClosestPoint, Motion=Z_3)  # -> Geometry, Transform
move_5 = Move(Geometry=cp_4.ClosestPoint, Motion=Z_3)  # -> Geometry, Transform
pline = PolyLine(Vertices=flatten(clx.Points), Closed=False)
smaller = SmallerThan(FirstNumber=dist, SecondNumber=Slider(0.098, range=0..1))  # -> SmallerThan, OrEqualTo
number_slider_4 = Slider(4.3, range=0..10)
ln_2 = Line(StartPoint=move_4.Geometry, EndPoint=move_5.Geometry)
explode = Explode(Curve=pline, Recursive=True)  # -> Segments, Vertices
pdecon = Deconstruct(Point=explode.Vertices)  # -> XComponent, YComponent, ZComponent
pline_2 = PolyLine(Vertices=merge, Closed=False)
dispatch = Dispatch(List=clx.Points, DispatchPattern=smaller.SmallerThan)  # -> ListA, ListB
len_2 = Length(Curve=ln_2)
dispatch_2 = Dispatch(List=graft(divide_2.Points), DispatchPattern=smaller.SmallerThan)  # -> ListA, ListB
sort = SortList(Keys=pdecon.ZComponent, ValuesA=explode.Vertices)  # -> Keys, reverse(ValuesA)
Z_4 = UnitZ(Factor=1)
addition_2 = Addition(A=len_2, B=Slider(0.15, range=0..10))
explode_2 = Explode(Curve=graft(pline), Recursive=True)  # -> Segments, Vertices
merge_2 = Merge(Data1=dispatch.ListA, Data2=dispatch.ListB)
line_2 = LineSDL(Start=divide_3.Points, Direction=Vector(0, 0, 1), Length=1)
item_5 = ListItem(List=sort.ValuesA, Index=0, Wrap=True)  # -> Item, Item1
mp = Midpoint(Curve=explode_2.Segments)
pline_3 = PolyLine(Vertices=flatten(divide_2.Points), Closed=False)
pdecon_2 = Deconstruct(Point=mp)  # -> XComponent, YComponent, ZComponent
cat_2 = Catenary(PointA=move_4.Geometry, PointB=move_5.Geometry, Length=addition_2, Gravity=Z_4)
crv_cp = CurveClosestPoint(Point=flatten([item_5.Item, item_5.Item1]), Curve=pline)  # -> Point, Parameter, Distance
crv_cp_2 = CurveClosestPoint(Point=flatten([item_5.Item1, item_5.Item]), Curve=pline_3)  # -> Point, Parameter, Distance
sort_2 = SortList(Keys=pdecon_2.ZComponent, ValuesA=explode_2.Segments)  # -> Keys, ValuesA
clx_2 = CurveLine(Curve=cat_2, Line=line_2)  # -> Points, Params, Count
dist_2 = Distance(PointA=graft(divide_3.Points), PointB=clx_2.Points)
line_3 = LineSDL(Start=crv_cp_2.Point, Direction=Vector(0, 0, 1), Length=1)
shatter = Shatter(Curve=pline_3, Parameters=crv_cp_2.Parameter)
pline_4 = PolyLine(Vertices=flatten(clx_2.Points), Closed=False)
item_6 = ListItem(List=reverse(sort_2.ValuesA), Index=0, Wrap=True)
clx_3 = CurveLine(Curve=pline, Line=line_3)  # -> Points, Params, Count
shatter_2 = Shatter(Curve=pline, Parameters=flatten(clx_3.Params))
first_last = FirstLast(List=shatter_2)  # -> FirstValue, LastValue
end = EndPoints(Curve=first_last.LastValue)  # -> Start, End
end_2 = EndPoints(Curve=first_last.FirstValue)  # -> Start, End
yz = YZPlane(Origin=end.End)
yz_2 = YZPlane(Origin=end_2.Start)
mirror = Mirror(Geometry=first_last.FirstValue, Plane=yz_2)  # -> Geometry, Transform
mirror_2 = Mirror(Geometry=first_last.LastValue, Plane=yz)  # -> Geometry, Transform
smaller_2 = SmallerThan(FirstNumber=dist_2, SecondNumber=Slider(0.098, range=0..1))  # -> SmallerThan, OrEqualTo
explode_3 = Explode(Curve=pline_4, Recursive=True)  # -> Segments, Vertices
pdecon_3 = Deconstruct(Point=explode_3.Vertices)  # -> XComponent, YComponent, ZComponent
join_3 = JoinCurves(Curves=flatten([pline, mirror_2.Geometry, mirror.Geometry]), Preserve=False)
cull_i = CullIndex(List=reverse(sort_2.ValuesA), Indices="0", Wrap=True)
first_last_2 = FirstLast(List=shatter)  # -> FirstValue, LastValue
dispatch_3 = Dispatch(List=clx_2.Points, DispatchPattern=smaller_2.SmallerThan)  # -> ListA, ListB
dispatch_4 = Dispatch(List=graft(divide_3.Points), DispatchPattern=smaller_2.SmallerThan)  # -> ListA, ListB
sort_3 = SortList(Keys=pdecon_3.ZComponent, ValuesA=explode_3.Vertices)  # -> Keys, reverse(ValuesA)
merge_3 = Merge(Data1=first_last.FirstValue, Data2=first_last.LastValue)
relay = Relay([mirror.Geometry, mirror_2.Geometry])
crv = Curve(relay)
explode_4 = Explode(Curve=graft(pline_4), Recursive=True)  # -> Segments, Vertices
line_4 = LineSDL(Start=explode_2.Vertices, Direction=Vector(0, 0, 1), Length=1)
explode_5 = Explode(Curve=crv, Recursive=True)  # -> flatten(Segments), flatten(Vertices)
merge_4 = Merge(Data1=dispatch_3.ListA, Data2=dispatch_3.ListB)
item_7 = ListItem(List=sort_3.ValuesA, Index=0, Wrap=True)  # -> Item, Item1
mp_2 = Midpoint(Curve=explode_4.Segments)
pline_5 = PolyLine(Vertices=flatten(divide_3.Points), Closed=False)
clx_4 = CurveLine(Curve=pline_3, Line=line_4)  # -> Points, Params, Count
panel = Panel("""0
1""")
pdecon_4 = Deconstruct(Point=mp_2)  # -> XComponent, YComponent, ZComponent
item_8 = ListItem(List=shatter, Index=0, Wrap=True)  # -> Item, Item1
pdecon_5 = Deconstruct(Point=explode_5.Vertices)  # -> XComponent, YComponent, ZComponent
crv_cp_3 = CurveClosestPoint(Point=flatten([item_7.Item, item_7.Item1]), Curve=pline_4)  # -> Point, Parameter, Distance
crv_cp_4 = CurveClosestPoint(Point=flatten([item_7.Item1, item_7.Item]), Curve=pline_5)  # -> Point, Parameter, Distance
trim = TrimTree(Tree=clx_4.Points, Depth=1)
sort_4 = SortList(Keys=pdecon_4.ZComponent, ValuesA=explode_4.Segments)  # -> Keys, ValuesA
sort_5 = SortList(Keys=pdecon_5.XComponent, ValuesA=explode_5.Vertices)  # -> Keys, ValuesA
cull_ends = CullEnds(List=explode_2.Vertices)  # -> List, Culled
line_5 = LineSDL(Start=crv_cp_4.Point, Direction=Vector(0, 0, 1), Length=1)
shatter_3 = Shatter(Curve=pline_5, Parameters=crv_cp_4.Parameter)
line_6 = LineSDL(Start=sort_5.ValuesA, Direction=Vector(0, 0, 1), Length=1)
clx_5 = CurveLine(Curve=pline_3, Line=line_6)  # -> Points, Params, Count
nulls_in_empty = NullsInEmptyBranches(DataWithEmptyBranches=clx_5.Points)
nullrep = ReplaceNulls(Items=nulls_in_empty, Replacements=Toggle(False))  # -> Items, Count
cull_ends_2 = CullEnds(List=trim)  # -> List, Culled
item_9 = ListItem(List=reverse(sort_4.ValuesA), Index=0, Wrap=True)
clx_6 = CurveLine(Curve=pline_4, Line=line_5)  # -> Points, Params, Count
shatter_4 = Shatter(Curve=pline_4, Parameters=flatten(clx_6.Params))
first_last_3 = FirstLast(List=shatter_4)  # -> FirstValue, LastValue
end_3 = EndPoints(Curve=first_last_3.LastValue)  # -> Start, End
end_4 = EndPoints(Curve=first_last_3.FirstValue)  # -> Start, End
yz_3 = YZPlane(Origin=end_3.End)
yz_4 = YZPlane(Origin=end_4.Start)
mirror_3 = Mirror(Geometry=first_last_3.FirstValue, Plane=yz_4)  # -> Geometry, Transform
mirror_4 = Mirror(Geometry=first_last_3.LastValue, Plane=yz_3)  # -> Geometry, Transform
cull_ends_3 = CullEnds(List=sort_5.ValuesA)  # -> List, Culled
crv_2 = Curve([first_last_2.FirstValue, first_last_2.LastValue])
join_4 = JoinCurves(Curves=flatten([pline_4, mirror_4.Geometry, mirror_3.Geometry]), Preserve=False)
cull_i_2 = CullIndex(List=reverse(sort_4.ValuesA), Indices="0", Wrap=True)
dispatch_5 = Dispatch(List=flatten(sort_5.ValuesA), DispatchPattern=flatten(nullrep.Items))  # -> ListA, ListB
first_last_4 = FirstLast(List=shatter_3)  # -> FirstValue, LastValue
ln_3 = Line(StartPoint=cull_ends_2.List, EndPoint=cull_ends.List)  # -> flatten(Line)
mp_3 = Midpoint(Curve=ln_3)
merge_5 = Merge(Data1=first_last_3.FirstValue, Data2=first_last_3.LastValue)
relay_2 = Relay([mirror_3.Geometry, mirror_4.Geometry])
crv_3 = Curve(relay_2)
pdecon_6 = Deconstruct(Point=mp_3)  # -> XComponent, YComponent, ZComponent
line_7 = LineSDL(Start=explode_4.Vertices, Direction=Vector(0, 0, 1), Length=1)
ln_4 = Line(StartPoint=flatten(clx_5.Points), EndPoint=dispatch_5.ListA)
explode_6 = Explode(Curve=crv_3, Recursive=True)  # -> flatten(Segments), flatten(Vertices)
len_3 = Length(Curve=ln_4)
clx_7 = CurveLine(Curve=pline_5, Line=line_7)  # -> Points, Params, Count
pt = Point([Point(-5, -3.425166865, 1.5), Point(5, -3.425166865, 1.5)])
sort_6 = SortList(Keys=pdecon_6.XComponent, ValuesA=ln_3)  # -> Keys, ValuesA
Y_2 = UnitY(Factor=1)
item_10 = ListItem(List=shatter_3, Index=0, Wrap=True)  # -> Item, Item1
move_6 = Move(Geometry=pt, Motion=Y_2)  # -> Geometry, Transform
explode_7 = Explode(Curve=crv_2, Recursive=True)  # -> flatten(Segments), Vertices
pdecon_7 = Deconstruct(Point=explode_6.Vertices)  # -> XComponent, YComponent, ZComponent
sort_7 = SortList(Keys=len_3, ValuesA=ln_4)  # -> Keys, reverse(ValuesA)
number_slider_5 = Slider(100, range=0..100)
panel_3 = Panel("""0
1""")
trim_2 = TrimTree(Tree=clx_7.Points, Depth=1)
number_slider_6 = Slider(6.6, range=0..20)
merge_6 = Merge(Data1=move_6.Geometry, Data2=dispatch_5.ListA)
crv_4 = Curve(explode_7.Segments)
sort_8 = SortList(Keys=pdecon_7.XComponent, ValuesA=explode_6.Vertices)  # -> Keys, ValuesA
number_slider_7 = Slider(1, range=0..1)
cull_ends_4 = CullEnds(List=explode_4.Vertices)  # -> List, Culled
cull_i_3 = CullIndex(List=sort_7.ValuesA, Indices=panel_3, Wrap=True)
crv_5 = Curve(cull_i_3)
line_8 = LineSDL(Start=sort_8.ValuesA, Direction=Vector(0, 0, 1), Length=1)
clx_8 = CurveLine(Curve=pline_5, Line=line_8)  # -> Points, Params, Count
nulls_in_empty_2 = NullsInEmptyBranches(DataWithEmptyBranches=clx_8.Points)
crv_6 = Curve(cull_i)
nullrep_2 = ReplaceNulls(Items=nulls_in_empty_2, Replacements=Toggle(False))  # -> Items, Count
cull_ends_5 = CullEnds(List=trim_2)  # -> List, Culled
number_slider_8 = Slider(0.1, range=0..0.1)
cull_ends_6 = CullEnds(List=sort_8.ValuesA)  # -> List, Culled
number_slider_9 = Slider(202, range=0..1000)
item_11 = ListItem(List=sort_7.ValuesA, Index=panel_3, Wrap=True)
neg_3 = Negative(Value=number_slider_6)
dispatch_6 = Dispatch(List=flatten(sort_8.ValuesA), DispatchPattern=flatten(nullrep_2.Items))  # -> ListA, ListB
len_4 = Length(Curve=crv_6)
len_5 = Length(Curve=crv_4)
ln_5 = Line(StartPoint=cull_ends_5.List, EndPoint=cull_ends_4.List)  # -> flatten(Line)
mp_4 = Midpoint(Curve=ln_5)
shatter_5 = Shatter(Curve=reparameterize(crv_5), Parameters=Slider(0.1, range=0..1))
pdecon_8 = Deconstruct(Point=mp_4)  # -> XComponent, YComponent, ZComponent
ln_6 = Line(StartPoint=flatten(clx_8.Points), EndPoint=dispatch_6.ListA)
first_last_5 = FirstLast(List=shatter_5)  # -> FirstValue, LastValue
len_6 = Length(Curve=first_last_5.LastValue)
neg_4 = Negative(Value=len_6)
len_7 = Length(Curve=ln_6)
neg_5 = Negative(Value=len_4)
sort_9 = SortList(Keys=pdecon_8.XComponent, ValuesA=ln_5)  # -> Keys, ValuesA
neg_6 = Negative(Value=Slider(10.2, range=0..20))
number_slider_10 = Slider(1, range=0..10)
neg_7 = Negative(Value=number_slider_10)
sort_10 = SortList(Keys=len_7, ValuesA=ln_6)  # -> Keys, reverse(ValuesA)
number_slider_11 = Slider(100, range=0..100)
panel_4 = Panel("""0
1""")
deviationedge = DeviationEdge(line=explode_5.Segments, force=number_slider_6)  # -> deviation_edge; inputs line: Line; disabled
#   port line: A line that defines the end nodes of the edge.
#   port force: The desired force on the edge. If negative, the edge is in compression. Otherwise, it is in tension.
#   port deviation_edge: A COMPAS CEM deviation edge.
# ---------- deviationedge: Python ----------
"""
Create a deviation edge from a rhino line.
"""
from ghpythonlib.componentbase import executingcomponent as component

from compas_cem.elements import DeviationEdge


class DeviationEdgeComponent(component):
    def RunScript(self, line, force):
        if line and force is not None:
            return DeviationEdge.from_rhino_line(line, force)
# ---------- end deviationedge ----------
number_slider_12 = Slider(1, range=0..1)
cull_i_4 = CullIndex(List=sort_10.ValuesA, Indices=panel_4, Wrap=True)
crv_7 = Curve(cull_i_4)
deviationedge_2 = DeviationEdge(line=item_6, force=neg_6)  # -> deviation_edge; inputs line: Line; same code as deviationedge
crv_8 = Curve(item_8.Item1)
crv_9 = Curve(cull_i_2)
neg_8 = Negative(Value=Slider(1, range=0..10))
neg_9 = Negative(Value=number_slider_10)
number_slider_13 = Slider(0.1, range=0..0.1)
number_slider_14 = Slider(202, range=0..1000)
item_12 = ListItem(List=sort_10.ValuesA, Index=panel_4, Wrap=True)
neg_10 = Negative(Value=Slider(0.1, range=0..20))
trailedge = TrailEdge(line=first_last_5.LastValue, length=len_6)  # -> trail_edge; inputs line: Line
#   port line: A line that defines the end nodes of the edge.
#   port length: The desired length of the edge. If negative, the edge is in compression. Otherwise, it is in tension.
#   port trail_edge: A COMPAS CEM trail edge.
# ---------- trailedge: Python ----------
"""
Create a trail edge from a rhino line.
"""
from ghpythonlib.componentbase import executingcomponent as component

from compas_cem.elements import TrailEdge


class TrailEdgeComponent(component):
    def RunScript(self, line, length):
        if line and length is not None:
            return TrailEdge.from_rhino_line(line, length)
# ---------- end trailedge ----------
deviationedge_3 = DeviationEdge(line=item_11, force=Slider(0.8, range=0..10))  # -> deviation_edge; inputs line: Line; same code as deviationedge
trailedge_2 = TrailEdge(line=crv_4, length=len_5)  # -> trail_edge; inputs line: Line; same code as trailedge
len_8 = Length(Curve=crv_9)
deviationedge_4 = DeviationEdge(line=sort_6.ValuesA, force=neg_9)  # -> deviation_edge; inputs line: Line; same code as deviationedge
deviationedge_5 = DeviationEdge(line=first_last_5.FirstValue, force=neg_8)  # -> deviation_edge; inputs line: Line; same code as deviationedge
trailedge_3 = TrailEdge(line=crv_6, length=neg_5)  # -> trail_edge; inputs line: Line; same code as trailedge
neg_11 = Negative(Value=Slider(31.77, range=0..100))
shatter_6 = Shatter(Curve=reparameterize(crv_7), Parameters=Slider(0.1, range=0..1))
neg_12 = Negative(Value=Slider(0.1, range=0..0.1))
deviationedge_6 = DeviationEdge(line=crv_8, force=Slider(20, range=0..20))  # -> deviation_edge; inputs line: Line; same code as deviationedge
first_last_6 = FirstLast(List=shatter_6)  # -> FirstValue, LastValue
len_9 = Length(Curve=first_last_6.LastValue)
neg_13 = Negative(Value=len_9)
Z_5 = UnitZ(Factor=neg_12)
neg_14 = Negative(Value=len_8)
neg_15 = Negative(Value=Slider(10.2, range=0..20))
number_slider_15 = Slider(1, range=0..10)
neg_16 = Negative(Value=number_slider_15)
lineload = GhPythonScript(line=flatten([explode_7.Segments, item_8.Item1]), load_vector=Z_5)  # -> out, point, vector; inputs line: list of Line, load_vector: Vector3d
# ---------- lineload: Python ----------
from compas_rhino.geometry import RhinoLine
from compas_rhino.geometry import RhinoVector

from compas.geometry import add_vectors
from compas.geometry import scale_vector

from compas.utilities import geometric_key

import rhinoscriptsyntax as rs

gkey_xyz = {}
gkey_load = {}

load_vector = RhinoVector.from_geometry(load_vector).to_compas()

for ln in line:
    ln = RhinoLine.from_geometry(ln).to_compas()
    
    # calculate load on line end-points    
    lvec = scale_vector(load_vector, ln.length * 0.5)
    
    for pt in ln:
        gkey = geometric_key(pt)
        gkey_xyz[gkey] = pt
        
        if gkey in gkey_load:
            gkey_load[gkey] = add_vectors(gkey_load[gkey], lvec)
        else:
            gkey_load[gkey] = lvec

point = []
vector = []

for gkey, xyz in gkey_xyz.items():
    point.append(rs.AddPoint(*xyz))
    vector.append(rs.AddPoint(*gkey_load[gkey]))
# ---------- end lineload ----------
nodesupport = NodeSupport(point=flatten(merge_6))  # -> node_support; inputs point: Point3d
#   port point: The position of the node where to assign a support.
#   port node_support: A COMPAS CEM node support.
# ---------- nodesupport: Python ----------
"""
Create a node support from a rhino point.
"""
from ghpythonlib.componentbase import executingcomponent as component

from compas_cem.supports import NodeSupport


class NodeSupportComponent(component):
    def RunScript(self, point):
        if point:
            return NodeSupport.from_rhino_point(point)
# ---------- end nodesupport ----------
deviationedge_7 = DeviationEdge(line=pline_2, force=neg_10)  # -> deviation_edge; inputs line: Line; same code as deviationedge
deviationedge_8 = DeviationEdge(line=item_9, force=neg_15)  # -> deviation_edge; inputs line: Line; same code as deviationedge
neg_17 = Negative(Value=Slider(1, range=0..10))
neg_18 = Negative(Value=number_slider_15)
merge_7 = Merge(Data1=trailedge_3, Data2=trailedge, Data3=trailedge_2)  # -> flatten(Result)
nodeload = NodeLoad(point=lineload.point, vector=lineload.vector)  # -> node_load; inputs point: Point3d, vector: Vector3d
#   port point: The position of the node where to apply the load.
#   port vector: The load vector.
#   port node_load: A COMPAS CEM node load.
# ---------- nodeload: Python ----------
"""
Create a load vector to be applied at a node.
"""
from ghpythonlib.componentbase import executingcomponent as component

from compas_cem.loads import NodeLoad


class NodeLoadComponent(component):
    def RunScript(self, point, vector):
        if point and vector:
            return NodeLoad.from_rhino_point_and_vector(point, vector)
# ---------- end nodeload ----------
merge_8 = Merge(
    Data1=deviationedge_3,
    Data2=deviationedge_4,
    Data3=deviationedge_5,
    Data4=deviationedge_6,
    Data5=deviationedge,
    Data6=deviationedge_2)  # -> flatten(Result)
trailedge_4 = TrailEdge(line=first_last_6.LastValue, length=len_9)  # -> trail_edge; inputs line: Line; same code as trailedge
deviationedge_9 = DeviationEdge(line=item_12, force=Slider(0.8, range=0..10))  # -> deviation_edge; inputs line: Line; same code as deviationedge
deviationedge_10 = DeviationEdge(line=sort_9.ValuesA, force=neg_18)  # -> deviation_edge; inputs line: Line; same code as deviationedge
deviationedge_11 = DeviationEdge(line=first_last_6.FirstValue, force=neg_17)  # -> deviation_edge; inputs line: Line; same code as deviationedge
trailedge_5 = TrailEdge(line=crv_9, length=neg_14)  # -> trail_edge; inputs line: Line; same code as trailedge
Z_6 = UnitZ(Factor=1)
view_constrained_form = BooleanToggle(False)

# ---- group: Form Display - Controls
load_min = Slider(0.001, range=0..0.001)
lineweight_thickness_factor = Slider(0.1, range=0..10)
load_scale = Slider(1, range=0..1)
list = ValueList({"Forces": 0, "Lengths": 1}, selected="Forces")
int = Integer(list)
num = Number(lineweight_thickness_factor)
num_2 = Number(load_scale)
num_3 = Number(load_min)

# ---- group: Topoloy Display - Controls
load_min_2 = Slider(0.001, range=0..0.001)
dash_length = Slider(0.04, range=0..0.1)
sphere_radius = Slider(0.07, range=0..0.1)
load_scale_2 = Slider(0.1, range=0..1)
num_4 = Number(Slider(2.1, range=0..10))
num_5 = Number(load_min_2)
num_6 = Number(dash_length)
num_7 = Number(sphere_radius)

# ----
number_slider_16 = Slider(0.001, range=0..0.001)
cem_colors = CEMColors()  # -> color_tension, color_compression, color_edge, color_node, color_node_support, color_node_origin, color_load, color_reaction, color_trail, color_auxiliary_trail
#   port color_tension: The color for edges under a tension force.
#   port color_compression: The color for edges under a compression force.
#   port color_edge: The color for a regular edge.
#   port color_node: The color for a regular node.
#   port color_node_support: The color for a support node.
#   port color_node_origin: The color for an origin node.
#   port color_load: The color for an applied load.
#   port color_reaction: The color for a reaction force.
#   port color_trail: The color to paint a trail.
#   port color_auxiliary_trail: The color to paint an auxiliary trail.
# ---------- cem_colors: Python ----------
"""
Get the artists color scheme for the objects of the CEM framework.
"""
from ghpythonlib.componentbase import executingcomponent as component

from compas_cem import COLORS
import rhinoscriptsyntax as rs


class ArtistColorsComponent(component):
    def RunScript(self):
        colors = {key: rs.CreateColor(c) for key, c in COLORS.items()}

        color_tension = colors["tension"]
        color_compression = colors["compression"]
        color_edge = colors["edge"]
        color_node = colors["node"]
        color_node_support = colors["node_support"]
        color_node_origin = colors["node_origin"]
        color_load = colors["load"]
        color_reaction = colors["support_force"]
        color_trail = colors["trail"]
        color_auxiliary_trail = colors["auxiliary_trail"]

        colors = (color_tension, color_compression, color_edge, color_node, color_node_support, color_node_origin, color_load, color_reaction, color_trail, color_auxiliary_trail)

        return colors
# ---------- end cem_colors ----------
entwine = Entwine(Branch00=cem_colors.color_node_origin, Branch01=cem_colors.color_node_support, FlattenInputs=True)
merge_9 = Merge(Data1=cem_colors.color_compression, Data2=cem_colors.color_tension)
col = Colour(cem_colors.color_auxiliary_trail)
col_2 = Colour(entwine)
col_3 = Colour(cem_colors.color_load)
cem_colors_2 = CEMColors()  # -> color_tension, color_compression, color_edge, color_node, color_node_support, color_node_origin, color_load, color_reaction, color_trail, color_auxiliary_trail; same code as cem_colors
merge_10 = Merge(Data1=cem_colors_2.color_compression, Data2=cem_colors_2.color_tension)
col_4 = Colour(cem_colors_2.color_load)

# ---- group: File metadata
family_name = Panel("Stabbogen als Durchlauftager")
is_3d = BooleanToggle(True)
base_directory = Panel("C:\Users\Mark\Documents\GitHub\ms_cem_datasete\2.0\28_Stabbogen als Durchlauftrager")
txt = Text(family_name)
txt_2 = Text(base_directory)
bool = Boolean(is_3d)

# ----
export_topology_json = BooleanToggle(False)
export_form_json = BooleanToggle(False)
bool_2 = Boolean(export_topology_json)
bool_3 = Boolean(export_form_json)

save_topology_pdf = BooleanToggle(False)
save_form_pdf = BooleanToggle(False)
bool_4 = Boolean(save_topology_pdf)
bool_5 = Boolean(save_form_pdf)

# ---- group: Make2D - Camera plane
update_camera_plane = Button()
camera_plane_index = Slider(1, range=0..1)
bool_6 = Boolean(update_camera_plane)
int_2 = Integer(camera_plane_index)

# ----
reaction_scale = Slider(0.1, range=0..4)

# ---- group: PDF Controls
edge_width = Slider(2, range=0..5)
node_radius = Slider(0.05, range=0..0.5)
node_edgeweight = Slider(1.5, range=0..5)
arrow_width = Slider(1.5, range=0..5)
load_scale_3 = Slider(3.6, range=0..4)
load_gap = Slider(0.07, range=0..2)
reaction_gap = Slider(0.07, range=0..1)
extra_segments_lineweight = Panel("dotted")
extra_segments_line_thickness_form = Panel("0.75")
extra_segments_line_color_form = Panel("120, 120, 120")
num_8 = Number(edge_width)
num_9 = Number(node_radius)
num_10 = Number(node_edgeweight)
num_11 = Number(arrow_width)
num_12 = Number(load_scale_3)
num_13 = Number(load_gap)
num_14 = Number(reaction_scale)
txt_3 = Text(extra_segments_lineweight)
num_15 = Number(reaction_gap)
num_16 = Number(extra_segments_line_thickness_form)
txt_4 = Text(extra_segments_line_color_form)

# ---- group: COMPAS-based Make2D
int_3 = Integer(int_2)
bool_7 = Boolean(bool_6)
viewports = ViewportProperties(Update=bool_7, AutoUpdate=False)  # -> ViewportNames, ActiveViewportIndex, ViewportBounds, ViewportDisplayMode, CameraLocation, CameraTarget, CameraPlane, CameraLensLength, CameraProjection, CameraUp
item_13 = ListItem(List=viewports.CameraPlane, Index=int_3, Wrap=True)
panel_5 = Panel(viewports.ViewportNames)
pln = Plane(item_13)
panel_6 = Panel(pln)

# ----
crv_10 = Curve([first_last_4.FirstValue, first_last_4.LastValue])
pt_2 = Point([Point(-5, -3.425166865, 1.5), Point(5, -3.425166865, 1.5)])
crv_11 = Curve(item_10.Item1)
neg_19 = Negative(Value=Slider(31.77, range=0..100))
neg_20 = Negative(Value=Slider(0.1, range=0..0.1))
deviationedge_12 = DeviationEdge(line=crv_11, force=Slider(20, range=0..20))  # -> deviation_edge; inputs line: Line; same code as deviationedge
Z_7 = UnitZ(Factor=neg_20)
merge_11 = Merge(
    Data1=deviationedge_9,
    Data2=deviationedge_10,
    Data3=deviationedge_11,
    Data4=deviationedge_12,
    Data5=deviationedge_7,
    Data6=deviationedge_8)  # -> flatten(Result)

explode_8 = Explode(Curve=crv_10, Recursive=True)  # -> flatten(Segments), Vertices
merge_12 = Merge(Data1=pt_2, Data2=dispatch_6.ListA)
crv_12 = Curve(explode_8.Segments)
len_10 = Length(Curve=crv_12)
trailedge_6 = TrailEdge(line=crv_12, length=len_10)  # -> trail_edge; inputs line: Line; same code as trailedge
merge_13 = Merge(Data1=trailedge_5, Data2=trailedge_4, Data3=trailedge_6)  # -> flatten(Result)

lineload_2 = GhPythonScript(line=flatten([explode_8.Segments, item_10.Item1]), load_vector=Z_7)  # -> out, point, vector; inputs line: list of Line, load_vector: Vector3d; same code as lineload
nodesupport_2 = NodeSupport(point=flatten(merge_12))  # -> node_support; inputs point: Point3d; same code as nodesupport
nodeload_2 = NodeLoad(point=lineload_2.point, vector=lineload_2.vector)  # -> node_load; inputs point: Point3d, vector: Vector3d; same code as nodeload

# ---- group: Build topology diagram and trails
topologydiagram = TopologyDiagram(
    trail_edges=flatten([merge_13, merge_7]),
    deviation_edges=flatten([merge_11, merge_8]),
    loads=flatten([nodeload_2, nodeload]),
    supports=flatten([nodesupport_2, nodesupport]))  # -> topology; inputs nodes: list, trail_edges: list, deviation_edges: list, loads: list, supports: list
#   port nodes: A list of COMPAS CEM nodes to add to the diagram.
#   port trail_edges: A list of COMPAS CEM trail edges to add to the diagram.
#   port deviation_edges: A list of COMPAS CEM deviation edges to add to the diagram.
#   port loads: A list of COMPAS CEM loads to add to the diagram.
#   port supports: A list of COMPAS CEM supports to add to the diagram.
#   port topology: A COMPAS CEM topology diagram.
# ---------- topologydiagram: Python ----------
"""
Build a topology diagram.
"""
from ghpythonlib.componentbase import executingcomponent as component

from compas_cem.diagrams import TopologyDiagram


class BuildTopologyDiagramComponent(component):
    def RunScript(self, nodes, trail_edges, deviation_edges, loads, supports):

        topology = TopologyDiagram()

        if nodes:
            for node in nodes:
                topology.add_node(node)

        if trail_edges is not None:
            for trail_edge in trail_edges:
                topology.add_edge(trail_edge)

        if deviation_edges:
            for deviation_edge in deviation_edges:
                topology.add_edge(deviation_edge)

        if loads:
            for load in loads:
                topology.add_load(load)

        if supports:
            for support in supports:
                topology.add_support(support)

        return topology
# ---------- end topologydiagram ----------
Z_8 = UnitZ(Factor=1)

# ----
rev = Reverse(Vector=Z_8)

buildtrails = BuildTrails(add_auxiliary_trails=Toggle(True), auxiliary_trail_length="0.33", auxiliary_trail_vector=rev)  # -> topology, trails, auxiliary_trails; inputs add_auxiliary_trails: Boolean, auxiliary_trail_vector: Vector3d
#   port topology: A COMPAS CEM topology diagram.
#   port add_auxiliary_trails: Append auxiliary trail edges to the free nodes of the topology diagram. Defaults to False.
#   port auxiliary_trail_length: The length of the auxiliary trail edges to add. Defaults to 1.0.
#   port auxiliary_trail_vector: The direction to which the auxiliary trail edges will initially point to. Defaults to [1.0, 1.0, 1.0].
#   port topology: The input topology diagram. But now with computed trails.
#   port trails: The keys of the nodes in each of the found trails.
#   port auxiliary_trails: The keys of the appended auxiliary trail edges.
# ---------- buildtrails: Python ----------
"""
Automatically find the trails in a topology diagram. The diagram is modified in-place.
"""
from ghpythonlib.componentbase import executingcomponent as component

from compas_rhino.geometry import RhinoVector


class BuildTopologyDiagramComponent(component):
    def RunScript(self, topology, add_auxiliary_trails, auxiliary_trail_length, auxiliary_trail_vector):
        add_auxiliary_trails = add_auxiliary_trails or False

        if topology:

            topology = topology.copy()

            if auxiliary_trail_length:
                topology.auxiliary_trail_length = auxiliary_trail_length
            if auxiliary_trail_vector:
                topology.auxiliary_trail_vector = RhinoVector.from_geometry(auxiliary_trail_vector).to_compas()

            topology.build_trails(add_auxiliary_trails)

            trails = list(topology.trails())
            auxiliary_trails = list(topology.auxiliary_trail_edges())

            return topology, trails, auxiliary_trails
# ---------- end buildtrails ----------

# ---- group: Build topology diagram and trails (continued)
buildtrails_2 = BuildTrails(topology=topologydiagram, add_auxiliary_trails=Toggle(True), auxiliary_trail_length="0.33", auxiliary_trail_vector=rev)  # -> topology, trails, auxiliary_trails; inputs add_auxiliary_trails: Boolean, auxiliary_trail_vector: Vector3d; same code as buildtrails

# ---- group: Optimization parameters
topologydisassembly = DisassembleTopologyDiagram(topology=buildtrails_2.topology)  # -> nodes, origin_nodes, support_nodes, edges, trail_edges, deviation_edges, trails, auxiliary_trails
#   port topology: A COMPAS CEM topology diagram.
#   port nodes: All the node keys in the topology diagram.
#   port origin_nodes: The keys of the origin nodes in the topology diagram.
#   port support_nodes: The keys of the support nodes in the topology diagram.
#   port edges: All the edge keys in the topology diagram.
#   port trail_edges: The keys of the trail edges in the topology diagram.
#   port deviation_edges: The keys of the deviation edges in the topology diagram.
#   port trails: The trails in the topology diagram.
#   port auxiliary_trails: The auxiliary trails in the topology diagram.
# ---------- topologydisassembly: Python ----------
"""
Disassemble a topology diagram into its constituent parts.
"""
from ghpythonlib.componentbase import executingcomponent as component


class TopologyDisassemblyComponent(component):
    def RunScript(self, topology):
        if topology:
            trails = list(topology.trails())
            auxiliary_trails = list(topology.auxiliary_trails())

            edges = list(topology.edges())
            trail_edges = list(topology.trail_edges())
            deviation_edges = list(topology.deviation_edges())

            nodes = list(topology.nodes())
            origin_nodes = list(topology.origin_nodes())
            support_nodes = list(topology.support_nodes())

            return nodes, origin_nodes, support_nodes, edges, trail_edges, deviation_edges, trails, auxiliary_trails
# ---------- end topologydisassembly ----------
deviationedgeforceparameter = DeviationEdgeForceParameter(edge_key=topologydisassembly.deviation_edges, bound_low="3000", bound_up="3000")  # -> parameter
#   port edge_key: The key of a COMPAS CEM deviation edge.
#   port bound_low: The lower bound of the edge optimization parameter. Calculated as the initial edge parameter minus the absolute value of this bound.
#   port bound_up: The upper bound of the edge optimization parameter. Calculated as the initial edge parameter plus the absolute value of this bound.
#   port parameter: A COMPAS CEM deviation edge force parameter.
# ---------- deviationedgeforceparameter: Python ----------
"""
Set the force of a deviation edge as an optimization parameter.
"""
from ghpythonlib.componentbase import executingcomponent as component

from compas_cem.optimization import DeviationEdgeParameter


class DeviationEdgeParameterComponent(component):
    def RunScript(self, edge_key, bound_low, bound_up):
        if edge_key and bound_low is not None and bound_up is not None:
            return DeviationEdgeParameter(edge_key, bound_low, bound_up)
# ---------- end deviationedgeforceparameter ----------

# ---- group: topology
data = Data(buildtrails_2.topology)

# 02 Visualize Diagrams
data_2 = Data(data)

# ---- group: Inputs / Topology
data_3 = Data(data)

# ---- group: COMPAS-based Make2D
xy = XYPlane(Origin=Point(0, 0, 0))
data_4 = Data(data_3)
pln_2 = Plane(pln)
orient_and_project = GhPythonScript(topology=data_4, initial_plane=pln_2, target_plane=xy)  # -> out, topology_transformed; inputs initial_plane: Plane, target_plane: Plane
# ---------- orient_and_project: Python ----------
from compas_rhino.geometry import RhinoPlane
from compas.geometry import Transformation
from compas.geometry import Projection
from compas.geometry import Frame
from compas.geometry import transform_vectors
from compas.datastructures import network_transformed

# Build frames from rhino planes
frames = []
for plane in (initial_plane, target_plane):
    plane = RhinoPlane.from_geometry(plane)
    frame = Frame(plane.point, plane.xaxis, plane.yaxis)
    frames.append(frame)    
fa, fb = frames

# Re-orient node positions
transf = Transformation.from_frame_to_frame(fa, fb)
topology_transformed = network_transformed(topology, transf)

# Squash node positions to plane
z = fb.point.z
for node in topology_transformed.nodes():
    topology_transformed.node_attribute(node, "z", z)
# ---------- end orient_and_project ----------
data_5 = Data(orient_and_project.topology_transformed)

# ----
num_17 = Number(num_12)
data_6 = Data(data_5)
topologyartist = TopologyArtist(topology=data_6, load_scale=num_17)  # -> nodes, origin_nodes, support_nodes, edges, trail_edges, deviation_edges, loads; inputs node: list of Int32, edge: list
#   port topology: A COMPAS CEM topology diagram.
#   port node: A selection of the nodes in the diagram. Defaults to all the nodes.
#   port edge: A selection of the edges in the diagram. Defaults to all the edges.
#   port load_min: The minimum load magnitude to plot. Defaults to 1e-3.
#   port load_scale: The scaling factor of the loads. Defaults to 1.
#   port nodes: The nodes in the diagram as points.
#   port origin_nodes: The origin nodes in the diagram as points.
#   port support_nodes: The position of the support nodes in the diagram.
#   port edges: The edges in the diagram as lines.
#   port trail_edges: The trail edges in the diagram as lines.
#   port deviation_edges: The deviation edges in the diagram as lines.
#   port loads: The applied node loads as lines.
# ---------- topologyartist: Python ----------
"""
Draw a topology diagram.
"""
from ghpythonlib.componentbase import executingcomponent as component

from compas_cem.ghpython import TopologyArtist


class TopologyArtistComponent(component):
    def RunScript(self, topology, node, edge, load_min, load_scale):
        node = node or None
        edge = edge or None
        load_min = load_min or 1e-3
        load_scale = load_scale or 1.0
        if topology:
            artist = TopologyArtist(topology)

            nodes = artist.draw_nodes(node)
            origin_nodes = artist.draw_nodes_origin(node)
            support_nodes = artist.draw_nodes_support(node)

            edges = artist.draw_edges(edge)
            trail_edges = artist.draw_edges_trail(edge)
            deviation_edges = artist.draw_edges_deviation(edge)

            loads = artist.draw_loads(node, min_load=load_min, scale=load_scale)

            return nodes, origin_nodes, support_nodes, edges, trail_edges, deviation_edges, loads
# ---------- end topologyartist ----------
clean = CleanTree(RemoveNulls=True, RemoveInvalid=True, RemoveEmpty=False, Tree=[topologyartist.edges, topologyartist.loads])
python_3 = GhPythonScript(segment=clean)  # -> out, segment; inputs segment: list
# ---------- python_3: Python ----------
from compas_rhino.utilities import get_line_coordinates


segment = get_line_coordinates(segment)
# ---------- end python_3 ----------
data_7 = Data(python_3.segment)

data_8 = Data(data_7)
txt_5 = Text(txt_4)
txt_6 = Text(txt_3)
num_18 = Number(num_16)
lng = ListLength(List=data_8)
python_4 = GhPythonScript(D=flatten(txt_5), L=flatten(lng))  # -> out, color; inputs D: list, L: list of Int32
# ---------- python_4: Python ----------
color = []

for d, l in zip(D, L):
    
    d = [int(n) for n in d.split(", ")]
    c = [d] * l
    color.extend(c)
# ---------- end python_4 ----------
repeat = RepeatData(Data=num_18, Length=lng)
repeat_2 = RepeatData(Data=txt_6, Length=lng)
data_9 = Data(python_4.color)
txt_7 = Text(repeat_2)
num_19 = Number(repeat)

nodesearch = NodeSearch(diagram=buildtrails_2.topology, point=pt_2)  # -> node; inputs point: list of Point3d
#   port diagram: A COMPAS CEM topology or form diagram.
#   port point: The points to search for in the diagram.
#   port node: The node keys.
# ---------- nodesearch: Python ----------
"""
Search a node key in a topology or a form diagram using a point.
"""
from ghpythonlib.componentbase import executingcomponent as component

from compas.utilities import geometric_key
from compas_rhino.geometry import RhinoPoint


class NodeSearchComponent(component):
    def RunScript(self, diagram, point):
        if point and diagram:
            node = []
            for pt in point:
                pt = RhinoPoint.from_geometry(pt).to_compas()
                gkey = geometric_key(pt, diagram.tol)
                node.append(diagram.gkey_node[gkey])
            return node
# ---------- end nodesearch ----------
formfinding = FormFinding(topology=buildtrails_2.topology)  # -> form; inputs tmax: Int32
#   port topology: A COMPAS CEM topology diagram.
#   port tmax: The maximum number of iterations to run the form-finding algorithm for. Defaults to 100.
#   port eps_min: The convergence threshold of the form-finding algorithm. Default to 1e-6.
#   port form: A COMPAS CEM form diagram in static equilibrium.
# ---------- formfinding: Python ----------
"""
Generate a form diagram in static equilibrium.
"""
from ghpythonlib.componentbase import executingcomponent as component

from compas_cem.equilibrium import static_equilibrium


class FormFindingComponent(component):
    def RunScript(self, topology, tmax, eta_min):
        tmax = tmax or 100
        eta_min = eta_min or 1e-6
        if topology:
            return static_equilibrium(topology, tmax=tmax, eta=eta_min)
# ---------- end formfinding ----------

# ---- group: Optimization goal constraints
trailedgeforceconstraint = TrailEdgeForceConstraint(edge_key=buildtrails_2.auxiliary_trails, force="0.0")  # -> constraint
#   port edge_key: The key of a COMPAS CEM trail edge.
#   port force: The target force.
#   port weight: The weight of the constraint in the optimization problem. Defaults to one.
#   port constraint: A COMPAS CEM trail force constraint.
# ---------- trailedgeforceconstraint: Python ----------
"""
Make the force on a trail edge to reach a goal force value.
"""
from ghpythonlib.componentbase import executingcomponent as component

from compas_cem.optimization import TrailEdgeForceConstraint


class TrailEdgeForceConstraintComponent(component):
    def RunScript(self, edge_key, force, weight):
        weight = weight or 1.0
        if edge_key and force is not None:
            return TrailEdgeForceConstraint(edge_key, force, weight)
# ---------- end trailedgeforceconstraint ----------
topologydisassembly_2 = DisassembleTopologyDiagram(topology=topologydiagram)  # -> nodes, origin_nodes, support_nodes, edges, trail_edges, deviation_edges, trails, auxiliary_trails; same code as topologydisassembly
pointconstraint = PointConstraint(node_key=nodesearch, point=merge_12)  # -> constraint; inputs node_key: Int32, point: Point3d; disabled
#   port node_key: The key of a COMPAS CEM node.
#   port point: The target point.
#   port weight: The weight of the constraint in the optimization problem. Defaults to one.
#   port constraint: A COMPAS CEM node point constraint.
# ---------- pointconstraint: Python ----------
"""
Pull the position of a node to a target point.
"""
from ghpythonlib.componentbase import executingcomponent as component

from compas_cem.optimization import PointConstraint
from compas_rhino.geometry import RhinoPoint


class PointConstraintComponent(component):
    def RunScript(self, node_key, point, weight):
        weight = weight or 1.0
        if node_key is not None and point:
            point = RhinoPoint.from_geometry(point).to_compas()
            return PointConstraint(node_key, point, weight)
# ---------- end pointconstraint ----------
entwine_2 = Entwine(Branch00=pointconstraint, Branch01=trailedgeforceconstraint, FlattenInputs=True)  # -> flatten(Result)

# ----
constrainedformfinding = ConstrainedFormFinding(
    topology=buildtrails_2.topology,
    constraints=entwine_2,
    parameters=deviationedgeforceparameter,
    iters_max="400",
    eps="1e-6")  # -> form, penalty, iters, time; inputs constraints: list, parameters: list, iters_max: Int32; disabled
#   port topology: A COMPAS CEM topology diagram.
#   port constraints: A list of COMPAS CEM optimization constraints.
#   port parameters: A list of COMPAS CEM optimization parameters.
#   port algorithm: The name of the optimization algorithm to use.
#   port iters_max: The maximum number of iterations to run the optimization algorithm for.
#   port eps: The minimum penalty value to declare convergence.
#   port form: A COMPAS CEM form diagram in static equilibrium.
#   port penalty: The penalty score after optimization.
#   port iters: The elapsed number of iterations.
#   port time: The optimization elapsed time.
# ---------- constrainedformfinding: Python ----------
"""
Generate a form diagram in static equilibrium.
"""
from ghpythonlib.componentbase import executingcomponent as component

from compas_cem import PROXY_PORT

from compas.rpc import Proxy


class ConstrainedFormFindingComponent(component):
    def RunScript(self, topology, constraints, parameters, algorithm, iters_max, eps):
        algorithm = algorithm or "LD_SLSQP"
        iters_max = iters_max or 100
        eps = eps or 1e-6

        if topology and constraints and parameters:
            topology = topology.copy()

            with Proxy("compas_cem.optimization", port=PROXY_PORT) as opt:
                form, penalty, iters, time = opt.solve_nlopt_proxy(topology,
                                                                   constraints,
                                                                   parameters,
                                                                   algorithm,
                                                                   iters_max,
                                                                   eps)
            return form, penalty, iters, time
# ---------- end constrainedformfinding ----------
panel_7 = Panel(constrainedformfinding.penalty)
panel_8 = Panel(constrainedformfinding.iters)

# ---- group: constrained form
data_10 = Data(constrainedformfinding.form)

# ---- group: form
data_11 = Data(formfinding)

data_12 = Data(data_11)

# ---- group: constrained form
data_13 = Data(data_10)

# ----
filter = StreamFilter(Gate=view_constrained_form, Stream0=data_12, Stream1=data_13)
data_14 = Data(filter)

# ---- group: Inputs / Constrained Form
data_15 = Data(data_14)

# ----
data_16 = Data(data_3)
bool_8 = Boolean(bool)
txt_8 = Text(txt)
txt_9 = Text(txt_2)
data_17 = Data(data_15)
bool_9 = Boolean(bool)
txt_10 = Text(txt)
txt_11 = Text(txt_2)
nameschema = GhPythonScript(topology=data_16, is_3d=bool_8, family_name=txt_8, base_dir=txt_9)  # -> out, filepath; inputs is_3d: Boolean
# ---------- nameschema: Python ----------
"""familyname_diagram_2dor3d_numnodes_numsupports_numloads_numedges_numtrailedges_numdeviationedges_numauxtrails"""


import os

from compas_cem.diagrams import TopologyDiagram
from compas_cem.diagrams import FormDiagram


diagram = topology
# find out diagram type
cls = diagram.__class__.__name__
if cls == "TopologyDiagram":
    diagram_name = "T"

# check dimensionality
if is_3d:
    dim = "3d"
else:
    dim = "2d"
    
# get data from diagram
numnodes = str(len(list(diagram.nodes())))    
numsupports = str(len(list(diagram.support_nodes())))
numloads = str(len(list(diagram.loaded_nodes())))

numedges = str(len(list(diagram.edges())))
numtrailedges = str(len(list(diagram.trail_edges())))
numdeviationedges = str(len(list(diagram.deviation_edges())))
numauxtrails = str(len(list(diagram.auxiliary_trails()))) 
    
schema = (family_name, diagram_name, dim, numnodes, numsupports, numloads, numedges, numtrailedges, numdeviationedges, numauxtrails)
schema = "_".join(schema)
base_dir = os.path.abspath(base_dir)
filepath = os.path.abspath(os.path.join(base_dir, family_name, dim, schema))
# ---------- end nameschema ----------
nameschema_2 = GhPythonScript(form=data_17, is_3d=bool_9, family_name=txt_10, base_dir=txt_11)  # -> out, filepath; inputs is_3d: Boolean
# ---------- nameschema_2: Python ----------
"""familyname_diagram_2dor3d_numnodes_numsupports_numloads_numedges_numtrailedges_numdeviationedges_numauxtrails"""


import os

from compas_cem.diagrams import TopologyDiagram
from compas_cem.diagrams import FormDiagram


diagram = form
# find out diagram type
cls = diagram.__class__.__name__
if cls == "FormDiagram":
    diagram_name = "F"

# check dimensionality
if is_3d:
    dim = "3d"
else:
    dim = "2d"
    
# get data from diagram
numnodes = str(len(list(diagram.nodes())))    
numsupports = str(len(list(diagram.support_nodes())))
numloads = str(len(list(diagram.loaded_nodes())))
numedges = str(len(list(diagram.edges())))
    
schema = (family_name, diagram_name, dim, numnodes, numsupports, numloads, numedges)
schema = "_".join(schema)
base_dir = os.path.abspath(base_dir)
filepath = os.path.abspath(os.path.join(base_dir, family_name, dim, schema))
# ---------- end nameschema_2 ----------
txt_12 = Text(nameschema.filepath)
txt_13 = Text(nameschema_2.filepath)

# ---- group: COMPAS-based Make2D
xy_2 = XYPlane(Origin=Point(0, 0, 0))
data_18 = Data(data_15)
pln_3 = Plane(pln)
orient_and_project_2 = GhPythonScript(form=data_18, initial_plane=pln_3, target_plane=xy_2)  # -> out, form_transformed; inputs initial_plane: Plane, target_plane: Plane
# ---------- orient_and_project_2: Python ----------
from compas_rhino.geometry import RhinoPlane
from compas.geometry import Transformation
from compas.geometry import Projection
from compas.geometry import Frame
from compas.geometry import transform_vectors
from compas.datastructures import network_transformed

# Build frames from rhino planes
frames = []
for plane in (initial_plane, target_plane):
    plane = RhinoPlane.from_geometry(plane)
    frame = Frame(plane.point, plane.xaxis, plane.yaxis)
    frames.append(frame)    
fa, fb = frames

# Re-orient node positions
transf = Transformation.from_frame_to_frame(fa, fb)
form_transformed = network_transformed(form, transf)

# Squash node positions to plane
z = fb.point.z
for node in form_transformed.nodes():
    form_transformed.node_attribute(node, "z", z)
    

# Re-orient and squash loads
for node in form_transformed.nodes():
    # loads
    load = form_transformed.node_load(node)
    loadt = transform_vectors([load], transf).pop()
    form_transformed.node_attributes(node, ("qx", "qy", "qz"), loadt)
    
    # reaction force
    reaction = form_transformed.reaction_force(node)
    reactiont = transform_vectors([reaction], transf).pop()
    form_transformed.node_attributes(node, ("rx", "ry", "rz"), reactiont)
# ---------- end orient_and_project_2 ----------
data_19 = Data(orient_and_project_2.form_transformed)
data_20 = Data(data_19)
python_5 = GhPythonScript(form=data_20, reaction_min="0.001")  # -> out, form
# ---------- python_5: Python ----------
from compas.geometry import length_vector


nodes = list(form.nodes())


for node in nodes:
    if form.is_node_support(node) and length_vector(form.reaction_force(node)) <= reaction_min:
        form.delete_node(node)
# ---------- end python_5 ----------
data_21 = Data(python_5.form)

# ----
txt_14 = Text(txt_13)
num_20 = Number(flatten(num_19))
txt_15 = Text(flatten(txt_7))
bool_10 = Boolean(bool_4)
num_21 = Number(num_8)
num_22 = Number(num_9)
data_22 = Data(data_5)
num_23 = Number(num_10)
num_24 = Number(num_10)
txt_16 = Text(txt_12)
bool_11 = Boolean(bool_5)
data_23 = Data(data_21)
num_25 = Number(num_10)
num_26 = Number(num_12)
num_27 = Number(num_8)
num_28 = Number(num_9)
num_29 = Number(num_11)
num_30 = Number(num_13)
num_31 = Number(num_14)
num_32 = Number(num_15)
data_24 = Data(data_7)
data_25 = Data(data_9)
concat = Concatenate(FragmentA=txt_14, FragmentB=".pdf")
division = Division(A=num_24, B=2)
concat_2 = Concatenate(FragmentA=txt_16, FragmentB=".pdf")
python_6 = GhPythonScript(
    save_file=bool_10,
    topology=data_22,
    edge_width=num_21,
    node_radius=num_22,
    node_edgewidth=num_23,
    load_width=division,
    load_radius=num_22,
    fig_width="16",
    fig_height="9",
    fig_dpi="100",
    filepath=concat_2)  # -> out; inputs save_file: Boolean, fig_width: Int32, fig_height: Int32, fig_dpi: Int32
# ---------- python_6: Python ----------
from compas.rpc import Proxy


kwargs = {"topology": topology,
          "filepath": filepath,
          "edge_width": edge_width,
          "node_radius": node_radius,
          "node_edgewidth": node_edgewidth,
          "load_width": load_width,
          "load_radius": load_radius,
          "fig_width": fig_width,
          "fig_height": fig_height,
          "fig_dpi": fig_dpi}


if save_file:
    with Proxy("compas_cem.plotters") as plotters:
        data = plotters.topology_plotter_proxy(**kwargs)
        
    print("Done!")
    print(data)
# ---------- end python_6 ----------
python_7 = GhPythonScript(
    save_file=bool_11,
    form=data_23,
    edge_width=num_27,
    node_radius=num_28,
    node_edgewidth=num_25,
    load_width=num_29,
    load_scale=num_26,
    load_gap=num_30,
    reaction_width=num_29,
    reaction_scale=num_31,
    reaction_gap=num_32,
    segment=data_24,
    segment_color=data_25,
    segment_width=num_20,
    segment_ls=txt_15,
    fig_width="16",
    fig_height="9",
    fig_dpi="100",
    filepath=concat)  # -> out; inputs save_file: Boolean, segment: list, segment_color: list, segment_width: list, segment_ls: list, fig_width: Int32, fig_height: Int32, fig_dpi: Int32
# ---------- python_7: Python ----------
from compas.rpc import Proxy


kwargs = {"form": form,
          "filepath": filepath,
          "edge_width": edge_width,
          "node_radius": node_radius,
          "node_edgewidth": node_edgewidth,
          "load_width": load_width,
          "load_scale": load_scale,
          "load_gap": load_gap,
          "reaction_width": reaction_width,
          "reaction_scale": reaction_scale,
          "reaction_gap": reaction_gap,
          "segment": segment,
          "segment_color": segment_color,
          "segment_width": segment_width,
          "segment_ls": segment_ls,
          "fig_width": fig_width,
          "fig_height": fig_height,
          "fig_dpi": fig_dpi}


if save_file:
    with Proxy("compas_cem.plotters") as plotters:
        plotters.form_plotter_proxy(**kwargs)
        
    print("Done!")
# ---------- end python_7 ----------
panel_9 = Panel(python_6)
panel_10 = Panel(python_7)

txt_17 = Text(txt_12)
txt_18 = Text(txt_13)
bool_12 = Boolean(bool_2)
data_26 = Data(data_3)
bool_13 = Boolean(bool_3)
data_27 = Data(data_15)
exportjson = GhPythonScript(export=bool_12, diagram=data_26, filepath=txt_17)  # -> out
# ---------- exportjson: Python ----------
if export:
    diagram.to_json(filepath + ".json")
    
    print("Exported file to {}!".format(filepath + ".json"))
# ---------- end exportjson ----------
exportjson_2 = GhPythonScript(export=bool_13, diagram=data_27, filepath=txt_18)  # -> out; same code as exportjson
panel_11 = Panel(exportjson_2)
panel_12 = Panel(exportjson)

num_33 = Number(num_3)
num_34 = Number(num)
num_35 = Number(num_2)
int_4 = Integer(int)
data_28 = Data(data_14)
col_5 = Colour(col_4)
swatch = ColourSwatch(SwatchColor=RGBA(156, 156, 156, 195))

num_36 = Number(num_34)
int_5 = Integer(int_4)
data_29 = Data(data_28)
num_37 = Number(num_33)
num_38 = Number(num_35)
formartist = FormArtist(form=data_29, force_min=num_37, force_scale=num_38)  # -> nodes, support_nodes, edges, loads, reactions; inputs node: list of Int32, edge: list
#   port form: A COMPAS CEM topology diagram.
#   port node: A selection of the nodes in the diagram. Defaults to all the nodes.
#   port edge: A selection of the edges in the diagram. Defaults to all the edges.
#   port force_min: The smallest force magnitude to draw. Defaults to 1e-3
#   port force_scale: The scale of the loads and the reactions. Defaults to 1.
#   port nodes: The nodes of the diagram as points.
#   port support_nodes: The support nodes of the diagram as points
#   port edges: The edges of the diagram as lines.
#   port loads: The applied loads as lines.
#   port reactions: The reaction forces at the supports, as lines.
# ---------- formartist: Python ----------
"""
Draw a form diagram.
"""
from ghpythonlib.componentbase import executingcomponent as component

from compas_cem.ghpython import FormArtist


class FormArtistComponent(component):
    def RunScript(self, form, node, edge, force_min, force_scale):
        force_min = force_min or 1e-3
        force_scale = force_scale or 1
        if form:
            artist = FormArtist(form)

            nodes = artist.draw_nodes(node)
            edges = artist.draw_edges(edge)
            support_nodes = artist.draw_nodes_support(node)

            loads = artist.draw_loads(node, min_load=force_min, scale=force_scale)
            reactions = artist.draw_reactions(node, min_force=force_min, scale=force_scale)

            return nodes, support_nodes, edges, loads, reactions
# ---------- end formartist ----------
edgeresults = EdgeResults(form=data_29)  # -> length, force; inputs edge: list
#   port form: A COMPAS CEM form diagram.
#   port edge: A selection of edge keys to query the results on. Defaults to all the edges.
#   port length: The edge lengths.
#   port force: The edge forces.
# ---------- edgeresults: Python ----------
"""
Extract the post form-finding results of the edges in a form diagram.
"""
from ghpythonlib.componentbase import executingcomponent as component


class EdgeResultsComponent(component):
    def RunScript(self, form, edge):
        if form:
            edge = edge or list(form.edges())
            length = [form.edge_length_2(ed) for ed in edge]
            force = [form.edge_force(ed) for ed in edge]
            return length, force
# ---------- end edgeresults ----------
formdisassembly = DisassembleFormDiagram(form=data_29)  # -> nodes, support_nodes, edges
#   port form: A COMPAS CEM form diagram.
#   port nodes: All the node keys in the form diagram.
#   port support_nodes: The keys of the support nodes in the form diagram.
#   port edges: All the edge keys in the form diagram.
# ---------- formdisassembly: Python ----------
"""
Disassemble a form diagram into its constituent parts.
"""
from ghpythonlib.componentbase import executingcomponent as component


class FormDisassemblyComponent(component):
    def RunScript(self, form):
        if form:
            edges = list(form.edges())
            nodes = list(form.nodes())
            support_nodes = list(form.support_nodes())

            return nodes, support_nodes, edges
# ---------- end formdisassembly ----------
larger = LargerThan(FirstNumber=edgeresults.force, SecondNumber=0)  # -> LargerThan, OrEqualTo
abs = Absolute(Value=edgeresults.force)
filter_2 = StreamFilter(Gate=int_5, Stream0=edgeresults.force, Stream1=edgeresults.length)
item_14 = ListItem(List=merge_10, Index=larger.OrEqualTo, Wrap=True)
multiplication = Multiplication(A=abs, B=num_36)
python_8 = GhPythonScript(x=filter_2)  # -> out, a
# ---------- python_8: Python ----------
a = round(x, 3)
# ---------- end python_8 ----------
int_6 = Integer(formdisassembly.nodes)
pt_3 = Point(formartist.nodes)
crv_13 = Curve(formartist.edges)
crv_14 = Curve(formartist.loads)
num_39 = Number(python_8.a)
data_30 = Data(formdisassembly.edges)
crv_15 = Curve(formartist.loads)
crv_16 = Curve(formartist.reactions)
col_6 = Colour(item_14)
num_40 = Number(multiplication)

pt_4 = Point(pt_3)
int_7 = Integer(int_6)
data_31 = Data(data_30)
crv_17 = Curve(crv_13)
crv_18 = Curve(crv_14)
crv_19 = Curve(crv_15)
crv_20 = Curve(crv_16)
col_7 = Colour(col_6)
num_41 = Number(num_40)
num_42 = Number(num_39)
data_32 = Data(data_31)
pt_5 = Point(pt_4)
int_8 = Integer(int_7)
crv_21 = Curve(crv_17)
midpt = CurveMiddle(Curve=crv_21)

crv_22 = Curve(crv_17)
col_8 = Colour(col_7)
num_43 = Number(num_41)

crv_23 = Curve(crv_19)
crv_24 = Curve(crv_20)
col_9 = Colour(col_5)
end_5 = EndPoints(Curve=crv_23)  # -> Start, End
end_6 = EndPoints(Curve=crv_24)  # -> Start, End
vec2pt = Vector2Pt(PointA=end_6.Start, PointB=end_6.End, Unitize=False)  # -> Vector, Length
vec2pt_2 = Vector2Pt(PointA=end_5.Start, PointB=end_5.End, Unitize=False)  # -> Vector, Length

num_44 = Number(num_42)
crv_25 = Curve(crv_17)
midpt_2 = CurveMiddle(Curve=crv_25)

# ---- group: Edges
previewlw = CustomPreviewLineweights(Geometry=crv_22, Shader=col_8, Thickness=num_43, Absolute=False)

# ---- group: Reaction forces
vdisex = VectorDisplayEx(Point=end_6.Start, Vector=vec2pt.Vector, Colour=col_9, Width=2)

# ---- group: Node keys
tag = TextTag(Location=pt_5, Text=int_8, Colour=swatch)

# ---- group: Edge keys
tag_2 = TextTag(Location=midpt, Text=data_32, Colour=swatch)

# ---- group: Edge results
tag_3 = TextTag(Location=midpt_2, Text=num_44, Colour=ColourSwatch(SwatchColor=RGB(191, 4, 4)))

# ---- group: Loads
vdisex_2 = VectorDisplayEx(Point=end_5.Start, Vector=vec2pt_2.Vector, Colour=col_9, Width=2)

# ----
num_45 = Number(num_4)
data_33 = Data(data)
num_46 = Number(num_5)
num_47 = Number(num_7)
col_10 = Colour(col_3)
col_11 = Colour(col)
col_12 = Colour(col_2)

num_48 = Number(num_47)
num_49 = Number(num_46)
num_50 = Number(num_45)
data_34 = Data(data_33)
topologyartist_2 = TopologyArtist(topology=data_34)  # -> nodes, origin_nodes, support_nodes, edges, trail_edges, deviation_edges, loads; inputs node: list of Int32, edge: list; same code as topologyartist
topologydisassembly_3 = DisassembleTopologyDiagram(topology=data_34)  # -> nodes, origin_nodes, support_nodes, edges, trail_edges, deviation_edges, trails, auxiliary_trails; same code as topologydisassembly
python_9 = GhPythonScript(topology=data_34, auxiliary_trail=topologydisassembly_3.auxiliary_trails)  # -> out, auxiliary_trail; inputs auxiliary_trail: list
# ---------- python_9: Python ----------
from compas_cem.ghpython import TopologyArtist


if auxiliary_trail is not None:
    artist = TopologyArtist(topology)
   
    if auxiliary_trail is not None:
        auxiliary_trail = artist.draw_edges_trail(auxiliary_trail)
# ---------- end python_9 ----------
python_10 = GhPythonScript(trail=topologydisassembly_3.trail_edges, auxiliary_trail=topologydisassembly_3.auxiliary_trails)  # -> out, trail; inputs trail: list, auxiliary_trail: list
# ---------- python_10: Python ----------
trail = [tr for tr in trail if tr not in auxiliary_trail]
# ---------- end python_10 ----------
topologyartist_3 = TopologyArtist(topology=data_34, edge=python_10.trail, load_min=num_49, load_scale=num_50)  # -> nodes, origin_nodes, support_nodes, edges, trail_edges, deviation_edges, loads; inputs node: list of Int32, edge: list
#   port topology: A COMPAS CEM topology diagram.
#   port node: A selection of the nodes in the diagram. Defaults to all the nodes.
#   port edge: A selection of the edges in the diagram. Defaults to all the edges.
#   port load_min: The minimum load magnitude to plot. Defaults to 1e-3.
#   port load_scale: The scaling factor of the loads. Defaults to 1.
#   port nodes: The nodes in the diagram as points.
#   port origin_nodes: The origin nodes in the diagram as points.
#   port support_nodes: The position of the support nodes in the diagram.
#   port edges: The edges in the diagram as lines.
#   port trail_edges: The trail edges in the diagram as lines.
#   port deviation_edges: The deviation edges in the diagram as lines.
#   port loads: The applied node loads as lines.
# ---------- topologyartist_3: Python ----------
"""
Draw a topology diagram.
"""
from ghpythonlib.componentbase import executingcomponent as component

from compas_cem.ghpython import TopologyArtist


class TopologyArtistComponent(component):
    def RunScript(self, topology, node, edge, load_min, load_scale):
        node = node or None
        edge = edge or None
        load_min = load_min or 1e-3
        load_scale = load_scale or 1.0
        if topology:
            artist = TopologyArtist(topology)

            nodes = artist.draw_nodes(node)
            origin_nodes = artist.draw_nodes_origin(node)
            support_nodes = artist.draw_nodes_support(node)

            edges = artist.draw_edges(edge)
            trail_edges = artist.draw_edges_trail(node)
            deviation_edges = artist.draw_edges_deviation(node)

            loads = artist.draw_loads(node, min_load=load_min, scale=load_scale)

            return nodes, origin_nodes, support_nodes, edges, trail_edges, deviation_edges, loads
# ---------- end topologyartist_3 ----------
entwine_3 = Entwine(Branch00=topologyartist_3.origin_nodes, Branch01=topologyartist_3.support_nodes, FlattenInputs=True)
edgeresults_2 = EdgeResults(form=data_34, edge=python_10.trail)  # -> length, force; inputs edge: list; same code as edgeresults
edgeresults_3 = EdgeResults(form=data_34, edge=topologydisassembly_3.deviation_edges)  # -> length, force; inputs edge: list; same code as edgeresults
larger_2 = LargerThan(FirstNumber=edgeresults_3.force, SecondNumber=0)  # -> LargerThan, OrEqualTo
larger_3 = LargerThan(FirstNumber=edgeresults_2.length, SecondNumber=0)  # -> LargerThan, OrEqualTo
sph = Sphere(Base=entwine_3, Radius=num_48)
item_15 = ListItem(List=merge_9, Index=larger_2.OrEqualTo, Wrap=True)
item_16 = ListItem(List=merge_9, Index=larger_3.OrEqualTo, Wrap=True)
graft = GraftTree(Tree=item_15, IncludeEmptyLists=True, IncludeNullItems=True)
int_9 = Integer(topologydisassembly_3.nodes)
pt_6 = Point(topologyartist_2.nodes)

# ---- group: trail edges w/o aux
crv_26 = Curve(topologyartist_3.edges)

# ---- group: aux trails
crv_27 = Curve(python_9.auxiliary_trail)

# ---- group: deviation edges
crv_28 = Curve(topologyartist_3.deviation_edges)

# ----
brep = Brep(sph)
num_51 = Number(edgeresults_2.length)
num_52 = Number(edgeresults_3.force)
col_13 = Colour(item_16)
col_14 = Colour(graft)
data_35 = Data(topologydisassembly_3.edges)
crv_29 = Curve(topologyartist_2.edges)
crv_30 = Curve(topologyartist_3.loads)

data_36 = Data(data_35)
int_10 = Integer(int_9)
pt_7 = Point(pt_6)
crv_31 = Curve(crv_26)
crv_32 = Curve(crv_27)
crv_33 = Curve(crv_28)
crv_34 = Curve(crv_30)
brep_2 = Brep(brep)
num_53 = Number(num_51)
num_54 = Number(num_52)
col_15 = Colour(col_13)
col_16 = Colour(col_14)
crv_35 = Curve(crv_29)

data_37 = Data(data_36)
pt_8 = Point(pt_7)
crv_36 = Curve(crv_35)
int_11 = Integer(int_10)
swatch_2 = ColourSwatch(SwatchColor=RGBA(156, 156, 156, 195))
midpt_3 = CurveMiddle(Curve=crv_36)

crv_37 = Curve(crv_31)
num_55 = Number(num_53)
crv_38 = Curve(crv_33)
num_56 = Number(num_54)
swatch_3 = ColourSwatch(SwatchColor=RGB(184, 184, 184))
midpt_4 = CurveMiddle(Curve=crv_37)
midpt_5 = CurveMiddle(Curve=crv_38)

crv_39 = Curve(crv_32)
crv_40 = Curve(crv_31)
col_17 = Colour(col_15)
col_18 = Colour(col_11)
crv_41 = Curve(crv_33)
num_57 = Number(num_6)
col_19 = Colour(col_16)
dash = DashPattern(Curve=crv_41, Pattern=num_57)  # -> Dashes, Gaps

crv_42 = Curve(crv_34)
col_20 = Colour(col_10)
end_7 = EndPoints(Curve=crv_42)  # -> Start, End
vec2pt_3 = Vector2Pt(PointA=end_7.Start, PointB=end_7.End, Unitize=False)  # -> Vector, Length

brep_3 = Brep(brep_2)
col_21 = Colour(col_12)

# ---- group: Trail edges
preview = CustomPreview(Geometry=crv_40, Material=col_17)

# ---- group: Nodes
preview_2 = CustomPreview(Geometry=brep_3, Material=col_21)

# ---- group: Loads
vdisex_3 = VectorDisplayEx(Point=end_7.Start, Vector=vec2pt_3.Vector, Colour=col_20, Width=2)

# ---- group: Edge keys
tag_4 = TextTag(Location=midpt_3, Text=data_37, Colour=swatch_2)

# ---- group: Node keys
# 03 Export Data
tag_5 = TextTag(Location=pt_8, Text=int_11, Colour=swatch_2)

# ---- group: Deviation edges
preview_3 = CustomPreview(Geometry=crv_39, Material=col_18)

# ---- group: Auxiliary trails
preview_4 = CustomPreview(Geometry=dash.Dashes, Material=col_19)

# ---- group: Deviation forces
tag_6 = TextTag(Location=midpt_5, Text=num_56, Colour=swatch_3)

# ---- group: Trail lengths
tag_7 = TextTag(Location=midpt_4, Text=num_55, Colour=swatch_3)
