# Grasshopper definition cable_stayed_2d.ghx (Grasshopper 1.0.7)
# plug-ins: Human, Wombat, treesloth01

number_slider = Slider(3, range=0..10)
number_slider_2 = Slider(1, range=0..10)

# ---- group: Reload compas_cem
# 01 CEM framework model
button = Button()
python = GhPythonScript(unload=button)  # -> out; inputs unload: Boolean
# ---------- python: Python ----------
from compas_ghpython.utilities import unload_modules


if unload:
    unloaded = unload_modules("compas")
    print("Unloaded: {}".format(unloaded))
# ---------- end python ----------

# ----
top_chord = Curve([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])
even_number = Slider(2, range=0..100)
join = JoinCurves(Curves=top_chord, Preserve=False)
addition = Addition(A=number_slider_2, B=1)
divide = DivideCurve(Curve=join, Count=addition, Kinks=False)  # -> Points, Tangents, Parameters
end = EndPoints(Curve=join)  # -> Start, End
number_slider_3 = Slider(0.36, range=0..1)
number_slider_4 = Slider(1, range=0..1)
Z = UnitZ(Factor=1)
cull_ends = CullEnds(List=divide.Points)  # -> List, Culled
neg = Negative(Value=Z)
line = LineSDL(Start=cull_ends.List, Direction=Vector(0, 0, 1), Length=Slider(1.79, range=0..10))
addition_2 = Addition(A=Slider(10, range=0..10), B=Slider(10, range=0..10))
multiplication = Multiplication(A=addition_2, B=2)
pline = PolyLine(Vertices=divide.Points, Closed=False)
divide_2 = DivideCurve(Curve=line, Count=addition_2, Kinks=False)  # -> Points, Tangents, Parameters
cull_ends_2 = CullEnds(List=divide_2.Points)  # -> List, Culled
first_last = FirstLast(List=cull_ends_2.Culled)  # -> FirstValue, LastValue
divide_3 = DivideCurve(Curve=line, Count=addition_2, Kinks=False)  # -> Points, Tangents, Parameters
neg_2 = Negative(Value=Slider(0.351, range=0..1))
merge = Merge(Data1=cull_ends_2.List, Data2=first_last.LastValue)
end_2 = EndPoints(Curve=pline)  # -> Start, End
vec = VectorXYZ(XComponent=Slider(1, range=0..1), YComponent=0, ZComponent=neg_2)  # -> Vector, Length
pt = Point(Point(0, 0, 0))
ln = Line()
pt_2 = Point(Point(0, 0, 0))
cp = ClosestPoint(Point=pt, Cloud=divide_3.Points)  # -> ClosestPoint, CPIndex, Distance
line_2 = LineSDL(Start=merge, Direction=vec.Vector, Length=1)
ln_2 = Line(StartPoint=end_2.Start, EndPoint=end_2.End)
cull_i = CullIndex(List=divide_3.Points, Indices=cp.CPIndex, Wrap=True)
clx = CurveLine(Curve=pline, Line=line_2)  # -> Points, Params, Count
number_slider_5 = Slider(36, range=0..100)
repeat = RepeatData(Data=graft(cull_i), Length=Slider(2, range=0..10))
divide_4 = DivideCurve(Curve=pline, Count=multiplication, Kinks=False)  # -> Points, Tangents, Parameters
cp_2 = ClosestPoint(Point=pt_2, Cloud=divide_4.Points)  # -> ClosestPoint, CPIndex, Distance
cull_i_2 = CullIndex(List=divide_4.Points, Indices=cp_2.CPIndex, Wrap=True)
trim = TrimTree(Tree=clx.Points, Depth=1)
flip = FlipMatrix(Data=repeat)
yz = YZPlane(Origin=first_last.FirstValue)
bang = ExplodeTree(Data=flip)  # -> _0000000, _0000010
pline_2 = PolyLine(Vertices=divide_4.Points, Closed=False)
ln_3 = Line(StartPoint=merge, EndPoint=trim)
divide_5 = DivideCurve(Curve=ln_2, Count=number_slider_5, Kinks=False)  # -> Points, Tangents, Parameters
explode = Explode(Curve=pline_2, Recursive=True)  # -> Segments, Vertices
entwine = Entwine(Branch00=reverse(bang._0000000), Branch01=bang._0000010, FlattenInputs=True)
flatten = FlattenTree(Tree=entwine, Path="{0}")
end_3 = EndPoints(Curve=ln_3)  # -> Start, End
mp = Midpoint(Curve=explode.Segments)
pt_3 = Point(Point(-0.04191837544, 0, 0))
pt_4 = Point(Point(0.03420803496, 0, 0))
cp_3 = ClosestPoint(Point=end_3.End, Cloud=divide_5.Points)  # -> ClosestPoint, CPIndex, Distance
cp_4 = ClosestPoint(Point=[pt_3, pt_4], Cloud=mp)  # -> ClosestPoint, CPIndex, Distance
cull_i_3 = CullIndex(List=explode.Segments, Indices=cp_4.CPIndex, Wrap=True)
line_3 = LineSDL(Start=cull_ends.List, Direction=neg, Length=Slider(1.49, range=0..10))
item = ListItem(List=explode.Segments, Index=cp_4.CPIndex, Wrap=True)
addition_3 = Addition(A=number_slider_2, B=1)
end_4 = EndPoints(Curve=line_3)  # -> Start, End
ln_4 = Line(StartPoint=cull_i_2, EndPoint=flatten)
pline_3 = PolyLine(Vertices=divide_5.Points, Closed=False)
ln_5 = Line(StartPoint=end_3.Start, EndPoint=cp_3.ClosestPoint)
mirror = Mirror(Geometry=ln_5, Plane=yz)  # -> Geometry, Transform
equals = Equality(FirstNumber=addition_2, SecondNumber=1)  # -> Equality, Inequality
merge_2 = Merge(Data1=graft(end_4.Start), Data2=end_3.Start)
flip_2 = FlipMatrix(Data=mirror.Geometry)
end_5 = EndPoints(Curve=ln_4)  # -> Start, End
deck = Curve(pline_3)
division = Division(A=number_slider_5, B=addition_3)
first_last_2 = FirstLast(List=item)  # -> FirstValue, LastValue
flip_3 = FlipMatrix(Data=ln_5)
explode_2 = Explode(Curve=deck, Recursive=True)  # -> Segments, Vertices
subtraction = Subtraction(A=division, B=Slider(1, range=0..1))
flip_4 = FlipCurve(Curve=first_last_2.FirstValue)  # -> Curve, Flag
shatter = Shatter(Curve=reparameterize(graft([first_last_2.LastValue, flip_4.Curve])), Parameters=Slider(0.5, range=0..1))
pline_4 = PolyLine(Vertices=merge_2, Closed=False)
series = Series(Start=division, Step=division, Count=number_slider_2)
series_2 = Series(Start=subtraction, Step=division, Count=number_slider_2)
explode_3 = Explode(Curve=pline_4, Recursive=True)  # -> Segments, Vertices
first_last_3 = FirstLast(List=shatter)  # -> FirstValue, LastValue
filter = StreamFilter(Gate=equals.Equality, Stream0=cull_i_3, Stream1=first_last_3.LastValue)
other = Curve(filter)
num = Number([series, series_2])
crv = Curve(first_last_3.FirstValue)
filter_2 = StreamFilter(Gate=equals.Equality, Stream0=item, Stream1=crv)
item_2 = ListItem(List=explode_2.Segments, Index=num, Wrap=True)
item_3 = ListItem(List=end_5.End, Index=0, Wrap=True)
subtraction_2 = Subtraction(A=number_slider_2, B="1")
number_slider_6 = Slider(1, range=0..1)
trim_2 = TrimTree(Tree=item_3, Depth="2")
mid = Curve(filter_2)
merge_3 = Merge(Data1=end_4.Start, Data2=trim_2)
number_slider_7 = Slider(0.1, range=0..0.1)
end_6 = EndPoints()  # -> Start, End
pline_5 = PolyLine(Vertices=merge_3, Closed=False)
filter_3 = StreamFilter(Gate=equals.Equality, Stream0=explode_3.Segments, Stream1=pline_5)
ln_6 = Line(StartPoint=end_4.Start, EndPoint=end_4.End)
number_slider_8 = Slider(0.05, range=0..100)
stands = Curve(flatten([filter_3, ln_6]))
number_slider_9 = Slider(3.8, range=0..10)
number_slider_10 = Slider(100, range=0..100)
crv_2 = Curve(other)
len = Length(Curve=crv_2)
relay = Relay()
number_slider_11 = Slider(0.4, range=0..20)
crv_3 = Curve(stands)
len_2 = Length(Curve=crv_3)
neg_3 = Negative(Value=len)
crv_4 = Curve([other, mid])
deck_near_supports = Curve(mid)
neg_4 = Negative(Value=len_2)
neg_5 = Negative(Value=number_slider_11)
trailedge = TrailEdge(line=crv_2, length=neg_3)  # -> trail_edge; inputs line: Line
#   port line: A line that defines the end nodes of the edge.
#   port length: The desired length of the edge. If negative, the edge is in compression. Otherwise, it is in tension.
#   port trail_edge: A COMPAS CEM trail edge.
# ---------- trailedge: Python ----------
"""
Create a trail edge from a rhino line.
"""
from ghpythonlib.componentbase import executingcomponent as component

from compas_cem.elements import TrailEdge


class TrailEdgeComponent(component):
    def RunScript(self, line, length):
        if line and length is not None:
            return TrailEdge.from_rhino_line(line, length)
# ---------- end trailedge ----------
trailedge_2 = TrailEdge(line=crv_3, length=neg_4)  # -> trail_edge; inputs line: Line; same code as trailedge
deviationedge = DeviationEdge(line=ln_4, force=number_slider_11)  # -> deviation_edge; inputs line: Line
#   port line: A line that defines the end nodes of the edge.
#   port force: The desired force on the edge. If negative, the edge is in compression. Otherwise, it is in tension.
#   port deviation_edge: A COMPAS CEM deviation edge.
# ---------- deviationedge: Python ----------
"""
Create a deviation edge from a rhino line.
"""
from ghpythonlib.componentbase import executingcomponent as component

from compas_cem.elements import DeviationEdge


class DeviationEdgeComponent(component):
    def RunScript(self, line, force):
        if line and force is not None:
            return DeviationEdge.from_rhino_line(line, force)
# ---------- end deviationedge ----------
merge_4 = Merge(Data1=trailedge, Data2=trailedge_2)  # -> flatten(Result)
view_constrained_form = BooleanToggle(False)

# ---- group: Form Display - Controls
load_min = Slider(0.001, range=0..0.001)
lineweight_thickness_factor = Slider(0.1, range=0..10)
load_scale = Slider(1, range=0..1)
list = ValueList({"Forces": 0, "Lengths": 1}, selected="Forces")
int = Integer(list)
num_2 = Number(lineweight_thickness_factor)
num_3 = Number(load_scale)
num_4 = Number(load_min)

# ---- group: Topoloy Display - Controls
load_min_2 = Slider(0.001, range=0..0.001)
dash_length = Slider(0.04, range=0..0.1)
sphere_radius = Slider(0.07, range=0..0.1)
load_scale_2 = Slider(0.1, range=0..1)
num_5 = Number(Slider(2.1, range=0..10))
num_6 = Number(load_min_2)
num_7 = Number(dash_length)
num_8 = Number(sphere_radius)

# ----
number_slider_12 = Slider(0.001, range=0..0.001)
cem_colors = CEMColors()  # -> color_tension, color_compression, color_edge, color_node, color_node_support, color_node_origin, color_load, color_reaction, color_trail, color_auxiliary_trail
#   port color_tension: The color for edges under a tension force.
#   port color_compression: The color for edges under a compression force.
#   port color_edge: The color for a regular edge.
#   port color_node: The color for a regular node.
#   port color_node_support: The color for a support node.
#   port color_node_origin: The color for an origin node.
#   port color_load: The color for an applied load.
#   port color_reaction: The color for a reaction force.
#   port color_trail: The color to paint a trail.
#   port color_auxiliary_trail: The color to paint an auxiliary trail.
# ---------- cem_colors: Python ----------
"""
Get the artists color scheme for the objects of the CEM framework.
"""
from ghpythonlib.componentbase import executingcomponent as component

from compas_cem import COLORS
import rhinoscriptsyntax as rs


class ArtistColorsComponent(component):
    def RunScript(self):
        colors = {key: rs.CreateColor(c) for key, c in COLORS.items()}

        color_tension = colors["tension"]
        color_compression = colors["compression"]
        color_edge = colors["edge"]
        color_node = colors["node"]
        color_node_support = colors["node_support"]
        color_node_origin = colors["node_origin"]
        color_load = colors["load"]
        color_reaction = colors["support_force"]
        color_trail = colors["trail"]
        color_auxiliary_trail = colors["auxiliary_trail"]

        colors = (color_tension, color_compression, color_edge, color_node, color_node_support, color_node_origin, color_load, color_reaction, color_trail, color_auxiliary_trail)

        return colors
# ---------- end cem_colors ----------
entwine_2 = Entwine(Branch00=cem_colors.color_node_origin, Branch01=cem_colors.color_node_support, FlattenInputs=True)
merge_5 = Merge(Data1=cem_colors.color_compression, Data2=cem_colors.color_tension)
col = Colour(cem_colors.color_auxiliary_trail)
col_2 = Colour(entwine_2)
col_3 = Colour(cem_colors.color_load)
cem_colors_2 = CEMColors()  # -> color_tension, color_compression, color_edge, color_node, color_node_support, color_node_origin, color_load, color_reaction, color_trail, color_auxiliary_trail; same code as cem_colors
merge_6 = Merge(Data1=cem_colors_2.color_compression, Data2=cem_colors_2.color_tension)
col_4 = Colour(cem_colors_2.color_load)

# ---- group: File metadata
family_name = Panel("cable_stayed")
is_3d = BooleanToggle(False)
base_directory = Panel("C:\Users\Mark\Documents\GitHub\cem_dataset\bridges\37_cable_stayed")
txt = Text(family_name)
txt_2 = Text(base_directory)
bool = Boolean(is_3d)

# ----
export_topology_json = BooleanToggle(True)
export_form_json = BooleanToggle(False)
bool_2 = Boolean(export_topology_json)
bool_3 = Boolean(export_form_json)

save_topology_pdf = BooleanToggle(True)
save_form_pdf = BooleanToggle(False)
bool_4 = Boolean(save_topology_pdf)
bool_5 = Boolean(save_form_pdf)

# ---- group: Make2D - Camera plane
update_camera_plane = Button()
camera_plane_index = Slider(0, range=0..1)
bool_6 = Boolean(update_camera_plane)
int_2 = Integer(camera_plane_index)

# ----
reaction_scale = Slider(0.1, range=0..4)

# ---- group: PDF Controls
edge_width = Slider(2, range=0..5)
node_radius = Slider(0.05, range=0..0.5)
node_edgeweight = Slider(1.5, range=0..5)
arrow_width = Slider(1.5, range=0..5)
load_scale_3 = Slider(3.6, range=0..4)
load_gap = Slider(0.07, range=0..2)
reaction_gap = Slider(0.07, range=0..1)
extra_segments_lineweight = Panel("dotted")
extra_segments_line_thickness_form = Panel("0.75")
extra_segments_line_color_form = Panel("120, 120, 120")
num_9 = Number(edge_width)
num_10 = Number(node_radius)
num_11 = Number(node_edgeweight)
num_12 = Number(arrow_width)
num_13 = Number(load_scale_3)
num_14 = Number(load_gap)
num_15 = Number(reaction_scale)
txt_3 = Text(extra_segments_lineweight)
num_16 = Number(reaction_gap)
num_17 = Number(extra_segments_line_thickness_form)
txt_4 = Text(extra_segments_line_color_form)

# ---- group: COMPAS-based Make2D
int_3 = Integer(int_2)
bool_7 = Boolean(bool_6)
viewports = ViewportProperties(Update=bool_7, AutoUpdate=False)  # -> ViewportNames, ActiveViewportIndex, ViewportBounds, ViewportDisplayMode, CameraLocation, CameraTarget, CameraPlane, CameraLensLength, CameraProjection, CameraUp
item_4 = ListItem(List=viewports.CameraPlane, Index=int_3, Wrap=True)
panel = Panel(viewports.ViewportNames)
pln = Plane(item_4)
panel_2 = Panel(pln)

# ----
pt_5 = Point([Point(-5, -3.425166865, 1.5), Point(5, -3.425166865, 1.5)])
crv_5 = Curve([flip_3, flip_2])
neg_6 = Negative(Value=number_slider_8)
neg_7 = Negative(Value=Slider(0.1, range=0..0.1))
Z_2 = UnitZ(Factor=neg_7)
lineload = GhPythonScript(line=flatten(crv_4), load_vector=Z_2)  # -> out, point, vector; inputs line: list of Line, load_vector: Vector3d
# ---------- lineload: Python ----------
from compas_rhino.geometry import RhinoLine
from compas_rhino.geometry import RhinoVector

from compas.geometry import add_vectors
from compas.geometry import scale_vector

from compas.utilities import geometric_key

import rhinoscriptsyntax as rs

gkey_xyz = {}
gkey_load = {}

load_vector = RhinoVector.from_geometry(load_vector).to_compas()

for ln in line:
    ln = RhinoLine.from_geometry(ln).to_compas()
    
    # calculate load on line end-points    
    lvec = scale_vector(load_vector, ln.length * 0.5)
    
    for pt in ln:
        gkey = geometric_key(pt)
        gkey_xyz[gkey] = pt
        
        if gkey in gkey_load:
            gkey_load[gkey] = add_vectors(gkey_load[gkey], lvec)
        else:
            gkey_load[gkey] = lvec

point = []
vector = []

for gkey, xyz in gkey_xyz.items():
    point.append(rs.AddPoint(*xyz))
    vector.append(rs.AddPoint(*gkey_load[gkey]))
# ---------- end lineload ----------
nodeload = NodeLoad(point=lineload.point, vector=lineload.vector)  # -> node_load; inputs point: Point3d, vector: Vector3d
#   port point: The position of the node where to apply the load.
#   port vector: The load vector.
#   port node_load: A COMPAS CEM node load.
# ---------- nodeload: Python ----------
"""
Create a load vector to be applied at a node.
"""
from ghpythonlib.componentbase import executingcomponent as component

from compas_cem.loads import NodeLoad


class NodeLoadComponent(component):
    def RunScript(self, point, vector):
        if point and vector:
            return NodeLoad.from_rhino_point_and_vector(point, vector)
# ---------- end nodeload ----------

bang_2 = ExplodeTree(Data=crv_5)
merge_7 = Merge(Data1=pt_5, Data2=end_4.End)  # -> flatten(Result)
bang_3 = ExplodeTree(Data=crv_5)  # -> _0000, _0001, _0002, _0003
neg_8 = Negative(Value=Slider(20, range=0..20))
deviationedge_2 = DeviationEdge(line=deck_near_supports, force=neg_8)  # -> deviation_edge; inputs line: Line; same code as deviationedge

deviationedge_3 = DeviationEdge(line=[bang_3._0001, bang_3._0002, bang_3._0003], force=number_slider_8)  # -> deviation_edge; inputs line: Line; disabled; same code as deviationedge
nodesupport = NodeSupport(point=flatten(merge_7))  # -> node_support; inputs point: Point3d
#   port point: The position of the node where to assign a support.
#   port node_support: A COMPAS CEM node support.
# ---------- nodesupport: Python ----------
"""
Create a node support from a rhino point.
"""
from ghpythonlib.componentbase import executingcomponent as component

from compas_cem.supports import NodeSupport


class NodeSupportComponent(component):
    def RunScript(self, point):
        if point:
            return NodeSupport.from_rhino_point(point)
# ---------- end nodesupport ----------
merge_8 = Merge(Data1=deviationedge_2, Data2=deviationedge, Data4=deviationedge_3)  # -> flatten(Result)

# ---- group: Build topology diagram and trails
topologydiagram = TopologyDiagram(trail_edges=merge_4, deviation_edges=merge_8, loads=nodeload, supports=nodesupport)  # -> topology; inputs nodes: list, trail_edges: list, deviation_edges: list, loads: list, supports: list
#   port nodes: A list of COMPAS CEM nodes to add to the diagram.
#   port trail_edges: A list of COMPAS CEM trail edges to add to the diagram.
#   port deviation_edges: A list of COMPAS CEM deviation edges to add to the diagram.
#   port loads: A list of COMPAS CEM loads to add to the diagram.
#   port supports: A list of COMPAS CEM supports to add to the diagram.
#   port topology: A COMPAS CEM topology diagram.
# ---------- topologydiagram: Python ----------
"""
Build a topology diagram.
"""
from ghpythonlib.componentbase import executingcomponent as component

from compas_cem.diagrams import TopologyDiagram


class BuildTopologyDiagramComponent(component):
    def RunScript(self, nodes, trail_edges, deviation_edges, loads, supports):

        topology = TopologyDiagram()

        if nodes:
            for node in nodes:
                topology.add_node(node)

        if trail_edges is not None:
            for trail_edge in trail_edges:
                topology.add_edge(trail_edge)

        if deviation_edges:
            for deviation_edge in deviation_edges:
                topology.add_edge(deviation_edge)

        if loads:
            for load in loads:
                topology.add_load(load)

        if supports:
            for support in supports:
                topology.add_support(support)

        return topology
# ---------- end topologydiagram ----------
Z_3 = UnitZ(Factor=1)
buildtrails = BuildTrails(topology=topologydiagram, add_auxiliary_trails=Toggle(True), auxiliary_trail_length="0.33", auxiliary_trail_vector=Z_3)  # -> topology, trails, auxiliary_trails; inputs add_auxiliary_trails: Boolean, auxiliary_trail_vector: Vector3d
#   port topology: A COMPAS CEM topology diagram.
#   port add_auxiliary_trails: Append auxiliary trail edges to the free nodes of the topology diagram. Defaults to False.
#   port auxiliary_trail_length: The length of the auxiliary trail edges to add. Defaults to 1.0.
#   port auxiliary_trail_vector: The direction to which the auxiliary trail edges will initially point to. Defaults to [1.0, 1.0, 1.0].
#   port topology: The input topology diagram. But now with computed trails.
#   port trails: The keys of the nodes in each of the found trails.
#   port auxiliary_trails: The keys of the appended auxiliary trail edges.
# ---------- buildtrails: Python ----------
"""
Automatically find the trails in a topology diagram. The diagram is modified in-place.
"""
from ghpythonlib.componentbase import executingcomponent as component

from compas_rhino.geometry import RhinoVector


class BuildTopologyDiagramComponent(component):
    def RunScript(self, topology, add_auxiliary_trails, auxiliary_trail_length, auxiliary_trail_vector):
        add_auxiliary_trails = add_auxiliary_trails or False

        if topology:

            topology = topology.copy()

            if auxiliary_trail_length:
                topology.auxiliary_trail_length = auxiliary_trail_length
            if auxiliary_trail_vector:
                topology.auxiliary_trail_vector = RhinoVector.from_geometry(auxiliary_trail_vector).to_compas()

            topology.build_trails(add_auxiliary_trails)

            trails = list(topology.trails())
            auxiliary_trails = list(topology.auxiliary_trail_edges())

            return topology, trails, auxiliary_trails
# ---------- end buildtrails ----------

# ---- group: Optimization parameters
topologydisassembly = DisassembleTopologyDiagram(topology=buildtrails.topology)  # -> nodes, origin_nodes, support_nodes, edges, trail_edges, deviation_edges, trails, auxiliary_trails
#   port topology: A COMPAS CEM topology diagram.
#   port nodes: All the node keys in the topology diagram.
#   port origin_nodes: The keys of the origin nodes in the topology diagram.
#   port support_nodes: The keys of the support nodes in the topology diagram.
#   port edges: All the edge keys in the topology diagram.
#   port trail_edges: The keys of the trail edges in the topology diagram.
#   port deviation_edges: The keys of the deviation edges in the topology diagram.
#   port trails: The trails in the topology diagram.
#   port auxiliary_trails: The auxiliary trails in the topology diagram.
# ---------- topologydisassembly: Python ----------
"""
Disassemble a topology diagram into its constituent parts.
"""
from ghpythonlib.componentbase import executingcomponent as component


class TopologyDisassemblyComponent(component):
    def RunScript(self, topology):
        if topology:
            trails = list(topology.trails())
            auxiliary_trails = list(topology.auxiliary_trails())

            edges = list(topology.edges())
            trail_edges = list(topology.trail_edges())
            deviation_edges = list(topology.deviation_edges())

            nodes = list(topology.nodes())
            origin_nodes = list(topology.origin_nodes())
            support_nodes = list(topology.support_nodes())

            return nodes, origin_nodes, support_nodes, edges, trail_edges, deviation_edges, trails, auxiliary_trails
# ---------- end topologydisassembly ----------
deviationedgeforceparameter = DeviationEdgeForceParameter(edge_key=topologydisassembly.deviation_edges, bound_low="3000", bound_up="3000")  # -> parameter
#   port edge_key: The key of a COMPAS CEM deviation edge.
#   port bound_low: The lower bound of the edge optimization parameter. Calculated as the initial edge parameter minus the absolute value of this bound.
#   port bound_up: The upper bound of the edge optimization parameter. Calculated as the initial edge parameter plus the absolute value of this bound.
#   port parameter: A COMPAS CEM deviation edge force parameter.
# ---------- deviationedgeforceparameter: Python ----------
"""
Set the force of a deviation edge as an optimization parameter.
"""
from ghpythonlib.componentbase import executingcomponent as component

from compas_cem.optimization import DeviationEdgeParameter


class DeviationEdgeParameterComponent(component):
    def RunScript(self, edge_key, bound_low, bound_up):
        if edge_key and bound_low is not None and bound_up is not None:
            return DeviationEdgeParameter(edge_key, bound_low, bound_up)
# ---------- end deviationedgeforceparameter ----------

# ---- group: topology
data = Data(buildtrails.topology)

# 02 Visualize Diagrams
data_2 = Data(data)

# ---- group: Inputs / Topology
data_3 = Data(data)

# ---- group: COMPAS-based Make2D
xy = XYPlane(Origin=Point(0, 0, 0))
data_4 = Data(data_3)
pln_2 = Plane(pln)
orient_and_project = GhPythonScript(topology=data_4, initial_plane=pln_2, target_plane=xy)  # -> out, topology_transformed; inputs initial_plane: Plane, target_plane: Plane
# ---------- orient_and_project: Python ----------
from compas_rhino.geometry import RhinoPlane
from compas.geometry import Transformation
from compas.geometry import Projection
from compas.geometry import Frame
from compas.geometry import transform_vectors
from compas.datastructures import network_transformed

# Build frames from rhino planes
frames = []
for plane in (initial_plane, target_plane):
    plane = RhinoPlane.from_geometry(plane)
    frame = Frame(plane.point, plane.xaxis, plane.yaxis)
    frames.append(frame)    
fa, fb = frames

# Re-orient node positions
transf = Transformation.from_frame_to_frame(fa, fb)
topology_transformed = network_transformed(topology, transf)

# Squash node positions to plane
z = fb.point.z
for node in topology_transformed.nodes():
    topology_transformed.node_attribute(node, "z", z)
# ---------- end orient_and_project ----------
data_5 = Data(orient_and_project.topology_transformed)

# ----
num_18 = Number(num_13)
data_6 = Data(data_5)
topologyartist = TopologyArtist(topology=data_6, load_scale=num_18)  # -> nodes, origin_nodes, support_nodes, edges, trail_edges, deviation_edges, loads; inputs node: list of Int32, edge: list
#   port topology: A COMPAS CEM topology diagram.
#   port node: A selection of the nodes in the diagram. Defaults to all the nodes.
#   port edge: A selection of the edges in the diagram. Defaults to all the edges.
#   port load_min: The minimum load magnitude to plot. Defaults to 1e-3.
#   port load_scale: The scaling factor of the loads. Defaults to 1.
#   port nodes: The nodes in the diagram as points.
#   port origin_nodes: The origin nodes in the diagram as points.
#   port support_nodes: The position of the support nodes in the diagram.
#   port edges: The edges in the diagram as lines.
#   port trail_edges: The trail edges in the diagram as lines.
#   port deviation_edges: The deviation edges in the diagram as lines.
#   port loads: The applied node loads as lines.
# ---------- topologyartist: Python ----------
"""
Draw a topology diagram.
"""
from ghpythonlib.componentbase import executingcomponent as component

from compas_cem.ghpython import TopologyArtist


class TopologyArtistComponent(component):
    def RunScript(self, topology, node, edge, load_min, load_scale):
        node = node or None
        edge = edge or None
        load_min = load_min or 1e-3
        load_scale = load_scale or 1.0
        if topology:
            artist = TopologyArtist(topology)

            nodes = artist.draw_nodes(node)
            origin_nodes = artist.draw_nodes_origin(node)
            support_nodes = artist.draw_nodes_support(node)

            edges = artist.draw_edges(edge)
            trail_edges = artist.draw_edges_trail(edge)
            deviation_edges = artist.draw_edges_deviation(edge)

            loads = artist.draw_loads(node, min_load=load_min, scale=load_scale)

            return nodes, origin_nodes, support_nodes, edges, trail_edges, deviation_edges, loads
# ---------- end topologyartist ----------
clean = CleanTree(RemoveNulls=True, RemoveInvalid=True, RemoveEmpty=False, Tree=[topologyartist.edges, topologyartist.loads])
python_2 = GhPythonScript(segment=clean)  # -> out, segment; inputs segment: list
# ---------- python_2: Python ----------
from compas_rhino.utilities import get_line_coordinates


segment = get_line_coordinates(segment)
# ---------- end python_2 ----------
data_7 = Data(python_2.segment)

data_8 = Data(data_7)
txt_5 = Text(txt_4)
txt_6 = Text(txt_3)
num_19 = Number(num_17)
lng = ListLength(List=data_8)
python_3 = GhPythonScript(D=flatten(txt_5), L=flatten(lng))  # -> out, color; inputs D: list, L: list of Int32
# ---------- python_3: Python ----------
color = []

for d, l in zip(D, L):
    
    d = [int(n) for n in d.split(", ")]
    c = [d] * l
    color.extend(c)
# ---------- end python_3 ----------
repeat_2 = RepeatData(Data=num_19, Length=lng)
repeat_3 = RepeatData(Data=txt_6, Length=lng)
data_9 = Data(python_3.color)
txt_7 = Text(repeat_3)
num_20 = Number(repeat_2)

rev = Reverse(Vector=Z_3)
nodesearch = NodeSearch(diagram=buildtrails.topology, point=pt_5)  # -> node; inputs point: list of Point3d
#   port diagram: A COMPAS CEM topology or form diagram.
#   port point: The points to search for in the diagram.
#   port node: The node keys.
# ---------- nodesearch: Python ----------
"""
Search a node key in a topology or a form diagram using a point.
"""
from ghpythonlib.componentbase import executingcomponent as component

from compas.utilities import geometric_key
from compas_rhino.geometry import RhinoPoint


class NodeSearchComponent(component):
    def RunScript(self, diagram, point):
        if point and diagram:
            node = []
            for pt in point:
                pt = RhinoPoint.from_geometry(pt).to_compas()
                gkey = geometric_key(pt, diagram.tol)
                node.append(diagram.gkey_node[gkey])
            return node
# ---------- end nodesearch ----------
formfinding = FormFinding(topology=buildtrails.topology)  # -> form; inputs tmax: Int32
#   port topology: A COMPAS CEM topology diagram.
#   port tmax: The maximum number of iterations to run the form-finding algorithm for. Defaults to 100.
#   port eps_min: The convergence threshold of the form-finding algorithm. Default to 1e-6.
#   port form: A COMPAS CEM form diagram in static equilibrium.
# ---------- formfinding: Python ----------
"""
Generate a form diagram in static equilibrium.
"""
from ghpythonlib.componentbase import executingcomponent as component

from compas_cem.equilibrium import static_equilibrium


class FormFindingComponent(component):
    def RunScript(self, topology, tmax, eta_min):
        tmax = tmax or 100
        eta_min = eta_min or 1e-6
        if topology:
            return static_equilibrium(topology, tmax=tmax, eta=eta_min)
# ---------- end formfinding ----------

# ---- group: Optimization goal constraints
trailedgeforceconstraint = TrailEdgeForceConstraint(edge_key=buildtrails.auxiliary_trails, force="0.0")  # -> constraint
#   port edge_key: The key of a COMPAS CEM trail edge.
#   port force: The target force.
#   port weight: The weight of the constraint in the optimization problem. Defaults to one.
#   port constraint: A COMPAS CEM trail force constraint.
# ---------- trailedgeforceconstraint: Python ----------
"""
Make the force on a trail edge to reach a goal force value.
"""
from ghpythonlib.componentbase import executingcomponent as component

from compas_cem.optimization import TrailEdgeForceConstraint


class TrailEdgeForceConstraintComponent(component):
    def RunScript(self, edge_key, force, weight):
        weight = weight or 1.0
        if edge_key and force is not None:
            return TrailEdgeForceConstraint(edge_key, force, weight)
# ---------- end trailedgeforceconstraint ----------
topologydisassembly_2 = DisassembleTopologyDiagram(topology=topologydiagram)  # -> nodes, origin_nodes, support_nodes, edges, trail_edges, deviation_edges, trails, auxiliary_trails; same code as topologydisassembly
pointconstraint = PointConstraint(node_key=nodesearch, point=merge_7)  # -> constraint; inputs node_key: Int32, point: Point3d; disabled
#   port node_key: The key of a COMPAS CEM node.
#   port point: The target point.
#   port weight: The weight of the constraint in the optimization problem. Defaults to one.
#   port constraint: A COMPAS CEM node point constraint.
# ---------- pointconstraint: Python ----------
"""
Pull the position of a node to a target point.
"""
from ghpythonlib.componentbase import executingcomponent as component

from compas_cem.optimization import PointConstraint
from compas_rhino.geometry import RhinoPoint


class PointConstraintComponent(component):
    def RunScript(self, node_key, point, weight):
        weight = weight or 1.0
        if node_key is not None and point:
            point = RhinoPoint.from_geometry(point).to_compas()
            return PointConstraint(node_key, point, weight)
# ---------- end pointconstraint ----------
entwine_3 = Entwine(Branch00=pointconstraint, Branch01=trailedgeforceconstraint, FlattenInputs=True)  # -> flatten(Result)

# ----
constrainedformfinding = ConstrainedFormFinding(
    topology=buildtrails.topology,
    constraints=entwine_3,
    parameters=deviationedgeforceparameter,
    iters_max="400",
    eps="1e-6")  # -> form, penalty, iters, time; inputs constraints: list, parameters: list, iters_max: Int32; disabled
#   port topology: A COMPAS CEM topology diagram.
#   port constraints: A list of COMPAS CEM optimization constraints.
#   port parameters: A list of COMPAS CEM optimization parameters.
#   port algorithm: The name of the optimization algorithm to use.
#   port iters_max: The maximum number of iterations to run the optimization algorithm for.
#   port eps: The minimum penalty value to declare convergence.
#   port form: A COMPAS CEM form diagram in static equilibrium.
#   port penalty: The penalty score after optimization.
#   port iters: The elapsed number of iterations.
#   port time: The optimization elapsed time.
# ---------- constrainedformfinding: Python ----------
"""
Generate a form diagram in static equilibrium.
"""
from ghpythonlib.componentbase import executingcomponent as component

from compas_cem import PROXY_PORT

from compas.rpc import Proxy


class ConstrainedFormFindingComponent(component):
    def RunScript(self, topology, constraints, parameters, algorithm, iters_max, eps):
        algorithm = algorithm or "LD_SLSQP"
        iters_max = iters_max or 100
        eps = eps or 1e-6

        if topology and constraints and parameters:
            topology = topology.copy()

            with Proxy("compas_cem.optimization", port=PROXY_PORT) as opt:
                form, penalty, iters, time = opt.solve_nlopt_proxy(topology,
                                                                   constraints,
                                                                   parameters,
                                                                   algorithm,
                                                                   iters_max,
                                                                   eps)
            return form, penalty, iters, time
# ---------- end constrainedformfinding ----------
panel_3 = Panel(constrainedformfinding.penalty)
panel_4 = Panel(constrainedformfinding.iters)

# ---- group: constrained form
data_10 = Data(constrainedformfinding.form)

# ---- group: form
data_11 = Data(formfinding)

data_12 = Data(data_11)

# ---- group: constrained form
data_13 = Data(data_10)

# ----
filter_4 = StreamFilter(Gate=view_constrained_form, Stream0=data_12, Stream1=data_13)
data_14 = Data(filter_4)

# ---- group: Inputs / Constrained Form
data_15 = Data(data_14)

# ----
data_16 = Data(data_3)
bool_8 = Boolean(bool)
txt_8 = Text(txt)
txt_9 = Text(txt_2)
data_17 = Data(data_15)
bool_9 = Boolean(bool)
txt_10 = Text(txt)
txt_11 = Text(txt_2)
nameschema = GhPythonScript(topology=data_16, is_3d=bool_8, family_name=txt_8, base_dir=txt_9)  # -> out, filepath; inputs is_3d: Boolean
# ---------- nameschema: Python ----------
"""familyname_diagram_2dor3d_numnodes_numsupports_numloads_numedges_numtrailedges_numdeviationedges_numauxtrails"""


import os

from compas_cem.diagrams import TopologyDiagram
from compas_cem.diagrams import FormDiagram


diagram = topology
# find out diagram type
cls = diagram.__class__.__name__
if cls == "TopologyDiagram":
    diagram_name = "T"

# check dimensionality
if is_3d:
    dim = "3d"
else:
    dim = "2d"
    
# get data from diagram
numnodes = str(len(list(diagram.nodes())))    
numsupports = str(len(list(diagram.support_nodes())))
numloads = str(len(list(diagram.loaded_nodes())))

numedges = str(len(list(diagram.edges())))
numtrailedges = str(len(list(diagram.trail_edges())))
numdeviationedges = str(len(list(diagram.deviation_edges())))
numauxtrails = str(len(list(diagram.auxiliary_trails()))) 
    
schema = (family_name, diagram_name, dim, numnodes, numsupports, numloads, numedges, numtrailedges, numdeviationedges, numauxtrails)
schema = "_".join(schema)
base_dir = os.path.abspath(base_dir)
filepath = os.path.abspath(os.path.join(base_dir, family_name, dim, schema))
# ---------- end nameschema ----------
nameschema_2 = GhPythonScript(form=data_17, is_3d=bool_9, family_name=txt_10, base_dir=txt_11)  # -> out, filepath; inputs is_3d: Boolean
# ---------- nameschema_2: Python ----------
"""familyname_diagram_2dor3d_numnodes_numsupports_numloads_numedges_numtrailedges_numdeviationedges_numauxtrails"""


import os

from compas_cem.diagrams import TopologyDiagram
from compas_cem.diagrams import FormDiagram


diagram = form
# find out diagram type
cls = diagram.__class__.__name__
if cls == "FormDiagram":
    diagram_name = "F"

# check dimensionality
if is_3d:
    dim = "3d"
else:
    dim = "2d"
    
# get data from diagram
numnodes = str(len(list(diagram.nodes())))    
numsupports = str(len(list(diagram.support_nodes())))
numloads = str(len(list(diagram.loaded_nodes())))
numedges = str(len(list(diagram.edges())))
    
schema = (family_name, diagram_name, dim, numnodes, numsupports, numloads, numedges)
schema = "_".join(schema)
base_dir = os.path.abspath(base_dir)
filepath = os.path.abspath(os.path.join(base_dir, family_name, dim, schema))
# ---------- end nameschema_2 ----------
txt_12 = Text(nameschema.filepath)
txt_13 = Text(nameschema_2.filepath)

# ---- group: COMPAS-based Make2D
xy_2 = XYPlane(Origin=Point(0, 0, 0))
data_18 = Data(data_15)
pln_3 = Plane(pln)
orient_and_project_2 = GhPythonScript(form=data_18, initial_plane=pln_3, target_plane=xy_2)  # -> out, form_transformed; inputs initial_plane: Plane, target_plane: Plane
# ---------- orient_and_project_2: Python ----------
from compas_rhino.geometry import RhinoPlane
from compas.geometry import Transformation
from compas.geometry import Projection
from compas.geometry import Frame
from compas.geometry import transform_vectors
from compas.datastructures import network_transformed

# Build frames from rhino planes
frames = []
for plane in (initial_plane, target_plane):
    plane = RhinoPlane.from_geometry(plane)
    frame = Frame(plane.point, plane.xaxis, plane.yaxis)
    frames.append(frame)    
fa, fb = frames

# Re-orient node positions
transf = Transformation.from_frame_to_frame(fa, fb)
form_transformed = network_transformed(form, transf)

# Squash node positions to plane
z = fb.point.z
for node in form_transformed.nodes():
    form_transformed.node_attribute(node, "z", z)
    

# Re-orient and squash loads
for node in form_transformed.nodes():
    # loads
    load = form_transformed.node_load(node)
    loadt = transform_vectors([load], transf).pop()
    form_transformed.node_attributes(node, ("qx", "qy", "qz"), loadt)
    
    # reaction force
    reaction = form_transformed.reaction_force(node)
    reactiont = transform_vectors([reaction], transf).pop()
    form_transformed.node_attributes(node, ("rx", "ry", "rz"), reactiont)
# ---------- end orient_and_project_2 ----------
data_19 = Data(orient_and_project_2.form_transformed)
data_20 = Data(data_19)
python_4 = GhPythonScript(form=data_20, reaction_min="0.001")  # -> out, form
# ---------- python_4: Python ----------
from compas.geometry import length_vector


nodes = list(form.nodes())


for node in nodes:
    if form.is_node_support(node) and length_vector(form.reaction_force(node)) <= reaction_min:
        form.delete_node(node)
# ---------- end python_4 ----------
data_21 = Data(python_4.form)

# ----
txt_14 = Text(txt_13)
num_21 = Number(flatten(num_20))
txt_15 = Text(flatten(txt_7))
bool_10 = Boolean(bool_4)
num_22 = Number(num_9)
num_23 = Number(num_10)
data_22 = Data(data_5)
num_24 = Number(num_11)
num_25 = Number(num_11)
txt_16 = Text(txt_12)
bool_11 = Boolean(bool_5)
data_23 = Data(data_21)
num_26 = Number(num_11)
num_27 = Number(num_13)
num_28 = Number(num_9)
num_29 = Number(num_10)
num_30 = Number(num_12)
num_31 = Number(num_14)
num_32 = Number(num_15)
num_33 = Number(num_16)
data_24 = Data(data_7)
data_25 = Data(data_9)
concat = Concatenate(FragmentA=txt_14, FragmentB=".pdf")
division_2 = Division(A=num_25, B=2)
concat_2 = Concatenate(FragmentA=txt_16, FragmentB=".pdf")
python_5 = GhPythonScript(
    save_file=bool_10,
    topology=data_22,
    edge_width=num_22,
    node_radius=num_23,
    node_edgewidth=num_24,
    load_width=division_2,
    load_radius=num_23,
    fig_width="16",
    fig_height="9",
    fig_dpi="100",
    filepath=concat_2)  # -> out; inputs save_file: Boolean, fig_width: Int32, fig_height: Int32, fig_dpi: Int32
# ---------- python_5: Python ----------
from compas.rpc import Proxy


kwargs = {"topology": topology,
          "filepath": filepath,
          "edge_width": edge_width,
          "node_radius": node_radius,
          "node_edgewidth": node_edgewidth,
          "load_width": load_width,
          "load_radius": load_radius,
          "fig_width": fig_width,
          "fig_height": fig_height,
          "fig_dpi": fig_dpi}


if save_file:
    with Proxy("compas_cem.plotters") as plotters:
        data = plotters.topology_plotter_proxy(**kwargs)
        
    print("Done!")
    print(data)
# ---------- end python_5 ----------
python_6 = GhPythonScript(
    save_file=bool_11,
    form=data_23,
    edge_width=num_28,
    node_radius=num_29,
    node_edgewidth=num_26,
    load_width=num_30,
    load_scale=num_27,
    load_gap=num_31,
    reaction_width=num_30,
    reaction_scale=num_32,
    reaction_gap=num_33,
    segment=data_24,
    segment_color=data_25,
    segment_width=num_21,
    segment_ls=txt_15,
    fig_width="16",
    fig_height="9",
    fig_dpi="100",
    filepath=concat)  # -> out; inputs save_file: Boolean, segment: list, segment_color: list, segment_width: list, segment_ls: list, fig_width: Int32, fig_height: Int32, fig_dpi: Int32
# ---------- python_6: Python ----------
from compas.rpc import Proxy


kwargs = {"form": form,
          "filepath": filepath,
          "edge_width": edge_width,
          "node_radius": node_radius,
          "node_edgewidth": node_edgewidth,
          "load_width": load_width,
          "load_scale": load_scale,
          "load_gap": load_gap,
          "reaction_width": reaction_width,
          "reaction_scale": reaction_scale,
          "reaction_gap": reaction_gap,
          "segment": segment,
          "segment_color": segment_color,
          "segment_width": segment_width,
          "segment_ls": segment_ls,
          "fig_width": fig_width,
          "fig_height": fig_height,
          "fig_dpi": fig_dpi}


if save_file:
    with Proxy("compas_cem.plotters") as plotters:
        plotters.form_plotter_proxy(**kwargs)
        
    print("Done!")
# ---------- end python_6 ----------
panel_5 = Panel(python_5)
panel_6 = Panel(python_6)

txt_17 = Text(txt_12)
txt_18 = Text(txt_13)
bool_12 = Boolean(bool_2)
data_26 = Data(data_3)
bool_13 = Boolean(bool_3)
data_27 = Data(data_15)
exportjson = GhPythonScript(export=bool_12, diagram=data_26, filepath=txt_17)  # -> out
# ---------- exportjson: Python ----------
if export:
    diagram.to_json(filepath + ".json")
    
    print("Exported file to {}!".format(filepath + ".json"))
# ---------- end exportjson ----------
exportjson_2 = GhPythonScript(export=bool_13, diagram=data_27, filepath=txt_18)  # -> out; same code as exportjson
panel_7 = Panel(exportjson_2)
panel_8 = Panel(exportjson)

num_34 = Number(num_4)
num_35 = Number(num_2)
num_36 = Number(num_3)
int_4 = Integer(int)
data_28 = Data(data_14)
col_5 = Colour(col_4)
swatch = ColourSwatch(SwatchColor=RGBA(156, 156, 156, 195))

num_37 = Number(num_35)
int_5 = Integer(int_4)
data_29 = Data(data_28)
num_38 = Number(num_34)
num_39 = Number(num_36)
formartist = FormArtist(form=data_29, force_min=num_38, force_scale=num_39)  # -> nodes, support_nodes, edges, loads, reactions; inputs node: list of Int32, edge: list
#   port form: A COMPAS CEM topology diagram.
#   port node: A selection of the nodes in the diagram. Defaults to all the nodes.
#   port edge: A selection of the edges in the diagram. Defaults to all the edges.
#   port force_min: The smallest force magnitude to draw. Defaults to 1e-3
#   port force_scale: The scale of the loads and the reactions. Defaults to 1.
#   port nodes: The nodes of the diagram as points.
#   port support_nodes: The support nodes of the diagram as points
#   port edges: The edges of the diagram as lines.
#   port loads: The applied loads as lines.
#   port reactions: The reaction forces at the supports, as lines.
# ---------- formartist: Python ----------
"""
Draw a form diagram.
"""
from ghpythonlib.componentbase import executingcomponent as component

from compas_cem.ghpython import FormArtist


class FormArtistComponent(component):
    def RunScript(self, form, node, edge, force_min, force_scale):
        force_min = force_min or 1e-3
        force_scale = force_scale or 1
        if form:
            artist = FormArtist(form)

            nodes = artist.draw_nodes(node)
            edges = artist.draw_edges(edge)
            support_nodes = artist.draw_nodes_support(node)

            loads = artist.draw_loads(node, min_load=force_min, scale=force_scale)
            reactions = artist.draw_reactions(node, min_force=force_min, scale=force_scale)

            return nodes, support_nodes, edges, loads, reactions
# ---------- end formartist ----------
edgeresults = EdgeResults(form=data_29)  # -> length, force; inputs edge: list
#   port form: A COMPAS CEM form diagram.
#   port edge: A selection of edge keys to query the results on. Defaults to all the edges.
#   port length: The edge lengths.
#   port force: The edge forces.
# ---------- edgeresults: Python ----------
"""
Extract the post form-finding results of the edges in a form diagram.
"""
from ghpythonlib.componentbase import executingcomponent as component


class EdgeResultsComponent(component):
    def RunScript(self, form, edge):
        if form:
            edge = edge or list(form.edges())
            length = [form.edge_length_2(ed) for ed in edge]
            force = [form.edge_force(ed) for ed in edge]
            return length, force
# ---------- end edgeresults ----------
formdisassembly = DisassembleFormDiagram(form=data_29)  # -> nodes, support_nodes, edges
#   port form: A COMPAS CEM form diagram.
#   port nodes: All the node keys in the form diagram.
#   port support_nodes: The keys of the support nodes in the form diagram.
#   port edges: All the edge keys in the form diagram.
# ---------- formdisassembly: Python ----------
"""
Disassemble a form diagram into its constituent parts.
"""
from ghpythonlib.componentbase import executingcomponent as component


class FormDisassemblyComponent(component):
    def RunScript(self, form):
        if form:
            edges = list(form.edges())
            nodes = list(form.nodes())
            support_nodes = list(form.support_nodes())

            return nodes, support_nodes, edges
# ---------- end formdisassembly ----------
larger = LargerThan(FirstNumber=edgeresults.force, SecondNumber=0)  # -> LargerThan, OrEqualTo
abs = Absolute(Value=edgeresults.force)
filter_5 = StreamFilter(Gate=int_5, Stream0=edgeresults.force, Stream1=edgeresults.length)
item_5 = ListItem(List=merge_6, Index=larger.OrEqualTo, Wrap=True)
multiplication_2 = Multiplication(A=abs, B=num_37)
python_7 = GhPythonScript(x=filter_5)  # -> out, a
# ---------- python_7: Python ----------
a = round(x, 3)
# ---------- end python_7 ----------
int_6 = Integer(formdisassembly.nodes)
pt_6 = Point(formartist.nodes)
crv_6 = Curve(formartist.edges)
crv_7 = Curve(formartist.loads)
num_40 = Number(python_7.a)
data_30 = Data(formdisassembly.edges)
crv_8 = Curve(formartist.loads)
crv_9 = Curve(formartist.reactions)
col_6 = Colour(item_5)
num_41 = Number(multiplication_2)

pt_7 = Point(pt_6)
int_7 = Integer(int_6)
data_31 = Data(data_30)
crv_10 = Curve(crv_6)
crv_11 = Curve(crv_7)
crv_12 = Curve(crv_8)
crv_13 = Curve(crv_9)
col_7 = Colour(col_6)
num_42 = Number(num_41)
num_43 = Number(num_40)
data_32 = Data(data_31)
pt_8 = Point(pt_7)
int_8 = Integer(int_7)
crv_14 = Curve(crv_10)
midpt = CurveMiddle(Curve=crv_14)

crv_15 = Curve(crv_10)
col_8 = Colour(col_7)
num_44 = Number(num_42)

crv_16 = Curve(crv_12)
crv_17 = Curve(crv_13)
col_9 = Colour(col_5)
end_7 = EndPoints(Curve=crv_16)  # -> Start, End
end_8 = EndPoints(Curve=crv_17)  # -> Start, End
vec2pt = Vector2Pt(PointA=end_8.Start, PointB=end_8.End, Unitize=False)  # -> Vector, Length
vec2pt_2 = Vector2Pt(PointA=end_7.Start, PointB=end_7.End, Unitize=False)  # -> Vector, Length

num_45 = Number(num_43)
crv_18 = Curve(crv_10)
midpt_2 = CurveMiddle(Curve=crv_18)

# ---- group: Edges
previewlw = CustomPreviewLineweights(Geometry=crv_15, Shader=col_8, Thickness=num_44, Absolute=False)

# ---- group: Reaction forces
vdisex = VectorDisplayEx(Point=end_8.Start, Vector=vec2pt.Vector, Colour=col_9, Width=2)

# ---- group: Node keys
tag = TextTag(Location=pt_8, Text=int_8, Colour=swatch)

# ---- group: Edge keys
tag_2 = TextTag(Location=midpt, Text=data_32, Colour=swatch)

# ---- group: Edge results
tag_3 = TextTag(Location=midpt_2, Text=num_45, Colour=ColourSwatch(SwatchColor=RGB(191, 4, 4)))

# ---- group: Loads
vdisex_2 = VectorDisplayEx(Point=end_7.Start, Vector=vec2pt_2.Vector, Colour=col_9, Width=2)

# ----
num_46 = Number(num_5)
data_33 = Data(data)
num_47 = Number(num_6)
num_48 = Number(num_8)
col_10 = Colour(col_3)
col_11 = Colour(col)
col_12 = Colour(col_2)

num_49 = Number(num_48)
num_50 = Number(num_47)
num_51 = Number(num_46)
data_34 = Data(data_33)
topologyartist_2 = TopologyArtist(topology=data_34)  # -> nodes, origin_nodes, support_nodes, edges, trail_edges, deviation_edges, loads; inputs node: list of Int32, edge: list; same code as topologyartist
topologydisassembly_3 = DisassembleTopologyDiagram(topology=data_34)  # -> nodes, origin_nodes, support_nodes, edges, trail_edges, deviation_edges, trails, auxiliary_trails; same code as topologydisassembly
python_8 = GhPythonScript(topology=data_34, auxiliary_trail=topologydisassembly_3.auxiliary_trails)  # -> out, auxiliary_trail; inputs auxiliary_trail: list
# ---------- python_8: Python ----------
from compas_cem.ghpython import TopologyArtist


if auxiliary_trail is not None:
    artist = TopologyArtist(topology)
   
    if auxiliary_trail is not None:
        auxiliary_trail = artist.draw_edges_trail(auxiliary_trail)
# ---------- end python_8 ----------
python_9 = GhPythonScript(trail=topologydisassembly_3.trail_edges, auxiliary_trail=topologydisassembly_3.auxiliary_trails)  # -> out, trail; inputs trail: list, auxiliary_trail: list
# ---------- python_9: Python ----------
trail = [tr for tr in trail if tr not in auxiliary_trail]
# ---------- end python_9 ----------
topologyartist_3 = TopologyArtist(topology=data_34, edge=python_9.trail, load_min=num_50, load_scale=num_51)  # -> nodes, origin_nodes, support_nodes, edges, trail_edges, deviation_edges, loads; inputs node: list of Int32, edge: list
#   port topology: A COMPAS CEM topology diagram.
#   port node: A selection of the nodes in the diagram. Defaults to all the nodes.
#   port edge: A selection of the edges in the diagram. Defaults to all the edges.
#   port load_min: The minimum load magnitude to plot. Defaults to 1e-3.
#   port load_scale: The scaling factor of the loads. Defaults to 1.
#   port nodes: The nodes in the diagram as points.
#   port origin_nodes: The origin nodes in the diagram as points.
#   port support_nodes: The position of the support nodes in the diagram.
#   port edges: The edges in the diagram as lines.
#   port trail_edges: The trail edges in the diagram as lines.
#   port deviation_edges: The deviation edges in the diagram as lines.
#   port loads: The applied node loads as lines.
# ---------- topologyartist_3: Python ----------
"""
Draw a topology diagram.
"""
from ghpythonlib.componentbase import executingcomponent as component

from compas_cem.ghpython import TopologyArtist


class TopologyArtistComponent(component):
    def RunScript(self, topology, node, edge, load_min, load_scale):
        node = node or None
        edge = edge or None
        load_min = load_min or 1e-3
        load_scale = load_scale or 1.0
        if topology:
            artist = TopologyArtist(topology)

            nodes = artist.draw_nodes(node)
            origin_nodes = artist.draw_nodes_origin(node)
            support_nodes = artist.draw_nodes_support(node)

            edges = artist.draw_edges(edge)
            trail_edges = artist.draw_edges_trail(node)
            deviation_edges = artist.draw_edges_deviation(node)

            loads = artist.draw_loads(node, min_load=load_min, scale=load_scale)

            return nodes, origin_nodes, support_nodes, edges, trail_edges, deviation_edges, loads
# ---------- end topologyartist_3 ----------
entwine_4 = Entwine(Branch00=topologyartist_3.origin_nodes, Branch01=topologyartist_3.support_nodes, FlattenInputs=True)
edgeresults_2 = EdgeResults(form=data_34, edge=python_9.trail)  # -> length, force; inputs edge: list; same code as edgeresults
edgeresults_3 = EdgeResults(form=data_34, edge=topologydisassembly_3.deviation_edges)  # -> length, force; inputs edge: list; same code as edgeresults
larger_2 = LargerThan(FirstNumber=edgeresults_3.force, SecondNumber=0)  # -> LargerThan, OrEqualTo
larger_3 = LargerThan(FirstNumber=edgeresults_2.length, SecondNumber=0)  # -> LargerThan, OrEqualTo
sph = Sphere(Base=entwine_4, Radius=num_49)
item_6 = ListItem(List=merge_5, Index=larger_2.OrEqualTo, Wrap=True)
item_7 = ListItem(List=merge_5, Index=larger_3.OrEqualTo, Wrap=True)
graft = GraftTree(Tree=item_6, IncludeEmptyLists=True, IncludeNullItems=True)
int_9 = Integer(topologydisassembly_3.nodes)
pt_9 = Point(topologyartist_2.nodes)

# ---- group: trail edges w/o aux
crv_19 = Curve(topologyartist_3.edges)

# ---- group: aux trails
crv_20 = Curve(python_8.auxiliary_trail)

# ---- group: deviation edges
crv_21 = Curve(topologyartist_3.deviation_edges)

# ----
brep = Brep(sph)
num_52 = Number(edgeresults_2.length)
num_53 = Number(edgeresults_3.force)
col_13 = Colour(item_7)
col_14 = Colour(graft)
data_35 = Data(topologydisassembly_3.edges)
crv_22 = Curve(topologyartist_2.edges)
crv_23 = Curve(topologyartist_3.loads)

data_36 = Data(data_35)
int_10 = Integer(int_9)
pt_10 = Point(pt_9)
crv_24 = Curve(crv_19)
crv_25 = Curve(crv_20)
crv_26 = Curve(crv_21)
crv_27 = Curve(crv_23)
brep_2 = Brep(brep)
num_54 = Number(num_52)
num_55 = Number(num_53)
col_15 = Colour(col_13)
col_16 = Colour(col_14)
crv_28 = Curve(crv_22)

data_37 = Data(data_36)
pt_11 = Point(pt_10)
crv_29 = Curve(crv_28)
int_11 = Integer(int_10)
swatch_2 = ColourSwatch(SwatchColor=RGBA(156, 156, 156, 195))
midpt_3 = CurveMiddle(Curve=crv_29)

crv_30 = Curve(crv_24)
num_56 = Number(num_54)
crv_31 = Curve(crv_26)
num_57 = Number(num_55)
swatch_3 = ColourSwatch(SwatchColor=RGB(184, 184, 184))
midpt_4 = CurveMiddle(Curve=crv_30)
midpt_5 = CurveMiddle(Curve=crv_31)

crv_32 = Curve(crv_25)
crv_33 = Curve(crv_24)
col_17 = Colour(col_15)
col_18 = Colour(col_11)
crv_34 = Curve(crv_26)
num_58 = Number(num_7)
col_19 = Colour(col_16)
dash = DashPattern(Curve=crv_34, Pattern=num_58)  # -> Dashes, Gaps

crv_35 = Curve(crv_27)
col_20 = Colour(col_10)
end_9 = EndPoints(Curve=crv_35)  # -> Start, End
vec2pt_3 = Vector2Pt(PointA=end_9.Start, PointB=end_9.End, Unitize=False)  # -> Vector, Length

brep_3 = Brep(brep_2)
col_21 = Colour(col_12)

# ---- group: Trail edges
preview = CustomPreview(Geometry=crv_33, Material=col_17)

# ---- group: Nodes
preview_2 = CustomPreview(Geometry=brep_3, Material=col_21)

# ---- group: Loads
vdisex_3 = VectorDisplayEx(Point=end_9.Start, Vector=vec2pt_3.Vector, Colour=col_20, Width=2)

# ---- group: Edge keys
tag_4 = TextTag(Location=midpt_3, Text=data_37, Colour=swatch_2)

# ---- group: Deviation edges
preview_3 = CustomPreview(Geometry=crv_32, Material=col_18)

# ---- group: Auxiliary trails
preview_4 = CustomPreview(Geometry=dash.Dashes, Material=col_19)

# ---- group: Node keys
# 03 Export Data
tag_5 = TextTag(Location=pt_11, Text=int_11, Colour=swatch_2)

# ---- group: Deviation forces
tag_6 = TextTag(Location=midpt_5, Text=num_57, Colour=swatch_3)

# ---- group: Trail lengths
tag_7 = TextTag(Location=midpt_4, Text=num_56, Colour=swatch_3)
