# Grasshopper definition Sprengwekartige_A_2d.ghx (Grasshopper 1.0.7)
# plug-ins: Human, Telepathy, Wombat, treesloth01, Heteroptera

number_slider = Slider(21, range=0..100)
number_slider_2 = Slider(0.56, range=0..10)
number_slider_3 = Slider(0.29, range=0..1)
number_slider_4 = Slider(0.372, range=0..1)
number_slider_5 = Slider(0.123, range=0..1)
starting_curve = Curve(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)
neg = Negative(Value=number_slider_2)
divide = DivideCurve(Curve=starting_curve, Count=Slider(3, range=0..100), Kinks=False)  # -> Points, Tangents, Parameters
subtraction = Subtraction(A="1", B=number_slider_3)
entwine = Entwine(Branch00=number_slider_2, Branch01=neg, FlattenInputs=True)
subtraction_2 = Subtraction(A="1", B=number_slider_5)
divide_2 = DivideCurve(Curve=starting_curve, Count=Slider(30, range=11..30), Kinks=False)  # -> Points, Tangents, Parameters
neg_2 = Negative(Value=number_slider_4)
cull_ends = CullEnds(List=divide.Points)  # -> List, Culled
num = Number([number_slider_3, subtraction])
num_2 = Number([number_slider_5, subtraction_2])
X = UnitX(Factor=entwine)
entwine_2 = Entwine(Branch00=neg_2, Branch01=number_slider_4, FlattenInputs=True)
eval = EvaluateCurve(Curve=reparameterize(starting_curve), Parameter=num)  # -> Point, Tangent, Angle
end = EndPoints(Curve=starting_curve)  # -> Start, End
move = Move(Geometry=cull_ends.List, Motion=X)  # -> Geometry, Transform
Z = UnitZ(Factor=1)
eval_2 = EvaluateCurve(Curve=reparameterize(starting_curve), Parameter=num_2)  # -> Point, Tangent, Angle
neg_3 = Negative(Value=Z)
X_2 = UnitX(Factor=entwine_2)
Z_2 = UnitZ(Factor=Slider(1.23, range=0..10))
cp = ClosestPoint(Point=move.Geometry, Cloud=divide_2.Points)  # -> ClosestPoint, CPIndex, Distance
cp_2 = ClosestPoint(Point=eval.Point, Cloud=divide_2.Points)  # -> ClosestPoint, CPIndex, Distance
support = RemoteSender([end.Start, end.End])
flip = FlipMatrix(Data=cp.ClosestPoint)
avr = Average(Input=flip)
pline = PolyLine(Vertices=divide_2.Points, Closed=False)
neg_4 = Negative(Value=Z_2)
move_2 = Move(Geometry=avr, Motion=X_2)  # -> Geometry, Transform
Z_3 = UnitZ(Factor=1)
move_3 = Move(Geometry=eval_2.Point, Motion=neg_4)  # -> Geometry, Transform
explode = Explode(Curve=pline, Recursive=True)  # -> Segments, Vertices

# ---- group: Reload compas_cem
python = GhPythonScript(unload=Button())  # -> out; inputs unload: Boolean
# ---------- python: Python ----------
from compas_ghpython.utilities import unload_modules


if unload:
    unloaded = unload_modules("compas")
    print("Unloaded: {}".format(unloaded))
# ---------- end python ----------

# ----
neg_5 = Negative(Value=Z_3)
number_slider_6 = Slider(0.99, range=0..1)
# 01 CEM framework model
line = LineSDL(Start=move_2.Geometry, Direction=neg_3, Length=Slider(0.36, range=0..1))
ln = Line(StartPoint=[end.Start, end.End], EndPoint=move_3.Geometry)
line_2 = LineSDL(Start=move_3.Geometry, Direction=neg_5, Length=Slider(0.108, range=0..1))  # disabled
mp = Midpoint(Curve=explode.Segments)
ln_2 = Line(StartPoint=cp_2.ClosestPoint, EndPoint=move_3.Geometry)
pt = Point(Point(0, 0, 0))
end_2 = EndPoints(Curve=line_2)  # -> Start, End
end_3 = EndPoints(Curve=line)  # -> Start, End
number_slider_7 = Slider(0.35, range=0..1)
cp_3 = ClosestPoint(Point=pt, Cloud=mp)  # -> ClosestPoint, CPIndex, Distance
flip_2 = FlipCurve(Curve=ln)  # -> Curve, Flag
ln_3 = Line(StartPoint=end_3.End, EndPoint=flip)
Z_4 = UnitZ(Factor=1)
subtraction_3 = Subtraction(A="1", B=number_slider_7)
cull_i = CullIndex(List=explode.Segments, Indices=cp_3.CPIndex, Wrap=True)
item = ListItem(List=explode.Segments, Index=cp_3.CPIndex, Wrap=True)
support_2 = RemoteSender(end_2.End)  # disabled
eval_3 = EvaluateCurve(Curve=reparameterize(starting_curve), Parameter=[subtraction_3, number_slider_7])  # -> Point, Tangent, Angle
end_4 = EndPoints(Curve=ln_3)  # -> Start, End
number_slider_8 = Slider(0.05, range=0..1)
cp_4 = ClosestPoint(Point=eval_3.Point, Cloud=divide_2.Points)  # -> ClosestPoint, CPIndex, Distance
neg_6 = Negative(Value=Z_4)
other = Curve(cull_i)
mid = Curve(item)
eval_4 = EvaluateCurve(
    Curve=reparameterize(starting_curve),
    Parameter=[Slider(0.875, range=0..1), Slider(0.2, range=0..1), Slider(0.1, range=0..1)])  # -> Point, Tangent, Angle
deck = RemoteSender(other)
cp_5 = ClosestPoint(Point=cp_4.ClosestPoint, Cloud=divide_2.Points)  # -> ClosestPoint, CPIndex, Distance
mp_2 = Midpoint(Curve=starting_curve)
neg_7 = Negative(Value=number_slider_8)
cullpt = CullDuplicates(Points=end_4.Start, Tolerance=0.1, CullMode=3)  # -> Points, Indices, Valence
line_3 = LineSDL(Start=cp_4.ClosestPoint, Direction=neg_6, Length=Slider(1.37, range=0..10))
entwine_3 = Entwine(Branch00=number_slider_8, Branch01=neg_7, FlattenInputs=True)
end_5 = EndPoints(Curve=line_3)  # -> Start, End
X_3 = UnitX(Factor=entwine_3)
move_4 = Move(Geometry=cp_4.ClosestPoint, Motion=X_3)  # -> Geometry, Transform
cp_6 = ClosestPoint(Point=eval_4.Point, Cloud=divide_2.Points)  # -> ClosestPoint, CPIndex, Distance
mp_3 = Midpoint(Curve=line_3)
ln_4 = Line(StartPoint=cullpt.Points, EndPoint=mp_3)
pline_2 = PolyLine(Vertices=flatten(mp_3), Closed=False)
pdecon = Deconstruct(Point=cp_6.ClosestPoint)  # -> XComponent, YComponent, ZComponent
vs = Curve(ln_3)
branches = Curve(ln_4)
pdecon_2 = Deconstruct(Point=end_5.End)  # -> XComponent, YComponent, ZComponent
bang = ExplodeTree(Data=ln_3)  # -> Branch0, Branch1
between_brnaches = Curve(pline_2)
end_6 = EndPoints(Curve=between_brnaches)  # -> Start, End
pdecon_3 = Deconstruct(Point=end_6.End)  # -> XComponent, YComponent, ZComponent
subtraction_4 = Subtraction(A=pdecon_3.ZComponent, B=pdecon_2.ZComponent)
Z_5 = UnitZ(Factor=subtraction_4)
neg_8 = Negative(Value=Z_5)
number_slider_9 = Slider(1.75, range=0..10)
number_slider_10 = Slider(1.9571, range=0..10)
number_slider_11 = Slider(1.8, range=0..10)
number_slider_12 = Slider(1.662, range=0..10)
merge = Merge(Data1=end_6.Start, Data2=end_6.End)
number_slider_13 = Slider(1.7, range=0..10)
entwine_4 = Entwine(Branch00=bang.Branch0, Branch01=reverse(bang.Branch1), FlattenInputs=True)
divide_3 = DivideCurve(Curve=line_3, Count=Slider(4, range=0..10), Kinks=False)  # -> Points, Tangents, Parameters
move_5 = Move(Geometry=merge, Motion=neg_8)  # -> Geometry, Transform
item_2 = ListItem(List=entwine_4, Index=0, Wrap=number_slider_10)  # -> Item, Item1
ln_5 = Line(StartPoint=merge, EndPoint=move_5.Geometry)
crv = Curve(line_2)
deck_2 = RemoteReceiver(deck)

len = Length(Curve=deck_2)
neg_9 = Negative(Value=len)
trailedge = TrailEdge(line=deck_2, length=neg_9)  # -> trail_edge; inputs line: Line
#   port line: A line that defines the end nodes of the edge.
#   port length: The desired length of the edge. If negative, the edge is in compression. Otherwise, it is in tension.
#   port trail_edge: A COMPAS CEM trail edge.
# ---------- trailedge: Python ----------
"""
Create a trail edge from a rhino line.
"""
from ghpythonlib.componentbase import executingcomponent as component

from compas_cem.elements import TrailEdge


class TrailEdgeComponent(component):
    def RunScript(self, line, length):
        if line and length is not None:
            return TrailEdge.from_rhino_line(line, length)
# ---------- end trailedge ----------

bang_2 = ExplodeTree(Data=divide_3.Points)  # -> Branch0, Branch1
neg_10 = Negative(Value=number_slider_12)
neg_11 = Negative(Value=number_slider_9)
neg_12 = Negative(Value=number_slider_10)
neg_13 = Negative(Value=Slider(4.6, range=0..20))
neg_14 = Negative(Value=Slider(3.3, range=0..20))
neg_15 = Negative(Value=number_slider_10)
neg_16 = Negative(Value=Slider(1.1, range=0..20))
pline_3 = PolyLine(Vertices=divide_3.Points, Closed=False)
ln_6 = Line(StartPoint=bang_2.Branch0, EndPoint=bang_2.Branch1)
entwine_5 = Entwine(Branch00=between_brnaches, Branch01=ln_6, FlattenInputs=True)  # -> flatten(Result)
between_brnaches_2 = Curve(entwine_5)
cull_ends_2 = CullEnds(List=between_brnaches_2)  # -> List, Culled
deck_3 = RemoteReceiver(deck)
merge_2 = Merge(Data1=branches)
len_2 = Length(Curve=merge_2)
end_7 = EndPoints(Curve=pline_3)  # -> Start, End
support_3 = RemoteSender(end_7.End)
support_4 = RemoteReceiver([support, support_2, support_3])
number_slider_14 = Slider(1, range=0..1)
shatter = Shatter(Curve=reparameterize(pline_3), Parameters=Slider(0.25, range=0..1))
neg_17 = Negative(Value=number_slider_14)
explode_2 = Explode(Curve=pline_3, Recursive=True)  # -> Segments, Vertices
neg_18 = Negative(Value=len_2)
first_last = FirstLast(List=shatter)  # -> FirstValue, LastValue
end_8 = EndPoints(Curve=first_last.LastValue)  # -> Start, End
pdecon_4 = Deconstruct(Point=flatten(end_8.End))  # -> XComponent, YComponent, ZComponent
pdecon_5 = Deconstruct(Point=flatten(end_8.Start))  # -> XComponent, YComponent, ZComponent
extremums = MinMax(Number=pdecon_4.ZComponent)  # -> Minimum, Maximum
pt_2 = ConstructPoint(XCoordinate=pdecon.XComponent, YCoordinate=pdecon.YComponent, ZCoordinate=extremums.Maximum)
extremums_2 = MinMax(Number=pdecon_5.ZComponent)  # -> Minimum, Maximum
ln_7 = Line(StartPoint=cp_6.ClosestPoint, EndPoint=pt_2)
shatter_2 = Shatter(Curve=reparameterize(ln_7), Parameters=Slider(0.2, range=0..1))
first_last_2 = FirstLast(List=shatter_2)  # -> FirstValue, LastValue
bang_3 = ExplodeTree(Data=first_last_2.FirstValue)  # -> Branch0, Branch1, Branch2
crv_2 = Curve(first_last_2.LastValue)
end_9 = EndPoints(Curve=crv_2)  # -> Start, End
deviationedge = DeviationEdge(line=bang_3.Branch0, force=neg_13)  # -> deviation_edge; inputs line: Line
#   port line: A line that defines the end nodes of the edge.
#   port force: The desired force on the edge. If negative, the edge is in compression. Otherwise, it is in tension.
#   port deviation_edge: A COMPAS CEM deviation edge.
# ---------- deviationedge: Python ----------
"""
Create a deviation edge from a rhino line.
"""
from ghpythonlib.componentbase import executingcomponent as component

from compas_cem.elements import DeviationEdge


class DeviationEdgeComponent(component):
    def RunScript(self, line, force):
        if line and force is not None:
            return DeviationEdge.from_rhino_line(line, force)
# ---------- end deviationedge ----------
deviationedge_2 = DeviationEdge(line=bang_3.Branch1, force=neg_14)  # -> deviation_edge; inputs line: Line; same code as deviationedge
deviationedge_3 = DeviationEdge(line=bang_3.Branch2, force=neg_16)  # -> deviation_edge; inputs line: Line; same code as deviationedge
entwine_6 = Entwine(Branch00=number_slider_14, Branch01=neg_17, FlattenInputs=True)
len_3 = Length(Curve=explode_2.Segments)
neg_19 = Negative(Value=len_3)
number_slider_15 = Slider(2, range=0..10)
cull_ends_3 = CullEnds(List=explode_2.Segments)  # -> List, Culled
first_last_3 = FirstLast(List=explode_2.Segments)  # -> FirstValue, LastValue
vec = VectorXYZ(XComponent=entwine_6, YComponent=0, ZComponent=Slider(0.66, range=0..1))  # -> Vector, Length
deck_4 = RemoteReceiver(deck)
trailedge_2 = TrailEdge(line=merge_2, length=neg_18)  # -> trail_edge; inputs line: Line; disabled; same code as trailedge
len_4 = Length(Curve=first_last.LastValue)
end_10 = EndPoints(Curve=first_last.LastValue)  # -> Start, End
line_4 = LineSDL(Start=flatten(end_10.Start), Direction=vec.Vector, Length=1)
join = JoinCurves(Curves=deck_4, Preserve=False)  # -> reverse(Curves)
flip_3 = FlipMatrix(Data=line_4)
flip_4 = FlipMatrix(Data=end_10.Start)
pline_4 = PolyLine(Vertices=flip_4, Closed=False)
neg_20 = Negative(Value=len_4)
clx = CurveLine(Curve=graft(join), Line=flip_3)  # -> Points, Params, Count
item_3 = ListItem(List=clx.Points, Index=0, Wrap=True)
trailedge_3 = TrailEdge(line=first_last.LastValue, length=len_4)  # -> trail_edge; inputs line: Line; same code as trailedge
cp_7 = ClosestPoint(Point=clx.Points, Cloud=divide_2.Points)  # -> ClosestPoint, CPIndex, Distance
Z_6 = UnitZ(Factor=1)
len_5 = Length(Curve=crv_2)
trim = TrimTree(Tree=cp_7.ClosestPoint, Depth=1)
neg_21 = Negative(Value=len_5)
ln_8 = Line(StartPoint=trim, EndPoint=end_10.Start)
len_6 = Length(Curve=ln_8)
addition = Addition(A=len_6, B=Slider(0.00105, range=0..1))
cat = Catenary(PointA=cp_7.ClosestPoint, PointB=end_10.Start, Length=addition, Gravity=Z_6)
trailedge_4 = TrailEdge(line=crv_2, length=neg_21)  # -> trail_edge; inputs line: Line; same code as trailedge
merge_3 = Merge(Data1=trailedge_3, Data2=trailedge_4, Data3=trailedge)  # -> flatten(Result)
crv_3 = Curve(ln_8)
bang_4 = ExplodeTree(Data=crv_3)  # -> _0000000, _0000001, Branch2, Branch3
trim_2 = TrimTree(Tree=crv_3, Depth=1)
deviationedge_4 = DeviationEdge(line=[bang_4.Branch3, bang_4._0000000], force=number_slider_10)  # -> deviation_edge; inputs line: Line; same code as deviationedge
view_constrained_form = BooleanToggle(False)

# ---- group: Topoloy Display - Controls
dash_length = Slider(0.04, range=0..0.1)
sphere_radius = Slider(0.07, range=0..0.1)
load_scale = Slider(1, range=0..1)
load_min = Slider(0.001, range=0..0.001)
num_3 = Number(load_scale)
num_4 = Number(load_min)
num_5 = Number(dash_length)
num_6 = Number(sphere_radius)

# ---- group: Form Display - Controls
lineweight_thickness_factor = Slider(1, range=0..10)
list = ValueList({"Forces": 0, "Lengths": 1}, selected="Forces")
load_scale_2 = Slider(1, range=0..1)
load_min_2 = Slider(0.001, range=0..0.001)
num_7 = Number(lineweight_thickness_factor)
int = Integer(list)
num_8 = Number(load_scale_2)
num_9 = Number(load_min_2)

# ----
cem_colors = CEMColors()  # -> color_tension, color_compression, color_edge, color_node, color_node_support, color_node_origin, color_load, color_reaction, color_trail, color_auxiliary_trail
#   port color_tension: The color for edges under a tension force.
#   port color_compression: The color for edges under a compression force.
#   port color_edge: The color for a regular edge.
#   port color_node: The color for a regular node.
#   port color_node_support: The color for a support node.
#   port color_node_origin: The color for an origin node.
#   port color_load: The color for an applied load.
#   port color_reaction: The color for a reaction force.
#   port color_trail: The color to paint a trail.
#   port color_auxiliary_trail: The color to paint an auxiliary trail.
# ---------- cem_colors: Python ----------
"""
Get the artists color scheme for the objects of the CEM framework.
"""
from ghpythonlib.componentbase import executingcomponent as component

from compas_cem import COLORS
import rhinoscriptsyntax as rs


class ArtistColorsComponent(component):
    def RunScript(self):
        colors = {key: rs.CreateColor(c) for key, c in COLORS.items()}

        color_tension = colors["tension"]
        color_compression = colors["compression"]
        color_edge = colors["edge"]
        color_node = colors["node"]
        color_node_support = colors["node_support"]
        color_node_origin = colors["node_origin"]
        color_load = colors["load"]
        color_reaction = colors["support_force"]
        color_trail = colors["trail"]
        color_auxiliary_trail = colors["auxiliary_trail"]

        colors = (color_tension, color_compression, color_edge, color_node, color_node_support, color_node_origin, color_load, color_reaction, color_trail, color_auxiliary_trail)

        return colors
# ---------- end cem_colors ----------
merge_4 = Merge(Data1=cem_colors.color_compression, Data2=cem_colors.color_tension)
cem_colors_2 = CEMColors()  # -> color_tension, color_compression, color_edge, color_node, color_node_support, color_node_origin, color_load, color_reaction, color_trail, color_auxiliary_trail; same code as cem_colors
entwine_7 = Entwine(Branch00=cem_colors_2.color_node_origin, Branch01=cem_colors_2.color_node_support, FlattenInputs=True)
merge_5 = Merge(Data1=cem_colors_2.color_compression, Data2=cem_colors_2.color_tension)
col = Colour(cem_colors_2.color_auxiliary_trail)
col_2 = Colour(entwine_7)
col_3 = Colour(cem_colors_2.color_load)
col_4 = Colour(cem_colors.color_load)

# ---- group: File metadata
base_directory = Panel("C:\Users\Mark\Documents\GitHub\cem_dataset\bridges\8_Sprengwerkartige")
family_name = Panel("Sprengwerkartige_A")
is_3d = BooleanToggle(False)
txt = Text(family_name)
txt_2 = Text(base_directory)
bool = Boolean(is_3d)

# ----
export_topology_json = BooleanToggle(False)
export_form_json = BooleanToggle(False)
bool_2 = Boolean(export_topology_json)
bool_3 = Boolean(export_form_json)

save_topology_pdf = BooleanToggle(False)
save_form_pdf = BooleanToggle(False)
bool_4 = Boolean(save_topology_pdf)
bool_5 = Boolean(save_form_pdf)

# ---- group: Make2D - Camera plane
update_camera_plane = Button()
camera_plane_index = Slider(0, range=0..1)
bool_6 = Boolean(update_camera_plane)
int_2 = Integer(camera_plane_index)

# ----
reaction_scale = Slider(0.1, range=0..4)

# ---- group: PDF Controls
edge_width = Slider(2, range=0..5)
node_radius = Slider(0.05, range=0..0.5)
node_edgeweight = Slider(1.5, range=0..5)
arrow_width = Slider(1.5, range=0..5)
load_scale_3 = Slider(3.6, range=0..4)
load_gap = Slider(0.07, range=0..2)
reaction_gap = Slider(0.07, range=0..1)
extra_segments_lineweight = Panel("dotted")
extra_segments_line_thickness_form = Panel("0.75")
extra_segments_line_color_form = Panel("120, 120, 120")
num_10 = Number(edge_width)
num_11 = Number(node_radius)
num_12 = Number(node_edgeweight)
num_13 = Number(arrow_width)
num_14 = Number(load_scale_3)
num_15 = Number(load_gap)
num_16 = Number(reaction_scale)
txt_3 = Text(extra_segments_lineweight)
num_17 = Number(reaction_gap)
num_18 = Number(extra_segments_line_thickness_form)
txt_4 = Text(extra_segments_line_color_form)

# ---- group: COMPAS-based Make2D
int_3 = Integer(int_2)
bool_7 = Boolean(bool_6)
viewports = ViewportProperties(Update=bool_7, AutoUpdate=False)  # -> ViewportNames, ActiveViewportIndex, ViewportBounds, ViewportDisplayMode, CameraLocation, CameraTarget, CameraPlane, CameraLensLength, CameraProjection, CameraUp
item_4 = ListItem(List=viewports.CameraPlane, Index=int_3, Wrap=True)
panel = Panel(viewports.ViewportNames)
pln = Plane(item_4)
panel_2 = Panel(pln)

# ----
number_slider_16 = Slider(1.8, range=0..10)
neg_22 = Negative(Value=Slider(2.7, range=0..10))
neg_23 = Negative(Value=Slider(20, range=0..20))
neg_24 = Negative(Value=Slider(0.1, range=0..0.1))
Z_7 = UnitZ(Factor=neg_24)
deviationedge_5 = DeviationEdge(line=pline_4, force=number_slider_12)  # -> deviation_edge; inputs line: Line; disabled; same code as deviationedge
lineload = GhPythonScript(line=flatten([deck_3, mid]), load_vector=Z_7)  # -> out, point, vector; inputs line: list of Line, load_vector: Vector3d
# ---------- lineload: Python ----------
from compas_rhino.geometry import RhinoLine
from compas_rhino.geometry import RhinoVector

from compas.geometry import add_vectors
from compas.geometry import scale_vector

from compas.utilities import geometric_key

import rhinoscriptsyntax as rs

gkey_xyz = {}
gkey_load = {}

load_vector = RhinoVector.from_geometry(load_vector).to_compas()

for ln in line:
    ln = RhinoLine.from_geometry(ln).to_compas()
    
    # calculate load on line end-points    
    lvec = scale_vector(load_vector, ln.length * 0.5)
    
    for pt in ln:
        gkey = geometric_key(pt)
        gkey_xyz[gkey] = pt
        
        if gkey in gkey_load:
            gkey_load[gkey] = add_vectors(gkey_load[gkey], lvec)
        else:
            gkey_load[gkey] = lvec

point = []
vector = []

for gkey, xyz in gkey_xyz.items():
    point.append(rs.AddPoint(*xyz))
    vector.append(rs.AddPoint(*gkey_load[gkey]))
# ---------- end lineload ----------
deviationedge_6 = DeviationEdge(line=mid, force=neg_23)  # -> deviation_edge; inputs line: Line; same code as deviationedge
deviationedge_7 = DeviationEdge(line=[bang_4._0000001, bang_4.Branch2], force=number_slider_9)  # -> deviation_edge; inputs line: Line; same code as deviationedge
nodesupport = NodeSupport(point=[support_4, end_9.End])  # -> node_support; inputs point: Point3d
#   port point: The position of the node where to assign a support.
#   port node_support: A COMPAS CEM node support.
# ---------- nodesupport: Python ----------
"""
Create a node support from a rhino point.
"""
from ghpythonlib.componentbase import executingcomponent as component

from compas_cem.supports import NodeSupport


class NodeSupportComponent(component):
    def RunScript(self, point):
        if point:
            return NodeSupport.from_rhino_point(point)
# ---------- end nodesupport ----------
nodeload = NodeLoad(point=lineload.point, vector=lineload.vector)  # -> node_load; inputs point: Point3d, vector: Vector3d
#   port point: The position of the node where to apply the load.
#   port vector: The load vector.
#   port node_load: A COMPAS CEM node load.
# ---------- nodeload: Python ----------
"""
Create a load vector to be applied at a node.
"""
from ghpythonlib.componentbase import executingcomponent as component

from compas_cem.loads import NodeLoad


class NodeLoadComponent(component):
    def RunScript(self, point, vector):
        if point and vector:
            return NodeLoad.from_rhino_point_and_vector(point, vector)
# ---------- end nodeload ----------
merge_6 = Merge(
    Data1=deviationedge_4,
    Data2=deviationedge_7,
    Data3=deviationedge_5,
    Data4=deviationedge_6,
    Data5=deviationedge,
    Data6=deviationedge_2,
    Data7=deviationedge_3)  # -> flatten(Result)

# ---- group: Build topology diagram and trails
topologydiagram = TopologyDiagram(trail_edges=flatten(merge_3), deviation_edges=flatten(merge_6), loads=flatten(nodeload), supports=flatten(nodesupport))  # -> topology; inputs nodes: list, trail_edges: list, deviation_edges: list, loads: list, supports: list
#   port nodes: A list of COMPAS CEM nodes to add to the diagram.
#   port trail_edges: A list of COMPAS CEM trail edges to add to the diagram.
#   port deviation_edges: A list of COMPAS CEM deviation edges to add to the diagram.
#   port loads: A list of COMPAS CEM loads to add to the diagram.
#   port supports: A list of COMPAS CEM supports to add to the diagram.
#   port topology: A COMPAS CEM topology diagram.
# ---------- topologydiagram: Python ----------
"""
Build a topology diagram.
"""
from ghpythonlib.componentbase import executingcomponent as component

from compas_cem.diagrams import TopologyDiagram


class BuildTopologyDiagramComponent(component):
    def RunScript(self, nodes, trail_edges, deviation_edges, loads, supports):

        topology = TopologyDiagram()

        if nodes:
            for node in nodes:
                topology.add_node(node)

        if trail_edges is not None:
            for trail_edge in trail_edges:
                topology.add_edge(trail_edge)

        if deviation_edges:
            for deviation_edge in deviation_edges:
                topology.add_edge(deviation_edge)

        if loads:
            for load in loads:
                topology.add_load(load)

        if supports:
            for support in supports:
                topology.add_support(support)

        return topology
# ---------- end topologydiagram ----------
Z_8 = UnitZ(Factor=1)

# ----
rev = Reverse(Vector=Z_8)

# ---- group: Build topology diagram and trails (continued)
buildtrails = BuildTrails(topology=topologydiagram, add_auxiliary_trails=Toggle(True), auxiliary_trail_length="0.33", auxiliary_trail_vector=rev)  # -> topology, trails, auxiliary_trails; inputs add_auxiliary_trails: Boolean, auxiliary_trail_vector: Vector3d
#   port topology: A COMPAS CEM topology diagram.
#   port add_auxiliary_trails: Append auxiliary trail edges to the free nodes of the topology diagram. Defaults to False.
#   port auxiliary_trail_length: The length of the auxiliary trail edges to add. Defaults to 1.0.
#   port auxiliary_trail_vector: The direction to which the auxiliary trail edges will initially point to. Defaults to [1.0, 1.0, 1.0].
#   port topology: The input topology diagram. But now with computed trails.
#   port trails: The keys of the nodes in each of the found trails.
#   port auxiliary_trails: The keys of the appended auxiliary trail edges.
# ---------- buildtrails: Python ----------
"""
Automatically find the trails in a topology diagram. The diagram is modified in-place.
"""
from ghpythonlib.componentbase import executingcomponent as component

from compas_rhino.geometry import RhinoVector


class BuildTopologyDiagramComponent(component):
    def RunScript(self, topology, add_auxiliary_trails, auxiliary_trail_length, auxiliary_trail_vector):
        add_auxiliary_trails = add_auxiliary_trails or False

        if topology:

            topology = topology.copy()

            if auxiliary_trail_length:
                topology.auxiliary_trail_length = auxiliary_trail_length
            if auxiliary_trail_vector:
                topology.auxiliary_trail_vector = RhinoVector.from_geometry(auxiliary_trail_vector).to_compas()

            topology.build_trails(add_auxiliary_trails)

            trails = list(topology.trails())
            auxiliary_trails = list(topology.auxiliary_trail_edges())

            return topology, trails, auxiliary_trails
# ---------- end buildtrails ----------

# ---- group: Optimization parameters
topologydisassembly = DisassembleTopologyDiagram(topology=buildtrails.topology)  # -> nodes, origin_nodes, support_nodes, edges, trail_edges, deviation_edges, trails, auxiliary_trails
#   port topology: A COMPAS CEM topology diagram.
#   port nodes: All the node keys in the topology diagram.
#   port origin_nodes: The keys of the origin nodes in the topology diagram.
#   port support_nodes: The keys of the support nodes in the topology diagram.
#   port edges: All the edge keys in the topology diagram.
#   port trail_edges: The keys of the trail edges in the topology diagram.
#   port deviation_edges: The keys of the deviation edges in the topology diagram.
#   port trails: The trails in the topology diagram.
#   port auxiliary_trails: The auxiliary trails in the topology diagram.
# ---------- topologydisassembly: Python ----------
"""
Disassemble a topology diagram into its constituent parts.
"""
from ghpythonlib.componentbase import executingcomponent as component


class TopologyDisassemblyComponent(component):
    def RunScript(self, topology):
        if topology:
            trails = list(topology.trails())
            auxiliary_trails = list(topology.auxiliary_trails())

            edges = list(topology.edges())
            trail_edges = list(topology.trail_edges())
            deviation_edges = list(topology.deviation_edges())

            nodes = list(topology.nodes())
            origin_nodes = list(topology.origin_nodes())
            support_nodes = list(topology.support_nodes())

            return nodes, origin_nodes, support_nodes, edges, trail_edges, deviation_edges, trails, auxiliary_trails
# ---------- end topologydisassembly ----------
deviationedgeforceparameter = DeviationEdgeForceParameter(edge_key=topologydisassembly.deviation_edges, bound_low="10", bound_up="10")  # -> parameter
#   port edge_key: The key of a COMPAS CEM deviation edge.
#   port bound_low: The lower bound of the edge optimization parameter. Calculated as the initial edge parameter minus the absolute value of this bound.
#   port bound_up: The upper bound of the edge optimization parameter. Calculated as the initial edge parameter plus the absolute value of this bound.
#   port parameter: A COMPAS CEM deviation edge force parameter.
# ---------- deviationedgeforceparameter: Python ----------
"""
Set the force of a deviation edge as an optimization parameter.
"""
from ghpythonlib.componentbase import executingcomponent as component

from compas_cem.optimization import DeviationEdgeParameter


class DeviationEdgeParameterComponent(component):
    def RunScript(self, edge_key, bound_low, bound_up):
        if edge_key and bound_low is not None and bound_up is not None:
            return DeviationEdgeParameter(edge_key, bound_low, bound_up)
# ---------- end deviationedgeforceparameter ----------

# ---- group: topology
data = Data(buildtrails.topology)

# 02 Visualize Diagrams
data_2 = Data(data)

# ---- group: Inputs / Topology
data_3 = Data(data)

# ---- group: COMPAS-based Make2D
xy = XYPlane(Origin=Point(0, 0, 0))
data_4 = Data(data_3)
pln_2 = Plane(pln)
orient_and_project = GhPythonScript(topology=data_4, initial_plane=pln_2, target_plane=xy)  # -> out, topology_transformed; inputs initial_plane: Plane, target_plane: Plane
# ---------- orient_and_project: Python ----------
from compas_rhino.geometry import RhinoPlane
from compas.geometry import Transformation
from compas.geometry import Projection
from compas.geometry import Frame
from compas.geometry import transform_vectors
from compas.datastructures import network_transformed

# Build frames from rhino planes
frames = []
for plane in (initial_plane, target_plane):
    plane = RhinoPlane.from_geometry(plane)
    frame = Frame(plane.point, plane.xaxis, plane.yaxis)
    frames.append(frame)    
fa, fb = frames

# Re-orient node positions
transf = Transformation.from_frame_to_frame(fa, fb)
topology_transformed = network_transformed(topology, transf)

# Squash node positions to plane
z = fb.point.z
for node in topology_transformed.nodes():
    topology_transformed.node_attribute(node, "z", z)
# ---------- end orient_and_project ----------
data_5 = Data(orient_and_project.topology_transformed)

# ----
num_19 = Number(num_14)
data_6 = Data(data_5)
topologyartist = TopologyArtist(topology=data_6, load_scale=num_19)  # -> nodes, origin_nodes, support_nodes, edges, trail_edges, deviation_edges, loads; inputs node: list of Int32, edge: list
#   port topology: A COMPAS CEM topology diagram.
#   port node: A selection of the nodes in the diagram. Defaults to all the nodes.
#   port edge: A selection of the edges in the diagram. Defaults to all the edges.
#   port load_min: The minimum load magnitude to plot. Defaults to 1e-3.
#   port load_scale: The scaling factor of the loads. Defaults to 1.
#   port nodes: The nodes in the diagram as points.
#   port origin_nodes: The origin nodes in the diagram as points.
#   port support_nodes: The position of the support nodes in the diagram.
#   port edges: The edges in the diagram as lines.
#   port trail_edges: The trail edges in the diagram as lines.
#   port deviation_edges: The deviation edges in the diagram as lines.
#   port loads: The applied node loads as lines.
# ---------- topologyartist: Python ----------
"""
Draw a topology diagram.
"""
from ghpythonlib.componentbase import executingcomponent as component

from compas_cem.ghpython import TopologyArtist


class TopologyArtistComponent(component):
    def RunScript(self, topology, node, edge, load_min, load_scale):
        node = node or None
        edge = edge or None
        load_min = load_min or 1e-3
        load_scale = load_scale or 1.0
        if topology:
            artist = TopologyArtist(topology)

            nodes = artist.draw_nodes(node)
            origin_nodes = artist.draw_nodes_origin(node)
            support_nodes = artist.draw_nodes_support(node)

            edges = artist.draw_edges(edge)
            trail_edges = artist.draw_edges_trail(edge)
            deviation_edges = artist.draw_edges_deviation(edge)

            loads = artist.draw_loads(node, min_load=load_min, scale=load_scale)

            return nodes, origin_nodes, support_nodes, edges, trail_edges, deviation_edges, loads
# ---------- end topologyartist ----------
clean = CleanTree(RemoveNulls=True, RemoveInvalid=True, RemoveEmpty=False, Tree=[topologyartist.edges, topologyartist.loads])
python_2 = GhPythonScript(segment=clean)  # -> out, segment; inputs segment: list
# ---------- python_2: Python ----------
from compas_rhino.utilities import get_line_coordinates


segment = get_line_coordinates(segment)
# ---------- end python_2 ----------
data_7 = Data(python_2.segment)

data_8 = Data(data_7)
txt_5 = Text(txt_4)
txt_6 = Text(txt_3)
num_20 = Number(num_18)
lng = ListLength(List=data_8)
python_3 = GhPythonScript(D=flatten(txt_5), L=flatten(lng))  # -> out, color; inputs D: list, L: list of Int32
# ---------- python_3: Python ----------
color = []

for d, l in zip(D, L):
    
    d = [int(n) for n in d.split(", ")]
    c = [d] * l
    color.extend(c)
# ---------- end python_3 ----------
repeat = RepeatData(Data=num_20, Length=lng)
repeat_2 = RepeatData(Data=txt_6, Length=lng)
data_9 = Data(python_3.color)
txt_7 = Text(repeat_2)
num_21 = Number(repeat)

# ---- group: Optimization goal constraints
topologydisassembly_2 = DisassembleTopologyDiagram(topology=topologydiagram)  # -> nodes, origin_nodes, support_nodes, edges, trail_edges, deviation_edges, trails, auxiliary_trails; same code as topologydisassembly
trailedgeforceconstraint = TrailEdgeForceConstraint(edge_key=buildtrails.auxiliary_trails, force="0.0")  # -> constraint
#   port edge_key: The key of a COMPAS CEM trail edge.
#   port force: The target force.
#   port weight: The weight of the constraint in the optimization problem. Defaults to one.
#   port constraint: A COMPAS CEM trail force constraint.
# ---------- trailedgeforceconstraint: Python ----------
"""
Make the force on a trail edge to reach a goal force value.
"""
from ghpythonlib.componentbase import executingcomponent as component

from compas_cem.optimization import TrailEdgeForceConstraint


class TrailEdgeForceConstraintComponent(component):
    def RunScript(self, edge_key, force, weight):
        weight = weight or 1.0
        if edge_key and force is not None:
            return TrailEdgeForceConstraint(edge_key, force, weight)
# ---------- end trailedgeforceconstraint ----------

# ----
nodesearch = NodeSearch(diagram=buildtrails.topology)  # -> node; inputs point: list of Point3d
#   port diagram: A COMPAS CEM topology or form diagram.
#   port point: The points to search for in the diagram.
#   port node: The node keys.
# ---------- nodesearch: Python ----------
"""
Search a node key in a topology or a form diagram using a point.
"""
from ghpythonlib.componentbase import executingcomponent as component

from compas.utilities import geometric_key
from compas_rhino.geometry import RhinoPoint


class NodeSearchComponent(component):
    def RunScript(self, diagram, point):
        if point and diagram:
            node = []
            for pt in point:
                pt = RhinoPoint.from_geometry(pt).to_compas()
                gkey = geometric_key(pt, diagram.tol)
                node.append(diagram.gkey_node[gkey])
            return node
# ---------- end nodesearch ----------
formfinding = FormFinding(topology=buildtrails.topology)  # -> form; inputs tmax: Int32
#   port topology: A COMPAS CEM topology diagram.
#   port tmax: The maximum number of iterations to run the form-finding algorithm for. Defaults to 100.
#   port eps_min: The convergence threshold of the form-finding algorithm. Default to 1e-6.
#   port form: A COMPAS CEM form diagram in static equilibrium.
# ---------- formfinding: Python ----------
"""
Generate a form diagram in static equilibrium.
"""
from ghpythonlib.componentbase import executingcomponent as component

from compas_cem.equilibrium import static_equilibrium


class FormFindingComponent(component):
    def RunScript(self, topology, tmax, eta_min):
        tmax = tmax or 100
        eta_min = eta_min or 1e-6
        if topology:
            return static_equilibrium(topology, tmax=tmax, eta=eta_min)
# ---------- end formfinding ----------

# ---- group: Optimization goal constraints (continued)
pointconstraint = PointConstraint(node_key=nodesearch)  # -> constraint; inputs node_key: Int32, point: Point3d
#   port node_key: The key of a COMPAS CEM node.
#   port point: The target point.
#   port weight: The weight of the constraint in the optimization problem. Defaults to one.
#   port constraint: A COMPAS CEM node point constraint.
# ---------- pointconstraint: Python ----------
"""
Pull the position of a node to a target point.
"""
from ghpythonlib.componentbase import executingcomponent as component

from compas_cem.optimization import PointConstraint
from compas_rhino.geometry import RhinoPoint


class PointConstraintComponent(component):
    def RunScript(self, node_key, point, weight):
        weight = weight or 1.0
        if node_key is not None and point:
            point = RhinoPoint.from_geometry(point).to_compas()
            return PointConstraint(node_key, point, weight)
# ---------- end pointconstraint ----------
entwine_8 = Entwine(Branch00=pointconstraint, Branch01=trailedgeforceconstraint, FlattenInputs=True)  # -> flatten(Result)

# ----
constrainedformfinding = ConstrainedFormFinding(
    topology=buildtrails.topology,
    constraints=entwine_8,
    parameters=deviationedgeforceparameter,
    iters_max="400",
    eps="1e-6")  # -> form, penalty, iters, time; inputs constraints: list, parameters: list, iters_max: Int32; disabled
#   port topology: A COMPAS CEM topology diagram.
#   port constraints: A list of COMPAS CEM optimization constraints.
#   port parameters: A list of COMPAS CEM optimization parameters.
#   port algorithm: The name of the optimization algorithm to use.
#   port iters_max: The maximum number of iterations to run the optimization algorithm for.
#   port eps: The minimum penalty value to declare convergence.
#   port form: A COMPAS CEM form diagram in static equilibrium.
#   port penalty: The penalty score after optimization.
#   port iters: The elapsed number of iterations.
#   port time: The optimization elapsed time.
# ---------- constrainedformfinding: Python ----------
"""
Generate a form diagram in static equilibrium.
"""
from ghpythonlib.componentbase import executingcomponent as component

from compas_cem import PROXY_PORT

from compas.rpc import Proxy


class ConstrainedFormFindingComponent(component):
    def RunScript(self, topology, constraints, parameters, algorithm, iters_max, eps):
        algorithm = algorithm or "LD_SLSQP"
        iters_max = iters_max or 100
        eps = eps or 1e-6

        if topology and constraints and parameters:
            topology = topology.copy()

            with Proxy("compas_cem.optimization", port=PROXY_PORT) as opt:
                form, penalty, iters, time = opt.solve_nlopt_proxy(topology,
                                                                   constraints,
                                                                   parameters,
                                                                   algorithm,
                                                                   iters_max,
                                                                   eps)
            return form, penalty, iters, time
# ---------- end constrainedformfinding ----------
panel_3 = Panel(constrainedformfinding.penalty)
panel_4 = Panel(constrainedformfinding.iters)

# ---- group: form
data_10 = Data(formfinding)

# ---- group: constrained form
data_11 = Data(constrainedformfinding.form)

# ---- group: form
data_12 = Data(data_10)

# ---- group: constrained form
data_13 = Data(data_11)

# ----
filter = StreamFilter(Gate=view_constrained_form, Stream0=data_12, Stream1=data_13)
data_14 = Data(filter)

# ---- group: Inputs / Constrained Form
data_15 = Data(data_14)

# ----
data_16 = Data(data_3)
bool_8 = Boolean(bool)
txt_8 = Text(txt)
txt_9 = Text(txt_2)
data_17 = Data(data_15)
bool_9 = Boolean(bool)
txt_10 = Text(txt)
txt_11 = Text(txt_2)
nameschema = GhPythonScript(topology=data_16, is_3d=bool_8, family_name=txt_8, base_dir=txt_9)  # -> out, filepath; inputs is_3d: Boolean
# ---------- nameschema: Python ----------
"""familyname_diagram_2dor3d_numnodes_numsupports_numloads_numedges_numtrailedges_numdeviationedges_numauxtrails"""


import os

from compas_cem.diagrams import TopologyDiagram
from compas_cem.diagrams import FormDiagram


diagram = topology
# find out diagram type
cls = diagram.__class__.__name__
if cls == "TopologyDiagram":
    diagram_name = "T"

# check dimensionality
if is_3d:
    dim = "3d"
else:
    dim = "2d"
    
# get data from diagram
numnodes = str(len(list(diagram.nodes())))    
numsupports = str(len(list(diagram.support_nodes())))
numloads = str(len(list(diagram.loaded_nodes())))

numedges = str(len(list(diagram.edges())))
numtrailedges = str(len(list(diagram.trail_edges())))
numdeviationedges = str(len(list(diagram.deviation_edges())))
numauxtrails = str(len(list(diagram.auxiliary_trails()))) 
    
schema = (family_name, diagram_name, dim, numnodes, numsupports, numloads, numedges, numtrailedges, numdeviationedges, numauxtrails)
schema = "_".join(schema)
base_dir = os.path.abspath(base_dir)
filepath = os.path.abspath(os.path.join(base_dir, family_name, dim, schema))
# ---------- end nameschema ----------
nameschema_2 = GhPythonScript(form=data_17, is_3d=bool_9, family_name=txt_10, base_dir=txt_11)  # -> out, filepath; inputs is_3d: Boolean
# ---------- nameschema_2: Python ----------
"""familyname_diagram_2dor3d_numnodes_numsupports_numloads_numedges_numtrailedges_numdeviationedges_numauxtrails"""


import os

from compas_cem.diagrams import TopologyDiagram
from compas_cem.diagrams import FormDiagram


diagram = form
# find out diagram type
cls = diagram.__class__.__name__
if cls == "FormDiagram":
    diagram_name = "F"

# check dimensionality
if is_3d:
    dim = "3d"
else:
    dim = "2d"
    
# get data from diagram
numnodes = str(len(list(diagram.nodes())))    
numsupports = str(len(list(diagram.support_nodes())))
numloads = str(len(list(diagram.loaded_nodes())))
numedges = str(len(list(diagram.edges())))
    
schema = (family_name, diagram_name, dim, numnodes, numsupports, numloads, numedges)
schema = "_".join(schema)
base_dir = os.path.abspath(base_dir)
filepath = os.path.abspath(os.path.join(base_dir, family_name, dim, schema))
# ---------- end nameschema_2 ----------
txt_12 = Text(nameschema.filepath)
txt_13 = Text(nameschema_2.filepath)

# ---- group: COMPAS-based Make2D
xy_2 = XYPlane(Origin=Point(0, 0, 0))
data_18 = Data(data_15)
pln_3 = Plane(pln)
orient_and_project_2 = GhPythonScript(form=data_18, initial_plane=pln_3, target_plane=xy_2)  # -> out, form_transformed; inputs initial_plane: Plane, target_plane: Plane
# ---------- orient_and_project_2: Python ----------
from compas_rhino.geometry import RhinoPlane
from compas.geometry import Transformation
from compas.geometry import Projection
from compas.geometry import Frame
from compas.geometry import transform_vectors
from compas.datastructures import network_transformed

# Build frames from rhino planes
frames = []
for plane in (initial_plane, target_plane):
    plane = RhinoPlane.from_geometry(plane)
    frame = Frame(plane.point, plane.xaxis, plane.yaxis)
    frames.append(frame)    
fa, fb = frames

# Re-orient node positions
transf = Transformation.from_frame_to_frame(fa, fb)
form_transformed = network_transformed(form, transf)

# Squash node positions to plane
z = fb.point.z
for node in form_transformed.nodes():
    form_transformed.node_attribute(node, "z", z)
    

# Re-orient and squash loads
for node in form_transformed.nodes():
    # loads
    load = form_transformed.node_load(node)
    loadt = transform_vectors([load], transf).pop()
    form_transformed.node_attributes(node, ("qx", "qy", "qz"), loadt)
    
    # reaction force
    reaction = form_transformed.reaction_force(node)
    reactiont = transform_vectors([reaction], transf).pop()
    form_transformed.node_attributes(node, ("rx", "ry", "rz"), reactiont)
# ---------- end orient_and_project_2 ----------
data_19 = Data(orient_and_project_2.form_transformed)
data_20 = Data(data_19)
python_4 = GhPythonScript(form=data_20, reaction_min="0.001")  # -> out, form
# ---------- python_4: Python ----------
from compas.geometry import length_vector


nodes = list(form.nodes())


for node in nodes:
    if form.is_node_support(node) and length_vector(form.reaction_force(node)) <= reaction_min:
        form.delete_node(node)
# ---------- end python_4 ----------
data_21 = Data(python_4.form)

# ----
txt_14 = Text(txt_13)
num_22 = Number(flatten(num_21))
txt_15 = Text(flatten(txt_7))
bool_10 = Boolean(bool_4)
num_23 = Number(num_10)
num_24 = Number(num_11)
data_22 = Data(data_5)
num_25 = Number(num_12)
num_26 = Number(num_12)
txt_16 = Text(txt_12)
bool_11 = Boolean(bool_5)
data_23 = Data(data_21)
num_27 = Number(num_12)
num_28 = Number(num_14)
num_29 = Number(num_10)
num_30 = Number(num_11)
num_31 = Number(num_13)
num_32 = Number(num_15)
num_33 = Number(num_16)
num_34 = Number(num_17)
data_24 = Data(data_7)
data_25 = Data(data_9)
concat = Concatenate(FragmentA=txt_14, FragmentB=".pdf")
division = Division(A=num_26, B=2)
concat_2 = Concatenate(FragmentA=txt_16, FragmentB=".pdf")
python_5 = GhPythonScript(
    save_file=bool_10,
    topology=data_22,
    edge_width=num_23,
    node_radius=num_24,
    node_edgewidth=num_25,
    load_width=division,
    load_radius=num_24,
    fig_width="16",
    fig_height="9",
    fig_dpi="100",
    filepath=concat_2)  # -> out; inputs save_file: Boolean, fig_width: Int32, fig_height: Int32, fig_dpi: Int32
# ---------- python_5: Python ----------
from compas.rpc import Proxy


kwargs = {"topology": topology,
          "filepath": filepath,
          "edge_width": edge_width,
          "node_radius": node_radius,
          "node_edgewidth": node_edgewidth,
          "load_width": load_width,
          "load_radius": load_radius,
          "fig_width": fig_width,
          "fig_height": fig_height,
          "fig_dpi": fig_dpi}


if save_file:
    with Proxy("compas_cem.plotters") as plotters:
        data = plotters.topology_plotter_proxy(**kwargs)
        
    print("Done!")
    print(data)
# ---------- end python_5 ----------
python_6 = GhPythonScript(
    save_file=bool_11,
    form=data_23,
    edge_width=num_29,
    node_radius=num_30,
    node_edgewidth=num_27,
    load_width=num_31,
    load_scale=num_28,
    load_gap=num_32,
    reaction_width=num_31,
    reaction_scale=num_33,
    reaction_gap=num_34,
    segment=data_24,
    segment_color=data_25,
    segment_width=num_22,
    segment_ls=txt_15,
    fig_width="16",
    fig_height="9",
    fig_dpi="100",
    filepath=concat)  # -> out; inputs save_file: Boolean, segment: list, segment_color: list, segment_width: list, segment_ls: list, fig_width: Int32, fig_height: Int32, fig_dpi: Int32
# ---------- python_6: Python ----------
from compas.rpc import Proxy


kwargs = {"form": form,
          "filepath": filepath,
          "edge_width": edge_width,
          "node_radius": node_radius,
          "node_edgewidth": node_edgewidth,
          "load_width": load_width,
          "load_scale": load_scale,
          "load_gap": load_gap,
          "reaction_width": reaction_width,
          "reaction_scale": reaction_scale,
          "reaction_gap": reaction_gap,
          "segment": segment,
          "segment_color": segment_color,
          "segment_width": segment_width,
          "segment_ls": segment_ls,
          "fig_width": fig_width,
          "fig_height": fig_height,
          "fig_dpi": fig_dpi}


if save_file:
    with Proxy("compas_cem.plotters") as plotters:
        plotters.form_plotter_proxy(**kwargs)
        
    print("Done!")
# ---------- end python_6 ----------
panel_5 = Panel(python_5)
panel_6 = Panel(python_6)

txt_17 = Text(txt_12)
txt_18 = Text(txt_13)
bool_12 = Boolean(bool_2)
data_26 = Data(data_3)
bool_13 = Boolean(bool_3)
data_27 = Data(data_15)
exportjson = GhPythonScript(export=bool_12, diagram=data_26, filepath=txt_17)  # -> out
# ---------- exportjson: Python ----------
if export:
    diagram.to_json(filepath + ".json")
    
    print("Exported file to {}!".format(filepath + ".json"))
# ---------- end exportjson ----------
exportjson_2 = GhPythonScript(export=bool_13, diagram=data_27, filepath=txt_18)  # -> out; same code as exportjson
panel_7 = Panel(exportjson_2)
panel_8 = Panel(exportjson)

num_35 = Number(num_9)
num_36 = Number(num_7)
data_28 = Data(data_14)
num_37 = Number(num_8)
int_4 = Integer(int)
col_5 = Colour(col_4)
swatch = ColourSwatch(SwatchColor=RGBA(156, 156, 156, 195))

num_38 = Number(num_36)
int_5 = Integer(int_4)
data_29 = Data(data_28)
num_39 = Number(num_35)
num_40 = Number(num_37)
formartist = FormArtist(form=data_29, force_min=num_39, force_scale=num_40)  # -> nodes, support_nodes, edges, loads, reactions; inputs node: list of Int32, edge: list
#   port form: A COMPAS CEM topology diagram.
#   port node: A selection of the nodes in the diagram. Defaults to all the nodes.
#   port edge: A selection of the edges in the diagram. Defaults to all the edges.
#   port force_min: The smallest force magnitude to draw. Defaults to 1e-3
#   port force_scale: The scale of the loads and the reactions. Defaults to 1.
#   port nodes: The nodes of the diagram as points.
#   port support_nodes: The support nodes of the diagram as points
#   port edges: The edges of the diagram as lines.
#   port loads: The applied loads as lines.
#   port reactions: The reaction forces at the supports, as lines.
# ---------- formartist: Python ----------
"""
Draw a form diagram.
"""
from ghpythonlib.componentbase import executingcomponent as component

from compas_cem.ghpython import FormArtist


class FormArtistComponent(component):
    def RunScript(self, form, node, edge, force_min, force_scale):
        force_min = force_min or 1e-3
        force_scale = force_scale or 1
        if form:
            artist = FormArtist(form)

            nodes = artist.draw_nodes(node)
            edges = artist.draw_edges(edge)
            support_nodes = artist.draw_nodes_support(node)

            loads = artist.draw_loads(node, min_load=force_min, scale=force_scale)
            reactions = artist.draw_reactions(node, min_force=force_min, scale=force_scale)

            return nodes, support_nodes, edges, loads, reactions
# ---------- end formartist ----------
edgeresults = EdgeResults(form=data_29)  # -> length, force; inputs edge: list
#   port form: A COMPAS CEM form diagram.
#   port edge: A selection of edge keys to query the results on. Defaults to all the edges.
#   port length: The edge lengths.
#   port force: The edge forces.
# ---------- edgeresults: Python ----------
"""
Extract the post form-finding results of the edges in a form diagram.
"""
from ghpythonlib.componentbase import executingcomponent as component


class EdgeResultsComponent(component):
    def RunScript(self, form, edge):
        if form:
            edge = edge or list(form.edges())
            length = [form.edge_length_2(ed) for ed in edge]
            force = [form.edge_force(ed) for ed in edge]
            return length, force
# ---------- end edgeresults ----------
formdisassembly = DisassembleFormDiagram(form=data_29)  # -> nodes, support_nodes, edges
#   port form: A COMPAS CEM form diagram.
#   port nodes: All the node keys in the form diagram.
#   port support_nodes: The keys of the support nodes in the form diagram.
#   port edges: All the edge keys in the form diagram.
# ---------- formdisassembly: Python ----------
"""
Disassemble a form diagram into its constituent parts.
"""
from ghpythonlib.componentbase import executingcomponent as component


class FormDisassemblyComponent(component):
    def RunScript(self, form):
        if form:
            edges = list(form.edges())
            nodes = list(form.nodes())
            support_nodes = list(form.support_nodes())

            return nodes, support_nodes, edges
# ---------- end formdisassembly ----------
larger = LargerThan(FirstNumber=edgeresults.force, SecondNumber=0)  # -> LargerThan, OrEqualTo
abs = Absolute(Value=edgeresults.force)
filter_2 = StreamFilter(Gate=int_5, Stream0=edgeresults.force, Stream1=edgeresults.length)
item_5 = ListItem(List=merge_4, Index=larger.OrEqualTo, Wrap=True)
multiplication = Multiplication(A=abs, B=num_38)
python_7 = GhPythonScript(x=filter_2)  # -> out, a
# ---------- python_7: Python ----------
a = round(x, 3)
# ---------- end python_7 ----------
int_6 = Integer(formdisassembly.nodes)
data_30 = Data(formdisassembly.edges)
pt_3 = Point(formartist.nodes)
crv_4 = Curve(formartist.edges)
crv_5 = Curve(formartist.loads)
crv_6 = Curve(formartist.loads)
crv_7 = Curve(formartist.reactions)
col_6 = Colour(item_5)
num_41 = Number(multiplication)
num_42 = Number(python_7.a)

pt_4 = Point(pt_3)
int_7 = Integer(int_6)
data_31 = Data(data_30)
crv_8 = Curve(crv_4)
crv_9 = Curve(crv_5)
crv_10 = Curve(crv_6)
crv_11 = Curve(crv_7)
col_7 = Colour(col_6)
num_43 = Number(num_41)
num_44 = Number(num_42)
data_32 = Data(data_31)
pt_5 = Point(pt_4)
int_8 = Integer(int_7)
crv_12 = Curve(crv_8)
midpt = CurveMiddle(Curve=crv_12)

col_8 = Colour(col_7)
num_45 = Number(num_43)
crv_13 = Curve(crv_8)

crv_14 = Curve(crv_10)
crv_15 = Curve(crv_11)
col_9 = Colour(col_5)
end_11 = EndPoints(Curve=crv_14)  # -> Start, End
end_12 = EndPoints(Curve=crv_15)  # -> Start, End
vec2pt = Vector2Pt(PointA=end_12.Start, PointB=end_12.End, Unitize=False)  # -> Vector, Length
vec2pt_2 = Vector2Pt(PointA=end_11.Start, PointB=end_11.End, Unitize=False)  # -> Vector, Length

num_46 = Number(num_44)
crv_16 = Curve(crv_8)
midpt_2 = CurveMiddle(Curve=crv_16)

# ---- group: Edges
previewlw = CustomPreviewLineweights(Geometry=crv_13, Shader=col_8, Thickness=num_45, Absolute=False)

# ---- group: Loads
vdisex = VectorDisplayEx(Point=end_11.Start, Vector=vec2pt_2.Vector, Colour=col_9, Width=2)

# ---- group: Edge results
tag = TextTag(Location=midpt_2, Text=num_46, Colour=ColourSwatch(SwatchColor=RGBA(255, 0, 0, 195)))

# ---- group: Reaction forces
vdisex_2 = VectorDisplayEx(Point=end_12.Start, Vector=vec2pt.Vector, Colour=col_9, Width=2)

# ---- group: Edge keys
tag_2 = TextTag(Location=midpt, Text=data_32, Colour=swatch)

# ---- group: Node keys
tag_3 = TextTag(Location=pt_5, Text=int_8, Colour=swatch)

# ----
num_47 = Number(num_3)
data_33 = Data(data)
num_48 = Number(num_4)
num_49 = Number(num_6)
col_10 = Colour(col_3)
col_11 = Colour(col)
col_12 = Colour(col_2)

num_50 = Number(num_49)
num_51 = Number(num_48)
num_52 = Number(num_47)
data_34 = Data(data_33)
topologyartist_2 = TopologyArtist(topology=data_34)  # -> nodes, origin_nodes, support_nodes, edges, trail_edges, deviation_edges, loads; inputs node: list of Int32, edge: list; same code as topologyartist
topologydisassembly_3 = DisassembleTopologyDiagram(topology=data_34)  # -> nodes, origin_nodes, support_nodes, edges, trail_edges, deviation_edges, trails, auxiliary_trails; same code as topologydisassembly
python_8 = GhPythonScript(topology=data_34, auxiliary_trail=topologydisassembly_3.auxiliary_trails)  # -> out, auxiliary_trail; inputs auxiliary_trail: list
# ---------- python_8: Python ----------
from compas_cem.ghpython import TopologyArtist


if auxiliary_trail is not None:
    artist = TopologyArtist(topology)
   
    if auxiliary_trail is not None:
        auxiliary_trail = artist.draw_edges_trail(auxiliary_trail)
# ---------- end python_8 ----------
python_9 = GhPythonScript(trail=topologydisassembly_3.trail_edges, auxiliary_trail=topologydisassembly_3.auxiliary_trails)  # -> out, trail; inputs trail: list, auxiliary_trail: list
# ---------- python_9: Python ----------
trail = [tr for tr in trail if tr not in auxiliary_trail]
# ---------- end python_9 ----------
topologyartist_3 = TopologyArtist(topology=data_34, edge=python_9.trail, load_min=num_51, load_scale=num_52)  # -> nodes, origin_nodes, support_nodes, edges, trail_edges, deviation_edges, loads; inputs node: list of Int32, edge: list
#   port topology: A COMPAS CEM topology diagram.
#   port node: A selection of the nodes in the diagram. Defaults to all the nodes.
#   port edge: A selection of the edges in the diagram. Defaults to all the edges.
#   port load_min: The minimum load magnitude to plot. Defaults to 1e-3.
#   port load_scale: The scaling factor of the loads. Defaults to 1.
#   port nodes: The nodes in the diagram as points.
#   port origin_nodes: The origin nodes in the diagram as points.
#   port support_nodes: The position of the support nodes in the diagram.
#   port edges: The edges in the diagram as lines.
#   port trail_edges: The trail edges in the diagram as lines.
#   port deviation_edges: The deviation edges in the diagram as lines.
#   port loads: The applied node loads as lines.
# ---------- topologyartist_3: Python ----------
"""
Draw a topology diagram.
"""
from ghpythonlib.componentbase import executingcomponent as component

from compas_cem.ghpython import TopologyArtist


class TopologyArtistComponent(component):
    def RunScript(self, topology, node, edge, load_min, load_scale):
        node = node or None
        edge = edge or None
        load_min = load_min or 1e-3
        load_scale = load_scale or 1.0
        if topology:
            artist = TopologyArtist(topology)

            nodes = artist.draw_nodes(node)
            origin_nodes = artist.draw_nodes_origin(node)
            support_nodes = artist.draw_nodes_support(node)

            edges = artist.draw_edges(edge)
            trail_edges = artist.draw_edges_trail(node)
            deviation_edges = artist.draw_edges_deviation(node)

            loads = artist.draw_loads(node, min_load=load_min, scale=load_scale)

            return nodes, origin_nodes, support_nodes, edges, trail_edges, deviation_edges, loads
# ---------- end topologyartist_3 ----------
entwine_9 = Entwine(Branch00=topologyartist_3.origin_nodes, Branch01=topologyartist_3.support_nodes, FlattenInputs=True)
edgeresults_2 = EdgeResults(form=data_34, edge=python_9.trail)  # -> length, force; inputs edge: list; same code as edgeresults
edgeresults_3 = EdgeResults(form=data_34, edge=topologydisassembly_3.deviation_edges)  # -> length, force; inputs edge: list; same code as edgeresults
larger_2 = LargerThan(FirstNumber=edgeresults_3.force, SecondNumber=0)  # -> LargerThan, OrEqualTo
larger_3 = LargerThan(FirstNumber=edgeresults_2.length, SecondNumber=0)  # -> LargerThan, OrEqualTo
sph = Sphere(Base=entwine_9, Radius=num_50)
item_6 = ListItem(List=merge_5, Index=larger_2.OrEqualTo, Wrap=True)
item_7 = ListItem(List=merge_5, Index=larger_3.OrEqualTo, Wrap=True)
graft = GraftTree(Tree=item_6, IncludeEmptyLists=True, IncludeNullItems=True)
int_9 = Integer(topologydisassembly_3.nodes)
pt_6 = Point(topologyartist_2.nodes)
num_53 = Number(edgeresults_2.length)
num_54 = Number(edgeresults_3.force)
col_13 = Colour(graft)
data_35 = Data(topologydisassembly_3.edges)
crv_17 = Curve(topologyartist_2.edges)

# ---- group: trail edges w/o aux
crv_18 = Curve(topologyartist_3.edges)

# ---- group: aux trails
crv_19 = Curve(python_8.auxiliary_trail)

# ---- group: deviation edges
crv_20 = Curve(topologyartist_3.deviation_edges)

# ----
crv_21 = Curve(topologyartist_3.loads)
brep = Brep(sph)
col_14 = Colour(item_7)

data_36 = Data(data_35)
int_10 = Integer(int_9)
pt_7 = Point(pt_6)
crv_22 = Curve(crv_18)
crv_23 = Curve(crv_19)
crv_24 = Curve(crv_20)
crv_25 = Curve(crv_21)
brep_2 = Brep(brep)
num_55 = Number(num_53)
num_56 = Number(num_54)
col_15 = Colour(col_14)
col_16 = Colour(col_13)
crv_26 = Curve(crv_17)

data_37 = Data(data_36)
pt_8 = Point(pt_7)
crv_27 = Curve(crv_26)
int_11 = Integer(int_10)
swatch_2 = ColourSwatch(SwatchColor=RGBA(156, 156, 156, 195))
midpt_3 = CurveMiddle(Curve=crv_27)

crv_28 = Curve(crv_22)
num_57 = Number(num_55)
crv_29 = Curve(crv_24)
num_58 = Number(num_56)
swatch_3 = ColourSwatch(SwatchColor=RGB(184, 184, 184))
midpt_4 = CurveMiddle(Curve=crv_28)
midpt_5 = CurveMiddle(Curve=crv_29)

crv_30 = Curve(crv_23)
crv_31 = Curve(crv_22)
col_17 = Colour(col_15)
col_18 = Colour(col_11)
crv_32 = Curve(crv_24)
num_59 = Number(num_5)
col_19 = Colour(col_16)
dash = DashPattern(Curve=crv_32, Pattern=num_59)  # -> Dashes, Gaps

crv_33 = Curve(crv_25)
col_20 = Colour(col_10)
end_13 = EndPoints(Curve=crv_33)  # -> Start, End
vec2pt_3 = Vector2Pt(PointA=end_13.Start, PointB=end_13.End, Unitize=False)  # -> Vector, Length

brep_3 = Brep(brep_2)
col_21 = Colour(col_12)

# ---- group: Trail edges
preview = CustomPreview(Geometry=crv_31, Material=col_17)

# ---- group: Deviation edges
preview_2 = CustomPreview(Geometry=crv_30, Material=col_18)

# ---- group: Auxiliary trails
preview_3 = CustomPreview(Geometry=dash.Dashes, Material=col_19)

# ---- group: Trail lengths
tag_4 = TextTag(Location=midpt_4, Text=num_57, Colour=swatch_3)

# ---- group: Deviation forces
tag_5 = TextTag(Location=midpt_5, Text=num_58, Colour=swatch_3)

# ---- group: Nodes
preview_4 = CustomPreview(Geometry=brep_3, Material=col_21)

# ---- group: Loads
vdisex_3 = VectorDisplayEx(Point=end_13.Start, Vector=vec2pt_3.Vector, Colour=col_20, Width=2)

# ---- group: Edge keys
tag_6 = TextTag(Location=midpt_3, Text=data_37, Colour=swatch_2)

# ---- group: Node keys
# 03 Export Data
tag_7 = TextTag(Location=pt_8, Text=int_11, Colour=swatch_2)
