# Grasshopper definition Baumstutze_3d.ghx (Grasshopper 1.0.7)
# plug-ins: Human, Telepathy, Wombat

Y = UnitY(Factor=1)
starting_curve = Curve(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)
move = Move(Geometry=starting_curve, Motion=Y)  # -> Geometry, Transform
number_slider = Slider(21, range=0..100)
number_slider_2 = Slider(0.56, range=0..10)
multiplication = Multiplication(A=Slider(21, range=2..21), B=2)
number_slider_3 = Slider(21, range=0..100)
number_slider_4 = Slider(0.56, range=0..10)
number_slider_5 = Slider(0.29, range=0..1)
number_slider_6 = Slider(0.372, range=0..1)
number_slider_7 = Slider(0.123, range=0..1)
addition = Addition(A=multiplication, B=1)
neg = Negative(Value=number_slider_2)
divide = DivideCurve(Curve=move.Geometry, Count=Slider(3, range=0..100), Kinks=False)  # -> Points, Tangents, Parameters
number_slider_8 = Slider(0.29, range=0..1)
subtraction = Subtraction(A="1", B=number_slider_5)
entwine = Entwine(Branch00=number_slider_2, Branch01=neg, FlattenInputs=True)
number_slider_9 = Slider(0.372, range=0..1)
number_slider_10 = Slider(0.123, range=0..1)
subtraction_2 = Subtraction(A="1", B=number_slider_7)
divide_2 = DivideCurve(Curve=move.Geometry, Count=addition, Kinks=False)  # -> Points, Tangents, Parameters
neg_2 = Negative(Value=number_slider_6)
cull_ends = CullEnds(List=divide.Points)  # -> List, Culled
starting_curve_2 = Curve(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)
neg_3 = Negative(Value=number_slider_4)
num = Number([number_slider_5, subtraction])
num_2 = Number([number_slider_7, subtraction_2])
X = UnitX(Factor=entwine)
divide_3 = DivideCurve(Curve=starting_curve_2, Count=Slider(3, range=0..100), Kinks=False)  # -> Points, Tangents, Parameters
entwine_2 = Entwine(Branch00=neg_2, Branch01=number_slider_6, FlattenInputs=True)
subtraction_3 = Subtraction(A="1", B=number_slider_8)
entwine_3 = Entwine(Branch00=number_slider_4, Branch01=neg_3, FlattenInputs=True)
eval = EvaluateCurve(Curve=reparameterize(move.Geometry), Parameter=num)  # -> Point, Tangent, Angle
subtraction_4 = Subtraction(A="1", B=number_slider_10)
divide_4 = DivideCurve(Curve=starting_curve_2, Count=addition, Kinks=False)  # -> Points, Tangents, Parameters
end = EndPoints(Curve=move.Geometry)  # -> Start, End
neg_4 = Negative(Value=number_slider_9)
move_2 = Move(Geometry=cull_ends.List, Motion=X)  # -> Geometry, Transform
cull_ends_2 = CullEnds(List=divide_3.Points)  # -> List, Culled
Z = UnitZ(Factor=1)
eval_2 = EvaluateCurve(Curve=reparameterize(move.Geometry), Parameter=num_2)  # -> Point, Tangent, Angle
neg_5 = Negative(Value=Z)
X_2 = UnitX(Factor=entwine_2)
Z_2 = UnitZ(Factor=Slider(1.23, range=0..10))
cp = ClosestPoint(Point=move_2.Geometry, Cloud=divide_2.Points)  # -> ClosestPoint, CPIndex, Distance
num_3 = Number([number_slider_8, subtraction_3])
cp_2 = ClosestPoint(Point=eval.Point, Cloud=divide_2.Points)  # -> ClosestPoint, CPIndex, Distance
num_4 = Number([number_slider_10, subtraction_4])
X_3 = UnitX(Factor=entwine_3)
entwine_4 = Entwine(Branch00=neg_4, Branch01=number_slider_9, FlattenInputs=True)
support2 = RemoteSender([end.Start, end.End])
flip = FlipMatrix(Data=cp.ClosestPoint)
avr = Average(Input=flip)
pline = PolyLine(Vertices=divide_2.Points, Closed=False)
neg_6 = Negative(Value=Z_2)
eval_3 = EvaluateCurve(Curve=reparameterize(starting_curve_2), Parameter=num_3)  # -> Point, Tangent, Angle
# 01 CEM framework model
move_3 = Move(Geometry=avr, Motion=X_2)  # -> Geometry, Transform
end_2 = EndPoints(Curve=starting_curve_2)  # -> Start, End
move_4 = Move(Geometry=cull_ends_2.List, Motion=X_3)  # -> Geometry, Transform
Z_3 = UnitZ(Factor=1)
eval_4 = EvaluateCurve(Curve=reparameterize(starting_curve_2), Parameter=num_4)  # -> Point, Tangent, Angle
neg_7 = Negative(Value=Z_3)
Z_4 = UnitZ(Factor=1)
move_5 = Move(Geometry=eval_2.Point, Motion=neg_6)  # -> Geometry, Transform
X_4 = UnitX(Factor=entwine_4)
Z_5 = UnitZ(Factor=Slider(1.23, range=0..10))
cp_3 = ClosestPoint(Point=move_4.Geometry, Cloud=divide_4.Points)  # -> ClosestPoint, CPIndex, Distance
cp_4 = ClosestPoint(Point=eval_3.Point, Cloud=divide_4.Points)  # -> ClosestPoint, CPIndex, Distance
explode = Explode(Curve=pline, Recursive=True)  # -> Segments, Vertices
neg_8 = Negative(Value=Z_4)
support = RemoteSender([end_2.Start, end_2.End])
flip_2 = FlipMatrix(Data=cp_3.ClosestPoint)
avr_2 = Average(Input=flip_2)
pline_2 = PolyLine(Vertices=divide_4.Points, Closed=False)
neg_9 = Negative(Value=Z_5)
number_slider_11 = Slider(0.99, range=0..1)
line = LineSDL(Start=move_3.Geometry, Direction=neg_5, Length=Slider(0.36, range=0..1))
# 01 CEM framework model
move_6 = Move(Geometry=avr_2, Motion=X_4)  # -> Geometry, Transform
ln = Line(StartPoint=[end.Start, end.End], EndPoint=move_5.Geometry)
Z_6 = UnitZ(Factor=1)
move_7 = Move(Geometry=eval_4.Point, Motion=neg_9)  # -> Geometry, Transform
line_2 = LineSDL(Start=move_5.Geometry, Direction=neg_8, Length=Slider(0.108, range=0..1))  # disabled
mp = Midpoint(Curve=explode.Segments)
ln_2 = Line(StartPoint=cp_2.ClosestPoint, EndPoint=move_5.Geometry)
pt = Point(Point(0, 0, 0))
mp_2 = Midpoint(Curve=move.Geometry)
end_3 = EndPoints(Curve=line_2)  # -> Start, End
explode_2 = Explode(Curve=pline_2, Recursive=True)  # -> Segments, Vertices
end_4 = EndPoints(Curve=line)  # -> Start, End

# ---- group: Reload compas_cem
python = GhPythonScript(unload=Button())  # -> out; inputs unload: Boolean
# ---------- python: Python ----------
from compas_ghpython.utilities import unload_modules


if unload:
    unloaded = unload_modules("compas")
    print("Unloaded: {}".format(unloaded))
# ---------- end python ----------

# ----
neg_10 = Negative(Value=Z_6)
cp_5 = ClosestPoint(Point=pt, Cloud=mp)  # -> ClosestPoint, CPIndex, Distance
number_slider_12 = Slider(0.99, range=0..1)
python_2 = GhPythonScript(unload=Button())  # -> out; inputs unload: Boolean; same code as python
line_3 = LineSDL(Start=move_6.Geometry, Direction=neg_7, Length=Slider(0.36, range=0..1))
flip_3 = FlipCurve(Curve=ln)  # -> Curve, Flag
ln_3 = Line(StartPoint=[end_2.Start, end_2.End], EndPoint=move_7.Geometry)
line_4 = LineSDL(Start=move_7.Geometry, Direction=neg_10, Length=Slider(0.108, range=0..1))  # disabled
mp_3 = Midpoint(Curve=explode_2.Segments)
ln_4 = Line(StartPoint=cp_4.ClosestPoint, EndPoint=move_7.Geometry)
pt_2 = Point(Point(0, 0, 0))
mp_4 = Midpoint(Curve=starting_curve_2)
Z_7 = UnitZ(Factor=1)
end_5 = EndPoints(Curve=line_4)  # -> Start, End
cull_i = CullIndex(List=explode.Segments, Indices=cp_5.CPIndex, Wrap=True)
item = ListItem(List=explode.Segments, Index=cp_5.CPIndex, Wrap=True)
end_6 = EndPoints(Curve=line_3)  # -> Start, End
support_2 = RemoteSender(end_3.End)  # disabled
cp_6 = ClosestPoint(Point=pt_2, Cloud=mp_3)  # -> ClosestPoint, CPIndex, Distance
flip_4 = FlipCurve(Curve=ln_3)  # -> Curve, Flag
Y_2 = UnitY(Factor=1)
number_slider_13 = Slider(0.158, range=0..1)
neg_11 = Negative(Value=Z_7)
other = Curve(cull_i)
mid = Curve(item)
ln_5 = Line(StartPoint=end_4.End, EndPoint=flip)
Z_8 = UnitZ(Factor=1)
cull_i_2 = CullIndex(List=explode_2.Segments, Indices=cp_6.CPIndex, Wrap=True)
item_2 = ListItem(List=explode_2.Segments, Index=cp_6.CPIndex, Wrap=True)
end_7 = EndPoints(Curve=ln_5)  # -> Start, End
support_3 = RemoteSender(end_5.End)  # disabled
line_5 = LineSDL(Start=divide_4.Points, Direction=Y_2, Length=1)
line_6 = LineSDL(Start=mp_2, Direction=neg_11, Length=Slider(1.37, range=0..10))
deck2 = RemoteSender(other)
number_slider_14 = Slider(0.158, range=0..1)
neg_12 = Negative(Value=Z_8)
other_2 = Curve(cull_i_2)
mid_2 = Curve(item_2)
neg_13 = Negative(Value=number_slider_13)
cullpt = CullDuplicates(Points=end_7.Start, Tolerance=0.1, CullMode=3)  # -> Points, Indices, Valence
ln_6 = Line(StartPoint=end_6.End, EndPoint=flip_2)
mp_5 = Midpoint(Curve=line_6)
flip_5 = FlipMatrix()
end_8 = EndPoints(Curve=ln_6)  # -> Start, End
entwine_5 = Entwine(Branch00=number_slider_13, Branch01=neg_13, FlattenInputs=True)
line_7 = LineSDL(Start=mp_4, Direction=neg_12, Length=Slider(1.37, range=0..10))
deck = RemoteSender(other_2)
neg_14 = Negative(Value=number_slider_14)
end_9 = EndPoints(Curve=line_6)  # -> Start, End
cullpt_2 = CullDuplicates(Points=end_8.Start, Tolerance=0.1, CullMode=3)  # -> Points, Indices, Valence
mp_6 = Midpoint(Curve=line_7)
X_5 = UnitX(Factor=entwine_5)
entwine_6 = Entwine(Branch00=number_slider_14, Branch01=neg_14, FlattenInputs=True)
move_8 = Move(Geometry=mp_5, Motion=X_5)  # -> Geometry, Transform
ln_7 = Line(StartPoint=cullpt.Points, EndPoint=move_8.Geometry)
end_10 = EndPoints(Curve=line_7)  # -> Start, End
pline_3 = PolyLine(Vertices=flatten(move_8.Geometry), Closed=False)
X_6 = UnitX(Factor=entwine_6)
vs = Curve(ln_5)
branches = Curve(ln_7)
move_9 = Move(Geometry=mp_6, Motion=X_6)  # -> Geometry, Transform
ln_8 = Line(StartPoint=cullpt_2.Points, EndPoint=move_9.Geometry)
pdecon = Deconstruct(Point=end_9.End)  # -> XComponent, YComponent, ZComponent
pline_4 = PolyLine(Vertices=flatten(move_9.Geometry), Closed=False)
between_brnaches = Curve(pline_3)
end_11 = EndPoints(Curve=between_brnaches)  # -> Start, End
pdecon_2 = Deconstruct(Point=end_11.End)  # -> XComponent, YComponent, ZComponent
subtraction_5 = Subtraction(A=pdecon_2.ZComponent, B=pdecon.ZComponent)
Z_9 = UnitZ(Factor=subtraction_5)
bang = ExplodeTree(Data=ln_5)  # -> Branch0, Branch1
vs_2 = Curve(ln_6)
neg_15 = Negative(Value=Z_9)
branches_2 = Curve(ln_8)
neg_16 = Negative(Value=Slider(0.1, range=0..0.1))
merge = Merge(Data1=end_11.Start, Data2=end_11.End)
pdecon_3 = Deconstruct(Point=end_10.End)  # -> XComponent, YComponent, ZComponent
entwine_7 = Entwine(Branch00=bang.Branch0, Branch01=reverse(bang.Branch1), FlattenInputs=True)
move_10 = Move(Geometry=merge, Motion=neg_15)  # -> Geometry, Transform
support2_2 = RemoteSender(move_10.Geometry)
between_brnaches_2 = Curve(pline_4)
end_12 = EndPoints(Curve=between_brnaches_2)  # -> Start, End
pdecon_4 = Deconstruct(Point=end_12.End)  # -> XComponent, YComponent, ZComponent
subtraction_6 = Subtraction(A=pdecon_4.ZComponent, B=pdecon_3.ZComponent)
Z_10 = UnitZ(Factor=subtraction_6)
bang_2 = ExplodeTree(Data=ln_6)  # -> Branch0, Branch1
neg_17 = Negative(Value=Z_10)
deviationedge = DeviationEdge(line=line_5, force=neg_16)  # -> deviation_edge; inputs line: Line
#   port line: A line that defines the end nodes of the edge.
#   port force: The desired force on the edge. If negative, the edge is in compression. Otherwise, it is in tension.
#   port deviation_edge: A COMPAS CEM deviation edge.
# ---------- deviationedge: Python ----------
"""
Create a deviation edge from a rhino line.
"""
from ghpythonlib.componentbase import executingcomponent as component

from compas_cem.elements import DeviationEdge


class DeviationEdgeComponent(component):
    def RunScript(self, line, force):
        if line and force is not None:
            return DeviationEdge.from_rhino_line(line, force)
# ---------- end deviationedge ----------
ln_9 = Line(StartPoint=merge, EndPoint=move_10.Geometry)
crv = Curve(line_2)
item_3 = ListItem(List=entwine_7, Index=0, Wrap=True)  # -> Item, Item1
merge_2 = Merge(Data1=end_12.Start, Data2=end_12.End)
entwine_8 = Entwine(Branch00=bang_2.Branch0, Branch01=reverse(bang_2.Branch1), FlattenInputs=True)
move_11 = Move(Geometry=merge_2, Motion=neg_17)  # -> Geometry, Transform
support_4 = RemoteSender(move_11.Geometry)
deck2_2 = RemoteReceiver(deck2)
len = Length(Curve=deck2_2)
neg_18 = Negative(Value=Slider(4.4, range=0..10))
neg_19 = Negative(Value=Slider(0.2, range=0..10))
divide_5 = DivideCurve(Curve=ln_9, Count=Slider(4, range=0..10), Kinks=False)  # -> Points, Tangents, Parameters
neg_20 = Negative(Value=Slider(0.1, range=0..10))
neg_21 = Negative(Value=Slider(4.6, range=0..10))
neg_22 = Negative(Value=Slider(12.9, range=0..20))
neg_23 = Negative(Value=Slider(0.1, range=0..0.1))
bang_3 = ExplodeTree(Data=divide_5.Points)  # -> Branch0, Branch1
ln_10 = Line(StartPoint=merge_2, EndPoint=move_11.Geometry)
crv_2 = Curve(line_4)
item_4 = ListItem(List=entwine_8, Index=0, Wrap=True)  # -> Item, Item1
neg_24 = Negative(Value=len)
ln_11 = Line(StartPoint=bang_3.Branch0, EndPoint=bang_3.Branch1)
entwine_9 = Entwine(Branch00=between_brnaches, Branch01=ln_11, FlattenInputs=True)  # -> flatten(Result)
between_brnaches_3 = Curve(entwine_9)
cull_ends_3 = CullEnds(List=between_brnaches_3)  # -> List, Culled
deck2_3 = RemoteReceiver(deck2)
deck_2 = RemoteReceiver(deck)

len_2 = Length(Curve=deck_2)
neg_25 = Negative(Value=len_2)
trailedge = TrailEdge(line=deck_2, length=neg_25)  # -> trail_edge; inputs line: Line
#   port line: A line that defines the end nodes of the edge.
#   port length: The desired length of the edge. If negative, the edge is in compression. Otherwise, it is in tension.
#   port trail_edge: A COMPAS CEM trail edge.
# ---------- trailedge: Python ----------
"""
Create a trail edge from a rhino line.
"""
from ghpythonlib.componentbase import executingcomponent as component

from compas_cem.elements import TrailEdge


class TrailEdgeComponent(component):
    def RunScript(self, line, length):
        if line and length is not None:
            return TrailEdge.from_rhino_line(line, length)
# ---------- end trailedge ----------

deviationedge_2 = DeviationEdge(line=item_3.Item1, force=neg_20)  # -> deviation_edge; inputs line: Line; same code as deviationedge
deviationedge_3 = DeviationEdge(line=item_3.Item, force=neg_21)  # -> deviation_edge; inputs line: Line; same code as deviationedge
support2_3 = RemoteReceiver([support2_2, support2])
Z_11 = UnitZ(Factor=neg_23)
deviationedge_4 = DeviationEdge(line=cull_ends_3.Culled, force=neg_18)  # -> deviation_edge; inputs line: Line; same code as deviationedge
neg_26 = Negative(Value=Slider(4.4, range=0..10))
divide_6 = DivideCurve(Curve=ln_10, Count=Slider(4, range=0..10), Kinks=False)  # -> Points, Tangents, Parameters
neg_27 = Negative(Value=Slider(0.1, range=0..10))
pline_5 = PolyLine(Vertices=divide_5.Points, Closed=False)
deviationedge_5 = DeviationEdge(line=mid, force=neg_22)  # -> deviation_edge; inputs line: Line; same code as deviationedge
bang_4 = ExplodeTree(Data=divide_6.Points)  # -> Branch0, Branch1
lineload = GhPythonScript(line=flatten([deck2_3, mid]), load_vector=Z_11)  # -> out, point, vector; inputs line: list of Line, load_vector: Vector3d
# ---------- lineload: Python ----------
from compas_rhino.geometry import RhinoLine
from compas_rhino.geometry import RhinoVector

from compas.geometry import add_vectors
from compas.geometry import scale_vector

from compas.utilities import geometric_key

import rhinoscriptsyntax as rs

gkey_xyz = {}
gkey_load = {}

load_vector = RhinoVector.from_geometry(load_vector).to_compas()

for ln in line:
    ln = RhinoLine.from_geometry(ln).to_compas()
    
    # calculate load on line end-points    
    lvec = scale_vector(load_vector, ln.length * 0.5)
    
    for pt in ln:
        gkey = geometric_key(pt)
        gkey_xyz[gkey] = pt
        
        if gkey in gkey_load:
            gkey_load[gkey] = add_vectors(gkey_load[gkey], lvec)
        else:
            gkey_load[gkey] = lvec

point = []
vector = []

for gkey, xyz in gkey_xyz.items():
    point.append(rs.AddPoint(*xyz))
    vector.append(rs.AddPoint(*gkey_load[gkey]))
# ---------- end lineload ----------
nodesupport = NodeSupport(point=support2_3)  # -> node_support; inputs point: Point3d
#   port point: The position of the node where to assign a support.
#   port node_support: A COMPAS CEM node support.
# ---------- nodesupport: Python ----------
"""
Create a node support from a rhino point.
"""
from ghpythonlib.componentbase import executingcomponent as component

from compas_cem.supports import NodeSupport


class NodeSupportComponent(component):
    def RunScript(self, point):
        if point:
            return NodeSupport.from_rhino_point(point)
# ---------- end nodesupport ----------
ln_12 = Line(StartPoint=bang_4.Branch0, EndPoint=bang_4.Branch1)
entwine_10 = Entwine(Branch00=between_brnaches_2, Branch01=ln_12, FlattenInputs=True)  # -> flatten(Result)
between_brnaches_4 = Curve(entwine_10)
cull_ends_4 = CullEnds(List=between_brnaches_4)  # -> List, Culled
deck_3 = RemoteReceiver(deck)
explode_3 = Explode(Curve=pline_5, Recursive=True)  # -> Segments, Vertices
support_5 = RemoteReceiver([support, support_3, support_4, support_2])
pline_6 = PolyLine(Vertices=divide_6.Points, Closed=False)
trailedge_2 = TrailEdge(line=deck2_2, length=neg_24)  # -> trail_edge; inputs line: Line; same code as trailedge
len_3 = Length(Curve=pline_5)
neg_28 = Negative(Value=len_3)
merge_3 = Merge(Data1=branches)
len_4 = Length(Curve=merge_3)
neg_29 = Negative(Value=len_4)
nodeload = NodeLoad(point=lineload.point, vector=lineload.vector)  # -> node_load; inputs point: Point3d, vector: Vector3d
#   port point: The position of the node where to apply the load.
#   port vector: The load vector.
#   port node_load: A COMPAS CEM node load.
# ---------- nodeload: Python ----------
"""
Create a load vector to be applied at a node.
"""
from ghpythonlib.componentbase import executingcomponent as component

from compas_cem.loads import NodeLoad


class NodeLoadComponent(component):
    def RunScript(self, point, vector):
        if point and vector:
            return NodeLoad.from_rhino_point_and_vector(point, vector)
# ---------- end nodeload ----------
explode_4 = Explode(Curve=pline_6, Recursive=True)  # -> Segments, Vertices
merge_4 = Merge(Data1=deviationedge_3, Data2=deviationedge_2, Data3=deviationedge_4, Data4=deviationedge_5)  # -> flatten(Result)
trailedge_3 = TrailEdge(line=merge_3, length=neg_29)  # -> trail_edge; inputs line: Line; same code as trailedge
trailedge_4 = TrailEdge(line=pline_5, length=neg_28)  # -> trail_edge; inputs line: Line; same code as trailedge
len_5 = Length(Curve=pline_6)
neg_30 = Negative(Value=len_5)
merge_5 = Merge(Data1=branches_2)
len_6 = Length(Curve=merge_5)
neg_31 = Negative(Value=len_6)
trailedge_5 = TrailEdge(line=merge_5, length=neg_31)  # -> trail_edge; inputs line: Line; same code as trailedge
trailedge_6 = TrailEdge(line=pline_6, length=neg_30)  # -> trail_edge; inputs line: Line; same code as trailedge
merge_6 = Merge(Data1=trailedge_4, Data2=trailedge_3, Data3=trailedge_2)  # -> flatten(Result)
merge_7 = Merge(Data1=trailedge_6, Data2=trailedge_5, Data3=trailedge)  # -> flatten(Result)
view_constrained_form = BooleanToggle(False)

# ---- group: Topoloy Display - Controls
dash_length = Slider(0.04, range=0..0.1)
sphere_radius = Slider(0.07, range=0..0.1)
load_scale = Slider(1, range=0..1)
load_min = Slider(0.001, range=0..0.001)
num_5 = Number(load_scale)
num_6 = Number(load_min)
num_7 = Number(dash_length)
num_8 = Number(sphere_radius)

# ---- group: Form Display - Controls
lineweight_thickness_factor = Slider(1, range=0..10)
list = ValueList({"Forces": 0, "Lengths": 1}, selected="Forces")
load_scale_2 = Slider(1, range=0..1)
load_min_2 = Slider(0.001, range=0..0.001)
num_9 = Number(lineweight_thickness_factor)
int = Integer(list)
num_10 = Number(load_scale_2)
num_11 = Number(load_min_2)

# ---- group: File metadata
family_name = Panel("Baumstutze")
base_directory = Panel("C:\Users\Mark\Documents\GitHub\cem_dataset\bridges\9_Baumstutze")
is_3d = BooleanToggle(True)
txt = Text(family_name)
txt_2 = Text(base_directory)
bool = Boolean(is_3d)

# ----
export_topology_json = BooleanToggle(False)
export_form_json = BooleanToggle(False)
bool_2 = Boolean(export_topology_json)
bool_3 = Boolean(export_form_json)

save_topology_pdf = BooleanToggle(False)
save_form_pdf = BooleanToggle(False)
bool_4 = Boolean(save_topology_pdf)
bool_5 = Boolean(save_form_pdf)

# ---- group: Make2D - Camera plane
update_camera_plane = Button()
camera_plane_index = Slider(1, range=0..1)
bool_6 = Boolean(update_camera_plane)
int_2 = Integer(camera_plane_index)

# ----
reaction_scale = Slider(0.1, range=0..4)

# ---- group: PDF Controls
edge_width = Slider(2, range=0..5)
node_radius = Slider(0.05, range=0..0.5)
node_edgeweight = Slider(1.5, range=0..5)
arrow_width = Slider(1.5, range=0..5)
load_scale_3 = Slider(3.6, range=0..4)
load_gap = Slider(0.07, range=0..2)
reaction_gap = Slider(0.07, range=0..1)
extra_segments_lineweight = Panel("dotted")
extra_segments_line_thickness_form = Panel("0.75")
extra_segments_line_color_form = Panel("120, 120, 120")
num_12 = Number(edge_width)
num_13 = Number(node_radius)
num_14 = Number(node_edgeweight)
num_15 = Number(arrow_width)
num_16 = Number(load_scale_3)
num_17 = Number(load_gap)
num_18 = Number(reaction_scale)
txt_3 = Text(extra_segments_lineweight)
num_19 = Number(reaction_gap)
num_20 = Number(extra_segments_line_thickness_form)
txt_4 = Text(extra_segments_line_color_form)

# ---- group: COMPAS-based Make2D
int_3 = Integer(int_2)
bool_7 = Boolean(bool_6)
viewports = ViewportProperties(Update=bool_7, AutoUpdate=False)  # -> ViewportNames, ActiveViewportIndex, ViewportBounds, ViewportDisplayMode, CameraLocation, CameraTarget, CameraPlane, CameraLensLength, CameraProjection, CameraUp
item_5 = ListItem(List=viewports.CameraPlane, Index=int_3, Wrap=True)
panel = Panel(viewports.ViewportNames)
pln = Plane(item_5)
panel_2 = Panel(pln)

# ----
neg_32 = Negative(Value=Slider(0.2, range=0..10))
neg_33 = Negative(Value=Slider(12.9, range=0..20))
neg_34 = Negative(Value=Slider(0.1, range=0..0.1))
deviationedge_6 = DeviationEdge(line=item_4.Item1, force=neg_27)  # -> deviation_edge; inputs line: Line; same code as deviationedge
Z_12 = UnitZ(Factor=neg_34)
deviationedge_7 = DeviationEdge(line=cull_ends_4.Culled, force=neg_26)  # -> deviation_edge; inputs line: Line; same code as deviationedge
deviationedge_8 = DeviationEdge(line=mid_2, force=neg_33)  # -> deviation_edge; inputs line: Line; same code as deviationedge
lineload_2 = GhPythonScript(line=flatten([deck_3, mid_2]), load_vector=Z_12)  # -> out, point, vector; inputs line: list of Line, load_vector: Vector3d; same code as lineload
nodesupport_2 = NodeSupport(point=support_5)  # -> node_support; inputs point: Point3d; same code as nodesupport
nodeload_2 = NodeLoad(point=lineload_2.point, vector=lineload_2.vector)  # -> node_load; inputs point: Point3d, vector: Vector3d; same code as nodeload

neg_35 = Negative(Value=Slider(4.6, range=0..10))
deviationedge_9 = DeviationEdge(line=item_4.Item, force=neg_35)  # -> deviation_edge; inputs line: Line; same code as deviationedge

merge_8 = Merge(Data1=deviationedge_9, Data2=deviationedge_6, Data3=deviationedge_7, Data4=deviationedge_8, Data5=deviationedge)  # -> flatten(Result)

# ---- group: Build topology diagram and trails
topologydiagram = TopologyDiagram(
    trail_edges=flatten([merge_7, merge_6]),
    deviation_edges=flatten([merge_8, merge_4]),
    loads=flatten([nodeload_2, nodeload]),
    supports=flatten([nodesupport_2, nodesupport]))  # -> topology; inputs nodes: list, trail_edges: list, deviation_edges: list, loads: list, supports: list
#   port nodes: A list of COMPAS CEM nodes to add to the diagram.
#   port trail_edges: A list of COMPAS CEM trail edges to add to the diagram.
#   port deviation_edges: A list of COMPAS CEM deviation edges to add to the diagram.
#   port loads: A list of COMPAS CEM loads to add to the diagram.
#   port supports: A list of COMPAS CEM supports to add to the diagram.
#   port topology: A COMPAS CEM topology diagram.
# ---------- topologydiagram: Python ----------
"""
Build a topology diagram.
"""
from ghpythonlib.componentbase import executingcomponent as component

from compas_cem.diagrams import TopologyDiagram


class BuildTopologyDiagramComponent(component):
    def RunScript(self, nodes, trail_edges, deviation_edges, loads, supports):

        topology = TopologyDiagram()

        if nodes:
            for node in nodes:
                topology.add_node(node)

        if trail_edges is not None:
            for trail_edge in trail_edges:
                topology.add_edge(trail_edge)

        if deviation_edges:
            for deviation_edge in deviation_edges:
                topology.add_edge(deviation_edge)

        if loads:
            for load in loads:
                topology.add_load(load)

        if supports:
            for support in supports:
                topology.add_support(support)

        return topology
# ---------- end topologydiagram ----------
Z_13 = UnitZ(Factor=1)

# ----
rev = Reverse(Vector=Z_13)

# ---- group: Build topology diagram and trails (continued)
buildtrails = BuildTrails(topology=topologydiagram, add_auxiliary_trails=Toggle(True), auxiliary_trail_length="0.33", auxiliary_trail_vector=rev)  # -> topology, trails, auxiliary_trails; inputs add_auxiliary_trails: Boolean, auxiliary_trail_vector: Vector3d
#   port topology: A COMPAS CEM topology diagram.
#   port add_auxiliary_trails: Append auxiliary trail edges to the free nodes of the topology diagram. Defaults to False.
#   port auxiliary_trail_length: The length of the auxiliary trail edges to add. Defaults to 1.0.
#   port auxiliary_trail_vector: The direction to which the auxiliary trail edges will initially point to. Defaults to [1.0, 1.0, 1.0].
#   port topology: The input topology diagram. But now with computed trails.
#   port trails: The keys of the nodes in each of the found trails.
#   port auxiliary_trails: The keys of the appended auxiliary trail edges.
# ---------- buildtrails: Python ----------
"""
Automatically find the trails in a topology diagram. The diagram is modified in-place.
"""
from ghpythonlib.componentbase import executingcomponent as component

from compas_rhino.geometry import RhinoVector


class BuildTopologyDiagramComponent(component):
    def RunScript(self, topology, add_auxiliary_trails, auxiliary_trail_length, auxiliary_trail_vector):
        add_auxiliary_trails = add_auxiliary_trails or False

        if topology:

            topology = topology.copy()

            if auxiliary_trail_length:
                topology.auxiliary_trail_length = auxiliary_trail_length
            if auxiliary_trail_vector:
                topology.auxiliary_trail_vector = RhinoVector.from_geometry(auxiliary_trail_vector).to_compas()

            topology.build_trails(add_auxiliary_trails)

            trails = list(topology.trails())
            auxiliary_trails = list(topology.auxiliary_trail_edges())

            return topology, trails, auxiliary_trails
# ---------- end buildtrails ----------

# ---- group: Optimization parameters
topologydisassembly = DisassembleTopologyDiagram(topology=buildtrails.topology)  # -> nodes, origin_nodes, support_nodes, edges, trail_edges, deviation_edges, trails, auxiliary_trails; same code as topologydisassembly
deviationedgeforceparameter = DeviationEdgeForceParameter(edge_key=topologydisassembly.deviation_edges, bound_low="10", bound_up="10")  # -> parameter
#   port edge_key: The key of a COMPAS CEM deviation edge.
#   port bound_low: The lower bound of the edge optimization parameter. Calculated as the initial edge parameter minus the absolute value of this bound.
#   port bound_up: The upper bound of the edge optimization parameter. Calculated as the initial edge parameter plus the absolute value of this bound.
#   port parameter: A COMPAS CEM deviation edge force parameter.
# ---------- deviationedgeforceparameter: Python ----------
"""
Set the force of a deviation edge as an optimization parameter.
"""
from ghpythonlib.componentbase import executingcomponent as component

from compas_cem.optimization import DeviationEdgeParameter


class DeviationEdgeParameterComponent(component):
    def RunScript(self, edge_key, bound_low, bound_up):
        if edge_key and bound_low is not None and bound_up is not None:
            return DeviationEdgeParameter(edge_key, bound_low, bound_up)
# ---------- end deviationedgeforceparameter ----------

# ---- group: topology
data = Data(buildtrails.topology)

# 02 Visualize Diagrams
data_2 = Data(data)

# ----
num_21 = Number(num_5)
data_3 = Data(data)
num_22 = Number(num_6)
num_23 = Number(num_8)
cluster = Cluster(data=data_3, num=num_23, num_3=num_21, num_2=num_22)  # -> int_2, pt_2, data_4, crv_10, crv_6, crv_7, crv_8, crv_9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
data_4 = Data(cluster.data_4)
int_4 = Integer(cluster.int_2)
pt_3 = Point(cluster.pt_2)
col = Colour(cluster.col_10)
crv_3 = Curve(cluster.crv_6)
crv_4 = Curve(cluster.crv_7)
crv_5 = Curve(cluster.crv_8)
crv_6 = Curve(cluster.crv_9)
brep = Brep(cluster.brep_2)
num_24 = Number(cluster.num_9)
num_25 = Number(cluster.num_10)
col_2 = Colour(cluster.col_7)
col_3 = Colour(cluster.col_8)
col_4 = Colour(cluster.col_6)
col_5 = Colour(cluster.col_9)
crv_7 = Curve(cluster.crv_10)

data_5 = Data(data_4)
pt_4 = Point(pt_3)
crv_8 = Curve(crv_7)
int_5 = Integer(int_4)
swatch = ColourSwatch(SwatchColor=RGBA(156, 156, 156, 195))
midpt = CurveMiddle(Curve=crv_8)

crv_9 = Curve(crv_3)
num_26 = Number(num_24)
crv_10 = Curve(crv_5)
num_27 = Number(num_25)
swatch_2 = ColourSwatch(SwatchColor=RGB(184, 184, 184))
midpt_2 = CurveMiddle(Curve=crv_9)
midpt_3 = CurveMiddle(Curve=crv_10)

crv_11 = Curve(crv_4)
crv_12 = Curve(crv_3)
col_6 = Colour(col_2)
col_7 = Colour(col_3)
crv_13 = Curve(crv_5)
num_28 = Number(num_7)
col_8 = Colour(col_4)
dash = DashPattern(Curve=crv_13, Pattern=num_28)  # -> Dashes, Gaps

crv_14 = Curve(crv_6)
col_9 = Colour(col)
end_13 = EndPoints(Curve=crv_14)  # -> Start, End
vec2pt = Vector2Pt(PointA=end_13.Start, PointB=end_13.End, Unitize=False)  # -> Vector, Length

brep_2 = Brep(brep)
col_10 = Colour(col_5)

# ---- group: Trail edges
preview = CustomPreview(Geometry=crv_12, Material=col_6)

# ---- group: Deviation edges
preview_2 = CustomPreview(Geometry=crv_11, Material=col_7)

# ---- group: Auxiliary trails
preview_3 = CustomPreview(Geometry=dash.Dashes, Material=col_8)

# ---- group: Trail lengths
tag = TextTag(Location=midpt_2, Text=num_26, Colour=swatch_2)

# ---- group: Deviation forces
tag_2 = TextTag(Location=midpt_3, Text=num_27, Colour=swatch_2)

# ---- group: Nodes
preview_4 = CustomPreview(Geometry=brep_2, Material=col_10)

# ---- group: Loads
vdisex = VectorDisplayEx(Point=end_13.Start, Vector=vec2pt.Vector, Colour=col_9, Width=2)

# ---- group: Edge keys
tag_3 = TextTag(Location=midpt, Text=data_5, Colour=swatch)

# ---- group: Node keys
# 03 Export Data
tag_4 = TextTag(Location=pt_4, Text=int_5, Colour=swatch)

# ---- group: Inputs / Topology
data_6 = Data(data)

# ---- group: COMPAS-based Make2D
xy = XYPlane(Origin=Point(0, 0, 0))
data_7 = Data(data_6)
pln_2 = Plane(pln)
orient_and_project = GhPythonScript(topology=data_7, initial_plane=pln_2, target_plane=xy)  # -> out, topology_transformed; inputs initial_plane: Plane, target_plane: Plane
# ---------- orient_and_project: Python ----------
from compas_rhino.geometry import RhinoPlane
from compas.geometry import Transformation
from compas.geometry import Projection
from compas.geometry import Frame
from compas.geometry import transform_vectors
from compas.datastructures import network_transformed

# Build frames from rhino planes
frames = []
for plane in (initial_plane, target_plane):
    plane = RhinoPlane.from_geometry(plane)
    frame = Frame(plane.point, plane.xaxis, plane.yaxis)
    frames.append(frame)    
fa, fb = frames

# Re-orient node positions
transf = Transformation.from_frame_to_frame(fa, fb)
topology_transformed = network_transformed(topology, transf)

# Squash node positions to plane
z = fb.point.z
for node in topology_transformed.nodes():
    topology_transformed.node_attribute(node, "z", z)
# ---------- end orient_and_project ----------
data_8 = Data(orient_and_project.topology_transformed)

# ----
num_29 = Number(num_16)
data_9 = Data(data_8)
topologyartist = TopologyArtist(topology=data_9, load_scale=num_29)  # -> nodes, origin_nodes, support_nodes, edges, trail_edges, deviation_edges, loads; inputs node: list of Int32, edge: list; same code as topologyartist
clean = CleanTree(RemoveNulls=True, RemoveInvalid=True, RemoveEmpty=False, Tree=[topologyartist.edges, topologyartist.loads])
python_3 = GhPythonScript(segment=clean)  # -> out, segment; inputs segment: list
# ---------- python_3: Python ----------
from compas_rhino.utilities import get_line_coordinates


segment = get_line_coordinates(segment)
# ---------- end python_3 ----------
data_10 = Data(python_3.segment)

data_11 = Data(data_10)
txt_5 = Text(txt_4)
txt_6 = Text(txt_3)
num_30 = Number(num_20)
lng = ListLength(List=data_11)
python_4 = GhPythonScript(D=flatten(txt_5), L=flatten(lng))  # -> out, color; inputs D: list, L: list of Int32
# ---------- python_4: Python ----------
color = []

for d, l in zip(D, L):
    
    d = [int(n) for n in d.split(", ")]
    c = [d] * l
    color.extend(c)
# ---------- end python_4 ----------
repeat = RepeatData(Data=num_30, Length=lng)
repeat_2 = RepeatData(Data=txt_6, Length=lng)
data_12 = Data(python_4.color)
txt_7 = Text(repeat_2)
num_31 = Number(repeat)

# ---- group: Optimization goal constraints
topologydisassembly_2 = DisassembleTopologyDiagram(topology=topologydiagram)  # -> nodes, origin_nodes, support_nodes, edges, trail_edges, deviation_edges, trails, auxiliary_trails; same code as topologydisassembly
trailedgeforceconstraint = TrailEdgeForceConstraint(edge_key=buildtrails.auxiliary_trails, force="0.0")  # -> constraint
#   port edge_key: The key of a COMPAS CEM trail edge.
#   port force: The target force.
#   port weight: The weight of the constraint in the optimization problem. Defaults to one.
#   port constraint: A COMPAS CEM trail force constraint.
# ---------- trailedgeforceconstraint: Python ----------
"""
Make the force on a trail edge to reach a goal force value.
"""
from ghpythonlib.componentbase import executingcomponent as component

from compas_cem.optimization import TrailEdgeForceConstraint


class TrailEdgeForceConstraintComponent(component):
    def RunScript(self, edge_key, force, weight):
        weight = weight or 1.0
        if edge_key and force is not None:
            return TrailEdgeForceConstraint(edge_key, force, weight)
# ---------- end trailedgeforceconstraint ----------

# ----
nodesearch = NodeSearch(diagram=buildtrails.topology)  # -> node; inputs point: list of Point3d
#   port diagram: A COMPAS CEM topology or form diagram.
#   port point: The points to search for in the diagram.
#   port node: The node keys.
# ---------- nodesearch: Python ----------
"""
Search a node key in a topology or a form diagram using a point.
"""
from ghpythonlib.componentbase import executingcomponent as component

from compas.utilities import geometric_key
from compas_rhino.geometry import RhinoPoint


class NodeSearchComponent(component):
    def RunScript(self, diagram, point):
        if point and diagram:
            node = []
            for pt in point:
                pt = RhinoPoint.from_geometry(pt).to_compas()
                gkey = geometric_key(pt, diagram.tol)
                node.append(diagram.gkey_node[gkey])
            return node
# ---------- end nodesearch ----------
formfinding = FormFinding(topology=buildtrails.topology)  # -> form; inputs tmax: Int32
#   port topology: A COMPAS CEM topology diagram.
#   port tmax: The maximum number of iterations to run the form-finding algorithm for. Defaults to 100.
#   port eps_min: The convergence threshold of the form-finding algorithm. Default to 1e-6.
#   port form: A COMPAS CEM form diagram in static equilibrium.
# ---------- formfinding: Python ----------
"""
Generate a form diagram in static equilibrium.
"""
from ghpythonlib.componentbase import executingcomponent as component

from compas_cem.equilibrium import static_equilibrium


class FormFindingComponent(component):
    def RunScript(self, topology, tmax, eta_min):
        tmax = tmax or 100
        eta_min = eta_min or 1e-6
        if topology:
            return static_equilibrium(topology, tmax=tmax, eta=eta_min)
# ---------- end formfinding ----------

# ---- group: Optimization goal constraints (continued)
pointconstraint = PointConstraint(node_key=nodesearch)  # -> constraint; inputs node_key: Int32, point: Point3d
#   port node_key: The key of a COMPAS CEM node.
#   port point: The target point.
#   port weight: The weight of the constraint in the optimization problem. Defaults to one.
#   port constraint: A COMPAS CEM node point constraint.
# ---------- pointconstraint: Python ----------
"""
Pull the position of a node to a target point.
"""
from ghpythonlib.componentbase import executingcomponent as component

from compas_cem.optimization import PointConstraint
from compas_rhino.geometry import RhinoPoint


class PointConstraintComponent(component):
    def RunScript(self, node_key, point, weight):
        weight = weight or 1.0
        if node_key is not None and point:
            point = RhinoPoint.from_geometry(point).to_compas()
            return PointConstraint(node_key, point, weight)
# ---------- end pointconstraint ----------
entwine_11 = Entwine(Branch00=pointconstraint, Branch01=trailedgeforceconstraint, FlattenInputs=True)  # -> flatten(Result)

# ----
constrainedformfinding = ConstrainedFormFinding(
    topology=buildtrails.topology,
    constraints=entwine_11,
    parameters=deviationedgeforceparameter,
    iters_max="400",
    eps="1e-6")  # -> form, penalty, iters, time; inputs constraints: list, parameters: list, iters_max: Int32; disabled
#   port topology: A COMPAS CEM topology diagram.
#   port constraints: A list of COMPAS CEM optimization constraints.
#   port parameters: A list of COMPAS CEM optimization parameters.
#   port algorithm: The name of the optimization algorithm to use.
#   port iters_max: The maximum number of iterations to run the optimization algorithm for.
#   port eps: The minimum penalty value to declare convergence.
#   port form: A COMPAS CEM form diagram in static equilibrium.
#   port penalty: The penalty score after optimization.
#   port iters: The elapsed number of iterations.
#   port time: The optimization elapsed time.
# ---------- constrainedformfinding: Python ----------
"""
Generate a form diagram in static equilibrium.
"""
from ghpythonlib.componentbase import executingcomponent as component

from compas_cem import PROXY_PORT

from compas.rpc import Proxy


class ConstrainedFormFindingComponent(component):
    def RunScript(self, topology, constraints, parameters, algorithm, iters_max, eps):
        algorithm = algorithm or "LD_SLSQP"
        iters_max = iters_max or 100
        eps = eps or 1e-6

        if topology and constraints and parameters:
            topology = topology.copy()

            with Proxy("compas_cem.optimization", port=PROXY_PORT) as opt:
                form, penalty, iters, time = opt.solve_nlopt_proxy(topology,
                                                                   constraints,
                                                                   parameters,
                                                                   algorithm,
                                                                   iters_max,
                                                                   eps)
            return form, penalty, iters, time
# ---------- end constrainedformfinding ----------
panel_3 = Panel(constrainedformfinding.penalty)
panel_4 = Panel(constrainedformfinding.iters)

# ---- group: form
data_13 = Data(formfinding)

# ---- group: constrained form
data_14 = Data(constrainedformfinding.form)

# ---- group: form
data_15 = Data(data_13)

# ---- group: constrained form
data_16 = Data(data_14)

# ----
filter = StreamFilter(Gate=view_constrained_form, Stream0=data_15, Stream1=data_16)
data_17 = Data(filter)

num_32 = Number(num_11)
num_33 = Number(num_9)
data_18 = Data(data_17)
num_34 = Number(num_10)
int_6 = Integer(int)
cluster_2 = Cluster_2(data=data_18, num_2=num_32, num_3=num_34, num=num_33, int=int_6)  # -> int_4, data_4, pt_2, crv_5, crv_6, crv_7, crv_8, col_3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
pt_5 = Point(cluster_2.pt_2)
int_7 = Integer(cluster_2.int_4)
data_19 = Data(cluster_2.data_4)
crv_15 = Curve(cluster_2.crv_5)
crv_16 = Curve(cluster_2.crv_6)
crv_17 = Curve(cluster_2.crv_7)
crv_18 = Curve(cluster_2.crv_8)
col_11 = Colour(cluster_2.col_3)
col_12 = Colour(cluster_2.col_4)
num_35 = Number(cluster_2.num_9)
num_36 = Number(cluster_2.num_10)
data_20 = Data(data_19)
pt_6 = Point(pt_5)
int_8 = Integer(int_7)
swatch_3 = ColourSwatch(SwatchColor=RGBA(156, 156, 156, 195))
crv_19 = Curve(crv_15)
midpt_4 = CurveMiddle(Curve=crv_19)

crv_20 = Curve(crv_15)
col_13 = Colour(col_12)
num_37 = Number(num_35)

crv_21 = Curve(crv_17)
crv_22 = Curve(crv_18)
col_14 = Colour(col_11)
end_14 = EndPoints(Curve=crv_21)  # -> Start, End
end_15 = EndPoints(Curve=crv_22)  # -> Start, End
vec2pt_2 = Vector2Pt(PointA=end_15.Start, PointB=end_15.End, Unitize=False)  # -> Vector, Length
vec2pt_3 = Vector2Pt(PointA=end_14.Start, PointB=end_14.End, Unitize=False)  # -> Vector, Length

num_38 = Number(num_36)
crv_23 = Curve(crv_15)
midpt_5 = CurveMiddle(Curve=crv_23)

# ---- group: Edges
previewlw = CustomPreviewLineweights(Geometry=crv_20, Shader=col_13, Thickness=num_37, Absolute=False)

# ---- group: Loads
vdisex_2 = VectorDisplayEx(Point=end_14.Start, Vector=vec2pt_3.Vector, Colour=col_14, Width=2)

# ---- group: Edge results
tag_5 = TextTag(Location=midpt_5, Text=num_38, Colour=ColourSwatch(SwatchColor=RGBA(156, 156, 156, 195)))

# ---- group: Reaction forces
vdisex_3 = VectorDisplayEx(Point=end_15.Start, Vector=vec2pt_2.Vector, Colour=col_14, Width=2)

# ---- group: Edge keys
tag_6 = TextTag(Location=midpt_4, Text=data_20, Colour=swatch_3)

# ---- group: Node keys
tag_7 = TextTag(Location=pt_6, Text=int_8, Colour=swatch_3)

# ---- group: Inputs / Constrained Form
data_21 = Data(data_17)

# ----
data_22 = Data(data_6)
bool_8 = Boolean(bool)
txt_8 = Text(txt)
txt_9 = Text(txt_2)
data_23 = Data(data_21)
bool_9 = Boolean(bool)
txt_10 = Text(txt)
txt_11 = Text(txt_2)
nameschema = GhPythonScript(topology=data_22, is_3d=bool_8, family_name=txt_8, base_dir=txt_9)  # -> out, filepath; inputs is_3d: Boolean
# ---------- nameschema: Python ----------
"""familyname_diagram_2dor3d_numnodes_numsupports_numloads_numedges_numtrailedges_numdeviationedges_numauxtrails"""


import os

from compas_cem.diagrams import TopologyDiagram
from compas_cem.diagrams import FormDiagram


diagram = topology
# find out diagram type
cls = diagram.__class__.__name__
if cls == "TopologyDiagram":
    diagram_name = "T"

# check dimensionality
if is_3d:
    dim = "3d"
else:
    dim = "2d"
    
# get data from diagram
numnodes = str(len(list(diagram.nodes())))    
numsupports = str(len(list(diagram.support_nodes())))
numloads = str(len(list(diagram.loaded_nodes())))

numedges = str(len(list(diagram.edges())))
numtrailedges = str(len(list(diagram.trail_edges())))
numdeviationedges = str(len(list(diagram.deviation_edges())))
numauxtrails = str(len(list(diagram.auxiliary_trails()))) 
    
schema = (family_name, diagram_name, dim, numnodes, numsupports, numloads, numedges, numtrailedges, numdeviationedges, numauxtrails)
schema = "_".join(schema)
base_dir = os.path.abspath(base_dir)
filepath = os.path.abspath(os.path.join(base_dir, family_name, dim, schema))
# ---------- end nameschema ----------
nameschema_2 = GhPythonScript(form=data_23, is_3d=bool_9, family_name=txt_10, base_dir=txt_11)  # -> out, filepath; inputs is_3d: Boolean
# ---------- nameschema_2: Python ----------
"""familyname_diagram_2dor3d_numnodes_numsupports_numloads_numedges_numtrailedges_numdeviationedges_numauxtrails"""


import os

from compas_cem.diagrams import TopologyDiagram
from compas_cem.diagrams import FormDiagram


diagram = form
# find out diagram type
cls = diagram.__class__.__name__
if cls == "FormDiagram":
    diagram_name = "F"

# check dimensionality
if is_3d:
    dim = "3d"
else:
    dim = "2d"
    
# get data from diagram
numnodes = str(len(list(diagram.nodes())))    
numsupports = str(len(list(diagram.support_nodes())))
numloads = str(len(list(diagram.loaded_nodes())))
numedges = str(len(list(diagram.edges())))
    
schema = (family_name, diagram_name, dim, numnodes, numsupports, numloads, numedges)
schema = "_".join(schema)
base_dir = os.path.abspath(base_dir)
filepath = os.path.abspath(os.path.join(base_dir, family_name, dim, schema))
# ---------- end nameschema_2 ----------
txt_12 = Text(nameschema.filepath)
txt_13 = Text(nameschema_2.filepath)

# ---- group: COMPAS-based Make2D
xy_2 = XYPlane(Origin=Point(0, 0, 0))
data_24 = Data(data_21)
pln_3 = Plane(pln)
orient_and_project_2 = GhPythonScript(form=data_24, initial_plane=pln_3, target_plane=xy_2)  # -> out, form_transformed; inputs initial_plane: Plane, target_plane: Plane
# ---------- orient_and_project_2: Python ----------
from compas_rhino.geometry import RhinoPlane
from compas.geometry import Transformation
from compas.geometry import Projection
from compas.geometry import Frame
from compas.geometry import transform_vectors
from compas.datastructures import network_transformed

# Build frames from rhino planes
frames = []
for plane in (initial_plane, target_plane):
    plane = RhinoPlane.from_geometry(plane)
    frame = Frame(plane.point, plane.xaxis, plane.yaxis)
    frames.append(frame)    
fa, fb = frames

# Re-orient node positions
transf = Transformation.from_frame_to_frame(fa, fb)
form_transformed = network_transformed(form, transf)

# Squash node positions to plane
z = fb.point.z
for node in form_transformed.nodes():
    form_transformed.node_attribute(node, "z", z)
    

# Re-orient and squash loads
for node in form_transformed.nodes():
    # loads
    load = form_transformed.node_load(node)
    loadt = transform_vectors([load], transf).pop()
    form_transformed.node_attributes(node, ("qx", "qy", "qz"), loadt)
    
    # reaction force
    reaction = form_transformed.reaction_force(node)
    reactiont = transform_vectors([reaction], transf).pop()
    form_transformed.node_attributes(node, ("rx", "ry", "rz"), reactiont)
# ---------- end orient_and_project_2 ----------
data_25 = Data(orient_and_project_2.form_transformed)
data_26 = Data(data_25)
python_5 = GhPythonScript(form=data_26, reaction_min="0.001")  # -> out, form
# ---------- python_5: Python ----------
from compas.geometry import length_vector


nodes = list(form.nodes())


for node in nodes:
    if form.is_node_support(node) and length_vector(form.reaction_force(node)) <= reaction_min:
        form.delete_node(node)
# ---------- end python_5 ----------
data_27 = Data(python_5.form)

# ----
txt_14 = Text(txt_13)
num_39 = Number(flatten(num_31))
txt_15 = Text(flatten(txt_7))
bool_10 = Boolean(bool_4)
num_40 = Number(num_12)
num_41 = Number(num_13)
data_28 = Data(data_8)
num_42 = Number(num_14)
num_43 = Number(num_14)
txt_16 = Text(txt_12)
bool_11 = Boolean(bool_5)
data_29 = Data(data_27)
num_44 = Number(num_14)
num_45 = Number(num_16)
num_46 = Number(num_12)
num_47 = Number(num_13)
num_48 = Number(num_15)
num_49 = Number(num_17)
num_50 = Number(num_18)
num_51 = Number(num_19)
data_30 = Data(data_10)
data_31 = Data(data_12)
concat = Concatenate(FragmentA=txt_14, FragmentB=".pdf")
division = Division(A=num_43, B=2)
concat_2 = Concatenate(FragmentA=txt_16, FragmentB=".pdf")
python_6 = GhPythonScript(
    save_file=bool_10,
    topology=data_28,
    edge_width=num_40,
    node_radius=num_41,
    node_edgewidth=num_42,
    load_width=division,
    load_radius=num_41,
    fig_width="16",
    fig_height="9",
    fig_dpi="100",
    filepath=concat_2)  # -> out; inputs save_file: Boolean, fig_width: Int32, fig_height: Int32, fig_dpi: Int32
# ---------- python_6: Python ----------
from compas.rpc import Proxy


kwargs = {"topology": topology,
          "filepath": filepath,
          "edge_width": edge_width,
          "node_radius": node_radius,
          "node_edgewidth": node_edgewidth,
          "load_width": load_width,
          "load_radius": load_radius,
          "fig_width": fig_width,
          "fig_height": fig_height,
          "fig_dpi": fig_dpi}


if save_file:
    with Proxy("compas_cem.plotters") as plotters:
        data = plotters.topology_plotter_proxy(**kwargs)
        
    print("Done!")
    print(data)
# ---------- end python_6 ----------
python_7 = GhPythonScript(
    save_file=bool_11,
    form=data_29,
    edge_width=num_46,
    node_radius=num_47,
    node_edgewidth=num_44,
    load_width=num_48,
    load_scale=num_45,
    load_gap=num_49,
    reaction_width=num_48,
    reaction_scale=num_50,
    reaction_gap=num_51,
    segment=data_30,
    segment_color=data_31,
    segment_width=num_39,
    segment_ls=txt_15,
    fig_width="16",
    fig_height="9",
    fig_dpi="100",
    filepath=concat)  # -> out; inputs save_file: Boolean, segment: list, segment_color: list, segment_width: list, segment_ls: list, fig_width: Int32, fig_height: Int32, fig_dpi: Int32
# ---------- python_7: Python ----------
from compas.rpc import Proxy


kwargs = {"form": form,
          "filepath": filepath,
          "edge_width": edge_width,
          "node_radius": node_radius,
          "node_edgewidth": node_edgewidth,
          "load_width": load_width,
          "load_scale": load_scale,
          "load_gap": load_gap,
          "reaction_width": reaction_width,
          "reaction_scale": reaction_scale,
          "reaction_gap": reaction_gap,
          "segment": segment,
          "segment_color": segment_color,
          "segment_width": segment_width,
          "segment_ls": segment_ls,
          "fig_width": fig_width,
          "fig_height": fig_height,
          "fig_dpi": fig_dpi}


if save_file:
    with Proxy("compas_cem.plotters") as plotters:
        plotters.form_plotter_proxy(**kwargs)
        
    print("Done!")
# ---------- end python_7 ----------
panel_5 = Panel(python_6)
panel_6 = Panel(python_7)

txt_17 = Text(txt_12)
txt_18 = Text(txt_13)
bool_12 = Boolean(bool_2)
data_32 = Data(data_6)
bool_13 = Boolean(bool_3)
data_33 = Data(data_21)
exportjson = GhPythonScript(export=bool_12, diagram=data_32, filepath=txt_17)  # -> out
# ---------- exportjson: Python ----------
if export:
    diagram.to_json(filepath + ".json")
    
    print("Exported file to {}!".format(filepath + ".json"))
# ---------- end exportjson ----------
exportjson_2 = GhPythonScript(export=bool_13, diagram=data_33, filepath=txt_18)  # -> out; same code as exportjson
panel_7 = Panel(exportjson_2)
panel_8 = Panel(exportjson)

# ==== cluster Cluster
num = ClusterInput()
num_2 = ClusterInput()
num_3 = ClusterInput()
data = ClusterInput()
num_4 = Number(num)
num_5 = Number(num_2)
num_6 = Number(num_3)
data_2 = Data(data)
topologyartist = TopologyArtist(topology=data_2)  # -> nodes, origin_nodes, support_nodes, edges, trail_edges, deviation_edges, loads; inputs node: list of Int32, edge: list
#   port topology: A COMPAS CEM topology diagram.
#   port node: A selection of the nodes in the diagram. Defaults to all the nodes.
#   port edge: A selection of the edges in the diagram. Defaults to all the edges.
#   port load_min: The minimum load magnitude to plot. Defaults to 1e-3.
#   port load_scale: The scaling factor of the loads. Defaults to 1.
#   port nodes: The nodes in the diagram as points.
#   port origin_nodes: The origin nodes in the diagram as points.
#   port support_nodes: The position of the support nodes in the diagram.
#   port edges: The edges in the diagram as lines.
#   port trail_edges: The trail edges in the diagram as lines.
#   port deviation_edges: The deviation edges in the diagram as lines.
#   port loads: The applied node loads as lines.
# ---------- topologyartist: Python ----------
"""
Draw a topology diagram.
"""
from ghpythonlib.componentbase import executingcomponent as component

from compas_cem.ghpython import TopologyArtist


class TopologyArtistComponent(component):
    def RunScript(self, topology, node, edge, load_min, load_scale):
        node = node or None
        edge = edge or None
        load_min = load_min or 1e-3
        load_scale = load_scale or 1.0
        if topology:
            artist = TopologyArtist(topology)

            nodes = artist.draw_nodes(node)
            origin_nodes = artist.draw_nodes_origin(node)
            support_nodes = artist.draw_nodes_support(node)

            edges = artist.draw_edges(edge)
            trail_edges = artist.draw_edges_trail(edge)
            deviation_edges = artist.draw_edges_deviation(edge)

            loads = artist.draw_loads(node, min_load=load_min, scale=load_scale)

            return nodes, origin_nodes, support_nodes, edges, trail_edges, deviation_edges, loads
# ---------- end topologyartist ----------
topologydisassembly = DisassembleTopologyDiagram(topology=data_2)  # -> nodes, origin_nodes, support_nodes, edges, trail_edges, deviation_edges, trails, auxiliary_trails
#   port topology: A COMPAS CEM topology diagram.
#   port nodes: All the node keys in the topology diagram.
#   port origin_nodes: The keys of the origin nodes in the topology diagram.
#   port support_nodes: The keys of the support nodes in the topology diagram.
#   port edges: All the edge keys in the topology diagram.
#   port trail_edges: The keys of the trail edges in the topology diagram.
#   port deviation_edges: The keys of the deviation edges in the topology diagram.
#   port trails: The trails in the topology diagram.
#   port auxiliary_trails: The auxiliary trails in the topology diagram.
# ---------- topologydisassembly: Python ----------
"""
Disassemble a topology diagram into its constituent parts.
"""
from ghpythonlib.componentbase import executingcomponent as component


class TopologyDisassemblyComponent(component):
    def RunScript(self, topology):
        if topology:
            trails = list(topology.trails())
            auxiliary_trails = list(topology.auxiliary_trails())

            edges = list(topology.edges())
            trail_edges = list(topology.trail_edges())
            deviation_edges = list(topology.deviation_edges())

            nodes = list(topology.nodes())
            origin_nodes = list(topology.origin_nodes())
            support_nodes = list(topology.support_nodes())

            return nodes, origin_nodes, support_nodes, edges, trail_edges, deviation_edges, trails, auxiliary_trails
# ---------- end topologydisassembly ----------
cem_colors = CEMColors()  # -> color_tension, color_compression, color_edge, color_node, color_node_support, color_node_origin, color_load, color_reaction, color_trail, color_auxiliary_trail
#   port color_tension: The color for edges under a tension force.
#   port color_compression: The color for edges under a compression force.
#   port color_edge: The color for a regular edge.
#   port color_node: The color for a regular node.
#   port color_node_support: The color for a support node.
#   port color_node_origin: The color for an origin node.
#   port color_load: The color for an applied load.
#   port color_reaction: The color for a reaction force.
#   port color_trail: The color to paint a trail.
#   port color_auxiliary_trail: The color to paint an auxiliary trail.
# ---------- cem_colors: Python ----------
"""
Get the artists color scheme for the objects of the CEM framework.
"""
from ghpythonlib.componentbase import executingcomponent as component

from compas_cem import COLORS
import rhinoscriptsyntax as rs


class ArtistColorsComponent(component):
    def RunScript(self):
        colors = {key: rs.CreateColor(c) for key, c in COLORS.items()}

        color_tension = colors["tension"]
        color_compression = colors["compression"]
        color_edge = colors["edge"]
        color_node = colors["node"]
        color_node_support = colors["node_support"]
        color_node_origin = colors["node_origin"]
        color_load = colors["load"]
        color_reaction = colors["support_force"]
        color_trail = colors["trail"]
        color_auxiliary_trail = colors["auxiliary_trail"]

        colors = (color_tension, color_compression, color_edge, color_node, color_node_support, color_node_origin, color_load, color_reaction, color_trail, color_auxiliary_trail)

        return colors
# ---------- end cem_colors ----------
python = GhPythonScript(topology=data_2, auxiliary_trail=topologydisassembly.auxiliary_trails)  # -> out, auxiliary_trail; inputs auxiliary_trail: list
# ---------- python: Python ----------
from compas_cem.ghpython import TopologyArtist


if auxiliary_trail is not None:
    artist = TopologyArtist(topology)
   
    if auxiliary_trail is not None:
        auxiliary_trail = artist.draw_edges_trail(auxiliary_trail)
# ---------- end python ----------
python_2 = GhPythonScript(trail=topologydisassembly.trail_edges, auxiliary_trail=topologydisassembly.auxiliary_trails)  # -> out, trail; inputs trail: list, auxiliary_trail: list
# ---------- python_2: Python ----------
trail = [tr for tr in trail if tr not in auxiliary_trail]
# ---------- end python_2 ----------
topologyartist_2 = TopologyArtist(topology=data_2, edge=python_2.trail, load_min=num_5, load_scale=num_6)  # -> nodes, origin_nodes, support_nodes, edges, trail_edges, deviation_edges, loads; inputs node: list of Int32, edge: list
#   port topology: A COMPAS CEM topology diagram.
#   port node: A selection of the nodes in the diagram. Defaults to all the nodes.
#   port edge: A selection of the edges in the diagram. Defaults to all the edges.
#   port load_min: The minimum load magnitude to plot. Defaults to 1e-3.
#   port load_scale: The scaling factor of the loads. Defaults to 1.
#   port nodes: The nodes in the diagram as points.
#   port origin_nodes: The origin nodes in the diagram as points.
#   port support_nodes: The position of the support nodes in the diagram.
#   port edges: The edges in the diagram as lines.
#   port trail_edges: The trail edges in the diagram as lines.
#   port deviation_edges: The deviation edges in the diagram as lines.
#   port loads: The applied node loads as lines.
# ---------- topologyartist_2: Python ----------
"""
Draw a topology diagram.
"""
from ghpythonlib.componentbase import executingcomponent as component

from compas_cem.ghpython import TopologyArtist


class TopologyArtistComponent(component):
    def RunScript(self, topology, node, edge, load_min, load_scale):
        node = node or None
        edge = edge or None
        load_min = load_min or 1e-3
        load_scale = load_scale or 1.0
        if topology:
            artist = TopologyArtist(topology)

            nodes = artist.draw_nodes(node)
            origin_nodes = artist.draw_nodes_origin(node)
            support_nodes = artist.draw_nodes_support(node)

            edges = artist.draw_edges(edge)
            trail_edges = artist.draw_edges_trail(node)
            deviation_edges = artist.draw_edges_deviation(node)

            loads = artist.draw_loads(node, min_load=load_min, scale=load_scale)

            return nodes, origin_nodes, support_nodes, edges, trail_edges, deviation_edges, loads
# ---------- end topologyartist_2 ----------
entwine = Entwine(Branch00=topologyartist_2.origin_nodes, Branch01=topologyartist_2.support_nodes, FlattenInputs=True)
entwine_2 = Entwine(Branch00=cem_colors.color_node_origin, Branch01=cem_colors.color_node_support, FlattenInputs=True)
merge = Merge(Data1=cem_colors.color_compression, Data2=cem_colors.color_tension)
edgeresults = EdgeResults(form=data_2, edge=python_2.trail)  # -> length, force; inputs edge: list
#   port form: A COMPAS CEM form diagram.
#   port edge: A selection of edge keys to query the results on. Defaults to all the edges.
#   port length: The edge lengths.
#   port force: The edge forces.
# ---------- edgeresults: Python ----------
"""
Extract the post form-finding results of the edges in a form diagram.
"""
from ghpythonlib.componentbase import executingcomponent as component


class EdgeResultsComponent(component):
    def RunScript(self, form, edge):
        if form:
            edge = edge or list(form.edges())
            length = [form.edge_length_2(ed) for ed in edge]
            force = [form.edge_force(ed) for ed in edge]
            return length, force
# ---------- end edgeresults ----------
edgeresults_2 = EdgeResults(form=data_2, edge=topologydisassembly.deviation_edges)  # -> length, force; inputs edge: list; same code as edgeresults
larger = LargerThan(FirstNumber=edgeresults_2.force, SecondNumber=0)  # -> LargerThan, OrEqualTo
larger_2 = LargerThan(FirstNumber=edgeresults.length, SecondNumber=0)  # -> LargerThan, OrEqualTo
sph = Sphere(Base=entwine, Radius=num_4)
item = ListItem(List=merge, Index=larger.OrEqualTo, Wrap=True)
item_2 = ListItem(List=merge, Index=larger_2.OrEqualTo, Wrap=True)
graft = GraftTree(Tree=item, IncludeEmptyLists=True, IncludeNullItems=True)
int = Integer(topologydisassembly.nodes)
pt = Point(topologyartist.nodes)
num_7 = Number(edgeresults.length)
num_8 = Number(edgeresults_2.force)
col = Colour(graft)
data_3 = Data(topologydisassembly.edges)
crv = Curve(topologyartist.edges)

# ---- group: trail edges w/o aux
crv_2 = Curve(topologyartist_2.edges)

# ---- group: aux trails
crv_3 = Curve(python.auxiliary_trail)

# ---- group: deviation edges
crv_4 = Curve(topologyartist_2.deviation_edges)

# ----
crv_5 = Curve(topologyartist_2.loads)
brep = Brep(sph)
col_2 = Colour(item_2)
col_3 = Colour(cem_colors.color_auxiliary_trail)
col_4 = Colour(entwine_2)
col_5 = Colour(cem_colors.color_load)
num_9 = ClusterOutput(num_7)
num_10 = ClusterOutput(num_8)
col_6 = ClusterOutput(col)
crv_6 = ClusterOutput(crv_2)
crv_7 = ClusterOutput(crv_3)
crv_8 = ClusterOutput(crv_4)
crv_9 = ClusterOutput(crv_5)
brep_2 = ClusterOutput(brep)
col_7 = ClusterOutput(col_2)
col_8 = ClusterOutput(col_3)
col_9 = ClusterOutput(col_4)
crv_10 = ClusterOutput(crv)
col_10 = ClusterOutput(col_5)
data_4 = ClusterOutput(data_3)
pt_2 = ClusterOutput(pt)
int_2 = ClusterOutput(int)

# ==== cluster Cluster_2
num = ClusterInput()
int = ClusterInput()
data = ClusterInput()
num_2 = ClusterInput()
num_3 = ClusterInput()
num_4 = Number(num)
int_2 = Integer(int)
data_2 = Data(data)
num_5 = Number(num_2)
num_6 = Number(num_3)
formartist = FormArtist(form=data_2, force_min=num_5, force_scale=num_6)  # -> nodes, support_nodes, edges, loads, reactions; inputs node: list of Int32, edge: list
#   port form: A COMPAS CEM topology diagram.
#   port node: A selection of the nodes in the diagram. Defaults to all the nodes.
#   port edge: A selection of the edges in the diagram. Defaults to all the edges.
#   port force_min: The smallest force magnitude to draw. Defaults to 1e-3
#   port force_scale: The scale of the loads and the reactions. Defaults to 1.
#   port nodes: The nodes of the diagram as points.
#   port support_nodes: The support nodes of the diagram as points
#   port edges: The edges of the diagram as lines.
#   port loads: The applied loads as lines.
#   port reactions: The reaction forces at the supports, as lines.
# ---------- formartist: Python ----------
"""
Draw a form diagram.
"""
from ghpythonlib.componentbase import executingcomponent as component

from compas_cem.ghpython import FormArtist


class FormArtistComponent(component):
    def RunScript(self, form, node, edge, force_min, force_scale):
        force_min = force_min or 1e-3
        force_scale = force_scale or 1
        if form:
            artist = FormArtist(form)

            nodes = artist.draw_nodes(node)
            edges = artist.draw_edges(edge)
            support_nodes = artist.draw_nodes_support(node)

            loads = artist.draw_loads(node, min_load=force_min, scale=force_scale)
            reactions = artist.draw_reactions(node, min_force=force_min, scale=force_scale)

            return nodes, support_nodes, edges, loads, reactions
# ---------- end formartist ----------
edgeresults = EdgeResults(form=data_2)  # -> length, force; inputs edge: list; same code as edgeresults
cem_colors = CEMColors()  # -> color_tension, color_compression, color_edge, color_node, color_node_support, color_node_origin, color_load, color_reaction, color_trail, color_auxiliary_trail; same code as cem_colors
formdisassembly = DisassembleFormDiagram(form=data_2)  # -> nodes, support_nodes, edges
#   port form: A COMPAS CEM form diagram.
#   port nodes: All the node keys in the form diagram.
#   port support_nodes: The keys of the support nodes in the form diagram.
#   port edges: All the edge keys in the form diagram.
# ---------- formdisassembly: Python ----------
"""
Disassemble a form diagram into its constituent parts.
"""
from ghpythonlib.componentbase import executingcomponent as component


class FormDisassemblyComponent(component):
    def RunScript(self, form):
        if form:
            edges = list(form.edges())
            nodes = list(form.nodes())
            support_nodes = list(form.support_nodes())

            return nodes, support_nodes, edges
# ---------- end formdisassembly ----------
larger = LargerThan(FirstNumber=edgeresults.force, SecondNumber=0)  # -> LargerThan, OrEqualTo
merge = Merge(Data1=cem_colors.color_compression, Data2=cem_colors.color_tension)
abs = Absolute(Value=edgeresults.force)
filter = StreamFilter(Gate=int_2, Stream0=edgeresults.force, Stream1=edgeresults.length)
item = ListItem(List=merge, Index=larger.OrEqualTo, Wrap=True)
multiplication = Multiplication(A=abs, B=num_4)
python = GhPythonScript(x=filter)  # -> out, a
# ---------- python: Python ----------
a = round(x, 3)
# ---------- end python ----------
int_3 = Integer(formdisassembly.nodes)
data_3 = Data(formdisassembly.edges)
pt = Point(formartist.nodes)
crv = Curve(formartist.edges)
crv_2 = Curve(formartist.loads)
crv_3 = Curve(formartist.loads)
crv_4 = Curve(formartist.reactions)
col = Colour(cem_colors.color_load)
col_2 = Colour(item)
num_7 = Number(multiplication)
num_8 = Number(python.a)
int_4 = ClusterOutput(int_3)
data_4 = ClusterOutput(data_3)
pt_2 = ClusterOutput(pt)
crv_5 = ClusterOutput(crv)
crv_6 = ClusterOutput(crv_2)
crv_7 = ClusterOutput(crv_3)
crv_8 = ClusterOutput(crv_4)
col_3 = ClusterOutput(col)
col_4 = ClusterOutput(col_2)
num_9 = ClusterOutput(num_7)
num_10 = ClusterOutput(num_8)
