# Grasshopper definition zermattB_2d.ghx (Grasshopper 1.0.7)
# plug-ins: Human

crv = Curve([<curve referenced from the Rhino model> x2])
crv_2 = Curve([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])
crv_3 = Curve([<curve referenced from the Rhino model> x2])
crv_4 = Curve(<curve referenced from the Rhino model>)
pt = Point([Point(-5, -3.425166865, 1.5), Point(5, -3.425166865, 1.5)])

# ---- group: Reload compas_cem
# 01 CEM framework model
button = Button()
python = GhPythonScript(unload=button)  # -> out; inputs unload: Boolean
# ---------- python: Python ----------
from compas_ghpython.utilities import unload_modules


if unload:
    unloaded = unload_modules("compas")
    print("Unloaded: {}".format(unloaded))
# ---------- end python ----------

# ----
divide = DivideCurve(Curve=crv_2, Count=Slider(4, range=0..10), Kinks=False)  # -> Points, Tangents, Parameters
pline = PolyLine(Vertices=divide.Points, Closed=False)
explode = Explode(Curve=pline, Recursive=True)  # -> flatten(Segments), Vertices
join = JoinCurves(Curves=explode.Segments, Preserve=False)
explode_2 = Explode(Curve=join, Recursive=True)  # -> Segments, Vertices
item = ListItem(List=explode_2.Segments, Index="0", Wrap=True)
cull_i = CullIndex(List=explode_2.Segments, Indices="0", Wrap=True)
crv_5 = Curve(flatten(cull_i))
crv_6 = Curve(flatten(explode.Segments))
crv_7 = Curve(flatten(item))
crv_8 = Curve(crv_6)
crv_9 = Curve(crv_3)
crv_10 = Curve(crv_4)
crv_11 = Curve(crv_5)
neg = Negative(Value=Slider(0.1, range=0..0.1))
crv_12 = Curve(crv_7)
neg_2 = Negative(Value=Slider(8, range=0..20))
neg_3 = Negative(Value=Slider(5.2, range=0..20))
len = Length(Curve=crv_9)
len_2 = Length(Curve=crv_11)
Z = UnitZ(Factor=neg)
neg_4 = Negative(Value=Slider(5.3, range=0..10))
lineload = GhPythonScript(line=crv_8, load_vector=Z)  # -> out, point, vector; inputs line: list of Line, load_vector: Vector3d
# ---------- lineload: Python ----------
from compas_rhino.geometry import RhinoLine
from compas_rhino.geometry import RhinoVector

from compas.geometry import add_vectors
from compas.geometry import scale_vector

from compas.utilities import geometric_key

import rhinoscriptsyntax as rs

gkey_xyz = {}
gkey_load = {}

load_vector = RhinoVector.from_geometry(load_vector).to_compas()

for ln in line:
    ln = RhinoLine.from_geometry(ln).to_compas()
    
    # calculate load on line end-points    
    lvec = scale_vector(load_vector, ln.length * 0.5)
    
    for pt in ln:
        gkey = geometric_key(pt)
        gkey_xyz[gkey] = pt
        
        if gkey in gkey_load:
            gkey_load[gkey] = add_vectors(gkey_load[gkey], lvec)
        else:
            gkey_load[gkey] = lvec

point = []
vector = []

for gkey, xyz in gkey_xyz.items():
    point.append(rs.AddPoint(*xyz))
    vector.append(rs.AddPoint(*gkey_load[gkey]))
# ---------- end lineload ----------
nodesupport = NodeSupport(point=pt)  # -> node_support; inputs point: Point3d
#   port point: The position of the node where to assign a support.
#   port node_support: A COMPAS CEM node support.
# ---------- nodesupport: Python ----------
"""
Create a node support from a rhino point.
"""
from ghpythonlib.componentbase import executingcomponent as component

from compas_cem.supports import NodeSupport


class NodeSupportComponent(component):
    def RunScript(self, point):
        if point:
            return NodeSupport.from_rhino_point(point)
# ---------- end nodesupport ----------
deviationedge = DeviationEdge(line=crv_12, force=neg_3)  # -> deviation_edge; inputs line: Line
#   port line: A line that defines the end nodes of the edge.
#   port force: The desired force on the edge. If negative, the edge is in compression. Otherwise, it is in tension.
#   port deviation_edge: A COMPAS CEM deviation edge.
# ---------- deviationedge: Python ----------
"""
Create a deviation edge from a rhino line.
"""
from ghpythonlib.componentbase import executingcomponent as component

from compas_cem.elements import DeviationEdge


class DeviationEdgeComponent(component):
    def RunScript(self, line, force):
        if line and force is not None:
            return DeviationEdge.from_rhino_line(line, force)
# ---------- end deviationedge ----------
neg_5 = Negative(Value=len_2)
deviationedge_2 = DeviationEdge(line=crv, force=neg_4)  # -> deviation_edge; inputs line: Line; same code as deviationedge
deviationedge_3 = DeviationEdge(line=crv_10, force=Slider(1, range=0..1))  # -> deviation_edge; inputs line: Line; same code as deviationedge
trailedge = TrailEdge(line=crv_9, length=len)  # -> trail_edge; inputs line: Line
#   port line: A line that defines the end nodes of the edge.
#   port length: The desired length of the edge. If negative, the edge is in compression. Otherwise, it is in tension.
#   port trail_edge: A COMPAS CEM trail edge.
# ---------- trailedge: Python ----------
"""
Create a trail edge from a rhino line.
"""
from ghpythonlib.componentbase import executingcomponent as component

from compas_cem.elements import TrailEdge


class TrailEdgeComponent(component):
    def RunScript(self, line, length):
        if line and length is not None:
            return TrailEdge.from_rhino_line(line, length)
# ---------- end trailedge ----------
trailedge_2 = TrailEdge(line=crv_11, length=neg_5)  # -> trail_edge; inputs line: Line; same code as trailedge
nodeload = NodeLoad(point=lineload.point, vector=lineload.vector)  # -> node_load; inputs point: Point3d, vector: Vector3d
#   port point: The position of the node where to apply the load.
#   port vector: The load vector.
#   port node_load: A COMPAS CEM node load.
# ---------- nodeload: Python ----------
"""
Create a load vector to be applied at a node.
"""
from ghpythonlib.componentbase import executingcomponent as component

from compas_cem.loads import NodeLoad


class NodeLoadComponent(component):
    def RunScript(self, point, vector):
        if point and vector:
            return NodeLoad.from_rhino_point_and_vector(point, vector)
# ---------- end nodeload ----------
merge = Merge(Data2=deviationedge_2, Data3=deviationedge, Data4=deviationedge_3)  # -> flatten(Result)
merge_2 = Merge(Data1=trailedge_2, Data2=trailedge)  # -> flatten(Result)
view_constrained_form = BooleanToggle(False)

# ---- group: Topoloy Display - Controls
dash_length = Slider(0.04, range=0..0.1)
sphere_radius = Slider(0.07, range=0..0.1)
load_scale = Slider(1, range=0..1)
load_min = Slider(0.001, range=0..0.001)
num = Number(load_scale)
num_2 = Number(load_min)
num_3 = Number(dash_length)
num_4 = Number(sphere_radius)

# ---- group: Form Display - Controls
lineweight_thickness_factor = Slider(1, range=0..10)
list = ValueList({"Forces": 0, "Lengths": 1}, selected="Forces")
load_scale_2 = Slider(0.5, range=0..1)
load_min_2 = Slider(0.001, range=0..0.001)
num_5 = Number(lineweight_thickness_factor)
int = Integer(list)
num_6 = Number(load_scale_2)
num_7 = Number(load_min_2)

# ----
export_topology_json = BooleanToggle(True)  # disabled
export_form_json = BooleanToggle(True)  # disabled
bool = Boolean(export_topology_json)  # disabled
bool_2 = Boolean(export_form_json)  # disabled

save_form_pdf = BooleanToggle(True)  # disabled
save_topology_pdf = BooleanToggle(True)  # disabled
bool_3 = Boolean(save_topology_pdf)  # disabled
bool_4 = Boolean(save_form_pdf)  # disabled

reaction_scale = Slider(0.1, range=0..4)  # disabled

# ---- group: PDF Controls
edge_width = Slider(2, range=0..5)  # disabled
node_radius = Slider(0.07, range=0..0.5)  # disabled
arrow_width = Slider(1.5, range=0..5)  # disabled
load_scale_3 = Slider(1, range=0..4)  # disabled
load_gap = Slider(0.07, range=0..2)  # disabled
extra_segments_lineweight = Panel("dotted")  # disabled
extra_segments_line_thickness_topology = Panel("0.0")  # disabled
node_edgeweight = Slider(1.5, range=0..5)  # disabled
reaction_gap = Slider(0.07, range=0..1)  # disabled
extra_segments_line_color_topology = Panel("255, 255, 255")  # disabled
extra_segments_line_thickness_form = Panel("0.75")  # disabled
extra_segments_line_color_form = Panel("120, 120, 120")  # disabled
num_8 = Number(edge_width)  # disabled
num_9 = Number(node_radius)  # disabled
num_10 = Number(node_edgeweight)  # disabled
num_11 = Number(arrow_width)  # disabled
num_12 = Number(load_scale_3)  # disabled
num_13 = Number(load_gap)  # disabled
num_14 = Number(reaction_scale)  # disabled
txt = Text(extra_segments_lineweight)  # disabled
num_15 = Number(extra_segments_line_thickness_topology)  # disabled
num_16 = Number(extra_segments_line_thickness_form)  # disabled
txt_2 = Text(extra_segments_line_color_form)  # disabled
num_17 = Number(reaction_gap)  # disabled
txt_3 = Text(extra_segments_line_color_topology)  # disabled

# ---- group: File metadata
base_directory = Panel("/Users/arpj/datasets/cem/bridges")  # disabled
is_3d = BooleanToggle(False)  # disabled
family_name = Panel("zermattA")  # disabled
txt_4 = Text(family_name)  # disabled
txt_5 = Text(base_directory)  # disabled
bool_5 = Boolean(is_3d)  # disabled

# ---- group: Make2D - Camera plane
update_camera_plane = Button()  # disabled
camera_plane_index = Slider(1, range=0..1)  # disabled
bool_6 = Boolean(update_camera_plane)  # disabled
int_2 = Integer(camera_plane_index)  # disabled

# ---- group: COMPAS-based Make2D
int_3 = Integer(int_2)
bool_7 = Boolean(bool_6)
viewports = ViewportProperties(Update=bool_7, AutoUpdate=False)  # -> ViewportNames, ActiveViewportIndex, ViewportBounds, ViewportDisplayMode, CameraLocation, CameraTarget, CameraPlane, CameraLensLength, CameraProjection, CameraUp
item_2 = ListItem(List=viewports.CameraPlane, Index=int_3, Wrap=True)
panel = Panel(viewports.ViewportNames)
pln = Plane(item_2)
panel_2 = Panel(pln)

# ---- group: Build topology diagram and trails
topologydiagram = TopologyDiagram(trail_edges=merge_2, deviation_edges=merge, loads=nodeload, supports=nodesupport)  # -> topology; inputs nodes: list, trail_edges: list, deviation_edges: list, loads: list, supports: list
#   port nodes: A list of COMPAS CEM nodes to add to the diagram.
#   port trail_edges: A list of COMPAS CEM trail edges to add to the diagram.
#   port deviation_edges: A list of COMPAS CEM deviation edges to add to the diagram.
#   port loads: A list of COMPAS CEM loads to add to the diagram.
#   port supports: A list of COMPAS CEM supports to add to the diagram.
#   port topology: A COMPAS CEM topology diagram.
# ---------- topologydiagram: Python ----------
"""
Build a topology diagram.
"""
from ghpythonlib.componentbase import executingcomponent as component

from compas_cem.diagrams import TopologyDiagram


class BuildTopologyDiagramComponent(component):
    def RunScript(self, nodes, trail_edges, deviation_edges, loads, supports):

        topology = TopologyDiagram()

        if nodes:
            for node in nodes:
                topology.add_node(node)

        if trail_edges is not None:
            for trail_edge in trail_edges:
                topology.add_edge(trail_edge)

        if deviation_edges:
            for deviation_edge in deviation_edges:
                topology.add_edge(deviation_edge)

        if loads:
            for load in loads:
                topology.add_load(load)

        if supports:
            for support in supports:
                topology.add_support(support)

        return topology
# ---------- end topologydiagram ----------
Z_2 = UnitZ(Factor=1)

# ----
rev = Reverse(Vector=Z_2)

# ---- group: Build topology diagram and trails (continued)
buildtrails = BuildTrails(topology=topologydiagram, add_auxiliary_trails=Toggle(False), auxiliary_trail_length="0.33", auxiliary_trail_vector=rev)  # -> topology, trails, auxiliary_trails; inputs add_auxiliary_trails: Boolean, auxiliary_trail_vector: Vector3d
#   port topology: A COMPAS CEM topology diagram.
#   port add_auxiliary_trails: Append auxiliary trail edges to the free nodes of the topology diagram. Defaults to False.
#   port auxiliary_trail_length: The length of the auxiliary trail edges to add. Defaults to 1.0.
#   port auxiliary_trail_vector: The direction to which the auxiliary trail edges will initially point to. Defaults to [1.0, 1.0, 1.0].
#   port topology: The input topology diagram. But now with computed trails.
#   port trails: The keys of the nodes in each of the found trails.
#   port auxiliary_trails: The keys of the appended auxiliary trail edges.
# ---------- buildtrails: Python ----------
"""
Automatically find the trails in a topology diagram. The diagram is modified in-place.
"""
from ghpythonlib.componentbase import executingcomponent as component

from compas_rhino.geometry import RhinoVector


class BuildTopologyDiagramComponent(component):
    def RunScript(self, topology, add_auxiliary_trails, auxiliary_trail_length, auxiliary_trail_vector):
        add_auxiliary_trails = add_auxiliary_trails or False

        if topology:

            topology = topology.copy()

            if auxiliary_trail_length:
                topology.auxiliary_trail_length = auxiliary_trail_length
            if auxiliary_trail_vector:
                topology.auxiliary_trail_vector = RhinoVector.from_geometry(auxiliary_trail_vector).to_compas()

            topology.build_trails(add_auxiliary_trails)

            trails = list(topology.trails())
            auxiliary_trails = list(topology.auxiliary_trail_edges())

            return topology, trails, auxiliary_trails
# ---------- end buildtrails ----------

# ----
nodesearch = NodeSearch(diagram=buildtrails.topology, point=pt)  # -> node; inputs point: list of Point3d
#   port diagram: A COMPAS CEM topology or form diagram.
#   port point: The points to search for in the diagram.
#   port node: The node keys.
# ---------- nodesearch: Python ----------
"""
Search a node key in a topology or a form diagram using a point.
"""
from ghpythonlib.componentbase import executingcomponent as component

from compas.utilities import geometric_key
from compas_rhino.geometry import RhinoPoint


class NodeSearchComponent(component):
    def RunScript(self, diagram, point):
        if point and diagram:
            node = []
            for pt in point:
                pt = RhinoPoint.from_geometry(pt).to_compas()
                gkey = geometric_key(pt, diagram.tol)
                node.append(diagram.gkey_node[gkey])
            return node
# ---------- end nodesearch ----------

# ---- group: Optimization goal constraints
topologydisassembly = DisassembleTopologyDiagram(topology=topologydiagram)  # -> nodes, origin_nodes, support_nodes, edges, trail_edges, deviation_edges, trails, auxiliary_trails; same code as topologydisassembly
trailedgeforceconstraint = TrailEdgeForceConstraint(edge_key=buildtrails.auxiliary_trails, force="0.0")  # -> constraint; disabled
#   port edge_key: The key of a COMPAS CEM trail edge.
#   port force: The target force.
#   port weight: The weight of the constraint in the optimization problem. Defaults to one.
#   port constraint: A COMPAS CEM trail force constraint.
# ---------- trailedgeforceconstraint: Python ----------
"""
Make the force on a trail edge to reach a goal force value.
"""
from ghpythonlib.componentbase import executingcomponent as component

from compas_cem.optimization import TrailEdgeForceConstraint


class TrailEdgeForceConstraintComponent(component):
    def RunScript(self, edge_key, force, weight):
        weight = weight or 1.0
        if edge_key and force is not None:
            return TrailEdgeForceConstraint(edge_key, force, weight)
# ---------- end trailedgeforceconstraint ----------
pointconstraint = PointConstraint(node_key=nodesearch, point=pt)  # -> constraint; inputs node_key: Int32, point: Point3d
#   port node_key: The key of a COMPAS CEM node.
#   port point: The target point.
#   port weight: The weight of the constraint in the optimization problem. Defaults to one.
#   port constraint: A COMPAS CEM node point constraint.
# ---------- pointconstraint: Python ----------
"""
Pull the position of a node to a target point.
"""
from ghpythonlib.componentbase import executingcomponent as component

from compas_cem.optimization import PointConstraint
from compas_rhino.geometry import RhinoPoint


class PointConstraintComponent(component):
    def RunScript(self, node_key, point, weight):
        weight = weight or 1.0
        if node_key is not None and point:
            point = RhinoPoint.from_geometry(point).to_compas()
            return PointConstraint(node_key, point, weight)
# ---------- end pointconstraint ----------
entwine = Entwine(Branch00=pointconstraint, Branch01=trailedgeforceconstraint, FlattenInputs=True)  # -> flatten(Result)

# ---- group: Optimization parameters
topologydisassembly_2 = DisassembleTopologyDiagram(topology=buildtrails.topology)  # -> nodes, origin_nodes, support_nodes, edges, trail_edges, deviation_edges, trails, auxiliary_trails; same code as topologydisassembly
deviationedgeforceparameter = DeviationEdgeForceParameter(edge_key=topologydisassembly_2.deviation_edges, bound_low="5", bound_up="5")  # -> parameter
#   port edge_key: The key of a COMPAS CEM deviation edge.
#   port bound_low: The lower bound of the edge optimization parameter. Calculated as the initial edge parameter minus the absolute value of this bound.
#   port bound_up: The upper bound of the edge optimization parameter. Calculated as the initial edge parameter plus the absolute value of this bound.
#   port parameter: A COMPAS CEM deviation edge force parameter.
# ---------- deviationedgeforceparameter: Python ----------
"""
Set the force of a deviation edge as an optimization parameter.
"""
from ghpythonlib.componentbase import executingcomponent as component

from compas_cem.optimization import DeviationEdgeParameter


class DeviationEdgeParameterComponent(component):
    def RunScript(self, edge_key, bound_low, bound_up):
        if edge_key and bound_low is not None and bound_up is not None:
            return DeviationEdgeParameter(edge_key, bound_low, bound_up)
# ---------- end deviationedgeforceparameter ----------

# ----
deviationedgeforceparameter_2 = DeviationEdgeForceParameter(edge_key=topologydisassembly_2.trails, bound_low="1", bound_up="1")  # -> parameter; disabled; same code as deviationedgeforceparameter
formfinding = FormFinding(topology=buildtrails.topology, tmax=Slider(95, range=0..100), eps_min="50")  # -> form; inputs tmax: Int32
#   port topology: A COMPAS CEM topology diagram.
#   port tmax: The maximum number of iterations to run the form-finding algorithm for. Defaults to 100.
#   port eps_min: The convergence threshold of the form-finding algorithm. Default to 1e-6.
#   port form: A COMPAS CEM form diagram in static equilibrium.
# ---------- formfinding: Python ----------
"""
Generate a form diagram in static equilibrium.
"""
from ghpythonlib.componentbase import executingcomponent as component

from compas_cem.equilibrium import static_equilibrium


class FormFindingComponent(component):
    def RunScript(self, topology, tmax, eta_min):
        tmax = tmax or 100
        eta_min = eta_min or 1e-6
        if topology:
            return static_equilibrium(topology, tmax=tmax, eta=eta_min)
# ---------- end formfinding ----------
constrainedformfinding = ConstrainedFormFinding(
    topology=buildtrails.topology,
    constraints=entwine,
    parameters=[deviationedgeforceparameter, deviationedgeforceparameter_2],
    iters_max="400",
    eps="1e-6")  # -> form, penalty, iters, time; inputs constraints: list, parameters: list, iters_max: Int32; disabled
#   port topology: A COMPAS CEM topology diagram.
#   port constraints: A list of COMPAS CEM optimization constraints.
#   port parameters: A list of COMPAS CEM optimization parameters.
#   port algorithm: The name of the optimization algorithm to use.
#   port iters_max: The maximum number of iterations to run the optimization algorithm for.
#   port eps: The minimum penalty value to declare convergence.
#   port form: A COMPAS CEM form diagram in static equilibrium.
#   port penalty: The penalty score after optimization.
#   port iters: The elapsed number of iterations.
#   port time: The optimization elapsed time.
# ---------- constrainedformfinding: Python ----------
"""
Generate a form diagram in static equilibrium.
"""
from ghpythonlib.componentbase import executingcomponent as component

from compas_cem import PROXY_PORT

from compas.rpc import Proxy


class ConstrainedFormFindingComponent(component):
    def RunScript(self, topology, constraints, parameters, algorithm, iters_max, eps):
        algorithm = algorithm or "LD_SLSQP"
        iters_max = iters_max or 100
        eps = eps or 1e-6

        if topology and constraints and parameters:
            topology = topology.copy()

            with Proxy("compas_cem.optimization", port=PROXY_PORT) as opt:
                form, penalty, iters, time = opt.solve_nlopt_proxy(topology,
                                                                   constraints,
                                                                   parameters,
                                                                   algorithm,
                                                                   iters_max,
                                                                   eps)
            return form, penalty, iters, time
# ---------- end constrainedformfinding ----------
panel_3 = Panel(constrainedformfinding.iters)
panel_4 = Panel(constrainedformfinding.penalty)

# ---- group: topology
data = Data(buildtrails.topology)

# ---- group: constrained form
data_2 = Data(constrainedformfinding.form)

# ---- group: form
data_3 = Data(formfinding)

# ---- group: topology
# 02 Visualize Diagrams
data_4 = Data(data)

# ---- group: form
data_5 = Data(data_3)

# ---- group: constrained form
data_6 = Data(data_2)

# ----
filter = StreamFilter(Gate=view_constrained_form, Stream0=data_5, Stream1=data_6)
data_7 = Data(filter)

num_18 = Number(num_7)
num_19 = Number(num_5)
data_8 = Data(data_7)
num_20 = Number(num_6)
int_4 = Integer(int)
cluster = Cluster_2(data=data_8, num_2=num_18, num_3=num_20, num=num_19, int=int_4)  # -> int_4, data_4, pt_2, crv_5, crv_6, crv_7, crv_8, col_3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
pt_2 = Point(cluster.pt_2)
int_5 = Integer(cluster.int_4)
data_9 = Data(cluster.data_4)
crv_13 = Curve(cluster.crv_5)
crv_14 = Curve(cluster.crv_6)
crv_15 = Curve(cluster.crv_7)
crv_16 = Curve(cluster.crv_8)
col = Colour(cluster.col_3)
col_2 = Colour(cluster.col_4)
num_21 = Number(cluster.num_9)
num_22 = Number(cluster.num_10)
data_10 = Data(data_9)
pt_3 = Point(pt_2)
int_6 = Integer(int_5)
swatch = ColourSwatch(SwatchColor=RGBA(156, 156, 156, 195))
crv_17 = Curve(crv_13)
midpt = CurveMiddle(Curve=crv_17)

num_23 = Number(num)
data_11 = Data(data)
num_24 = Number(num_2)
num_25 = Number(num_4)
cluster_2 = Cluster(data=data_11, num=num_25, num_3=num_23, num_2=num_24)  # -> int_2, pt_2, data_4, crv_10, crv_6, crv_7, crv_8, crv_9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
data_12 = Data(cluster_2.data_4)
int_7 = Integer(cluster_2.int_2)
pt_4 = Point(cluster_2.pt_2)
col_3 = Colour(cluster_2.col_10)
crv_18 = Curve(cluster_2.crv_6)
crv_19 = Curve(cluster_2.crv_7)
crv_20 = Curve(cluster_2.crv_8)
crv_21 = Curve(cluster_2.crv_9)
brep = Brep(cluster_2.brep_2)
num_26 = Number(cluster_2.num_9)
num_27 = Number(cluster_2.num_10)
col_4 = Colour(cluster_2.col_7)
col_5 = Colour(cluster_2.col_8)
col_6 = Colour(cluster_2.col_6)
col_7 = Colour(cluster_2.col_9)
crv_22 = Curve(cluster_2.crv_10)

crv_23 = Curve(crv_13)
col_8 = Colour(col_2)
num_28 = Number(num_21)

crv_24 = Curve(crv_15)
crv_25 = Curve(crv_16)
col_9 = Colour(col)
end = EndPoints(Curve=crv_24)  # -> Start, End
end_2 = EndPoints(Curve=crv_25)  # -> Start, End
vec2pt = Vector2Pt(PointA=end_2.Start, PointB=end_2.End, Unitize=False)  # -> Vector, Length
vec2pt_2 = Vector2Pt(PointA=end.Start, PointB=end.End, Unitize=False)  # -> Vector, Length

num_29 = Number(num_22)
crv_26 = Curve(crv_13)
midpt_2 = CurveMiddle(Curve=crv_26)

data_13 = Data(data_12)
pt_5 = Point(pt_4)
crv_27 = Curve(crv_22)
int_8 = Integer(int_7)
swatch_2 = ColourSwatch(SwatchColor=RGBA(156, 156, 156, 195))
midpt_3 = CurveMiddle(Curve=crv_27)

crv_28 = Curve(crv_18)
num_30 = Number(num_26)
crv_29 = Curve(crv_20)
num_31 = Number(num_27)
swatch_3 = ColourSwatch(SwatchColor=RGB(184, 184, 184))
midpt_4 = CurveMiddle(Curve=crv_28)
midpt_5 = CurveMiddle(Curve=crv_29)

crv_30 = Curve(crv_19)
crv_31 = Curve(crv_18)
col_10 = Colour(col_4)
col_11 = Colour(col_5)
crv_32 = Curve(crv_20)
num_32 = Number(num_3)
col_12 = Colour(col_6)
dash = DashPattern(Curve=crv_32, Pattern=num_32)  # -> Dashes, Gaps

crv_33 = Curve(crv_21)
col_13 = Colour(col_3)
end_3 = EndPoints(Curve=crv_33)  # -> Start, End
vec2pt_3 = Vector2Pt(PointA=end_3.Start, PointB=end_3.End, Unitize=False)  # -> Vector, Length

brep_2 = Brep(brep)
col_14 = Colour(col_7)

# ---- group: Trail edges
preview = CustomPreview(Geometry=crv_31, Material=col_10)

# ---- group: Deviation edges
preview_2 = CustomPreview(Geometry=crv_30, Material=col_11)

# ---- group: Auxiliary trails
preview_3 = CustomPreview(Geometry=dash.Dashes, Material=col_12)

# ---- group: Noides
preview_4 = CustomPreview(Geometry=brep_2, Material=col_14)

# ---- group: Trail lengths
tag = TextTag(Location=midpt_4, Text=num_30, Colour=swatch_3)

# ---- group: Deviation forces
tag_2 = TextTag(Location=midpt_5, Text=num_31, Colour=swatch_3)

# ---- group: Edge results
tag_3 = TextTag(Location=midpt_2, Text=num_29, Colour=ColourSwatch(SwatchColor=RGBA(156, 156, 156, 195)))

# ---- group: Edges
previewlw = CustomPreviewLineweights(Geometry=crv_23, Shader=col_8, Thickness=num_28, Absolute=False)

# ---- group: Reaction forces
vdisex = VectorDisplayEx(Point=end_2.Start, Vector=vec2pt.Vector, Colour=col_9, Width=2)

# ---- group: Edge keys
tag_4 = TextTag(Location=midpt, Text=data_10, Colour=swatch)

tag_5 = TextTag(Location=midpt_3, Text=data_13, Colour=swatch_2)

# ---- group: Loads
vdisex_2 = VectorDisplayEx(Point=end.Start, Vector=vec2pt_2.Vector, Colour=col_9, Width=2)

# ---- group: Node keys
tag_6 = TextTag(Location=pt_3, Text=int_6, Colour=swatch)

# 03 Export Data
tag_7 = TextTag(Location=pt_5, Text=int_8, Colour=swatch_2)

# ---- group: Loads
vdisex_3 = VectorDisplayEx(Point=end_3.Start, Vector=vec2pt_3.Vector, Colour=col_13, Width=2)

# ---- group: Inputs / Topology
data_14 = Data(data)  # disabled

# ---- group: Inputs / Constrained Form
data_15 = Data(data_2)  # disabled

# ----
data_16 = Data(data_14)
bool_8 = Boolean(bool_5)
txt_6 = Text(txt_4)
txt_7 = Text(txt_5)
data_17 = Data(data_15)
bool_9 = Boolean(bool_5)
txt_8 = Text(txt_4)
txt_9 = Text(txt_5)
nameschema = GhPythonScript(topology=data_16, is_3d=bool_8, family_name=txt_6, base_dir=txt_7)  # -> out, filepath; inputs is_3d: Boolean
# ---------- nameschema: Python ----------
"""familyname_diagram_2dor3d_numnodes_numsupports_numloads_numedges_numtrailedges_numdeviationedges_numauxtrails"""


import os

from compas_cem.diagrams import TopologyDiagram
from compas_cem.diagrams import FormDiagram


diagram = topology
# find out diagram type
cls = diagram.__class__.__name__
if cls == "TopologyDiagram":
    diagram_name = "T"

# check dimensionality
if is_3d:
    dim = "3d"
else:
    dim = "2d"
    
# get data from diagram
numnodes = str(len(list(diagram.nodes())))    
numsupports = str(len(list(diagram.support_nodes())))
numloads = str(len(list(diagram.loaded_nodes())))

numedges = str(len(list(diagram.edges())))
numtrailedges = str(len(list(diagram.trail_edges())))
numdeviationedges = str(len(list(diagram.deviation_edges())))
numauxtrails = str(len(list(diagram.auxiliary_trails()))) 
    
schema = (family_name, diagram_name, dim, numnodes, numsupports, numloads, numedges, numtrailedges, numdeviationedges, numauxtrails)
schema = "_".join(schema)
base_dir = os.path.abspath(base_dir)
filepath = os.path.abspath(os.path.join(base_dir, family_name, dim, schema))
# ---------- end nameschema ----------
nameschema_2 = GhPythonScript(form=data_17, is_3d=bool_9, family_name=txt_8, base_dir=txt_9)  # -> out, filepath; inputs is_3d: Boolean
# ---------- nameschema_2: Python ----------
"""familyname_diagram_2dor3d_numnodes_numsupports_numloads_numedges_numtrailedges_numdeviationedges_numauxtrails"""


import os

from compas_cem.diagrams import TopologyDiagram
from compas_cem.diagrams import FormDiagram


diagram = form
# find out diagram type
cls = diagram.__class__.__name__
if cls == "FormDiagram":
    diagram_name = "F"

# check dimensionality
if is_3d:
    dim = "3d"
else:
    dim = "2d"
    
# get data from diagram
numnodes = str(len(list(diagram.nodes())))    
numsupports = str(len(list(diagram.support_nodes())))
numloads = str(len(list(diagram.loaded_nodes())))
numedges = str(len(list(diagram.edges())))
    
schema = (family_name, diagram_name, dim, numnodes, numsupports, numloads, numedges)
schema = "_".join(schema)
base_dir = os.path.abspath(base_dir)
filepath = os.path.abspath(os.path.join(base_dir, family_name, dim, schema))
# ---------- end nameschema_2 ----------
txt_10 = Text(nameschema.filepath)
txt_11 = Text(nameschema_2.filepath)

# ---- group: COMPAS-based Make2D
xy = XYPlane(Origin=Point(0, 0, 0))
data_18 = Data(data_15)
pln_2 = Plane(pln)
orient_and_project = GhPythonScript(form=data_18, initial_plane=pln_2, target_plane=xy)  # -> out, form_transformed; inputs initial_plane: Plane, target_plane: Plane
# ---------- orient_and_project: Python ----------
from compas_rhino.geometry import RhinoPlane
from compas.geometry import Transformation
from compas.geometry import Projection
from compas.geometry import Frame
from compas.geometry import transform_vectors
from compas.datastructures import network_transformed

# Build frames from rhino planes
frames = []
for plane in (initial_plane, target_plane):
    plane = RhinoPlane.from_geometry(plane)
    frame = Frame(plane.point, plane.xaxis, plane.yaxis)
    frames.append(frame)    
fa, fb = frames

# Re-orient node positions
transf = Transformation.from_frame_to_frame(fa, fb)
form_transformed = network_transformed(form, transf)

# Squash node positions to plane
z = fb.point.z
for node in form_transformed.nodes():
    form_transformed.node_attribute(node, "z", z)
    

# Re-orient and squash loads
for node in form_transformed.nodes():
    # loads
    load = form_transformed.node_load(node)
    loadt = transform_vectors([load], transf).pop()
    form_transformed.node_attributes(node, ("qx", "qy", "qz"), loadt)
    
    # reaction force
    reaction = form_transformed.reaction_force(node)
    reactiont = transform_vectors([reaction], transf).pop()
    form_transformed.node_attributes(node, ("rx", "ry", "rz"), reactiont)
# ---------- end orient_and_project ----------
data_19 = Data(orient_and_project.form_transformed)
data_20 = Data(data_19)
python_2 = GhPythonScript(form=data_20, reaction_min="0.001")  # -> out, form
# ---------- python_2: Python ----------
from compas.geometry import length_vector


nodes = list(form.nodes())


for node in nodes:
    if form.is_node_support(node) and length_vector(form.reaction_force(node)) <= reaction_min:
        form.delete_node(node)
# ---------- end python_2 ----------
data_21 = Data(python_2.form)

xy_2 = XYPlane(Origin=Point(0, 0, 0))
data_22 = Data(data_14)
pln_3 = Plane(pln)
orient_and_project_2 = GhPythonScript(topology=data_22, initial_plane=pln_3, target_plane=xy_2)  # -> out, topology_transformed; inputs initial_plane: Plane, target_plane: Plane
# ---------- orient_and_project_2: Python ----------
from compas_rhino.geometry import RhinoPlane
from compas.geometry import Transformation
from compas.geometry import Projection
from compas.geometry import Frame
from compas.geometry import transform_vectors
from compas.datastructures import network_transformed

# Build frames from rhino planes
frames = []
for plane in (initial_plane, target_plane):
    plane = RhinoPlane.from_geometry(plane)
    frame = Frame(plane.point, plane.xaxis, plane.yaxis)
    frames.append(frame)    
fa, fb = frames

# Re-orient node positions
transf = Transformation.from_frame_to_frame(fa, fb)
topology_transformed = network_transformed(topology, transf)

# Squash node positions to plane
z = fb.point.z
for node in topology_transformed.nodes():
    topology_transformed.node_attribute(node, "z", z)
# ---------- end orient_and_project_2 ----------
data_23 = Data(orient_and_project_2.topology_transformed)

# ----
txt_12 = Text(txt_10)
txt_13 = Text(txt_11)
bool_10 = Boolean(bool)
data_24 = Data(data_14)
bool_11 = Boolean(bool_2)
data_25 = Data(data_15)
exportjson = GhPythonScript(export=bool_10, diagram=data_24, filepath=txt_12)  # -> out
# ---------- exportjson: Python ----------
if export:
    diagram.to_json(filepath + ".json")
    
    print("Exported file to {}!".format(filepath + ".json"))
# ---------- end exportjson ----------
exportjson_2 = GhPythonScript(export=bool_11, diagram=data_25, filepath=txt_13)  # -> out; same code as exportjson
panel_5 = Panel(exportjson_2)
panel_6 = Panel(exportjson)

num_33 = Number(num_14)
num_34 = Number(num_12)
data_26 = Data(data_21)
min = Minimum(A=num_34, B=num_33)
formartist = FormArtist(form=data_26, force_scale=min)  # -> nodes, support_nodes, edges, loads, reactions; inputs node: list of Int32, edge: list
#   port form: A COMPAS CEM topology diagram.
#   port node: A selection of the nodes in the diagram. Defaults to all the nodes.
#   port edge: A selection of the edges in the diagram. Defaults to all the edges.
#   port force_min: The smallest force magnitude to draw. Defaults to 1e-3
#   port force_scale: The scale of the loads and the reactions. Defaults to 1.
#   port nodes: The nodes of the diagram as points.
#   port support_nodes: The support nodes of the diagram as points
#   port edges: The edges of the diagram as lines.
#   port loads: The applied loads as lines.
#   port reactions: The reaction forces at the supports, as lines.
# ---------- formartist: Python ----------
"""
Draw a form diagram.
"""
from ghpythonlib.componentbase import executingcomponent as component

from compas_cem.ghpython import FormArtist


class FormArtistComponent(component):
    def RunScript(self, form, node, edge, force_min, force_scale):
        node = node or None
        edge = edge or None
        force_min = force_min or 1e-3
        force_scale = force_scale or 1
        if form:
            artist = FormArtist(form)

            nodes = artist.draw_nodes(node)
            edges = artist.draw_edges(edge)
            support_nodes = artist.draw_nodes_support(node)

            loads = artist.draw_loads(node, min_load=force_min, scale=force_scale)
            reactions = artist.draw_reactions(node, min_force=force_min, scale=force_scale)

            return nodes, support_nodes, edges, loads, reactions
# ---------- end formartist ----------

clean = CleanTree(RemoveNulls=True, RemoveInvalid=True, RemoveEmpty=False, Tree=[formartist.edges, formartist.loads])

python_3 = GhPythonScript(segment=clean)  # -> out, segment; inputs segment: list
# ---------- python_3: Python ----------
from compas_rhino.utilities import get_line_coordinates


segment = get_line_coordinates(segment)
# ---------- end python_3 ----------
data_27 = Data(python_3.segment)

data_28 = Data(data_27)
txt_14 = Text(txt_3)
num_35 = Number(num_15)
txt_15 = Text(txt)
lng = ListLength(List=data_28)
python_4 = GhPythonScript(D=flatten(txt_14), L=flatten(lng))  # -> out, color; inputs D: list, L: list of Int32
# ---------- python_4: Python ----------
color = []

for d, l in zip(D, L):
    
    d = [int(n) for n in d.split(", ")]
    c = [d] * l
    color.extend(c)
# ---------- end python_4 ----------
repeat = RepeatData(Data=num_35, Length=lng)
repeat_2 = RepeatData(Data=txt_15, Length=lng)
data_29 = Data(python_4.color)
txt_16 = Text(repeat_2)
num_36 = Number(repeat)

num_37 = Number(num_12)
data_30 = Data(data_23)
topologyartist = TopologyArtist(topology=data_30, load_scale=num_37)  # -> nodes, origin_nodes, support_nodes, edges, trail_edges, deviation_edges, loads; inputs node: list of Int32, edge: list; same code as topologyartist

clean_2 = CleanTree(RemoveNulls=True, RemoveInvalid=True, RemoveEmpty=False, Tree=[topologyartist.edges, topologyartist.loads])

python_5 = GhPythonScript(segment=clean_2)  # -> out, segment; inputs segment: list; same code as python_3
data_31 = Data(python_5.segment)

data_32 = Data(data_31)
txt_17 = Text(txt_2)
txt_18 = Text(txt)
num_38 = Number(num_16)
lng_2 = ListLength(List=data_32)
python_6 = GhPythonScript(D=flatten(txt_17), L=flatten(lng_2))  # -> out, color; inputs D: list, L: list of Int32; same code as python_4
repeat_3 = RepeatData(Data=num_38, Length=lng_2)
repeat_4 = RepeatData(Data=txt_18, Length=lng_2)
data_33 = Data(python_6.color)
txt_19 = Text(repeat_4)
num_39 = Number(repeat_3)

num_40 = Number(flatten(num_36))
txt_20 = Text(flatten(txt_16))
txt_21 = Text(txt_11)
num_41 = Number(flatten(num_39))
txt_22 = Text(flatten(txt_19))
bool_12 = Boolean(bool_3)
num_42 = Number(num_8)
num_43 = Number(num_9)
data_34 = Data(data_27)
data_35 = Data(data_23)
num_44 = Number(num_10)
num_45 = Number(num_10)
txt_23 = Text(txt_10)
data_36 = Data(data_29)
bool_13 = Boolean(bool_4)
data_37 = Data(data_21)
num_46 = Number(num_10)
num_47 = Number(num_12)
num_48 = Number(num_8)
num_49 = Number(num_9)
num_50 = Number(num_11)
num_51 = Number(num_13)
num_52 = Number(num_14)
num_53 = Number(num_17)
data_38 = Data(data_31)
data_39 = Data(data_33)
concat = Concatenate(FragmentA=txt_21, FragmentB=".pdf")
concat_2 = Concatenate(FragmentA=txt_23, FragmentB=".pdf")
division = Division(A=num_45, B=2)
python_7 = GhPythonScript(
    save_file=bool_12,
    topology=data_35,
    edge_width=num_42,
    node_radius=num_43,
    node_edgewidth=num_44,
    load_width=division,
    load_radius=num_43,
    segment=data_34,
    segment_color=data_36,
    segment_width=num_40,
    segment_ls=txt_20,
    fig_width="16",
    fig_height="9",
    fig_dpi="100",
    filepath=concat_2)  # -> out; inputs save_file: Boolean, segment: list, segment_color: list, segment_width: list, segment_ls: list, fig_width: Int32, fig_height: Int32, fig_dpi: Int32
# ---------- python_7: Python ----------
from compas.rpc import Proxy


kwargs = {"topology": topology,
          "filepath": filepath,
          "edge_width": edge_width,
          "node_radius": node_radius,
          "node_edgewidth": node_edgewidth,
          "load_width": load_width,
          "load_radius": load_radius,
          "segment": segment,
          "segment_color": segment_color,
          "segment_width": segment_width,
          "segment_ls": segment_ls,
          "fig_width": fig_width,
          "fig_height": fig_height,
          "fig_dpi": fig_dpi}


if save_file:
    with Proxy("compas_cem.plotters") as plotters:
        data = plotters.topology_plotter_proxy(**kwargs)
        
    print("Done!")
    print(data)
# ---------- end python_7 ----------
python_8 = GhPythonScript(
    save_file=bool_13,
    form=data_37,
    edge_width=num_48,
    node_radius=num_49,
    node_edgewidth=num_46,
    load_width=num_50,
    load_scale=num_47,
    load_gap=num_51,
    reaction_width=num_50,
    reaction_scale=num_52,
    reaction_gap=num_53,
    segment=data_38,
    segment_color=data_39,
    segment_width=num_41,
    segment_ls=txt_22,
    fig_width="16",
    fig_height="9",
    fig_dpi="100",
    filepath=concat)  # -> out; inputs save_file: Boolean, segment: list, segment_color: list, segment_width: list, segment_ls: list, fig_width: Int32, fig_height: Int32, fig_dpi: Int32
# ---------- python_8: Python ----------
from compas.rpc import Proxy


kwargs = {"form": form,
          "filepath": filepath,
          "edge_width": edge_width,
          "node_radius": node_radius,
          "node_edgewidth": node_edgewidth,
          "load_width": load_width,
          "load_scale": load_scale,
          "load_gap": load_gap,
          "reaction_width": reaction_width,
          "reaction_scale": reaction_scale,
          "reaction_gap": reaction_gap,
          "segment": segment,
          "segment_color": segment_color,
          "segment_width": segment_width,
          "segment_ls": segment_ls,
          "fig_width": fig_width,
          "fig_height": fig_height,
          "fig_dpi": fig_dpi}


if save_file:
    with Proxy("compas_cem.plotters") as plotters:
        plotters.form_plotter_proxy(**kwargs)
        
    print("Done!")
# ---------- end python_8 ----------
panel_7 = Panel(python_7)
panel_8 = Panel(python_8)

# ==== cluster Cluster
num = ClusterInput()
num_2 = ClusterInput()
num_3 = ClusterInput()
data = ClusterInput()
num_4 = Number(num)
num_5 = Number(num_2)
num_6 = Number(num_3)
data_2 = Data(data)
topologyartist = TopologyArtist(topology=data_2)  # -> nodes, origin_nodes, support_nodes, edges, trail_edges, deviation_edges, loads; inputs node: list of Int32, edge: list
#   port topology: A COMPAS CEM topology diagram.
#   port node: A selection of the nodes in the diagram. Defaults to all the nodes.
#   port edge: A selection of the edges in the diagram. Defaults to all the edges.
#   port load_min: The minimum load magnitude to plot. Defaults to 1e-3.
#   port load_scale: The scaling factor of the loads. Defaults to 1.
#   port nodes: The nodes in the diagram as points.
#   port origin_nodes: The origin nodes in the diagram as points.
#   port support_nodes: The position of the support nodes in the diagram.
#   port edges: The edges in the diagram as lines.
#   port trail_edges: The trail edges in the diagram as lines.
#   port deviation_edges: The deviation edges in the diagram as lines.
#   port loads: The applied node loads as lines.
# ---------- topologyartist: Python ----------
"""
Draw a topology diagram.
"""
from ghpythonlib.componentbase import executingcomponent as component

from compas_cem.ghpython import TopologyArtist


class TopologyArtistComponent(component):
    def RunScript(self, topology, node, edge, load_min, load_scale):
        node = node or None
        edge = edge or None
        load_min = load_min or 1e-3
        load_scale = load_scale or 1.0
        if topology:
            artist = TopologyArtist(topology)

            nodes = artist.draw_nodes(node)
            origin_nodes = artist.draw_nodes_origin(node)
            support_nodes = artist.draw_nodes_support(node)

            edges = artist.draw_edges(edge)
            trail_edges = artist.draw_edges_trail(edge)
            deviation_edges = artist.draw_edges_deviation(edge)

            loads = artist.draw_loads(node, min_load=load_min, scale=load_scale)

            return nodes, origin_nodes, support_nodes, edges, trail_edges, deviation_edges, loads
# ---------- end topologyartist ----------
topologydisassembly = DisassembleTopologyDiagram(topology=data_2)  # -> nodes, origin_nodes, support_nodes, edges, trail_edges, deviation_edges, trails, auxiliary_trails
#   port topology: A COMPAS CEM topology diagram.
#   port nodes: All the node keys in the topology diagram.
#   port origin_nodes: The keys of the origin nodes in the topology diagram.
#   port support_nodes: The keys of the support nodes in the topology diagram.
#   port edges: All the edge keys in the topology diagram.
#   port trail_edges: The keys of the trail edges in the topology diagram.
#   port deviation_edges: The keys of the deviation edges in the topology diagram.
#   port trails: The trails in the topology diagram.
#   port auxiliary_trails: The auxiliary trails in the topology diagram.
# ---------- topologydisassembly: Python ----------
"""
Disassemble a topology diagram into its constituent parts.
"""
from ghpythonlib.componentbase import executingcomponent as component


class TopologyDisassemblyComponent(component):
    def RunScript(self, topology):
        if topology:
            trails = list(topology.trails())
            auxiliary_trails = list(topology.auxiliary_trails())

            edges = list(topology.edges())
            trail_edges = list(topology.trail_edges())
            deviation_edges = list(topology.deviation_edges())

            nodes = list(topology.nodes())
            origin_nodes = list(topology.origin_nodes())
            support_nodes = list(topology.support_nodes())

            return nodes, origin_nodes, support_nodes, edges, trail_edges, deviation_edges, trails, auxiliary_trails
# ---------- end topologydisassembly ----------
cem_colors = CEMColors()  # -> color_tension, color_compression, color_edge, color_node, color_node_support, color_node_origin, color_load, color_reaction, color_trail, color_auxiliary_trail
#   port color_tension: The color for edges under a tension force.
#   port color_compression: The color for edges under a compression force.
#   port color_edge: The color for a regular edge.
#   port color_node: The color for a regular node.
#   port color_node_support: The color for a support node.
#   port color_node_origin: The color for an origin node.
#   port color_load: The color for an applied load.
#   port color_reaction: The color for a reaction force.
#   port color_trail: The color to paint a trail.
#   port color_auxiliary_trail: The color to paint an auxiliary trail.
# ---------- cem_colors: Python ----------
"""
Get the artists color scheme for the objects of the CEM framework.
"""
from ghpythonlib.componentbase import executingcomponent as component

from compas_cem import COLORS
import rhinoscriptsyntax as rs


class ArtistColorsComponent(component):
    def RunScript(self):
        colors = {key: rs.CreateColor(c) for key, c in COLORS.items()}

        color_tension = colors["tension"]
        color_compression = colors["compression"]
        color_edge = colors["edge"]
        color_node = colors["node"]
        color_node_support = colors["node_support"]
        color_node_origin = colors["node_origin"]
        color_load = colors["load"]
        color_reaction = colors["support_force"]
        color_trail = colors["trail"]
        color_auxiliary_trail = colors["auxiliary_trail"]

        colors = (color_tension, color_compression, color_edge, color_node, color_node_support, color_node_origin, color_load, color_reaction, color_trail, color_auxiliary_trail)

        return colors
# ---------- end cem_colors ----------
python = GhPythonScript(topology=data_2, auxiliary_trail=topologydisassembly.auxiliary_trails)  # -> out, auxiliary_trail; inputs auxiliary_trail: list
# ---------- python: Python ----------
from compas_cem.ghpython import TopologyArtist


if auxiliary_trail is not None:
    artist = TopologyArtist(topology)
   
    if auxiliary_trail is not None:
        auxiliary_trail = artist.draw_edges_trail(auxiliary_trail)
# ---------- end python ----------
python_2 = GhPythonScript(trail=topologydisassembly.trail_edges, auxiliary_trail=topologydisassembly.auxiliary_trails)  # -> out, trail; inputs trail: list, auxiliary_trail: list
# ---------- python_2: Python ----------
trail = [tr for tr in trail if tr not in auxiliary_trail]
# ---------- end python_2 ----------
topologyartist_2 = TopologyArtist(topology=data_2, edge=python_2.trail, load_min=num_5, load_scale=num_6)  # -> nodes, origin_nodes, support_nodes, edges, trail_edges, deviation_edges, loads; inputs node: list of Int32, edge: list
#   port topology: A COMPAS CEM topology diagram.
#   port node: A selection of the nodes in the diagram. Defaults to all the nodes.
#   port edge: A selection of the edges in the diagram. Defaults to all the edges.
#   port load_min: The minimum load magnitude to plot. Defaults to 1e-3.
#   port load_scale: The scaling factor of the loads. Defaults to 1.
#   port nodes: The nodes in the diagram as points.
#   port origin_nodes: The origin nodes in the diagram as points.
#   port support_nodes: The position of the support nodes in the diagram.
#   port edges: The edges in the diagram as lines.
#   port trail_edges: The trail edges in the diagram as lines.
#   port deviation_edges: The deviation edges in the diagram as lines.
#   port loads: The applied node loads as lines.
# ---------- topologyartist_2: Python ----------
"""
Draw a topology diagram.
"""
from ghpythonlib.componentbase import executingcomponent as component

from compas_cem.ghpython import TopologyArtist


class TopologyArtistComponent(component):
    def RunScript(self, topology, node, edge, load_min, load_scale):
        node = node or None
        edge = edge or None
        load_min = load_min or 1e-3
        load_scale = load_scale or 1.0
        if topology:
            artist = TopologyArtist(topology)

            nodes = artist.draw_nodes(node)
            origin_nodes = artist.draw_nodes_origin(node)
            support_nodes = artist.draw_nodes_support(node)

            edges = artist.draw_edges(edge)
            trail_edges = artist.draw_edges_trail(node)
            deviation_edges = artist.draw_edges_deviation(node)

            loads = artist.draw_loads(node, min_load=load_min, scale=load_scale)

            return nodes, origin_nodes, support_nodes, edges, trail_edges, deviation_edges, loads
# ---------- end topologyartist_2 ----------
entwine = Entwine(Branch00=topologyartist_2.origin_nodes, Branch01=topologyartist_2.support_nodes, FlattenInputs=True)
entwine_2 = Entwine(Branch00=cem_colors.color_node_origin, Branch01=cem_colors.color_node_support, FlattenInputs=True)
merge = Merge(Data1=cem_colors.color_compression, Data2=cem_colors.color_tension)
edgeresults = EdgeResults(form=data_2, edge=python_2.trail)  # -> length, force; inputs edge: list
#   port form: A COMPAS CEM form diagram.
#   port edge: A selection of edge keys to query the results on. Defaults to all the edges.
#   port length: The edge lengths.
#   port force: The edge forces.
# ---------- edgeresults: Python ----------
"""
Extract the post form-finding results of the edges in a form diagram.
"""
from ghpythonlib.componentbase import executingcomponent as component


class EdgeResultsComponent(component):
    def RunScript(self, form, edge):
        if form:
            edge = edge or list(form.edges())
            length = [form.edge_length_2(ed) for ed in edge]
            force = [form.edge_force(ed) for ed in edge]
            return length, force
# ---------- end edgeresults ----------
edgeresults_2 = EdgeResults(form=data_2, edge=topologydisassembly.deviation_edges)  # -> length, force; inputs edge: list; same code as edgeresults
larger = LargerThan(FirstNumber=edgeresults_2.force, SecondNumber=0)  # -> LargerThan, OrEqualTo
larger_2 = LargerThan(FirstNumber=edgeresults.length, SecondNumber=0)  # -> LargerThan, OrEqualTo
sph = Sphere(Base=entwine, Radius=num_4)
item = ListItem(List=merge, Index=larger.OrEqualTo, Wrap=True)
graft = GraftTree(Tree=item, IncludeEmptyLists=True, IncludeNullItems=True)
item_2 = ListItem(List=merge, Index=larger_2.OrEqualTo, Wrap=True)
int = Integer(topologydisassembly.nodes)
pt = Point(topologyartist.nodes)
num_7 = Number(edgeresults.length)
num_8 = Number(edgeresults_2.force)
col = Colour(graft)
data_3 = Data(topologydisassembly.edges)
crv = Curve(topologyartist.edges)

# ---- group: trail edges w/o aux
crv_2 = Curve(topologyartist_2.edges)

# ---- group: aux trails
crv_3 = Curve(python.auxiliary_trail)

# ---- group: deviation edges
crv_4 = Curve(topologyartist_2.deviation_edges)

# ----
crv_5 = Curve(topologyartist_2.loads)
brep = Brep(sph)
col_2 = Colour(item_2)
col_3 = Colour(cem_colors.color_auxiliary_trail)
col_4 = Colour(entwine_2)
col_5 = Colour(cem_colors.color_load)
num_9 = ClusterOutput(num_7)
num_10 = ClusterOutput(num_8)
col_6 = ClusterOutput(col)
crv_6 = ClusterOutput(crv_2)
crv_7 = ClusterOutput(crv_3)
crv_8 = ClusterOutput(crv_4)
crv_9 = ClusterOutput(crv_5)
brep_2 = ClusterOutput(brep)
col_7 = ClusterOutput(col_2)
col_8 = ClusterOutput(col_3)
col_9 = ClusterOutput(col_4)
crv_10 = ClusterOutput(crv)
col_10 = ClusterOutput(col_5)
data_4 = ClusterOutput(data_3)
pt_2 = ClusterOutput(pt)
int_2 = ClusterOutput(int)

# ==== cluster Cluster_2
num = ClusterInput()
int = ClusterInput()
data = ClusterInput()
num_2 = ClusterInput()
num_3 = ClusterInput()
num_4 = Number(num)
int_2 = Integer(int)
data_2 = Data(data)
num_5 = Number(num_2)
num_6 = Number(num_3)
cem_colors = CEMColors()  # -> color_tension, color_compression, color_edge, color_node, color_node_support, color_node_origin, color_load, color_reaction, color_trail, color_auxiliary_trail; same code as cem_colors
formartist = FormArtist(form=data_2, force_min=num_5, force_scale=num_6)  # -> nodes, support_nodes, edges, loads, reactions; inputs node: list of Int32, edge: list
#   port form: A COMPAS CEM topology diagram.
#   port node: A selection of the nodes in the diagram. Defaults to all the nodes.
#   port edge: A selection of the edges in the diagram. Defaults to all the edges.
#   port force_min: The smallest force magnitude to draw. Defaults to 1e-3
#   port force_scale: The scale of the loads and the reactions. Defaults to 1.
#   port nodes: The nodes of the diagram as points.
#   port support_nodes: The support nodes of the diagram as points
#   port edges: The edges of the diagram as lines.
#   port loads: The applied loads as lines.
#   port reactions: The reaction forces at the supports, as lines.
# ---------- formartist: Python ----------
"""
Draw a form diagram.
"""
from ghpythonlib.componentbase import executingcomponent as component

from compas_cem.ghpython import FormArtist


class FormArtistComponent(component):
    def RunScript(self, form, node, edge, force_min, force_scale):
        force_min = force_min or 1e-3
        force_scale = force_scale or 1
        if form:
            artist = FormArtist(form)

            nodes = artist.draw_nodes(node)
            edges = artist.draw_edges(edge)
            support_nodes = artist.draw_nodes_support(node)

            loads = artist.draw_loads(node, min_load=force_min, scale=force_scale)
            reactions = artist.draw_reactions(node, min_force=force_min, scale=force_scale)

            return nodes, support_nodes, edges, loads, reactions
# ---------- end formartist ----------
edgeresults = EdgeResults(form=data_2)  # -> length, force; inputs edge: list; same code as edgeresults
formdisassembly = DisassembleFormDiagram(form=data_2)  # -> nodes, support_nodes, edges
#   port form: A COMPAS CEM form diagram.
#   port nodes: All the node keys in the form diagram.
#   port support_nodes: The keys of the support nodes in the form diagram.
#   port edges: All the edge keys in the form diagram.
# ---------- formdisassembly: Python ----------
"""
Disassemble a form diagram into its constituent parts.
"""
from ghpythonlib.componentbase import executingcomponent as component


class FormDisassemblyComponent(component):
    def RunScript(self, form):
        if form:
            edges = list(form.edges())
            nodes = list(form.nodes())
            support_nodes = list(form.support_nodes())

            return nodes, support_nodes, edges
# ---------- end formdisassembly ----------
larger = LargerThan(FirstNumber=edgeresults.force, SecondNumber=0)  # -> LargerThan, OrEqualTo
merge = Merge(Data1=cem_colors.color_compression, Data2=cem_colors.color_tension)
abs = Absolute(Value=edgeresults.force)
filter = StreamFilter(Gate=int_2, Stream0=edgeresults.force, Stream1=edgeresults.length)
item = ListItem(List=merge, Index=larger.OrEqualTo, Wrap=True)
multiplication = Multiplication(A=abs, B=num_4)
python = GhPythonScript(x=filter)  # -> out, a
# ---------- python: Python ----------
a = round(x, 3)
# ---------- end python ----------
int_3 = Integer(formdisassembly.nodes)
data_3 = Data(formdisassembly.edges)
pt = Point(formartist.nodes)
crv = Curve(formartist.edges)
crv_2 = Curve(formartist.loads)
crv_3 = Curve(formartist.loads)
crv_4 = Curve(formartist.reactions)
col = Colour(cem_colors.color_load)
col_2 = Colour(item)
num_7 = Number(multiplication)
num_8 = Number(python.a)
int_4 = ClusterOutput(int_3)
data_4 = ClusterOutput(data_3)
pt_2 = ClusterOutput(pt)
crv_5 = ClusterOutput(crv)
crv_6 = ClusterOutput(crv_2)
crv_7 = ClusterOutput(crv_3)
crv_8 = ClusterOutput(crv_4)
col_3 = ClusterOutput(col)
col_4 = ClusterOutput(col_2)
num_9 = ClusterOutput(num_7)
num_10 = ClusterOutput(num_8)
